# Grasshopper definition 20260810-beam-piece-scan-reconstruct.gh (Grasshopper 1.0.8)
# plug-ins: CockroachGH

cloud = PointCloud(<pointcloud referenced from the Rhino model>)
downsample = Downsample(PointCloud=cloud, N=Slider(50772, range=0..1000000))
normals = CloudNormals(PointCloud=downsample, Radius=1, Iter=30, Neigbhours=10, D=1, Erase=True)
cloud_2 = PointCloud(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)
cloudclustercilantro = CloudClusterCilantro(
    PointCloud=normals,
    VoxelSizeSearch=Slider(0.7, range=0..1),
    NormalThresholdDegree=2,
    MinClusterSize=100,
    ColorPointCloud=True,
    Split=invert(False))
cloudransac = CloudRANSAC(
    PointCloud=cloudclustercilantro,
    Radius=Slider(0, range=0..1),
    Neigbhours=0,
    Iterations=Slider(5, range=0..10),
    InliersOrOutliers=invert(True))
panel = Panel(cloudclustercilantro)
explode = CloudExplode(PointCloud=cloudransac)  # -> Points, Normals, Colors
plfit = PlaneFit(Points=explode.Points)  # -> Plane, Deviation
dom = ConstructDomain(DomainStart="-100", DomainEnd="100")
dom_2 = ConstructDomain(DomainStart="-50", DomainEnd="50")
avr = Average(Input=explode.Points)
xy = XYPlane(Origin=Point(0, 0, 0))  # disabled
pl_origin = PlaneOrigin(Base=plfit.Plane, Origin=avr)
rectangle = Rectangle(Plane=pl_origin, XSize=dom_2, YSize=dom_2, Radius=0)  # -> Rectangle, Length
boundary = BoundarySurfaces(Edges=rectangle.Rectangle)
bvol = BoundaryVolume(Boundaries=flatten(boundary))
flatten = FlattenTree(Tree=pl_origin, Path="{0}")
item = ListItem(List=flatten, Index=0, Wrap=True)  # -> Item, Item1, Item2, Item3, Item4, Item5, Item6, Item7, Item8
dom_3 = ConstructDomain(DomainStart=Slider(-8.348, range=-50..50), DomainEnd=Slider(8.995, range=-50..50))
dom_4 = ConstructDomain(DomainStart=Slider(-14.489, range=-50..50), DomainEnd=Slider(18.137, range=-50..50))
dom_5 = ConstructDomain(DomainStart=Slider(-9.576, range=-50..50), DomainEnd=Slider(6.213, range=-50..50))
dom_6 = ConstructDomain(DomainStart=Slider(-17.355, range=-50..50), DomainEnd=Slider(24.894, range=-50..50))
dom_7 = ConstructDomain(DomainStart=Slider(-9.576, range=-50..50), DomainEnd=Slider(6.213, range=-50..50))
dom_8 = ConstructDomain(DomainStart=Slider(-17.355, range=-50..50), DomainEnd=Slider(24.894, range=-50..50))
dom_9 = ConstructDomain(DomainStart=Slider(-7.14, range=-50..50), DomainEnd=Slider(6.551, range=-50..50))
dom_10 = ConstructDomain(DomainStart=Slider(-7.14, range=-50..50), DomainEnd=Slider(6.551, range=-50..50))
dom_11 = ConstructDomain(DomainStart=Slider(-7.14, range=-50..50), DomainEnd=Slider(6.551, range=-50..50))
dom_12 = ConstructDomain(DomainStart=Slider(-18.051, range=-50..50), DomainEnd=Slider(21.515, range=-50..50))
dom_13 = ConstructDomain(DomainStart=Slider(-8.585, range=-50..50), DomainEnd=Slider(6.007, range=-50..50))
dom_14 = ConstructDomain(DomainStart=Slider(-8.585, range=-50..50), DomainEnd=Slider(6.007, range=-50..50))
dom_15 = ConstructDomain(DomainStart=Slider(-7.14, range=-50..50), DomainEnd=Slider(6.551, range=-50..50))
dom_16 = ConstructDomain(DomainStart=Slider(-7.14, range=-50..50), DomainEnd=Slider(6.551, range=-50..50))
dom_17 = ConstructDomain(DomainStart=Slider(-7.14, range=-50..50), DomainEnd=Slider(6.551, range=-50..50))
dom_18 = ConstructDomain(DomainStart=Slider(-8.585, range=-50..50), DomainEnd=Slider(6.007, range=-50..50))
dom_19 = ConstructDomain(DomainStart=Slider(-8.585, range=-50..50), DomainEnd=Slider(6.007, range=-50..50))
dom_20 = ConstructDomain(DomainStart=Slider(-8.585, range=-50..50), DomainEnd=Slider(6.007, range=-50..50))
rectangle_2 = Rectangle(Plane=item.Item, XSize=dom_3, YSize=dom_4, Radius=0)  # -> Rectangle, Length
rectangle_3 = Rectangle(Plane=item.Item1, XSize=dom_5, YSize=dom_6, Radius=0)  # -> Rectangle, Length
rectangle_4 = Rectangle(Plane=item.Item2, XSize=dom_7, YSize=dom_8, Radius=0)  # -> Rectangle, Length
rectangle_5 = Rectangle(Plane=item.Item3, XSize=dom_9, YSize=dom_12, Radius=0)  # -> Rectangle, Length
rectangle_6 = Rectangle(Plane=item.Item4, XSize=dom_10, YSize=dom_13, Radius=0)  # -> Rectangle, Length
rectangle_7 = Rectangle(Plane=item.Item6, XSize=dom_11, YSize=dom_14, Radius=0)  # -> Rectangle, Length
rectangle_8 = Rectangle(Plane=item.Item5, XSize=dom_15, YSize=dom_18, Radius=0)  # -> Rectangle, Length
rectangle_9 = Rectangle(Plane=item.Item7, XSize=dom_16, YSize=dom_19, Radius=0)  # -> Rectangle, Length
rectangle_10 = Rectangle(Plane=item.Item8, XSize=dom_17, YSize=dom_20, Radius=0)  # -> Rectangle, Length
xy_2 = XYPlane(Origin=Point(0, 0, 0))
merge = Merge(
    Data1=rectangle_2.Rectangle,
    Data2=rectangle_3.Rectangle,
    Data3=rectangle_4.Rectangle,
    Data4=rectangle_5.Rectangle,
    Data5=rectangle_6.Rectangle,
    Data6=rectangle_8.Rectangle,
    Data7=rectangle_7.Rectangle,
    Data8=rectangle_9.Rectangle,
    Data9=rectangle_10.Rectangle)
dom_21 = ConstructDomain(DomainStart=Slider(-23.573, range=-50..50), DomainEnd=Slider(13.703, range=-50..50))
dom_22 = ConstructDomain(DomainStart=Slider(-25.018, range=-50..50), DomainEnd=Slider(17.56, range=-50..50))
rectangle_11 = Rectangle(Plane=xy_2, XSize=dom_21, YSize=dom_22, Radius=0)  # -> Rectangle, Length
boundary_2 = BoundarySurfaces(Edges=[merge, rectangle_11.Rectangle])
bvol_2 = BoundaryVolume(Boundaries=boundary_2)
