# Grasshopper definition annotate_assembly_LLM.gh (Grasshopper 1.0.8)

# ----
# Input Geometry
# (Segmented)
colour_swatch = ColourSwatch(SwatchColor=RGBA(0, 0, 0, 94))
geometry = Geometry([<extrusion referenced from the Rhino model> x3, <brep referenced from the Rhino model>, <extrusion referenced from the Rhino model> x2, <brep referenced from the Rhino model> x4, <extrusion referenced from the Rhino model> x2, <brep referenced from the Rhino model>, <extrusion referenced from the Rhino model> x2, <brep referenced from the Rhino model> x8])
custom_preview = CustomPreview(Geometry=geometry, Material=colour_swatch)

boxes_generated_from_mesh = Box([{Plane=PlaneXY(-10.94383603, 0.3856903294, 0.4453468248), X=Domain(-0.01952373329, 0.01952373329), Y=Domain(-0.02409320366, 0.02409320366), Z=Domain(-0.3748509998, 0.3748509998)}, {Plane=Plane(origin=(-10.9340816, 0.3871585088, 0.06350049934), x=(0.06975647374, 0.9975640503, 0), y=(-0.9975640503, 0.06975647374, 0)), X=Domain(-0.02036933612, 0.02018060036), Y=Domain(-0.01317365503, 0.01259136005), Z=Domain(-0.006821504897, 0.006821504897)}, {Plane=Plane(origin=(-10.69974966, 0.3957418271, 0.7534203763), x=(1, 0, 0), y=(0, 0.0348994967, 0.999390827)), X=Domain(-0.2164893126, 0.2164893126), Y=Domain(-0.0631184206, 0.06223890239), Z=Domain(-0.02759248317, 0.02996337301)}, {Plane=PlaneXY(-10.4675599, 0.3923002823, 0.4445688682), X=Domain(-0.01556857515, 0.01556857515), Y=Domain(-0.02640476117, 0.02640476117), Z=Domain(-0.3743307963, 0.3743307963)}, {Plane=Plane(origin=(-10.46863986, 0.3981522415, 0.06396207643), x=(0.9975640503, 0.06975647374, 0), y=(-0.06975647374, 0.9975640503, 0)), X=Domain(-0.01262872588, 0.01297842324), Y=Domain(-0.01974880574, 0.01991467648), Z=Domain(-0.005784156241, 0.005784156241)}, {Plane=Plane(origin=(-10.92806556, -0.05221020246, 0.06359410286), x=(0.06975647374, 0.9975640503, 0), y=(-0.9975640503, 0.06975647374, 0)), X=Domain(-0.02031056799, 0.02046905678), Y=Domain(-0.01378839929, 0.01246468599), Z=Domain(-0.006303914463, 0.006303914463)}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])  # disabled

# ---- group: Segmented Pointcloud of Santo Chair
point_cloud = PointCloud([<point cloud referenced from the Rhino model> x14])  # disabled

# ---- group: Santo Chair
number_slider = Slider(0, range=0..1.5)  # disabled
unit_x = UnitX(Factor=number_slider)  # disabled
point_cloud_2 = PointCloud([<point cloud referenced from the Rhino model> x10])  # disabled
point_cloud_3 = PointCloud(point_cloud)  # disabled
move = Move(Geometry=point_cloud_3, Motion=unit_x)  # -> Geometry, Transform; disabled

# ----
# Segmented Pointcloud Coloring
series = Series(Start=0, Step=0.05, Count=50)  # disabled
number_slider_2 = Slider(10, range=0..100)  # disabled
colour_hsv = ColourHSV(Alpha=1, Hue=series, Saturation=1, Value=1)  # -> flatten(Colour); disabled
python_3_script = Python3Script(input_list=colour_hsv, seed=number_slider_2)  # -> out, list_random; inputs input_list: list; disabled
# ---------- python_3_script: Python ----------
import random

list_random = list(input_list)
random.shuffle(list_random)
# ---------- end python_3_script ----------
custom_preview_2 = CustomPreview(Geometry=flatten(move.Geometry), Material=python_3_script.list_random)  # disabled

pointcloud_resolution = Slider(150, range=0..500)  # disabled
brep_input = Brep([<brep referenced from the Rhino model> x54])  # disabled
pointcloud_generation = PointcloudGeneration(B=pointcloud_resolution, brep=brep_input)  # disabled

# ---- group: Set of Pointclouds
point_cloud_4 = PointCloud(pointcloud_generation)  # disabled

# ----
colour_swatch_2 = ColourSwatch(SwatchColor=RGB(82, 82, 82))  # disabled

series_2 = Series(Start=0, Step=0.05, Count=50)  # disabled
number_slider_3 = Slider(54, range=0..100)  # disabled
colour_hsv_2 = ColourHSV(Alpha=1, Hue=series_2, Saturation=1, Value=1)  # -> flatten(Colour); disabled
python_3_script_2 = Python3Script(input_list=colour_hsv_2, seed=number_slider_3)  # -> out, list_random; inputs input_list: list; disabled; same code as python_3_script
custom_preview_3 = CustomPreview(Geometry=flatten(point_cloud_4), Material=colour_swatch_2)  # disabled

# ----
# Oriented-Bounding-Box (OBB) Generation
list = ValueList({"Quick Pass | box-like shapes": 1, "Balanced | most shapes)": 2, "High Precision | complex shapes": 3}, selected="High Precision | complex shapes")
accuracy = ValueList({"Low | 45": 45, "Balanced | 90": 90, "Accurate | 180": 180, "Maximum | 360": 360}, selected="Accurate | 180")
c__minbbox = CSharpScript(data=flatten(geometry), rotation_divisions=accuracy, refinement_iterations=list)  # -> out, min_bbox; inputs initial_plane: Plane, rotation_divisions: Int32, refinement_iterations: Int32
# ---------- c__minbbox: C# ----------
using System;
using System.Collections.Generic;
using System.Linq;
using System.Threading.Tasks;
using Rhino;
using Rhino.Geometry;
using Grasshopper.Kernel;
using Grasshopper.Kernel.Types;

public class Script_Instance : GH_ScriptInstance
{
  private readonly RhinoDoc RhinoDocument;
  private readonly GH_Document GrasshopperDocument;
  private readonly IGH_Component Component;
  private readonly int Iteration;

  // --- settings
  private int _rotationDivisions = 90;         // steps per 90 degrees
  private const double HALF_PI = Math.PI * 0.5;

  // ====================== PUBLIC RUN ======================
  // data can be: GeometryBase, PointCloud, IEnumerable<Point3d>, or GH trees of GH_Point
  private void RunScript(
		object data,
		Plane initial_plane,
		int rotation_divisions,
		int refinement_iterations,
		ref object min_bbox)
  {
    // Normalize inputs
    _rotationDivisions = rotation_divisions > 0 ? rotation_divisions : 90;
    int iterations = refinement_iterations > 0 ? refinement_iterations : 1;

    // Try to extract a point list
    var pts = ExtractPoints(data);

    // Fallback to GeometryBase if not a point set
    GeometryBase geo = null;
    if (pts == null || pts.Count < 3)
      geo = data as GeometryBase;

    if ((pts == null || pts.Count < 3) && (geo == null || !geo.IsValid))
    {
      Component.AddRuntimeMessage(GH_RuntimeMessageLevel.Error, "Provide a valid Geometry, PointCloud, or list of Points.");
      return;
    }

    // Center for rotations
    Point3d center =
      (pts != null) ? new BoundingBox(pts).Center
                    : geo.GetBoundingBox(false).Center;

    // Base plane (WorldXY at center if none)
    Plane best = initial_plane.IsValid ? initial_plane : new Plane(center, Vector3d.ZAxis);
    best.Origin = center;

    // Delegate that returns bbox volume for a given test plane
    Func<Plane, double> volumeAtPlane;

    if (pts != null)
      volumeAtPlane = (Plane pl) => BBoxFromPointsInPlane(pts, pl).Volume;
    else
      volumeAtPlane = (Plane pl) =>
      {
        BoundingBox bb = geo.GetBoundingBox(pl);
        return bb.IsValid ? bb.Volume : double.MaxValue;
      };

    // Refinement passes
    for (int i = 0; i < iterations; i++)
      best = FindOptimalPlaneOrientation(best, center, volumeAtPlane);

    // Build final Box for output
    Box finalBox;
    if (pts != null)
    {
      var bb = BBoxFromPointsInPlane(pts, best);
      finalBox = new Box(best, bb);
    }
    else
    {
      geo.GetBoundingBox(best, out finalBox);
    }

    min_bbox = new GH_Box(finalBox);
  }

  // ================== CORE ORIENTATION SEARCH ==================
  private Plane FindOptimalPlaneOrientation(Plane basePlane, Point3d rotationCenter, Func<Plane, double> volumeAtPlane)
  {
    Plane p = basePlane;
    p = RefineAxis(p, p.XAxis, rotationCenter, volumeAtPlane);
    p = RefineAxis(p, p.YAxis, rotationCenter, volumeAtPlane);
    p = RefineAxis(p, p.ZAxis, rotationCenter, volumeAtPlane);

    // second pass often improves a bit more
    p = RefineAxis(p, p.XAxis, rotationCenter, volumeAtPlane);
    p = RefineAxis(p, p.YAxis, rotationCenter, volumeAtPlane);
    p = RefineAxis(p, p.ZAxis, rotationCenter, volumeAtPlane);
    return p;
  }

  private Plane RefineAxis(Plane start, Vector3d axis, Point3d center, Func<Plane, double> volumeAtPlane)
  {
    double step = HALF_PI / _rotationDivisions; // divisions per 90 degrees
    double bestAngle = 0.0;
    double bestVol = double.MaxValue;

    // Parallel sweep 0..90°
    Parallel.For(0, _rotationDivisions, i =>
    {
      double ang = i * step;
      Plane t = start;
      t.Rotate(ang, axis, center);
      double v = volumeAtPlane(t);

      // thread-safe best pick
      double orig;
      double newv;
      do
      {
        orig = bestVol;
        newv = Math.Min(orig, v);
        if (newv == orig) break;
      } while (System.Threading.Interlocked.CompareExchange(ref bestVol, newv, orig) != orig);

      if (v == newv) // this thread found the new min
        bestAngle = ang;
    });

    Plane result = start;
    result.Rotate(bestAngle, axis, center);
    return result;
  }

  // ================== POINT HELPERS ==================
  private List<Point3d> ExtractPoints(object data)
  {
    if (data == null) return null;

    // PointCloud
    var pc = data as PointCloud;
    if (pc != null && pc.Count > 0)
    {
      var L = new List<Point3d>(pc.Count);
      foreach (var p in pc) L.Add(p.Location);
      return L;
    }

    // GH trees/lists of GH_Point or Point3d
    var pts = new List<Point3d>();
    var enumerable = data as System.Collections.IEnumerable;
    if (enumerable != null)
    {
      foreach (var it in enumerable)
      {
        if (it is GH_Point ghp)      pts.Add(ghp.Value);
        else if (it is Point3d p3d)  pts.Add(p3d);
        else if (it is Point pt)     pts.Add(new Point3d(pt.Location));
        else if (it is PointCloud pc2)
          foreach (var p in pc2) pts.Add(p.Location);
      }
      if (pts.Count > 0) return pts;
    }

    return null;
  }

  private BoundingBox BBoxFromPointsInPlane(List<Point3d> pts, Plane plane, double minThickness = 1e-6)
  {
    // move points into plane coords
    var toLocal = Transform.PlaneToPlane(plane, Plane.WorldXY);
    var local = new List<Point3d>(pts.Count);
    foreach (var p in pts)
    {
      var q = p;
      q.Transform(toLocal);
      local.Add(q);
    }

    var bb = new BoundingBox(local);
    // If almost planar, enforce a tiny thickness to keep volume finite and Box valid
    if (Math.Abs(bb.Max.Z - bb.Min.Z) < minThickness)
    {
      var min = bb.Min; var max = bb.Max;
      min.Z -= 0.5 * minThickness; max.Z += 0.5 * minThickness;
      bb = new BoundingBox(min, max);
    }
    return bb;
  }
}
# ---------- end c__minbbox ----------
yz_plane = YZPlane(Origin=Point(0, 0, 0))
rotate = Rotate(Geometry=c__minbbox.min_bbox, Angle=expr("-x", 1.570796327), Plane=yz_plane)  # -> Geometry, Transform
min_bbox_geo = Geometry(c__minbbox.min_bbox)
debox = DeconstructBox(Box=min_bbox_geo)  # -> Plane, X, Y, Z
min_bbox_width_num = Number(debox.X)
min_bbox_length_num = Number(debox.Y)
min_bbox_height_num = Number(debox.Z)
min_bbox_pln = Plane(debox.Plane)

# ---- group: Boxes Rotated (Y is up)
box = Box(c__minbbox.min_bbox)

# ----
evaluate_box = EvaluateBox(Box=box, UParameter=0.5, VParameter=0.5, WParameter=0.5)  # -> Plane, Point, Include

# ----
# Reorganization of Axes
number_slider_4 = Slider(0, range=-1..1)
min_bbox_geo_2 = Geometry(box)
vector_xyz = VectorXYZ(XComponent=number_slider_4, YComponent=Slider(0, range=-1..1), ZComponent=Slider(1, range=-1..1))  # -> Vector, Length
reorder_axes_python = Python3Script(
    B=min_bbox_geo_2,
    UpHint=vector_xyz.Vector,
    TiltDeg=Slider(83, range=0..100),
    LockRoll=Toggle(False),
    StrictPreserve=Toggle(False))  # -> out, N, GlobalPlane, Report, Xlines, Ylines, Zlines; inputs B: list of Box, TiltDeg: Int32, LockRoll: Boolean, StrictPreserve: Boolean
# ---------- reorder_axes_python: Python ----------
import Rhino.Geometry as rg
import math

# ---- tiny symmetric 3x3 eigen (Jacobi) ----
def eigen_sym3(M, iters=32, eps=1e-12):
    A=[M[0][:],M[1][:],M[2][:]]; V=[[1,0,0],[0,1,0],[0,0,1]]
    for _ in range(iters):
        p=q=0; m=0.0
        for i in range(3):
            for j in range(i+1,3):
                v=abs(A[i][j])
                if v>m: p,q,m=i,j,v
        if m<eps: break
        phi=0.5*math.atan2(2*A[p][q], A[q][q]-A[p][p])
        c,s=math.cos(phi), math.sin(phi)
        for k in range(3):
            Apk,Aqk=A[p][k],A[q][k]
            A[p][k]=c*Apk - s*Aqk
            A[q][k]=s*Apk + c*Aqk
        for k in range(3):
            Akp,Akq=A[k][p],A[k][q]
            A[k][p]=c*Akp - s*Akq
            A[k][q]=s*Akp + c*Akq
        for k in range(3):
            Vkp,Vkq=V[k][p],V[k][q]
            V[k][p]=c*Vkp - s*Vkq
            V[k][q]=s*Vkp + c*Vkq
    vals=[A[0][0],A[1][1],A[2][2]]
    vecs=[[V[0][i],V[1][i],V[2][i]] for i in range(3)]
    return vals, vecs

def global_frame(boxes, up_hint=None):
    M=[[0,0,0],[0,0,0],[0,0,0]]
    cx=cy=cz=0.0; n=0
    for bx in boxes:
        c=bx.Center; cx+=c.X; cy+=c.Y; cz+=c.Z; n+=1
        for v in (bx.Plane.XAxis, bx.Plane.YAxis, bx.Plane.ZAxis):
            v=rg.Vector3d(v); 
            if not v.Unitize(): continue
            M[0][0]+=v.X*v.X; M[0][1]+=v.X*v.Y; M[0][2]+=v.X*v.Z
            M[1][0]+=v.Y*v.X; M[1][1]+=v.Y*v.Y; M[1][2]+=v.Y*v.Z
            M[2][0]+=v.Z*v.X; M[2][1]+=v.Z*v.Y; M[2][2]+=v.Z*v.Z
    C=rg.Point3d(cx/n, cy/n, cz/n)
    vals, vecs = eigen_sym3(M)
    order = sorted(range(3), key=lambda i: vals[i], reverse=True)
    X=rg.Vector3d(*vecs[order[0]]); Y=rg.Vector3d(*vecs[order[1]]); Z=rg.Vector3d(*vecs[order[2]])
    for a in (X,Y,Z): a.Unitize()
    if rg.Vector3d.CrossProduct(X,Y)*Z < 0: Z*=-1
    
    # ---- MODIFICATION IS HERE ----
    if up_hint and up_hint.IsValid and up_hint.Length > 1e-9:
        u = rg.Vector3d(up_hint)
        u.Unitize()
        cand = [X, Y, Z]
        k = max(range(3), key=lambda i: abs(cand[i] * u))
        
        # 1. Force the axis most aligned with the hint to become the Y-axis (UP).
        Y = cand[k] * (1.0 if (cand[k] * u) >= 0 else -1.0)
        Y.Unitize()
        
        # 2. Get the remaining two candidate axes.
        rem = [rg.Vector3d(cand[i]) for i in range(3) if i != k]
        
        # 3. Choose the X-axis. A good choice is the remaining axis that is
        #    most perpendicular to our new Y-axis.
        rem.sort(key=lambda v: abs(v * Y))
        X = rem[0]
        
        # 4. Construct a valid right-handed coordinate system (X cross Y = Z).
        Z = rg.Vector3d.CrossProduct(X, Y)
        Z.Unitize()
        
        # 5. Re-calculate X to ensure it's perfectly orthogonal to both Y and Z.
        X = rg.Vector3d.CrossProduct(Y, Z)
        X.Unitize()

    return rg.Plane(C,X,Y)

def angle_to_axes(v, frame):
    v=rg.Vector3d(v); v.Unitize()
    axes=(frame.XAxis, frame.YAxis, frame.ZAxis)
    # smallest angle to any canonical axis (in degrees)
    d = max(abs(v*a) for a in axes)
    d = max(-1.0, min(1.0, d))
    return math.degrees(math.acos(d))

def rotate_roll(X,Y,Z, axis, refX):
    def proj(u):
        p = u - (u*axis)*axis
        return p.Unitize() and p or None
    px, t = proj(X), proj(refX)
    if px and t:
        a = math.atan2(rg.Vector3d.CrossProduct(px,t)*axis, px*t)
        R = rg.Transform.Rotation(a, axis, rg.Point3d.Origin)
        X.Transform(R); Y.Transform(R); Z.Transform(R)
    return X,Y,Z

def normalize_box(bx, g, tilt_deg, lock_roll, strict_preserve):
    # original axes & lengths
    Xo=rg.Vector3d(bx.Plane.XAxis); Yo=rg.Vector3d(bx.Plane.YAxis); Zo=rg.Vector3d(bx.Plane.ZAxis)
    Lx, Ly, Lz = bx.X.Length, bx.Y.Length, bx.Z.Length

    # --- pick the *longest dimension* axis (this was the bug) ---
    idx_long = max(range(3), key=lambda i: (Lx,Ly,Lz)[i])
    long_axis = [Xo,Yo,Zo][idx_long]
    theta = angle_to_axes(long_axis, g)  # deg from any canonical axis

    if strict_preserve or theta >= tilt_deg:
        # DIAGONAL (or strict): preserve order; only sign-fix (and optional roll)
        X,Y,Z = Xo,Yo,Zo
        if X*g.XAxis < 0: X*=-1
        if Y*g.YAxis < 0: Y*=-1
        if rg.Vector3d.CrossProduct(X,Y)*Z < 0: Z*=-1
        if lock_roll:
            axis = [X,Y,Z][idx_long]; axis.Unitize()
            X,Y,Z = rotate_roll(X,Y,Z, axis, g.XAxis)
        w,d,h = Lx,Ly,Lz
    else:
        # NEAR-ORTHOGONAL: allow axis reordering to global frame
        src=[Xo,Yo,Zo]; ln=[Lx,Ly,Lz]; ref=[g.XAxis,g.YAxis,g.ZAxis]
        used=set(); idx=[]; sgn=[]
        for R in ref:
            dots=[abs(R*src[k]) if k not in used else -1.0 for k in range(3)]
            j=max(range(3), key=lambda k: dots[k]); used.add(j); idx.append(j)
            sgn.append(1.0 if (R*src[j])>=0 else -1.0)
        X=rg.Vector3d(src[idx[0]])*sgn[0]; Y=rg.Vector3d(src[idx[1]])*sgn[1]; Z=rg.Vector3d(src[idx[2]])*sgn[2]
        if rg.Vector3d.CrossProduct(X,Y)*Z < 0: Z*=-1
        w,d,h = ln[idx[0]], ln[idx[1]], ln[idx[2]]

    pl = rg.Plane(bx.Center, X, Y)
    nb = rg.Box(pl,
                rg.Interval(-0.5*w, 0.5*w),
                rg.Interval(-0.5*d, 0.5*d),
                rg.Interval(-0.5*h, 0.5*h))
    return nb, theta

# ---- main ----
# These inputs (B, UpHint, TiltDeg, etc.) are expected to be set by the Grasshopper environment.
# For standalone testing, you would need to define them. For example:
# B = [...] # A list of Rhino.Geometry.Box objects
# UpHint = rg.Vector3d(0, 1, 0) # A hint vector
# TiltDeg = 20.0
# LockRoll = True
# StrictPreserve = False

boxes = list(B) if "B" in globals() and B else []
if "TiltDeg" not in globals() or TiltDeg is None: TiltDeg = 20.0
if "LockRoll" not in globals() or LockRoll is None: LockRoll = True
if "StrictPreserve" not in globals() or StrictPreserve is None: StrictPreserve = False
if "UpHint" not in globals(): UpHint = None

N = []; GlobalPlane = rg.Plane.WorldXY; Report=""
Xlines=[]; Ylines=[]; Zlines=[]
if boxes:
    GlobalPlane = global_frame(boxes, UpHint)
    thetas=[]
    for bx in boxes:
        nb, th = normalize_box(bx, GlobalPlane, TiltDeg, LockRoll, StrictPreserve)
        N.append(nb); thetas.append(th)
        # debug axis lines (5% of max box size)
        s = 0.05*max(nb.X.Length, nb.Y.Length, nb.Z.Length)
        o = nb.Center
        Xlines.append(rg.Line(o, o + nb.Plane.XAxis*s))
        Ylines.append(rg.Line(o, o + nb.Plane.YAxis*s))
        Zlines.append(rg.Line(o, o + nb.Plane.ZAxis*s))
    Report = "Normalized {} boxes. mean tilt={:.1f}°, min={:.1f}°, max={:.1f}°. strict={}.".format(
        len(N), sum(thetas)/len(thetas), min(thetas), max(thetas), StrictPreserve)
else:
    Report = "No boxes."

# The script would then assign its outputs (N, GlobalPlane, etc.) to Grasshopper output variables.
# ---------- end reorder_axes_python ----------
panel = Panel(reorder_axes_python.Report)
evaluate_box_2 = EvaluateBox(Box=reorder_axes_python.N, UParameter=0.5, VParameter=0.5, WParameter=0.5)  # -> Plane, Point, Include

box_2 = Box(reorder_axes_python.N)
custom_preview_4 = CustomPreview(Geometry=box_2, Material=ColourSwatch(SwatchColor=RGBA(145, 145, 145, 150)))

json_decoder = Python3Script(imagePath="C:\Users\tizian\Downloads\timber_structure.jpg", boxes=box_2, run=Toggle(True))  # -> log; inputs imagePath: String, boxes: list of Box
# ---------- json_decoder: Python ----------
# r: google-genai, pillow
"""
Grasshopper Python 3 component: Workspace Export

INPUTS
  boxes       Box    List    oriented bounding boxes, one per part
  imagePath   str    Item    reference photo of the structure
  run         bool   Item    Boolean Toggle

OUTPUTS
  jsonPath    where workspace.json was written
  jsonOutput  the JSON itself
  log         what happened

Writes workspace.json (schema 2.1.0) into the same folder as the image.
The Gemini key goes in a text file, path is printed below on the first run.
"""

import base64
import io
import json
import math
import os
import random
import time

KEY_NAME = "gemini_api_key.txt"
HOME_KEY = os.path.join(os.path.expanduser("~"), "Documents", "robarch", KEY_NAME)
MODEL = "gemini-3.7-flash"
TOLERANCE = 0.01          # metres, contact tolerance for connections
MATERIAL = "historic timber"


# --- key -------------------------------------------------------------------

def key_paths():
    """Next to the .gh, one level up (repo root), then Documents\robarch."""
    paths = []
    try:
        gh = ghenv.Component.OnPingDocument().FilePath   # noqa: F821
        if gh:
            here = os.path.dirname(gh)
            paths.append(os.path.join(here, KEY_NAME))
            paths.append(os.path.join(os.path.dirname(here), KEY_NAME))
    except Exception:
        pass
    paths.append(HOME_KEY)
    return paths


def get_key():
    """Returns (key, note). Note says where it came from, or what was checked."""
    env = os.environ.get("GEMINI_API_KEY")
    if env and env.strip():
        return env.strip(), "key from GEMINI_API_KEY"

    checked = key_paths()
    for path in checked:
        if os.path.exists(path):
            with open(path, encoding="utf-8-sig") as fh:
                text = fh.read().strip().strip('"').strip("'")
            if text:
                return text, "key from %s" % path
            return None, "key file is empty: %s" % path

    os.makedirs(os.path.dirname(HOME_KEY), exist_ok=True)
    open(HOME_KEY, "w").close()
    return None, "no key file found, checked:\n    " + "\n    ".join(checked)


# --- geometry --------------------------------------------------------------

def to_ws(v):
    """Rhino Z-up -> workspace Y-up."""
    return (v[0], v[2], -v[1])


def box_to_part_geometry(box, scale):
    """Rhino Box -> origin / dimensions / rotation, verified against the reference bundle."""
    p = box.Plane
    ax = (p.XAxis.X, p.XAxis.Y, p.XAxis.Z)
    ay = (p.YAxis.X, p.YAxis.Y, p.YAxis.Z)
    az = (p.ZAxis.X, p.ZAxis.Y, p.ZAxis.Z)
    c = box.Center

    o = to_ws((c.X, c.Y, c.Z))
    w, h, d = box.Y.Length, box.Z.Length, box.X.Length

    cx = [-a for a in to_ws(ay)]
    cy = to_ws(az)
    cz = [-a for a in to_ws(ax)]

    m23 = max(-1.0, min(1.0, cz[1]))
    rx = math.asin(-m23)
    if abs(m23) < 0.9999999:
        ry, rz = math.atan2(cz[0], cz[2]), math.atan2(cx[1], cy[1])
    else:
        ry, rz = math.atan2(-cx[2], cx[0]), 0.0

    r = lambda v: round(v, 6)
    return {
        "origin": {"x": r(o[0] * scale), "y": r(o[1] * scale), "z": r(o[2] * scale)},
        "dimensions": {"width": r(w * scale), "height": r(h * scale), "depth": r(d * scale)},
        "rotation": {"x": r(rx), "y": r(ry), "z": r(rz)},
    }


def box_frame(box):
    p = box.Plane
    c = box.Center
    return {
        "c": (c.X, c.Y, c.Z),
        "a": (
            (p.XAxis.X, p.XAxis.Y, p.XAxis.Z),
            (p.YAxis.X, p.YAxis.Y, p.YAxis.Z),
            (p.ZAxis.X, p.ZAxis.Y, p.ZAxis.Z),
        ),
        "h": (box.X.Length / 2.0, box.Y.Length / 2.0, box.Z.Length / 2.0),
    }


def touching(a, b, tol):
    """Separating axis test on both boxes inflated by tol."""
    dot = lambda u, v: u[0] * v[0] + u[1] * v[1] + u[2] * v[2]
    ha = [x + tol / 2 for x in a["h"]]
    hb = [x + tol / 2 for x in b["h"]]
    tw = [b["c"][i] - a["c"][i] for i in range(3)]
    t = [dot(tw, a["a"][i]) for i in range(3)]
    R = [[dot(a["a"][i], b["a"][j]) for j in range(3)] for i in range(3)]
    A = [[abs(R[i][j]) + 1e-9 for j in range(3)] for i in range(3)]

    for i in range(3):
        if abs(t[i]) > ha[i] + sum(hb[j] * A[i][j] for j in range(3)):
            return False
    for j in range(3):
        if abs(sum(t[i] * R[i][j] for i in range(3))) > hb[j] + sum(ha[i] * A[i][j] for i in range(3)):
            return False
    for i in range(3):
        for j in range(3):
            i1, i2 = (i + 1) % 3, (i + 2) % 3
            j1, j2 = (j + 1) % 3, (j + 2) % 3
            ra = ha[i1] * A[i2][j] + ha[i2] * A[i1][j]
            rb = hb[j1] * A[i][j2] + hb[j2] * A[i][j1]
            if abs(t[i2] * R[i1][j] - t[i1] * R[i2][j]) > ra + rb:
                return False
    return True


def adjacency(frames, tol):
    n = len(frames)
    adj = [set() for _ in range(n)]
    for i in range(n):
        for j in range(i + 1, n):
            if touching(frames[i], frames[j], tol):
                adj[i].add(j)
                adj[j].add(i)
    return [sorted(s) for s in adj]


# --- naming via Gemini -----------------------------------------------------

def name_parts(key, geoms, adj, image_bytes, mime):
    """Returns (object_name, ids, labels). Geometry never goes through the model."""
    rows = []
    for i, g in enumerate(geoms):
        o, d = g["origin"], g["dimensions"]
        touches = ", ".join("part_%02d" % (j + 1) for j in adj[i]) or "none"
        rows.append("part_%02d | centre (%.2f, %.2f, %.2f) | size %.2f x %.2f x %.2f | touches: %s"
                    % (i + 1, o["x"], o["y"], o["z"], d["width"], d["height"], d["depth"], touches))

    prompt = (
        "You see a photo of a timber structure and its parts as boxes.\n"
        "Y is up, lengths in metres.\n\n" + "\n".join(rows) + "\n\n"
        "Name every part using timber framing vocabulary (post, beam, sill beam, "
        "top plate, rail, brace, stud, corner post), adding front/back, left/right, "
        "upper/lower where it disambiguates. Use the adjacency and the sizes to work "
        "out each role.\n"
        "Return only JSON, one entry per part, ids in lower snake_case and unique:\n"
        '{"objectName": "...", "parts": [{"index": 1, "id": "bottom_beam_front", '
        '"label": "Bottom Beam Front"}]}'
    )

    from google import genai
    from google.genai import types

    client = genai.Client(api_key=key)
    resp = client.models.generate_content(
        model=MODEL,
        contents=[types.Part.from_bytes(data=image_bytes, mime_type=mime),
                  types.Part.from_text(text=prompt)],
        config=types.GenerateContentConfig(response_mime_type="application/json"),
    )

    txt = (resp.text or "").strip()
    txt = txt[txt.find("{"): txt.rfind("}") + 1]
    data = json.loads(txt)

    ids = ["part_%02d" % (i + 1) for i in range(len(geoms))]
    labels = [None] * len(geoms)
    for e in data.get("parts", []):
        i = int(e.get("index", 0)) - 1
        if 0 <= i < len(geoms) and e.get("id"):
            ids[i] = str(e["id"]).strip().lower().replace(" ", "_")
            labels[i] = str(e.get("label") or "").strip() or None

    seen = {}
    for i, pid in enumerate(ids):
        if pid in seen:
            seen[pid] += 1
            ids[i] = "%s_%d" % (pid, seen[pid])
        else:
            seen[pid] = 1
        labels[i] = labels[i] or " ".join(w.capitalize() for w in ids[i].split("_"))

    return str(data.get("objectName") or "Timber Structure"), ids, labels


# --- bundle ----------------------------------------------------------------

def now():
    return time.strftime("%Y-%m-%dT%H:%M:%S.000Z", time.gmtime())


def uid(prefix):
    return "%s_%s" % (prefix, "".join(random.choice("abcdefghijklmnopqrstuvwxyz0123456789")
                                      for _ in range(11)))


def cover_uri(image_bytes, mime):
    """Downscaled JPEG data URI, so the JSON does not carry the full photo."""
    try:
        from PIL import Image
        img = Image.open(io.BytesIO(image_bytes)).convert("RGB")
        if max(img.size) > 1600:
            f = 1600.0 / max(img.size)
            img = img.resize((int(img.size[0] * f), int(img.size[1] * f)), Image.LANCZOS)
        buf = io.BytesIO()
        img.save(buf, format="JPEG", quality=82)
        small = buf.getvalue()
        if len(small) < len(image_bytes):
            return "data:image/jpeg;base64," + base64.b64encode(small).decode("ascii")
    except Exception:
        pass
    return "data:%s;base64,%s" % (mime, base64.b64encode(image_bytes).decode("ascii"))


def build(geoms, ids, labels, adj, name, image_path, image_bytes, mime):
    ev_id = uid("ev")
    stamp = now()
    parts = [{
        "id": ids[i],
        "label": labels[i],
        "origin": g["origin"],
        "dimensions": g["dimensions"],
        "rotation": g["rotation"],
        "connections": [ids[j] for j in adj[i]],
        "material": MATERIAL,
        "status": "intact",
        "notes": "",
    } for i, g in enumerate(geoms)]

    return {
        "schemaVersion": "2.1.0",
        "template": None,
        "instance": {
            "id": uid("inst"),
            "name": name,
            "templateRef": None,
            "parts": parts,
            "location": "",
            "provenance": "ROB|ARCH 2026 workshop scan",
            "notes": "%s divided into %d connected components for condition mapping." % (name, len(parts)),
            "coverImage": cover_uri(image_bytes, mime),
            "sourcePhotoEvidenceId": ev_id,
            "defaultDisplayMode": "boxes",
            "createdAt": stamp,
        },
        "evidence": [{
            "id": ev_id,
            "kind": "photo",
            "attachedTo": None,
            "capturedAt": stamp,
            "capturedBy": None,
            "url": "idb://%s" % ev_id,
            "text": None,
            "measurement": None,
            "confirmsConditionRef": None,
            "refutesConditionRef": None,
            "fileName": os.path.basename(image_path),
            "byteSize": len(image_bytes),
            "mimeType": mime,
        }],
        "conditions": [],
        "plans": [],
        "currentPlanId": None,
        "executionLog": [],
        "conversations": [],
        "createdAt": stamp,
        "updatedAt": stamp,
        "collaboration": {"projectId": "workshop:%s" % ids[0], "modelVersion": "1"},
    }


# --- run -------------------------------------------------------------------
# Split in two: prepare() touches Rhino and must stay on the main thread, but it
# is fast. finish() is plain Python and does the slow network call, so it runs on
# a background thread and Grasshopper stays responsive.

def prepare(boxes, image_path, scale):
    boxes = [b for b in boxes if b and b.IsValid]
    if not boxes:
        raise ValueError("No valid boxes connected.")
    if not image_path or not os.path.exists(image_path):
        raise ValueError("Image not found: %s" % image_path)

    with open(image_path, "rb") as fh:
        image_bytes = fh.read()

    return {
        "geoms": [box_to_part_geometry(b, scale) for b in boxes],
        "adj": adjacency([box_frame(b) for b in boxes], TOLERANCE / scale),
        "image_bytes": image_bytes,
        "mime": "image/png" if image_path.lower().endswith(".png") else "image/jpeg",
        "image_path": image_path,
    }


def finish(prep):
    """Returns (json_text, out_path, log_lines). No Rhino types in here."""
    geoms, adj = prep["geoms"], prep["adj"]
    lines = ["%d boxes, %d connections." % (len(geoms), sum(len(a) for a in adj) // 2)]

    name = "Timber Structure"
    ids = ["part_%02d" % (i + 1) for i in range(len(geoms))]
    labels = [" ".join(w.capitalize() for w in i.split("_")) for i in ids]

    key, note = get_key()
    lines.append(note)
    if not key:
        lines.append("Using generic part names.")
    else:
        try:
            t0 = time.time()
            name, ids, labels = name_parts(key, geoms, adj, prep["image_bytes"], prep["mime"])
            lines.append("Named by %s in %.1f s: %s" % (MODEL, time.time() - t0, name))
        except Exception as exc:
            lines.append("Model failed (%s), using generic part names." % exc)

    ws = build(geoms, ids, labels, adj, name, prep["image_path"],
               prep["image_bytes"], prep["mime"])
    text = json.dumps(ws, indent=2, ensure_ascii=False)

    folder = os.path.dirname(os.path.abspath(prep["image_path"]))
    out_path = os.path.join(folder, "workspace.json")
    with open(out_path, "w", encoding="utf-8") as fh:
        fh.write(text)

    photos = os.path.join(folder, "photos")
    os.makedirs(photos, exist_ok=True)
    with open(os.path.join(photos, "%s.jpg" % ws["evidence"][0]["id"]), "wb") as fh:
        fh.write(prep["image_bytes"])

    lines.append("Written: %s" % out_path)
    return text, out_path, lines


jsonPath = None
jsonOutput = None
log = "Toggle run to export."

if globals().get("run"):
    import threading

    import Grasshopper
    import Rhino
    import scriptcontext as sc

    STATE = sc.sticky.setdefault("workspace_export_jobs", {})
    job_id = str(ghenv.Component.InstanceGuid)          # noqa: F821
    job = STATE.get(job_id)

    def wake_up(delay=500):
        """Ask Grasshopper to re-solve this component a moment from now."""
        doc = ghenv.Component.OnPingDocument()           # noqa: F821
        if doc:
            doc.ScheduleSolution(
                delay,
                Grasshopper.Kernel.GH_Document.GH_ScheduleDelegate(
                    lambda _: ghenv.Component.ExpireSolution(False)   # noqa: F821
                ),
            )

    if job is None:
        scale = Rhino.RhinoMath.UnitScale(sc.doc.ModelUnitSystem, Rhino.UnitSystem.Meters)
        try:
            prep = prepare(list(globals().get("boxes") or []), globals().get("imagePath"), scale)
        except Exception as exc:
            STATE[job_id] = {"done": True, "result": None, "error": str(exc), "t0": time.time()}
            log = str(exc)
        else:
            job = {"done": False, "result": None, "error": None, "t0": time.time()}
            STATE[job_id] = job

            def work(prep=prep, job=job):
                try:
                    job["result"] = finish(prep)
                except Exception as exc:
                    job["error"] = str(exc)
                finally:
                    job["done"] = True

            threading.Thread(target=work, daemon=True).start()
            log = "Working, Grasshopper stays usable."
            wake_up()

    elif not job["done"]:
        log = "Working, %.0f s so far." % (time.time() - job["t0"])
        wake_up()

    else:
        if job["error"]:
            log = job["error"]
        else:
            jsonOutput, jsonPath, lines = job["result"]
            log = "\n".join(lines)

else:
    # toggling run off clears the job, so the next True starts a fresh export
    try:
        import scriptcontext as sc
        sc.sticky.get("workspace_export_jobs", {}).pop(
            str(ghenv.Component.InstanceGuid), None                  # noqa: F821
        )
    except Exception:
        pass

print(log)
# ---------- end json_decoder ----------

panel_2 = Panel(json_decoder)

# ==== cluster PointcloudGeneration
brep = ClusterInput()
deconstruct_brep = DeconstructBrep(Brep=brep)  # -> Faces, Edges, Vertices
simplify_tree = SimplifyTree(Tree=deconstruct_brep.Faces, Front=False)
area = Area(Geometry=simplify_tree)  # -> Area, Centroid
tree_statistics = TreeStatistics(Tree=simplify_tree)  # -> Paths, Length, Count
B = ClusterInput()
multiplication = Multiplication(A=area.Area, B=B)
list_length = ListLength(List=tree_statistics.Paths)
series = Series(Start=0, Step=1, Count=list_length)
graft_tree = GraftTree(Tree=series, IncludeEmptyLists=True, IncludeNullItems=True)
simplify_tree_2 = SimplifyTree(Tree=graft_tree, Front=False)
populate_2d = Populate2D(Region=simplify_tree, Count=multiplication, Seed=simplify_tree_2)
path_mapper = PathMapper(populate_2d, source="{A;B}", target="{A}")
point_cloud_attributes = PointCloudAttributes(Locations=path_mapper)  # -> Cloud, Locations, Normals, Colours, Hidden, Extra
point_cloud = PointCloud(point_cloud_attributes.Cloud)
point_cloud_2 = ClusterOutput(point_cloud)
