# Grasshopper definition beam_joint_section_V1.ghx (Grasshopper 1.0.8)
# plug-ins: Human

# ---- group: Select Joint
value_list = ValueList({"SW1", "SW2 – Stehendes gerades Blatt mit beidseitig schrägem Stoß": "SW2"}, selected="SW1")
refresh = Python3Script(refresh=Button(), picker=value_list)  # -> out, keys, report
# ---------- refresh: Python ----------
"""GH Python 3 -- JOINT PICKER: auto-fill a Value List from the catalogue.

Wire a Value List component INTO `picker`, set `refresh` True once.
The Value List then shows every joint in data/corpus/joints/ (label from the
datasheet's first line, value = the key). Wire that same Value List into
gh_repair's `key`. Re-run refresh after authoring a new joint.

Inputs:
    picker   (no type hint needed -- only its wire matters)
    refresh  (bool)
Outputs:
    keys, report
"""
import sys, os

REPO = r"C:\Users\tizian\workspace\projects\workshop_robarch_2026"
SRC = os.path.join(REPO, "src")
if SRC not in sys.path:
    sys.path.append(SRC)
for m in list(sys.modules):
    if m.startswith("workshop_robarch_2026"):
        sys.modules.pop(m)

from workshop_robarch_2026 import joints
import Grasshopper.Kernel.Special as ghs

keys = joints.list_keys(REPO)
report = ["{} joint(s): {}".format(len(keys), ", ".join(keys) or "-")]


def _label(key):
    md = joints.load_datasheet(REPO, key)
    for line in md.splitlines():
        line = line.strip().lstrip("#").strip()
        if line:
            return line          # e.g. "SW2 -- Half lap with mitered ends"
    return key

if refresh and keys:
    filled = False
    try:
        picker_param = None
        for prm in ghenv.Component.Params.Input:
            if prm.NickName == "picker":
                picker_param = prm
                break
        for src in (picker_param.Sources if picker_param else []):
            if isinstance(src, ghs.GH_ValueList):
                sel = None
                if src.SelectedItems.Count > 0:
                    sel = str(src.SelectedItems[0].Value).strip('"')
                src.ListItems.Clear()
                for k in keys:
                    src.ListItems.Add(
                        ghs.GH_ValueListItem(_label(k), '"{}"'.format(k)))
                # keep the previous selection if it still exists
                for i, k in enumerate(keys):
                    if k == sel:
                        src.SelectItem(i)
                        break
                src.ExpireSolution(True)
                filled = True
    except Exception as exc:
        report.append("could not fill Value List: {}".format(exc))
    report.append("dropdown filled" if filled
                  else "wire a Value List INTO `picker`")
# ---------- end refresh ----------
panel = Panel(refresh.report)

value_list_2 = ValueList({"SW1", "SW2 – Stehendes gerades Blatt mit beidseitig schrägem Stoß": "SW2"}, selected="SW2 – Stehendes gerades Blatt mit beidseitig schrägem Stoß")
refresh_2 = Python3Script(refresh=Button(), picker=value_list_2)  # -> out, keys, report; same code as refresh
panel_2 = Panel(refresh_2.report)

value_list_3 = ValueList({"SW1", "SW2 – Stehendes gerades Blatt mit beidseitig schrägem Stoß": "SW2"}, selected="SW1")
refresh_3 = Python3Script(refresh=Button(), picker=value_list_3)  # -> out, keys, report; same code as refresh
panel_3 = Panel(refresh_3.report)

# ----
steps_degrees = Panel("15")
value_list_4 = ValueList({"far end": "1", "near end": "-1"}, selected="far end")
box = Box({Plane=PlaneXY(9.873750695, -1.478421158, 0), X=Domain(0, 0.0451323131), Y=Domain(0, 2.752617333), Z=Domain(0, 0.3243183747)})

# ---- group: Run
run = BooleanToggle(True)

# ----
multiplication = Multiplication(A=Slider(42, range=0..72), B=steps_degrees)

# ---- group: Run
run_2 = BooleanToggle(True)

# ----
save = BooleanToggle(True)
curve = Curve([<curve referenced from the Rhino model> x2])

# ---- group: Inspector of Joints
gh_joint_inspector = Python3Script(key=value_list, run=run_2)  # -> out, curves, stock, cutters, kept, prosthesis, report
# ---------- gh_joint_inspector: Python ----------
"""GH Python 3 -- JOINT INSPECT: load a catalogue joint and look inside it.

Shows everything a joint entry contains, in canonical space at the origin:
the stock, each cutter as a transparent solid, the resulting kept/prosthesis
partition, the acceptance-test report, and the datasheet text.

Inputs:
    key     (str)   joint key, e.g. "SW1" (empty -> report lists the catalogue)
    run     (bool)
Outputs:
    stock       canonical stock Brep (preview as wireframe/ghosted)
    curves      the authoring curves: one branch per cutter, the closed planar
                profile(s) each cutter was defined with (round-trip exact, up
                to winding direction -- profiles are stored CCW)
    cutters     one branch per cutter -- preview transparent to see the planes
    kept        kept piece of the canonical partition
    prosthesis  prosthesis piece
    report      acceptance test, per-cut listing, datasheet
"""
import sys, os

REPO = r"C:\Users\tizian\workspace\projects\workshop_robarch_2026"
SRC = os.path.join(REPO, "src")
if SRC not in sys.path:
    sys.path.append(SRC)
for m in list(sys.modules):
    if m.startswith("workshop_robarch_2026"):
        sys.modules.pop(m)

from workshop_robarch_2026 import kernel, joints, evaluator
from workshop_robarch_2026.version import VERSION

import Rhino.Geometry as rg
from Grasshopper import DataTree
from Grasshopper.Kernel.Data import GH_Path

stock = None
curves = DataTree[object]()
cutters = DataTree[object]()
kept = DataTree[object]()
prosthesis = DataTree[object]()
report = ["version: {}".format(VERSION)]

if run and key:
    try:
        j = joints.load_joint(REPO, str(key))
        aspect = float(j["aspect"])
        report.append("joint: {}   aspect: {}   cutters: {}".format(
            j["key"], aspect, len(j["cuts"])))

        # acceptance test
        chk = joints.check_joint(j)
        report.append("partition_ok: {}   orientation_ok: {}   end_overshoot_ok: {}".format(
            chk["partition_ok"], chk.get("orientation_ok"), chk.get("end_overshoot_ok")))
        report.append("kept {:.0%} / prosthesis {:.0%}".format(
            chk["kept_fraction"], chk["prosthesis_fraction"]))

        # per-cut listing
        for c in j["cuts"]:
            n = c["normal"]
            report.append("  {}: normal ({:+.2f} {:+.2f} {:+.2f})  depth {:.2f}  "
                          "{} polyset(s)".format(c["name"], n[0], n[1], n[2],
                                                 c["amount"], len(c["polysets"])))

        # geometry: stock, cutter solids, partition
        stock_cut = kernel.canonical_stock(aspect, float(j.get("section", 1.0)))
        stock_breps = evaluator.lhf_breps(stock_cut.to_json())
        stock = stock_breps[0] if stock_breps else None

        named = [kernel.Cut.from_json(c) for c in j["cuts"]]
        for i, c in enumerate(named):
            c.name = "lhf_%d" % (i + 1)
            cj_one = c.to_json()
            for ps in cj_one["polysets"]:
                pts = [rg.Point3d(*p) for p in
                       evaluator.profile_world_points(cj_one, ps)]
                if pts[0].DistanceTo(pts[-1]) > 1e-12:
                    pts.append(pts[0])
                curves.Add(rg.PolylineCurve(pts), GH_Path(i))
            try:
                for b in evaluator.lhf_breps(cj_one):
                    cutters.Add(b, GH_Path(i))
            except Exception as exc:
                report.append("  {} FAILED to build: {}".format(c.name, exc))

        all_cuts = [stock_cut] + named
        names = ", ".join(c.name for c in named)
        cj = [c.to_json() for c in all_cuts]
        for pname, expr, tree in (
                ("kept", "Difference(lhf_0, Union(%s))" % names, kept),
                ("prosthesis", "Intersection(lhf_0, Union(%s))" % names, prosthesis)):
            try:
                bs = evaluator.evaluate_part({"cuts": cj, "expression": expr})
                tree.AddRange(bs, GH_Path(0))
            except Exception as exc:
                report.append("{} evaluation FAILED: {}".format(pname, exc))

        # datasheet
        md = joints.load_datasheet(REPO, str(key))
        if md.strip():
            report.append("--- datasheet ---")
            report += md.strip().splitlines()
        else:
            report.append("(no datasheet -- create {}.md)".format(key))
    except Exception as exc:
        report.append("ERROR: {}".format(exc))
else:
    report.append("catalogue: {}".format(", ".join(joints.list_keys(REPO)) or "(empty)"))
    report.append("set key + run to inspect a joint")
# ---------- end gh_joint_inspector ----------

# ----
gh_repair = Python3Script(
    box=box,
    key=value_list_3,
    position=Slider(1, range=0..1),
    rotation=multiplication,
    side=value_list_4,
    interface_scale=Slider(2, range=0.5..2),
    run=run)  # -> out, kept, prosthesis, cut_plane, info; inputs box: Box
# ---------- gh_repair: Python ----------
"""GH Python 3 -- REPAIR (human-driven v1): place a catalogue joint on a beam.

The beam is a Rhino BOX; its longest axis becomes the beam axis. The joint is
selected by key (Value List), positioned by slider, rotated in degrees, and
`side` says which end becomes the prosthesis.

Inputs:
    box             (Box)    the beam
    key             (str)    joint key from the catalogue (see info for keys)
    position        (float)  cut position along the axis [m from beam start]
    rotation        (float)  degrees about the beam axis
    side            (int)    +1 = far end is replaced, -1 = near end
    interface_scale (float)  [1.0]
    run             (bool)
Outputs:
    kept, prosthesis, cut_plane, info
"""
# r: roslibpy

import sys, os

REPO = r"C:\Users\tizian\workspace\projects\workshop_robarch_2026"
SRC = os.path.join(REPO, "src")
if SRC not in sys.path:
    sys.path.append(SRC)
for m in list(sys.modules):
    if m.startswith("workshop_robarch_2026"):
        sys.modules.pop(m)

from workshop_robarch_2026 import kernel, joints, evaluator
from workshop_robarch_2026.version import VERSION

import numpy as np
import Rhino.Geometry as rg
from Grasshopper import DataTree
from Grasshopper.Kernel.Data import GH_Path

kept = DataTree[object]()
prosthesis = DataTree[object]()
cut_plane = None
info = ["version: {}".format(VERSION)]

def _box_frame(b):
    """Box -> frame dict; longest axis = beam axis v; right-handed."""
    pl = b.Plane
    ax = [np.array([pl.XAxis.X, pl.XAxis.Y, pl.XAxis.Z]),
          np.array([pl.YAxis.X, pl.YAxis.Y, pl.YAxis.Z]),
          np.array([pl.ZAxis.X, pl.ZAxis.Y, pl.ZAxis.Z])]
    ext = [b.X.Length, b.Y.Length, b.Z.Length]
    iv = int(np.argmax(ext))
    iu = (iv + 1) % 3
    iw = (iv + 2) % 3
    U, V = ax[iu], ax[iv]
    W = np.cross(U, V)
    W /= np.linalg.norm(W)
    # origin: the box corner from which +U, +V, +W all point inward
    corner = b.PointAt(0, 0, 0)
    o = np.array([corner.X, corner.Y, corner.Z])
    ivals = [b.X, b.Y, b.Z]
    o = (np.array([b.Plane.Origin.X, b.Plane.Origin.Y, b.Plane.Origin.Z])
         + ivals[0].Min * ax[0] + ivals[1].Min * ax[1] + ivals[2].Min * ax[2])
    # if W is opposite the box's own third axis, shift origin to the far
    # w-corner so the frame stays on the box with right-handed axes
    if float(W @ ax[iw]) < 0:
        o = o + ext[iw] * ax[iw]
    return {"origin": o.tolist(), "u": U.tolist(), "v": V.tolist(),
            "w": W.tolist(), "width": float(ext[iu]),
            "height": float(ext[iw]), "length": float(ext[iv])}

if run and box is not None and key:
    try:
        j = joints.load_joint(REPO, str(key))
        frame = _box_frame(box)
        r = kernel.build_repair(
            j, frame,
            position=float(position) if position is not None else frame["length"] / 2,
            rotate_deg=float(rotation) if rotation else 0.0,
            side=int(side) if side else +1,
            interface_scale=float(interface_scale) if interface_scale else 1.0)

        info.append("joint: {}   interface: {:.1f} cm".format(
            key, r["interface_length"] * 100))
        info.append("cut @ {:.3f}   band {:.2f}..{:.2f}   side: {}".format(
            r["position_used"], r["band"][0], r["band"][1],
            "near (flipped)" if r["flipped"] else "far"))

        o, V = frame["origin"], frame["v"]
        U, W = frame["u"], frame["w"]
        hw, hh = frame["width"] / 2.0, frame["height"] / 2.0
        pos = r["position_used"]
        cpt = rg.Point3d(
            o[0] + hw * U[0] + hh * W[0] + pos * V[0],
            o[1] + hw * U[1] + hh * W[1] + pos * V[1],
            o[2] + hw * U[2] + hh * W[2] + pos * V[2])
        vn = rg.Vector3d(V[0], V[1], V[2]); vn.Unitize()
        cut_plane = rg.Plane(cpt, vn)

        for part in r["parts"]:
            try:
                bs = evaluator.evaluate_part(part)
            except Exception as exc:
                info.append("WARNING: {} failed: {}".format(part["name"], exc))
                bs = []
            (kept if part["name"] == "kept" else prosthesis).AddRange(bs, GH_Path(0))
            vol = 0.0
            for b in bs:
                vp = rg.VolumeMassProperties.Compute(b)
                if vp:
                    vol += vp.Volume
            info.append("{}: {} brep(s)  vol={:.2f} L".format(
                part["name"], len(bs), vol * 1000))
    except Exception as exc:
        info.append("ERROR: {}".format(exc))
else:
    info.append("catalogue: {}".format(", ".join(joints.list_keys(REPO)) or "(empty)"))
    info.append("connect box + key, set run")
# ---------- end gh_repair ----------
geometry = Geometry(gh_joint_inspector.cutters)
geometry_2 = Geometry(gh_joint_inspector.kept)
geometry_3 = Geometry(gh_joint_inspector.prosthesis)
geometry_4 = Geometry(gh_joint_inspector.curves)
geometry_5 = Geometry(gh_joint_inspector.stock)
gh_joint_author = Python3Script(cutters=curve, depths=Slider(1, range=-1..1), key=value_list_2, aspect=Slider(3, range=0..10), save=save)  # -> out, stock, kept, prosthesis, report; inputs cutters: list of Curve
# ---------- gh_joint_author: Python ----------
"""GH Python 3 -- JOINT AUTHOR: turn Rhino curves into a catalogue joint.

Model your joint in CANONICAL SPACE at the world origin:
    stock section 1 x 1:  x, z in [-0.5, +0.5]
    stock length along y: 0 to `aspect` (e.g. 3.0)
Draw one CLOSED PLANAR curve per cutter. Cutters remove the PROSTHESIS-side
material of the interface. Every cutter must overshoot the stock in x/z --
never share a face with the stock sides (the tangency lesson).

Inputs:
    cutters (Curve, list)  closed planar curves, one per cutter
    depths  (float, list)  extrusion depth per cutter, along each curve's
                           plane normal; negative = extrude the other way
    key     (str)          e.g. "SW2"
    aspect  (float)        interface length in section units (e.g. 3.0)
    save    (bool)         write data/corpus/joints/<key>.json (+ .md skeleton)
Outputs:
    stock                  the canonical stock box for the given aspect --
                           draw your cutters against exactly this
    kept, prosthesis       canonical partition preview (validation by eye)
    report                 acceptance test + per-cutter diagnostics
"""
import sys, os

REPO = r"C:\Users\tizian\workspace\projects\workshop_robarch_2026"
SRC = os.path.join(REPO, "src")
if SRC not in sys.path:
    sys.path.append(SRC)
for m in list(sys.modules):
    if m.startswith("workshop_robarch_2026"):
        sys.modules.pop(m)

from workshop_robarch_2026 import kernel, joints, evaluator
from workshop_robarch_2026.version import VERSION

import numpy as np
import Rhino.Geometry as rg
from Grasshopper import DataTree
from Grasshopper.Kernel.Data import GH_Path

kept = DataTree[object]()
prosthesis = DataTree[object]()
stock = None
report = ["version: {}".format(VERSION)]

def _curve_to_cut(crv, depth, name):
    ok, plane = crv.TryGetPlane(0.001)
    if not ok:
        raise ValueError("{}: curve is not planar".format(name))
    n = np.array([plane.Normal.X, plane.Normal.Y, plane.Normal.Z], float)
    amount = float(depth)
    if amount < 0:
        n, amount = -n, -amount
    ok, poly = crv.TryGetPolyline()
    if not ok:
        params = crv.DivideByCount(64, True)
        pts = [crv.PointAt(t) for t in params]
    else:
        pts = list(poly)
        if len(pts) > 1 and pts[0].DistanceTo(pts[-1]) < 1e-9:
            pts = pts[:-1]
    P = np.array([[p.X, p.Y, p.Z] for p in pts], float)
    u2, v2, nn = kernel.frame_from_normal(n)
    P0 = P.mean(axis=0)
    offset = float(P0 @ nn)
    in_plane = [float(P0 @ u2), float(P0 @ v2)]
    prof = np.array([[(p - P0) @ u2, (p - P0) @ v2] for p in P])
    return kernel.Cut(name, False, nn, offset, in_plane, amount, [prof])

asp = float(aspect) if aspect else 3.0
try:
    _sb = evaluator.lhf_breps(kernel.canonical_stock(asp).to_json())
    stock = _sb[0] if _sb else None
except Exception as exc:
    report.append("stock preview failed: {}".format(exc))

if cutters and key:
    try:
        crvs = cutters if isinstance(cutters, list) else [cutters]
        dpts = depths if isinstance(depths, list) else [depths]
        if len(dpts) == 1 and len(crvs) > 1:
            dpts = dpts * len(crvs)
        cuts = [_curve_to_cut(c, d, "lhf_%d" % (i + 1))
                for i, (c, d) in enumerate(zip(crvs, dpts))]

        j = {"schema": kernel.SCHEMA, "key": str(key), "aspect": asp,
             "section": 1.0, "cuts": [c.to_json() for c in cuts]}

        # headless acceptance
        chk = joints.check_joint(j)
        report.append("partition_ok: {}   kept {:.0%} / prosthesis {:.0%}".format(
            chk["partition_ok"], chk["kept_fraction"], chk["prosthesis_fraction"]))
        if chk["overlap_points"] or chk["uncovered_points"]:
            report.append("PROBLEM: overlap {} pts, uncovered {} pts".format(
                chk["overlap_points"], chk["uncovered_points"]))
        if not chk["has_both_sides"]:
            report.append("PROBLEM: cutters produce no interface (one side empty)")
        if not chk.get("end_overshoot_ok", True):
            report.append("PROBLEM: a cutter ends exactly at y=aspect -- extend it")
            report.append("  past the prosthesis end (overshoot along y too)")
        if not chk.get("orientation_ok", True):
            report.append("PROBLEM: orientation inverted -- cutters must remove")
            report.append("  more material toward y=aspect (the prosthesis end)")

        # canonical partition preview via the real evaluator
        stock_cut = kernel.canonical_stock(asp)
        named = [kernel.Cut.from_json(c) for c in j["cuts"]]
        for i, c in enumerate(named):
            c.name = "lhf_%d" % (i + 1)
        all_cuts = [stock_cut] + named
        names = ", ".join(c.name for c in named)
        cj = [c.to_json() for c in all_cuts]
        for pname, expr, tree in (
            ("kept", "Difference(lhf_0, Union(%s))" % names, kept),
            ("prosthesis", "Intersection(lhf_0, Union(%s))" % names, prosthesis)):
            try:
                bs = evaluator.evaluate_part({"cuts": cj, "expression": expr})
                tree.AddRange(bs, GH_Path(0))
                report.append("{}: {} brep(s)".format(pname, len(bs)))
            except Exception as exc:
                report.append("{} FAILED: {}".format(pname, exc))
        report += evaluator.diagnose_cuts({"cuts": cj, "expression": ""})

        if save and chk["partition_ok"] and chk["has_both_sides"] and chk.get("orientation_ok", True) and chk.get("end_overshoot_ok", True):
            path = joints.save_joint(REPO, str(key), asp, cuts)
            report.append("SAVED: {}".format(path))
            report.append("datasheet: fill in {}.md next to it".format(key))
        elif save:
            report.append("NOT saved -- fix the problems above first")
    except Exception as exc:
        report.append("ERROR: {}".format(exc))
else:
    report.append("connect cutter curves + key, set save when the preview is right")
    report.append("catalogue: {}".format(", ".join(joints.list_keys(REPO)) or "(empty)"))
# ---------- end gh_joint_author ----------
panel_4 = Panel(gh_joint_inspector.report)
geometry_6 = Geometry(gh_joint_author.kept)
geometry_7 = Geometry(gh_joint_author.stock)
geometry_8 = Geometry(gh_joint_author.prosthesis)
panel_5 = Panel(gh_repair.info)
panel_6 = Panel(gh_repair.out)
geometry_9 = Geometry(gh_repair.kept)
geometry_10 = Geometry(gh_repair.prosthesis)
plane = Plane(gh_repair.cut_plane)
panel_7 = Panel(gh_joint_author.report)
lines = CustomPreview(Geometry=geometry_7, Material=ColourSwatch(SwatchColor=RGBA(255, 204, 0, 0)))
unit_y = UnitY(Factor=Slider(1, range=0..1))
number_slider = Slider(0.0001, range=0..0.005)
move = Move(Geometry=geometry_10, Motion=unit_y)  # -> Geometry, Transform

# ---- group: Run
run_3 = BooleanToggle(True)

# ----
illustration = Python3Script(
    pieces=[geometry_9, move.Geometry],
    density=Slider(0.9, range=0..5),
    end_threshold=Slider(0.2, range=0..1),
    lift=number_slider,
    run=run_3)  # -> out, visible, hidden, grain, report; inputs pieces: list of Brep
# ---------- illustration: Python ----------
"""GH Python 3 -- GRAIN v3: 3D wood-grain curves for the catalogue look.

Live companion to the "Katalog" display mode (white shading, black edges,
dashed hidden lines): generates real 3D grain curves ON the faces of the
pieces, lifted a hair off the surface. Solids occlude their own back-face
grain naturally -- nothing is view-dependent.

Grain by face type (angle between face normal and beam axis):
    |dot| >  end_threshold [0.15] -> growth-ring CYLINDERS around the piece's
        pith line, intersected with the face plane: circles on square cuts,
        stretched ovals on miters and scarf cheeks (anatomically continuous)
    |dot| <= end_threshold        -> longitudinal flowing lines

v3: clipping fully vectorized in 2D face space (numpy) -- no per-point
RhinoCommon calls; expect ~5-10x faster than v2.

Inputs:
    pieces        (Brep, list)
    axis          (Vector)  beam axis; empty -> longest bbox direction
    density       (float) [1.0]
    lift          (float) [auto = 0.0004 x bbox diagonal]
    end_threshold (float) [0.85] faces with |dot| above this get rings
    run           (bool)
Outputs:
    grain, report
"""
import sys, os, math, random

REPO = r"C:\Users\tizian\workspace\projects\workshop_robarch_2026"
SRC = os.path.join(REPO, "src")
if SRC not in sys.path:
    sys.path.append(SRC)

import numpy as np
import Rhino
import Rhino.Geometry as rg
from Grasshopper import DataTree
from Grasshopper.Kernel.Data import GH_Path

GRAIN_V = "12"
grain = DataTree[object]()
report = []


def _face_plane(face):
    ok, plane = face.TryGetPlane(0.001)
    return plane if ok else None


def _loops_2d(face, plane):
    loops = []
    for lp in face.Loops:
        c = lp.To3dCurve()
        if c is None:
            continue
        div = c.DivideByCount(96, True)
        if not div:
            continue
        pts = [c.PointAt(t) for t in div]
        arr = np.array([[(p - plane.Origin) * plane.XAxis,
                         (p - plane.Origin) * plane.YAxis] for p in pts])
        loops.append(arr)
    return loops


def _segments(loops):
    a, b = [], []
    for L in loops:
        a.append(L)
        b.append(np.roll(L, -1, axis=0))
    return np.vstack(a), np.vstack(b)


def _mask_points(P, seg_a, seg_b):
    if len(P) == 0:
        return np.zeros(0, bool)
    px, py = P[:, 0:1], P[:, 1:2]
    x1, y1 = seg_a[:, 0][None, :], seg_a[:, 1][None, :]
    x2, y2 = seg_b[:, 0][None, :], seg_b[:, 1][None, :]
    cond = (y1 > py) != (y2 > py)
    xin = x1 + (py - y1) * (x2 - x1) / (y2 - y1 + 1e-30)
    return (np.sum(cond & (px < xin), axis=1) % 2) == 1


def _snap_to_boundary(p_out, p_in, seg_a, seg_b):
    """Exact crossing of segment p_out->p_in with the face boundary (2D).
    Returns the crossing closest to the inside point, or None."""
    dd = p_in - p_out
    e = seg_b - seg_a
    w = seg_a - p_out[None, :]
    denom = dd[0] * (-e[:, 1]) - dd[1] * (-e[:, 0])
    denom = np.where(np.abs(denom) < 1e-30, 1e-30, denom)
    t = (w[:, 0] * (-e[:, 1]) - w[:, 1] * (-e[:, 0])) / denom
    u = (dd[0] * w[:, 1] - dd[1] * w[:, 0]) / denom
    ok = (t >= -1e-9) & (t <= 1 + 1e-9) & (u >= -1e-9) & (u <= 1 + 1e-9)
    if not ok.any():
        return None
    tbest = t[ok].max()
    return p_out + np.clip(tbest, 0, 1) * dd


def _face_inner_point(seg_a, seg_b, u0, u1, v0, v1, rnd):
    """A 2D point strictly inside the face polygon (centroid, then random)."""
    cands = [np.array([[(u0 + u1) / 2.0, (v0 + v1) / 2.0]])]
    for _ in range(24):
        cands.append(np.array([[u0 + rnd.random() * (u1 - u0),
                                v0 + rnd.random() * (v1 - v0)]]))
    for c in cands:
        if _mask_points(c, seg_a, seg_b)[0]:
            return c[0]
    return None


def _runs_to_curves(pts2d, mask, plane, lift_vec, seg_a, seg_b, min_pts=2):
    out = []
    if len(pts2d) == 0:
        return out
    idx = np.where(mask)[0]
    if len(idx) == 0:
        return out
    breaks = np.where(np.diff(idx) > 1)[0]
    starts = np.r_[0, breaks + 1]
    ends = np.r_[breaks, len(idx) - 1]
    for s, e in zip(starts, ends):
        run = idx[s:e + 1]
        if len(run) < min_pts:
            continue
        chain = [pts2d[i] for i in run]
        i0, i1 = run[0], run[-1]
        if i0 > 0:  # entered the face: snap start onto the boundary
            q = _snap_to_boundary(pts2d[i0 - 1], pts2d[i0], seg_a, seg_b)
            if q is not None:
                chain.insert(0, q)
        if i1 < len(pts2d) - 1:  # left the face: snap end onto the boundary
            q = _snap_to_boundary(pts2d[i1 + 1], pts2d[i1], seg_a, seg_b)
            if q is not None:
                chain.append(q)
        pts = [plane.Origin + plane.XAxis * float(u) + plane.YAxis * float(v)
               + lift_vec for u, v in chain]
        out.append(rg.PolylineCurve(pts))
    return out


def _rings_conic(plane, pith, a, allpts, du, dv, ring_base, dens, rnd, dot):
    """Growth-ring cylinders around the pith line intersected with the face
    plane. One system for ALL faces: circles (square cuts) -> stretched
    ovals (miters, scarfs) -> pairs of parallel lines (axis-parallel faces,
    i.e. tangential grain), all from the same ring radii."""
    A = np.array([a.X, a.Y, a.Z])
    X = np.array([plane.XAxis.X, plane.XAxis.Y, plane.XAxis.Z])
    Y = np.array([plane.YAxis.X, plane.YAxis.Y, plane.YAxis.Z])
    O = np.array([plane.Origin.X, plane.Origin.Y, plane.Origin.Z])
    P = np.array([pith.X, pith.Y, pith.Z])

    def rej(v):
        return v - (v @ A) * A

    e1, e2 = rej(X), rej(Y)
    c0p = rej(O - P)
    # radii ladder shared by every branch
    def radii():
        r = ring_base / dens * (0.4 + 0.4 * rnd.random())
        while True:
            yield r
            r += ring_base / dens * (0.75 + 0.5 * rnd.random())
    # farthest loop point from the pith line
    rmax = 0.0
    for uu, vv in allpts:
        wp = c0p + uu * e1 + vv * e2
        rmax = max(rmax, float(np.sqrt(wp @ wp)))

    polys = []
    if dot < 0.06:
        # DEGENERATE: axis lies in the plane -> ring-line pairs.
        pu, pv = -dv, du
        P3 = rej(pu * X + pv * Y)
        Pn = float(np.sqrt(P3 @ P3))
        if Pn < 1e-12:
            return []
        Ph = P3 / Pn
        base = float(c0p @ Ph)
        hq = c0p - base * Ph
        h = float(np.sqrt(hq @ hq))
        proj_s = allpts[:, 0] * du + allpts[:, 1] * dv
        s0, s1 = float(proj_s.min()), float(proj_s.max())
        span = s1 - s0
        if span < 1e-9:
            return []
        step = span / 90.0
        svals = np.arange(s0 - step, s1 + 2 * step, step)
        amp = ring_base * 0.15
        for r in radii():
            if r > rmax + ring_base:
                break
            if r <= h + 1e-12:
                continue
            for sgn in (+1.0, -1.0):
                alpha = (-base + sgn * math.sqrt(r * r - h * h)) / Pn
                off = amp * np.sin(2 * 6.28 * (svals - s0) / span
                                   + rnd.random() * 6.28)
                pp = alpha + off
                polys.append(np.column_stack([svals * du + pp * pu,
                                              svals * dv + pp * pv]))
        return polys

    # CONIC: well-conditioned quadratic -> (possibly very long) ellipses
    G = np.array([[e1 @ e1, e1 @ e2], [e1 @ e2, e2 @ e2]])
    bv = 2.0 * np.array([c0p @ e1, c0p @ e2])
    try:
        m = np.linalg.solve(G, -bv / 2.0)
    except Exception:
        return []
    lam, vec = np.linalg.eigh(G)
    if lam[0] < 1e-12:
        return []
    npts = int(np.clip(97 * (lam[1] / lam[0]) ** 0.25, 97, 641))
    t = np.linspace(0, 2 * math.pi, npts)
    cc = float(c0p @ c0p)
    for r in radii():
        if r > rmax + ring_base:
            break
        k = -(float(m @ (G @ m)) + float(bv @ m) + (cc - r * r))
        if k > 1e-14:
            r1, r2 = math.sqrt(k / lam[0]), math.sqrt(k / lam[1])
            wob = 1.0 + 0.04 * np.sin(3 * t + rnd.random() * 6)
            d = (np.outer(np.cos(t) * r1 * wob, vec[:, 0]) +
                 np.outer(np.sin(t) * r2 * wob, vec[:, 1]))
            polys.append(d + m[None, :])
    return polys


if run and pieces:
    try:
        breps = pieces if isinstance(pieces, list) else [pieces]
        breps = [b for b in breps if b is not None]
        bb = rg.BoundingBox.Empty
        for b in breps:
            bb.Union(b.GetBoundingBox(True))
        diag = bb.Diagonal.Length

        ax = axis
        if ax is None or (hasattr(ax, "Length") and ax.Length < 1e-9):
            d = bb.Diagonal
            ax = rg.Vector3d(1, 0, 0)
            best = -1
            for cand in (rg.Vector3d(1, 0, 0), rg.Vector3d(0, 1, 0),
                         rg.Vector3d(0, 0, 1)):
                ext = abs(d * cand)
                if ext > best:
                    best, ax = ext, cand
        a = rg.Vector3d(ax)
        a.Unitize()

        lift_v = float(lift) if lift else diag * 0.0008
        thr = float(end_threshold) if end_threshold else 0.15
        dens = float(density or 1.0)
        n_curves = 0
        face_lines = []

        # section frame perpendicular to the axis (shared by all pieces)
        e1 = rg.Vector3d.CrossProduct(a, rg.Vector3d(0, 0, 1))
        if e1.Length < 1e-6:
            e1 = rg.Vector3d.CrossProduct(a, rg.Vector3d(1, 0, 0))
        e1.Unitize()
        e2 = rg.Vector3d.CrossProduct(a, e1)
        e2.Unitize()

        for bi, b in enumerate(breps):
            # an Inward-oriented solid flips every face normal: lift must
            # respect the BREP's orientation, not only the face's
            ssign = -1.0 if b.SolidOrientation == \
                rg.BrepSolidOrientation.Inward else 1.0
            pbb = b.GetBoundingBox(True)
            pc = pbb.Center
            pd = pbb.Diagonal
            ext1 = abs(pd * e1) / 2.0
            ext2 = abs(pd * e2) / 2.0
            prnd = random.Random(0xA5 ^ (bi * 7919) ^
                                 (hash(round(pc.X + pc.Y + pc.Z, 3)) & 0xFFFF))
            pith = (rg.Point3d(pc) +
                    e1 * (ext1 * prnd.uniform(-0.45, 0.45)) +
                    e2 * (ext2 * prnd.uniform(-0.45, 0.45)))
            ring_base = min(ext1, ext2) / 4.0 * (0.9 + 0.2 * prnd.random())
            for fi, f in enumerate(b.Faces):
                plane = _face_plane(f)
                if plane is None:
                    continue
                n = rg.Vector3d(plane.Normal)
                n.Unitize()
                # OUTWARD normal from the surface itself -- TryGetPlane's
                # normal sign is arbitrary and must not be trusted for lift
                um = f.Domain(0).Mid
                vm = f.Domain(1).Mid
                out_n = f.NormalAt(um, vm)
                if f.OrientationIsReversed:
                    out_n.Reverse()
                out_n.Unitize()
                dot = abs(n * a)
                kind = "lines" if dot < 0.06 else "rings"

                loops = _loops_2d(f, plane)
                if not loops:
                    continue
                seg_a, seg_b = _segments(loops)
                allpts = np.vstack(loops)
                u0, u1 = allpts[:, 0].min(), allpts[:, 0].max()
                v0, v1 = allpts[:, 1].min(), allpts[:, 1].max()
                if (u1 - u0) < 1e-9 or (v1 - v0) < 1e-9:
                    continue

                dvec = a - n * (a * n)
                if dvec.Length < 1e-9:
                    dvec = plane.XAxis
                dvec.Unitize()
                du = dvec * plane.XAxis
                dv = dvec * plane.YAxis

                seed = hash((bi, fi, round(plane.Origin.X, 4),
                             round(plane.Origin.Y, 4),
                             round(plane.Origin.Z, 4))) & 0xFFFF
                rnd = random.Random(seed)
                # EMPIRICAL outward check: probe a point off the face along
                # the assumed normal; if it lands inside the solid, flip.
                # Immune to every orientation convention.
                flipped = ""
                ip = _face_inner_point(seg_a, seg_b, u0, u1, v0, v1, rnd)
                if ip is not None:
                    p3 = plane.Origin + plane.XAxis * float(ip[0]) \
                         + plane.YAxis * float(ip[1])
                    probe = p3 + out_n * max(lift_v * 4.0, diag * 0.002)
                    try:
                        if b.IsPointInside(probe, 1e-6, True):
                            out_n = -out_n
                            flipped = " !"
                    except Exception:
                        pass
                lift_vec = out_n * lift_v

                polys2d = _rings_conic(plane, pith, a, allpts, du, dv,
                                       ring_base, dens, rnd, dot)
                n_face = 0
                for pts2d in polys2d:
                    mask = _mask_points(pts2d, seg_a, seg_b)
                    crvs = _runs_to_curves(pts2d, mask, plane, lift_vec,
                                           seg_a, seg_b)
                    for c in crvs:
                        grain.Add(c, GH_Path(bi))
                    n_face += len(crvs)
                n_curves += n_face
                face_lines.append("p{} f{}: dot={:.2f} -> {} ({} crv){}".format(
                    bi, fi, dot, kind, n_face, flipped))

        report.append("grain v{}: {} curves on {} piece(s)  lift {:.4f}  "
                      "end_threshold {:.2f}".format(
                          GRAIN_V, n_curves, len(breps), lift_v, thr))
        if len(face_lines) <= 28:
            report += face_lines
    except Exception as exc:
        report.append("ERROR: {}".format(exc))
else:
    report.append("wire kept + prosthesis into `pieces`, set run")
# ---------- end illustration ----------
python_3_script = Python3Script(pieces=move.Geometry, lift=number_slider)  # -> out, edges, report; inputs pieces: Brep
# ---------- python_3_script: Python ----------
"""GH Python 3 -- EDGES: brep edges lifted off the solid, catalogue-style.

Extracts every edge of the pieces and offsets it outward along the bisector
of its adjacent faces' normals, orientation verified EMPIRICALLY per edge
(probe point + Brep.IsPointInside), same as the grain component. Feed the
result into Custom Preview Lineweights (black, thickness 3-4) for the thick
book edges -- fully visible, never swallowed by the white shading.

Inputs:
    pieces  (Brep, list)
    lift    (float) [auto = 0.0008 x bbox diagonal, matching the grain]
    run     (bool)
Outputs:
    edges   lifted edge curves, one branch per piece
    report
"""
import Rhino.Geometry as rg
from Grasshopper import DataTree
from Grasshopper.Kernel.Data import GH_Path

EDGES_V = "1"
edges = DataTree[object]()
report = []
run = 'TRUE'

if run and pieces:
    try:
        breps = pieces if isinstance(pieces, list) else [pieces]
        breps = [b for b in breps if b is not None]
        bb = rg.BoundingBox.Empty
        for b in breps:
            bb.Union(b.GetBoundingBox(True))
        diag = bb.Diagonal.Length
        lift_v = float(lift) if lift else diag * 0.0008
        probe_d = max(lift_v * 4.0, diag * 0.002)

        n_edges = 0
        n_flip = 0
        for bi, b in enumerate(breps):
            for e in b.Edges:
                # outward-ish direction: bisector of adjacent face normals
                d = rg.Vector3d(0, 0, 0)
                for fidx in e.AdjacentFaces():
                    f = b.Faces[fidx]
                    um = f.Domain(0).Mid
                    vm = f.Domain(1).Mid
                    n = f.NormalAt(um, vm)
                    if f.OrientationIsReversed:
                        n.Reverse()
                    d += n
                if d.Length < 1e-9:
                    d = rg.Vector3d(0, 0, 1)
                d.Unitize()
                # empirical check at the edge midpoint
                tmid = e.Domain.Mid
                m = e.PointAt(tmid)
                try:
                    if b.IsPointInside(m + d * probe_d, 1e-6, True):
                        d = -d
                        n_flip += 1
                except Exception:
                    pass
                c = e.DuplicateCurve()
                c.Translate(d * lift_v)
                edges.Add(c, GH_Path(bi))
                n_edges += 1
        report.append("edges v{}: {} edge(s) on {} piece(s)  lift {:.4f}  "
                      "({} empirically flipped)".format(
                          EDGES_V, n_edges, len(breps), lift_v, n_flip))
    except Exception as exc:
        report.append("ERROR: {}".format(exc))
else:
    report.append("wire kept + prosthesis into `pieces`, set run")
# ---------- end python_3_script ----------
custom_preview = CustomPreview(Geometry=geometry_9, Material=ColourSwatch(SwatchColor=RGBA(0, 0, 0, 0)))
custom_preview_lineweights = CustomPreviewLineweights(
    Geometry=move.Geometry,
    Shader=ColourSwatch(SwatchColor=RGB(0, 0, 0)),
    Thickness=Slider(7.1, range=0..10),
    Absolute=False)
custom_preview_2 = CustomPreview(Geometry=[illustration.grain, python_3_script.edges], Material=ColourSwatch(SwatchColor=RGB(145, 145, 145)))
panel_8 = Panel(illustration.report)
