# Grasshopper definition 01-Curime-Fabrication.gh (Grasshopper 1.0.8)
# plug-ins: Robots

bit_diameter = Panel("3.175")
list = ValueList({"Normal Curve": 0, "Flipped Curve": 1}, selected="Normal Curve")
crv = Curve()
flip = FlipCurve(Curve=crv)  # -> Curve, Flag
filter = StreamFilter(Gate=list, Stream0=crv, Stream1=flip.Curve)
python = GhPythonScript(start_depth="0", cut_depth="3", pass_depth="1")  # -> out, all_pass; inputs start_depth: Int32
# ---------- python: Python ----------
d_temp = start_depth

pass_t= []

while d_temp < cut_depth:
    pass_t.append(d_temp)
    d_temp += pass_depth

pass_t.append(cut_depth)

all_pass = pass_t
print(pass_t)
# ---------- end python ----------
offset = OffsetCurve(Curve=filter, Distance=bit_diameter, Corners=1)
Z = UnitZ(Factor=expr("-x", python.all_pass))
move = Move(Geometry=offset, Motion=Z)  # -> Geometry, Transform
dispatch = Dispatch(List=move.Geometry, DispatchPattern=[True, False])  # -> ListA, ListB
flip_2 = FlipCurve(Curve=dispatch.ListB)  # -> Curve, Flag
panel = Panel("""0
1
2
3""")
end = EndPoints(Curve=dispatch.ListA)  # -> Start, End
end_2 = EndPoints(Curve=flip_2.Curve)  # -> Start, End
weave = Weave(Pattern=panel, Stream0=end.Start, Stream1=end.End, Stream2=end_2.Start, Stream3=end_2.End, NullGaps=False)
pline = PolyLine(Vertices=weave, Closed=False)
disc = Discontinuity(Curve=pline, Level=1)  # -> Points, Parameters
xy = XYPlane(Origin=disc.Points)

pt = ConstructPoint(XCoordinate="0", YCoordinate=".01", ZCoordinate="80")
list_2 = RobotsLibrary({"UR3e", "UR5e", "UR10e", "UR16e", "UR3", "UR5", "UR10", "UR20", "UR20RbVogui"}, selected="UR20RbVogui", Type=0)
list_3 = ValueList({"AMB1400_Marking": 0, "AMB1400_6mm": 1, "AMB1400_10mm": 2}, selected="AMB1400_6mm")

crv_2 = Curve(<curve referenced from the Rhino model>)
crv_3 = Curve(<curve referenced from the Rhino model>)

pipeline = GeometryPipeline(
    GroupByLayer=False,
    GroupByType=False,
    IncludeHidden=True,
    IncludeLocked=True,
    LayerFilter="AMB1400",
    NameFilter="*",
    SublayerFiltering=True,
    TypeFilter=32)
pt_2 = ConstructPoint(XCoordinate="140", YCoordinate="0", ZCoordinate="115")
mjoin = MeshJoin(Meshes=pipeline)
Z_2 = UnitZ(Factor="-1")
pl = ConstructPlane(Origin=pt_2, XAxis=Z_2, YAxis=Vector(0, 1, 0))
createtool = CreateTool(Name="AMB1400_Marking", TCP=pl, Weight="3.35", Centroid=pt, Mesh=mjoin)  # -> Tool, TCP

pipeline_2 = GeometryPipeline(
    GroupByLayer=False,
    GroupByType=False,
    IncludeHidden=True,
    IncludeLocked=True,
    LayerFilter="AMB1400",
    NameFilter="*",
    SublayerFiltering=True,
    TypeFilter=32)
pt_3 = ConstructPoint(XCoordinate="198.91", YCoordinate="0", ZCoordinate="115.96")
mjoin_2 = MeshJoin(Meshes=pipeline_2)
Z_3 = UnitZ(Factor="-1")
pl_2 = ConstructPlane(Origin=pt_3, XAxis=Z_3, YAxis=Vector(0, 1, 0))
createtool_2 = CreateTool(Name="AMB1400_6mm", TCP=pl_2, Weight="3.35", Centroid=pt, Mesh=mjoin_2)  # -> Tool, TCP

pipeline_3 = GeometryPipeline(
    GroupByLayer=False,
    GroupByType=False,
    IncludeHidden=True,
    IncludeLocked=True,
    LayerFilter="AMB1400",
    NameFilter="*",
    SublayerFiltering=True,
    TypeFilter=32)
pt_4 = ConstructPoint(XCoordinate="190.69", YCoordinate="0", ZCoordinate="115.73")
mjoin_3 = MeshJoin(Meshes=pipeline_3)
Z_4 = UnitZ(Factor="-1")
pl_3 = ConstructPlane(Origin=pt_4, XAxis=Z_4, YAxis=Vector(0, 1, 0))
createtool_3 = CreateTool(Name="AMB1400_10mm", TCP=pl_3, Weight="3.35", Centroid=pt, Mesh=mjoin_3)  # -> Tool, TCP

xy_2 = XYPlane(Origin=Point(0, 0, 0))

crv_4 = Curve(<curve referenced from the Rhino model>)
crv_5 = Curve(<curve referenced from the Rhino model>)

crv_6 = Curve(<curve referenced from the Rhino model>)
crv_7 = Curve(<curve referenced from the Rhino model>)

crv_8 = Curve(<curve referenced from the Rhino model>)
crv_9 = Curve(<curve referenced from the Rhino model>)

pt_5 = ConstructPoint(XCoordinate="673.69", YCoordinate="476.53", ZCoordinate="-116.67")

range = Range(Domain=Domain(0, 1), Steps="20")
loft = Loft(Curves=[crv_3, crv_2], Options={Adjust=False, Closed=False, LoftEnds=0, LoftSimp=0, LoftType=0, Rebuild=10, Refit=0.01})
range_2 = Range(Domain=Domain(0, 1), Steps="20")
range_3 = Range(Domain=Domain(0, 1), Steps="20")
range_4 = Range(Domain=Domain(0, 1), Steps="20")
tweencrv = TweenCurve(CurveA=crv_3, CurveB=crv_2, Factor=range, BlendType=0)
loft_2 = Loft(Curves=[crv_4, crv_5], Options={Adjust=False, Closed=False, LoftEnds=0, LoftSimp=0, LoftType=0, Rebuild=10, Refit=0.01})
loft_3 = Loft(Curves=[crv_6, crv_7], Options={Adjust=False, Closed=False, LoftEnds=0, LoftSimp=0, LoftType=0, Rebuild=10, Refit=0.01})
loft_4 = Loft(Curves=[crv_8, crv_9], Options={Adjust=False, Closed=False, LoftEnds=0, LoftSimp=0, LoftType=0, Rebuild=10, Refit=0.01})
planar = IsPlanar(Surface=loft, Interior=True)  # -> Planar, Plane
tweencrv_2 = TweenCurve(CurveA=crv_4, CurveB=crv_5, Factor=range_2, BlendType=0)
tweencrv_3 = TweenCurve(CurveA=crv_6, CurveB=crv_7, Factor=range_3, BlendType=0)
tweencrv_4 = TweenCurve(CurveA=crv_8, CurveB=crv_9, Factor=range_4, BlendType=0)
planar_2 = IsPlanar(Surface=loft_2, Interior=True)  # -> Planar, Plane
planar_3 = IsPlanar(Surface=loft_3, Interior=True)  # -> Planar, Plane
planar_4 = IsPlanar(Surface=loft_4, Interior=True)  # -> Planar, Plane
ext = ExtendCurve(Curve=tweencrv, Type=0, Start="10", End="10")
xy_3 = XYPlane(Origin=pt_5)
c_script = CSharpScript(plane=xy_3, x=Slider(0, range=-180..180), y=Slider(-0.01, range=-180..180), z=Slider(-1.54, range=-180..180))  # -> out, P, PX, PY, PZ; inputs plane: Plane, x: Double, y: Double, z: Double
# ---------- c_script: C# ----------
// Grasshopper Script Instance
#region Usings
using System;
using System.Linq;
using System.Collections;
using System.Collections.Generic;
using System.Drawing;

using Rhino;
using Rhino.Geometry;

using Grasshopper;
using Grasshopper.Kernel;
using Grasshopper.Kernel.Data;
using Grasshopper.Kernel.Types;
#endregion

public class Script_Instance : GH_ScriptInstance
{
    #region Notes
    /* 
      Members:
        RhinoDoc RhinoDocument
        GH_Document GrasshopperDocument
        IGH_Component Component
        int Iteration

      Methods (Virtual & overridable):
        Print(string text)
        Print(string format, params object[] args)
        Reflect(object obj)
        Reflect(object obj, string method_name)
    */
    #endregion

    private void RunScript(
		Plane plane,
		double x,
		double y,
		double z,
		ref object P,
		ref object PX,
		ref object PY,
		ref object PZ)
    {

        plane.Rotate(x, plane.XAxis);
        plane.Rotate(y, plane.YAxis);
        plane.Rotate(z, plane.ZAxis);
        // Write your logic here
        P = plane;
        PX = plane.XAxis;
        PY = plane.YAxis;
        PZ = plane.ZAxis;
    }
}
# ---------- end c_script ----------

# ---- group: Geometry Preview
geo = Geometry(<brep referenced from the Rhino model>)
orient = Orient(Geometry=geo, Source=PlaneXY(0, 0, 0), Target=c_script.P)  # -> Geometry, Transform
wires = BrepWireframe(Brep=orient.Geometry, Density=-1)
preview = CustomPreview(Geometry=wires, Material=ColourSwatch(SwatchColor=RGB(0, 0, 0)))

# ----
xy_4 = XYPlane(Origin=Point(0, 0, 0))
long_pocket = Curve(<curve referenced from the Rhino model>)
orient_2 = Orient(Geometry=long_pocket, Source=xy_4, Target=c_script.P)  # -> Geometry, Transform
oriented_pocket = Curve(orient_2.Geometry)
explode = Explode(Curve=oriented_pocket, Recursive=True)  # -> Segments, Vertices

ext_2 = ExtendCurve(Curve=tweencrv_2, Type=0, Start="10", End="10")
ext_3 = ExtendCurve(Curve=tweencrv_3, Type=0, Start="0", End="10")
ext_4 = ExtendCurve(Curve=tweencrv_4, Type=0, Start="10", End="0")
end_3 = EndPoints(Curve=crv_3)  # -> Start, End
end_4 = EndPoints(Curve=crv_2)  # -> Start, End
end_5 = EndPoints(Curve=crv_4)  # -> Start, End
end_6 = EndPoints(Curve=crv_5)  # -> Start, End
end_7 = EndPoints(Curve=crv_6)  # -> Start, End
end_8 = EndPoints(Curve=crv_7)  # -> Start, End
end_9 = EndPoints(Curve=crv_8)  # -> Start, End
end_10 = EndPoints(Curve=crv_9)  # -> Start, End
loadrobotsystem = LoadRobotSystem(Name=list_2, Base=xy_2)
vec2pt = Vector2Pt(PointA=end_3.Start, PointB=end_4.Start, Unitize=False)  # -> Vector, Length
line = LineSDL(Start=c_script.P, Direction=c_script.PX, Length="1000")
line_2 = LineSDL(Start=c_script.P, Direction=c_script.PY, Length="1000")
rectangle = Rectangle(Plane=c_script.P, XSize="800", YSize="800", Radius=0)  # -> Rectangle, Length
vec2pt_2 = Vector2Pt(PointA=end_5.Start, PointB=end_6.Start, Unitize=False)  # -> Vector, Length
vec2pt_3 = Vector2Pt(PointA=end_7.Start, PointB=end_8.Start, Unitize=False)  # -> Vector, Length
vec2pt_4 = Vector2Pt(PointA=end_9.Start, PointB=end_10.Start, Unitize=False)  # -> Vector, Length
vdisex = VectorDisplayEx(Point=end_3.Start, Vector=vec2pt.Vector, Colour=RGB(0, 0, 0), Width=2)
boundary = BoundarySurfaces(Edges=rectangle.Rectangle)
vdisex_2 = VectorDisplayEx(Point=end_5.Start, Vector=vec2pt_2.Vector, Colour=RGB(0, 0, 0), Width=2)
vdisex_3 = VectorDisplayEx(Point=end_7.Start, Vector=vec2pt_3.Vector, Colour=RGB(0, 0, 0), Width=2)
vdisex_4 = VectorDisplayEx(Point=end_9.Start, Vector=vec2pt_4.Vector, Colour=RGB(0, 0, 0), Width=2)
tool_selection = StreamFilter(Gate=list_3, Stream0=createtool.Tool, Stream1=createtool_2.Tool, Stream2=createtool_3.Tool)
filter_2 = StreamFilter(Gate=list_3, Stream0="3.175", Stream1="6", Stream2="10")
pl_offset = PlaneOffset(BasePlane=planar.Plane, Offset=expr("x/2", filter_2))
pl_offset_2 = PlaneOffset(BasePlane=planar_2.Plane, Offset=expr("x/2", filter_2))
pl_offset_3 = PlaneOffset(BasePlane=planar_3.Plane, Offset=expr("x/2", filter_2))
pl_offset_4 = PlaneOffset(BasePlane=planar_4.Plane, Offset=expr("x/2", filter_2))
orient_3 = Orient(Geometry=ext, Source=planar.Plane, Target=pl_offset)  # -> Geometry, Transform
orient_4 = Orient(Geometry=ext_2, Source=planar_2.Plane, Target=pl_offset_2)  # -> Geometry, Transform
orient_5 = Orient(Geometry=ext_3, Source=planar_3.Plane, Target=pl_offset_3)  # -> Geometry, Transform
orient_6 = Orient(Geometry=ext_4, Source=planar_4.Plane, Target=pl_offset_4)  # -> Geometry, Transform
cluster = Cluster(plane=pl_offset)
dispatch_2 = Dispatch(List=orient_3.Geometry, DispatchPattern=[True, False])  # -> ListA, ListB
dispatch_3 = Dispatch(List=orient_4.Geometry, DispatchPattern=[True, False])  # -> ListA, ListB
dispatch_4 = Dispatch(List=orient_5.Geometry, DispatchPattern=[True, False])  # -> ListA, ListB
dispatch_5 = Dispatch(List=orient_6.Geometry, DispatchPattern=[True, False])  # -> ListA, ListB
flip_3 = FlipCurve(Curve=dispatch_2.ListB)  # -> Curve, Flag
flip_4 = FlipCurve(Curve=dispatch_3.ListB)  # -> Curve, Flag
flip_5 = FlipCurve(Curve=dispatch_4.ListB)  # -> Curve, Flag
flip_6 = FlipCurve(Curve=dispatch_5.ListB)  # -> Curve, Flag
weave_2 = Weave(Pattern=[0, 1], Stream0=dispatch_2.ListA, Stream1=flip_3.Curve, NullGaps=False)
pt_6 = ConstructPoint(
    XCoordinate=Slider(500, range=-500..1000),
    YCoordinate=Slider(0, range=-500..1000),
    ZCoordinate=Slider(20, range=-500..1000))
weave_3 = Weave(Pattern=[0, 1], Stream0=dispatch_3.ListA, Stream1=flip_4.Curve, NullGaps=False)
weave_4 = Weave(Pattern=[0, 1], Stream0=dispatch_4.ListA, Stream1=flip_5.Curve, NullGaps=False)
weave_5 = Weave(Pattern=[0, 1], Stream0=dispatch_5.ListA, Stream1=flip_6.Curve, NullGaps=False)
disc_2 = Discontinuity(Curve=weave_2, Level=1)  # -> flatten(Points), Parameters

cut_depth = Panel("22.5")
stepover_percentage = Panel("40")
milling_bit_diameter = Panel("6")
safety_factor = Slider(0.66, range=0..10)
python_2 = GhPythonScript(start_depth="0", cut_depth="45", pass_depth="2")  # -> out, all_pass; inputs start_depth: Int32; same code as python
srf = Surface(<surface referenced from the Rhino model>)
planar_5 = IsPlanar(Surface=srf, Interior=True)  # -> Planar, Plane
dom = ConstructDomain(DomainStart=expr("-x/2", "160"), DomainEnd=expr("x/2", "160"))
dom_2 = ConstructDomain(DomainStart=expr("-x/2", "140"), DomainEnd=expr("x/2", "140"))
crv_10 = Curve(oriented_pocket)
rectangle_2 = Rectangle(Plane=planar_5.Plane, XSize=dom_2, YSize=dom, Radius=0)  # -> Rectangle, Length
list_4 = ValueList({"This Side": 0, "Other Side": 1}, selected="This Side")
explode_2 = Explode(Curve=crv_10, Recursive=True)  # -> Segments, Vertices
disc_3 = Discontinuity(Curve=rectangle_2.Rectangle, Level=1)  # -> Points, Parameters
item = ListItem(List=explode_2.Segments, Index=0, Wrap=True)  # -> Item, Item1, Item2, Item3
crv_11 = Curve(item.Item)
crv_12 = Curve(item.Item2)
multiplication = Multiplication(A=milling_bit_diameter, B=safety_factor)
flip_7 = FlipCurve(Curve=crv_12)  # -> Curve, Flag
ext_5 = ExtendCurve(Curve=crv_11, Type=0, Start=multiplication, End=multiplication)
ext_6 = ExtendCurve(Curve=flip_7.Curve, Type=0, Start=multiplication, End=multiplication)
offset_2 = OffsetCurve(Curve=ext_5, Distance=expr("-x/2", milling_bit_diameter), Corners=1)
offset_3 = OffsetCurve(Curve=ext_6, Distance=expr("x/2", milling_bit_diameter), Corners=1)
end_11 = EndPoints(Curve=offset_2)  # -> Start, End
end_12 = EndPoints(Curve=offset_3)  # -> Start, End
expression = Expression(x=milling_bit_diameter, y=stepover_percentage, Expression="x*(1-(y/100))")
ln = Line(StartPoint=end_11.Start, EndPoint=end_12.Start)
ln_2 = Line(StartPoint=end_11.End, EndPoint=end_12.End)
divdist = DivideDistance(Curve=ln_2, Distance=expression)  # -> Points, Tangents, Parameters
divdist_2 = DivideDistance(Curve=ln, Distance=expression)  # -> Points, Tangents, Parameters
ln_3 = Line(StartPoint=divdist_2.Points, EndPoint=divdist.Points)
dispatch_6 = Dispatch(List=ln_3, DispatchPattern=[True, False])  # -> ListA, ListB
flip_8 = FlipCurve(Curve=dispatch_6.ListB)  # -> Curve, Flag
panel_2 = Panel("""0
1
2
3""")
end_13 = EndPoints(Curve=dispatch_6.ListA)  # -> Start, End
end_14 = EndPoints(Curve=flip_8.Curve)  # -> Start, End
weave_6 = Weave(Pattern=panel_2, Stream0=end_13.Start, Stream1=end_13.End, Stream2=end_14.Start, Stream3=end_14.End, NullGaps=False)
panel_3 = Panel(python_2.all_pass)
merge = Merge(Data1=flatten(weave_6), Data2=end_12.Start, Data3=end_12.End)
neg = Negative(Value=panel_3)
pline_2 = PolyLine(Vertices=flatten(merge), Closed=False)
Z_5 = UnitZ(Factor=neg)
move_2 = Move(Geometry=pline_2, Motion=Z_5)  # -> Geometry, Transform
dispatch_7 = Dispatch(List=move_2.Geometry, DispatchPattern=[True, False])  # -> ListA, ListB
flip_9 = FlipCurve(Curve=dispatch_7.ListB)  # -> Curve, Flag
weave_7 = Weave(Pattern=[0, 1], Stream0=dispatch_7.ListA, Stream1=flip_9.Curve, NullGaps=False)
disc_4 = Discontinuity(Curve=weave_7, Level=1)  # -> flatten(Points), Parameters
pline_3 = PolyLine(Vertices=disc_4.Points, Closed=False)
preview_2 = CustomPreview(Geometry=pline_3, Material=ColourSwatch(SwatchColor=RGB(87, 87, 87)))  # disabled
xy_5 = XYPlane(Origin=disc_4.Points)
pflip = FlipPlane(Plane=xy_5, ReverseX=Toggle(True), ReverseY=Toggle(False), SwapAxes=Toggle(False))

pt_7 = Point(disc_4.Points)
xy_6 = XYPlane(Origin=pt_7)
orient_7 = Orient(Geometry=pt_6, Source=PlaneXY(0, 0, 0), Target=c_script.P)  # -> Geometry, Transform
disc_5 = Discontinuity(Curve=weave_3, Level=1)  # -> flatten(Points), Parameters
disc_6 = Discontinuity(Curve=weave_4, Level=1)  # -> flatten(Points), Parameters
disc_7 = Discontinuity(Curve=weave_5, Level=1)  # -> flatten(Points), Parameters
xy_7 = XYPlane(Origin=disc_2.Points)
pline_4 = PolyLine(Vertices=disc_2.Points, Closed=False)

# ---- group: Turn Motor On and Wait
wait = Wait(Time="5")
setdo = SetDO(DO="4", Value=Toggle(False))
setdo_2 = SetDO(DO="4", Value=Toggle(True))
setao = SetAO(AO="1", Value=Slider(0.87, range=0..1))
merge_2 = Merge(Data1=setdo, Data2=setao, Data3=setdo_2, Data4=wait)
groupcommand = GroupCommand(Commands=merge_2)

# ----
xy_8 = XYPlane(Origin=disc_5.Points)
xy_9 = XYPlane(Origin=disc_6.Points)
xy_10 = XYPlane(Origin=disc_7.Points)

# ---- group: Motor Off
setdo_3 = SetDO(DO="4", Value=Toggle(False))
setao_2 = SetAO(AO="1", Value=Slider(0, range=0..1))
merge_3 = Merge(Data1=setdo_3, Data2=setao_2)
groupcommand_2 = GroupCommand(Commands=merge_3)

# ----
pline_5 = PolyLine(Vertices=disc_5.Points, Closed=False)
pline_6 = PolyLine(Vertices=disc_6.Points, Closed=False)
pline_7 = PolyLine(Vertices=disc_7.Points, Closed=False)
xy_11 = XYPlane(Origin=orient_7.Geometry)
padjust = AdjustPlane(Plane=xy_7, Normal=vec2pt.Vector)
padjust_2 = AdjustPlane(Plane=xy_8, Normal=vec2pt_2.Vector)
padjust_3 = AdjustPlane(Plane=xy_9, Normal=vec2pt_3.Vector)
padjust_4 = AdjustPlane(Plane=xy_10, Normal=vec2pt_4.Vector)
toggle = BooleanToggle(True)
orient_8 = Orient(Geometry=padjust, Source=PlaneXY(0, 0, 0), Target=c_script.P)  # -> Geometry, Transform

setdo_4 = SetDO(DO="4", Value=Toggle(False))
setdo_5 = SetDO(DO="4", Value=Toggle(True))
setao_3 = SetAO(AO="1", Value=Slider(0.987, range=0..1))
merge_4 = Merge(Data1=setdo_4, Data2=setao_3, Data3=setdo_5)
groupcommand_3 = GroupCommand(Commands=merge_4)

orient_9 = Orient(Geometry=padjust_2, Source=PlaneXY(0, 0, 0), Target=c_script.P)  # -> Geometry, Transform
orient_10 = Orient(Geometry=padjust_3, Source=PlaneXY(0, 0, 0), Target=c_script.P)  # -> Geometry, Transform
orient_11 = Orient(Geometry=padjust_4, Source=PlaneXY(0, 0, 0), Target=c_script.P)  # -> Geometry, Transform
prot = RotatePlane(Plane=orient_8.Geometry, Angle=degrees(Slider(135, range=0..270)))
prot_2 = RotatePlane(Plane=orient_9.Geometry, Angle=degrees(Slider(171.72, range=0..270)))
prot_3 = RotatePlane(Plane=orient_10.Geometry, Angle=degrees(Slider(171.72, range=0..270)))
prot_4 = RotatePlane(Plane=orient_11.Geometry, Angle=degrees(Slider(171.72, range=0..270)))
list_5 = ValueList({"Joint", "Linear", "Process"}, selected="Process")
list_6 = ValueList({"Joint", "Linear", "Process"}, selected="Linear")
list_7 = FlagFields({"Shoulder": 1, "Elbow": 2, "Wrist": 4}, selected=[])
pt_8 = Point(<point referenced from the Rhino model>)
xy_12 = XYPlane(Origin=pt_8)
toolpaths = Slider(0, range=0..3)
filter_3 = StreamFilter(Gate=toolpaths, Stream0=prot, Stream1=prot_2, Stream2=prot_3, Stream3=prot_4)
pflip_2 = FlipPlane(Plane=xy_12, ReverseX=True, ReverseY=False, SwapAxes=False)

toolpath = Plane(filter_3)
first = ListItem(List=toolpath, Index=0, Wrap=True)
last = ListItem(List=toolpath, Index=-1, Wrap=True)
pl_offset_5 = PlaneOffset(BasePlane=last, Offset="-90")
pl_offset_6 = PlaneOffset(BasePlane=first, Offset="-75")

createtarget = CreateTarget(
    Plane=pl_offset_6,
    Configuration=list_7,
    Motion=list_6,
    Tool=tool_selection,
    Speed="15",
    Command=groupcommand,
    IsCartesian=True)
createtarget_2 = CreateTarget(Plane=toolpath, Configuration=list_7, Motion=list_6, Tool=tool_selection, Speed="15", IsCartesian=True)
createtarget_3 = CreateTarget(
    Plane=pl_offset_5,
    Configuration=list_7,
    Motion=list_6,
    Tool=tool_selection,
    Speed="15",
    Command=groupcommand_2,
    IsCartesian=True)
merge_5 = Merge(Data1=createtarget, Data2=createtarget_2, Data3=createtarget_3)
createprogram = CreateProgram(Name="DefaultProgram", RobotSystem=loadrobotsystem, Targets=merge_5, StepSize=1)  # -> Program, Code, Duration, Warnings, Errors
programsimulation = ProgramSimulation(Program=createprogram.Program, Time=Slider(0, range=0..1), Normalized=True)  # -> SystemMeshes, JointRotations, Plane, Index, Time, Program, Errors
item_2 = ListItem(List=programsimulation.Plane, Index=0, Wrap=True)  # -> Item1, Item
first_2 = ListItem(Index=0, Wrap=True)
last_2 = ListItem(Index=-1, Wrap=True)
cluster_2 = Cluster(plane=item_2.Item1)

upload_play = Button()
play = Button()
stop = Button()
remoteconnection = RemoteConnection(Program=createprogram.Program, IP="192.168.0.210", Upload=upload_play, Play=play, Pause=stop)

pl_offset_7 = PlaneOffset(BasePlane=first_2, Offset="-75")
pl_offset_8 = PlaneOffset(BasePlane=last_2, Offset="-75")
c_script_2 = CSharpScript()  # -> out, F, L; inputs Planes: list of Plane, OZ: Double
# ---------- c_script_2: C# ----------
// Grasshopper Script Instance
#region Usings
using System;
using System.Linq;
using System.Collections;
using System.Collections.Generic;
using System.Drawing;

using Rhino;
using Rhino.Geometry;

using Grasshopper;
using Grasshopper.Kernel;
using Grasshopper.Kernel.Data;
using Grasshopper.Kernel.Types;
#endregion

public class Script_Instance : GH_ScriptInstance
{
    #region Notes
    /* 
      Members:
        RhinoDoc RhinoDocument
        GH_Document GrasshopperDocument
        IGH_Component Component
        int Iteration

      Methods (Virtual & overridable):
        Print(string text)
        Print(string format, params object[] args)
        Reflect(object obj)
        Reflect(object obj, string method_name)
    */
    #endregion

    private void RunScript(
		List<Plane> Planes,
		double OZ,
		ref object F,
		ref object L)
    {
        // Write your logic here
        if ( Planes != null && Planes.Count>0)
        {
            Plane firstPlane = Planes[0];
            Plane lastPlane = Planes[Planes.Count-1];

            double planeDiff = Math.Abs(firstPlane.OriginZ - lastPlane.OriginZ);
            Vector3d TranslateZ = new Vector3d(0,0,OZ);

            firstPlane.OriginZ+= OZ;
            lastPlane.OriginZ+=OZ;
            lastPlane.OriginZ+=planeDiff;

             F = firstPlane;
             L  = lastPlane;
        }


    }
}
# ---------- end c_script_2 ----------

# ==== cluster Cluster
plane = ClusterInput()

# ---- group: BaseFeature
c_script = CSharpScript(plane=plane)  # -> out, P, PX, PY, PZ; inputs plane: Plane
# ---------- c_script: C# ----------
// Grasshopper Script Instance
#region Usings
using System;
using System.Linq;
using System.Collections;
using System.Collections.Generic;
using System.Drawing;

using Rhino;
using Rhino.Geometry;

using Grasshopper;
using Grasshopper.Kernel;
using Grasshopper.Kernel.Data;
using Grasshopper.Kernel.Types;
#endregion

public class Script_Instance : GH_ScriptInstance
{
    #region Notes
    /* 
      Members:
        RhinoDoc RhinoDocument
        GH_Document GrasshopperDocument
        IGH_Component Component
        int Iteration

      Methods (Virtual & overridable):
        Print(string text)
        Print(string format, params object[] args)
        Reflect(object obj)
        Reflect(object obj, string method_name)
    */
    #endregion

    private void RunScript(
		Plane plane,
		ref object P,
		ref object PX,
		ref object PY,
		ref object PZ)
    {
        // Write your logic here
        P = plane;
        PX = plane.XAxis*150;
        PY = plane.YAxis*150;
        PZ = plane.ZAxis*150;
    }
}
# ---------- end c_script ----------
vdisex = VectorDisplayEx(Point=c_script.P, Vector=c_script.PX, Colour=ColourSwatch(SwatchColor=RGB(255, 0, 0)), Width=2)
vdisex_2 = VectorDisplayEx(Point=c_script.P, Vector=c_script.PY, Colour=ColourSwatch(SwatchColor=RGB(60, 255, 0)), Width=2)
vdisex_3 = VectorDisplayEx(Point=c_script.P, Vector=c_script.PZ, Colour=ColourSwatch(SwatchColor=RGB(0, 102, 255)), Width=2)
