# Grasshopper definition 01-marking-on-column.gh (Grasshopper 1.0.8)
# plug-ins: Robots

crv = Curve(<curve referenced from the Rhino model>)
crv_2 = Curve(<curve referenced from the Rhino model>)
X = UnitX(Factor=Slider(6.017, range=0..8))

# ---- group: ColumnSide2
pt = ConstructPoint(XCoordinate="-279.21", YCoordinate="1174.01", ZCoordinate="-869.20")
xy = XYPlane(Origin=pt)
c_script = CSharpScript(plane=xy, x=Slider(0, range=-180..180), y=Slider(0, range=-180..180), z=Slider(1.57, range=-180..180))  # -> out, P, PX, PY, PZ; inputs plane: Plane, x: Double, y: Double, z: Double
# ---------- c_script: C# ----------
// Grasshopper Script Instance
#region Usings
using System;
using System.Linq;
using System.Collections;
using System.Collections.Generic;
using System.Drawing;

using Rhino;
using Rhino.Geometry;

using Grasshopper;
using Grasshopper.Kernel;
using Grasshopper.Kernel.Data;
using Grasshopper.Kernel.Types;
#endregion

public class Script_Instance : GH_ScriptInstance
{
    #region Notes
    /* 
      Members:
        RhinoDoc RhinoDocument
        GH_Document GrasshopperDocument
        IGH_Component Component
        int Iteration

      Methods (Virtual & overridable):
        Print(string text)
        Print(string format, params object[] args)
        Reflect(object obj)
        Reflect(object obj, string method_name)
    */
    #endregion

    private void RunScript(
		Plane plane,
		double x,
		double y,
		double z,
		ref object P,
		ref object PX,
		ref object PY,
		ref object PZ)
    {

        plane.Rotate(x, plane.XAxis);
        plane.Rotate(y, plane.YAxis);
        plane.Rotate(z, plane.ZAxis);
        // Write your logic here
        P = plane;
        PX = plane.XAxis;
        PY = plane.YAxis;
        PZ = plane.ZAxis;
    }
}
# ---------- end c_script ----------

# ----
ext = ExtendCurve(Curve=crv, Type=0, Start="10", End="10")

# ---- group: ColumnBas
pt_2 = ConstructPoint(XCoordinate="433.53", YCoordinate="1270.67", ZCoordinate="-875.84")

xy_2 = XYPlane(Origin=pt_2)
c_script_2 = CSharpScript(plane=xy_2, x=Slider(1.58, range=-180..180), y=Slider(0, range=-180..180), z=Slider(0.013, range=-180..180))  # -> out, P, PX, PY, PZ; inputs plane: Plane, x: Double, y: Double, z: Double; same code as c_script

# ----
move = Move(Geometry=crv_2, Motion=X)  # -> Geometry, Transform
flip = FlipCurve(Curve=ext)  # -> Curve, Flag
ext_2 = ExtendCurve(Curve=move.Geometry, Type=0, Start="0", End="0")
xy_3 = XYPlane(Origin=Point(0, 0, 0))
disc = Discontinuity(Curve=flip.Curve, Level=1)  # -> Points, Parameters
disc_2 = Discontinuity(Curve=ext_2, Level=1)  # -> Points, Parameters
xy_4 = XYPlane(Origin=disc.Points)  # disabled
xz = XZPlane(Origin=disc_2.Points)
pt_3 = ConstructPoint(XCoordinate="0", YCoordinate=".01", ZCoordinate="80")
cluster = Cluster(plane=c_script.P)
list = ValueList({"AMB1400_Marking": 0, "AMB1400_6mm": 1, "AMB1400_10mm": 2}, selected="AMB1400_Marking")

pipeline = GeometryPipeline(
    GroupByLayer=False,
    GroupByType=False,
    IncludeHidden=True,
    IncludeLocked=True,
    LayerFilter="AMB1400",
    NameFilter="*",
    SublayerFiltering=True,
    TypeFilter=32)
pt_4 = ConstructPoint(XCoordinate="132", YCoordinate="0", ZCoordinate="115")
mjoin = MeshJoin(Meshes=pipeline)
Z = UnitZ(Factor="-1")
pl = ConstructPlane(Origin=pt_4, XAxis=Z, YAxis=Vector(0, 1, 0))
createtool = CreateTool(Name="AMB1400_Marking", TCP=pl, Weight="3.35", Centroid=pt_3, Mesh=mjoin)  # -> Tool, TCP

pipeline_2 = GeometryPipeline(
    GroupByLayer=False,
    GroupByType=False,
    IncludeHidden=True,
    IncludeLocked=True,
    LayerFilter="AMB1400",
    NameFilter="*",
    SublayerFiltering=True,
    TypeFilter=32)
pt_5 = ConstructPoint(XCoordinate="198.91", YCoordinate="0", ZCoordinate="115.96")
mjoin_2 = MeshJoin(Meshes=pipeline_2)
Z_2 = UnitZ(Factor="-1")
pl_2 = ConstructPlane(Origin=pt_5, XAxis=Z_2, YAxis=Vector(0, 1, 0))
createtool_2 = CreateTool(Name="AMB1400_6mm", TCP=pl_2, Weight="3.35", Centroid=pt_3, Mesh=mjoin_2)  # -> Tool, TCP

pipeline_3 = GeometryPipeline(
    GroupByLayer=False,
    GroupByType=False,
    IncludeHidden=True,
    IncludeLocked=True,
    LayerFilter="AMB1400",
    NameFilter="*",
    SublayerFiltering=True,
    TypeFilter=32)
pt_6 = ConstructPoint(XCoordinate="190.69", YCoordinate="0", ZCoordinate="115.73")
mjoin_3 = MeshJoin(Meshes=pipeline_3)
Z_3 = UnitZ(Factor="-1")
pl_3 = ConstructPlane(Origin=pt_6, XAxis=Z_3, YAxis=Vector(0, 1, 0))
createtool_3 = CreateTool(Name="AMB1400_10mm", TCP=pl_3, Weight="3.35", Centroid=pt_3, Mesh=mjoin_3)  # -> Tool, TCP

X_2 = UnitX(Factor=Slider(-1.5, range=-8..8))
crv_3 = Curve(<curve referenced from the Rhino model>)
crv_4 = Curve([<curve referenced from the Rhino model> x2])
crv_5 = Curve(<curve referenced from the Rhino model>)
crv_6 = Curve(<curve referenced from the Rhino model>)
move_2 = Move(Geometry=crv_3, Motion=X_2)  # -> Geometry, Transform
crv_7 = Curve([<curve referenced from the Rhino model> x3])
speed = Panel("15")
list_2 = FlagFields({"Shoulder": 1, "Elbow": 2, "Wrist": 4}, selected=[])
vertical_offset = Slider(1, range=-100..100)
safety_plane_normal_offset = Slider(-150, range=-250..100)
pipeline_4 = GeometryPipeline(
    GroupByLayer=False,
    GroupByType=False,
    IncludeHidden=True,
    IncludeLocked=True,
    LayerFilter="BaseGeometry",
    NameFilter="*",
    SublayerFiltering=True,
    TypeFilter=1073741848)
feature_plane = Plane(c_script.P)
join = JoinCurves(Curves=crv_4, Preserve=False)
join_2 = JoinCurves(Curves=crv_5, Preserve=False)
join_3 = JoinCurves(Curves=crv_6, Preserve=False)
ext_3 = ExtendCurve(Curve=move_2.Geometry, Type=0, Start="0", End="0")
join_4 = JoinCurves(Curves=crv_7, Preserve=False)
disc_3 = Discontinuity(Curve=join, Level=1)  # -> Points, Parameters
disc_4 = Discontinuity(Curve=join_3, Level=1)  # -> Points, Parameters
pt_7 = ConstructPoint(XCoordinate="0", YCoordinate="1075", ZCoordinate="0")
disc_5 = Discontinuity(Curve=ext_3, Level=1)  # -> Points, Parameters
xz_2 = XZPlane(Origin=disc_3.Points)
yz = YZPlane(Origin=disc_4.Points)
xz_3 = XZPlane(Origin=disc_5.Points)
xy_5 = XYPlane(Origin=pt_7)
orient = Orient(Geometry=join_2, Source=xy_5, Target=c_script.P)  # -> Geometry, Transform
orient_2 = Orient(Geometry=join_4, Source=xy_5, Target=c_script.P)  # -> Geometry, Transform
disc_6 = Discontinuity(Curve=orient.Geometry, Level=1)  # -> Points, Parameters
disc_7 = Discontinuity(Curve=orient_2.Geometry, Level=1)  # -> Points, Parameters
yz_2 = YZPlane(Origin=disc_6.Points)  # disabled
xz_4 = XZPlane(Origin=disc_7.Points)  # disabled
cluster_2 = Cluster(plane=xy_3)

# ---- group: Flip Plane
pflip = FlipPlane(Plane=xz_3, ReverseX=Toggle(False), ReverseY=Toggle(False), SwapAxes=Toggle(False))

# ----
orient_3 = Orient(Geometry=pipeline_4, Source=xy_5, Target=feature_plane)  # -> Geometry, Transform
tool_selection = StreamFilter(Gate=list, Stream0=createtool.Tool, Stream1=createtool_2.Tool, Stream2=createtool_3.Tool)
tool_diameter = StreamFilter(Gate=list, Stream0="3.175", Stream1="6", Stream2="10")
wires = BrepWireframe(Brep=orient_3.Geometry, Density=-1)
pl_offset = PlaneOffset(BasePlane=pflip, Offset=vertical_offset)
dash = DashPattern(Curve=wires, Pattern="40")  # -> Dashes, Gaps; disabled
preview = CustomPreview(Geometry=orient_3.Geometry, Material=ColourSwatch(SwatchColor=RGB(41, 41, 41)))
list_3 = RobotsLibrary({"UR3e", "UR5e", "UR10e", "UR16e", "UR3", "UR5", "UR10", "UR20", "UR20RbVogui"}, selected="UR20RbVogui", Type=0)
list_4 = ValueList({"AMB1400_Marking": 0, "AMB1400_6mm": 1, "AMB1400_10mm": 2}, selected="AMB1400_6mm")
xy_6 = XYPlane(Origin=Point(0, 0, 0))
prot = RotatePlane(Plane=pl_offset, Angle=degrees(Slider(90, range=0..1000)))
item = ListItem(List=prot, Index=0, Wrap=True)  # -> Item1, Item
loadrobotsystem = LoadRobotSystem(Name=list_3, Base=xy_6)
pl_offset_2 = PlaneOffset(BasePlane=item.Item, Offset=safety_plane_normal_offset)
pl_offset_3 = PlaneOffset(BasePlane=item.Item1, Offset=safety_plane_normal_offset)
vec = VectorXYZ(XComponent=Slider(0, range=0..1000), YComponent=Slider(-20, range=-500..500), ZComponent=0)  # -> Vector, Length
move_3 = Move(Geometry=pl_offset_2, Motion=vec.Vector)  # -> Geometry, Transform
tool = ToolParameter(tool_selection)
list_5 = ValueList({"Joint", "Linear", "Process"}, selected="Linear")

# ---- group: Turn Motor On and Wait
wait = Wait(Time="5")
setdo = SetDO(DO="4", Value=Toggle(False))
setdo_2 = SetDO(DO="4", Value=Toggle(True))
setao = SetAO(AO="1", Value=Slider(0.9, range=0..1))
merge = Merge(Data1=setdo, Data2=setao, Data3=setdo_2, Data4=wait)
groupcommand = GroupCommand(Commands=merge)

# ---- group: Motor Off
setdo_3 = SetDO(DO="4", Value=Toggle(False))
setao_2 = SetAO(AO="1", Value=Slider(0, range=0..1))
merge_2 = Merge(Data1=setdo_3, Data2=setao_2)
groupcommand_2 = GroupCommand(Commands=merge_2)

# ----
panel = Panel("20")
list_6 = ValueList({"Joint", "Linear", "Process"}, selected="Joint")
createtarget = CreateTarget(Plane=move_3.Geometry, Configuration=list_2, Motion=list_6, Tool=tool, Speed=speed, IsCartesian=True)
createtarget_2 = CreateTarget(Plane=pl_offset_2, Configuration=list_2, Motion=list_5, Tool=tool, Speed=speed, Command=groupcommand, IsCartesian=True)
createtarget_3 = CreateTarget(Plane=prot, Configuration=list_2, Motion=list_5, Tool=tool, Speed="8", IsCartesian=True)
createtarget_4 = CreateTarget(Plane=pl_offset_3, Configuration=list_2, Motion=list_5, Tool=tool, Speed=speed, Command=groupcommand_2, IsCartesian=True)
createtarget_5 = CreateTarget(Plane=move_3.Geometry, Configuration=list_2, Motion=list_5, Tool=tool, Speed=speed, IsCartesian=True)
merge_3 = Merge(Data2=createtarget, Data3=createtarget_2, Data4=createtarget_3, Data5=createtarget_4, Data6=createtarget_5)  # -> flatten(Result)
createprogram = CreateProgram(Name="DefaultProgram", RobotSystem=loadrobotsystem, Targets=merge_3, StepSize=1)  # -> Program, Code, Duration, Warnings, Errors

upload_play = Button()
play = Button()
stop = Button()
remoteconnection = RemoteConnection(Program=createprogram.Program, IP="192.168.0.210", Upload=upload_play, Play=play, Pause=stop)

programsimulation = ProgramSimulation(Program=createprogram.Program, Time=Slider(0.735, range=0..1), Normalized=True)  # -> SystemMeshes, JointRotations, Plane, Index, Time, Program, Errors
preview_2 = CustomPreview(Geometry=programsimulation.SystemMeshes, Material=ColourSwatch(SwatchColor=RGB(135, 135, 135)))
item_2 = ListItem(List=programsimulation.Plane, Index=0, Wrap=True)  # -> Item1, Item
deg = Degrees(Radians=programsimulation.JointRotations)
cluster_3 = Cluster(plane=item_2.Item1)
panel_2 = Panel(deg)

# ==== cluster Cluster
plane = ClusterInput()

# ---- group: BaseFeature
c_script = CSharpScript(plane=plane)  # -> out, P, PX, PY, PZ; inputs plane: Plane
# ---------- c_script: C# ----------
// Grasshopper Script Instance
#region Usings
using System;
using System.Linq;
using System.Collections;
using System.Collections.Generic;
using System.Drawing;

using Rhino;
using Rhino.Geometry;

using Grasshopper;
using Grasshopper.Kernel;
using Grasshopper.Kernel.Data;
using Grasshopper.Kernel.Types;
#endregion

public class Script_Instance : GH_ScriptInstance
{
    #region Notes
    /* 
      Members:
        RhinoDoc RhinoDocument
        GH_Document GrasshopperDocument
        IGH_Component Component
        int Iteration

      Methods (Virtual & overridable):
        Print(string text)
        Print(string format, params object[] args)
        Reflect(object obj)
        Reflect(object obj, string method_name)
    */
    #endregion

    private void RunScript(
		Plane plane,
		ref object P,
		ref object PX,
		ref object PY,
		ref object PZ)
    {
        // Write your logic here
        P = plane;
        PX = plane.XAxis*150;
        PY = plane.YAxis*150;
        PZ = plane.ZAxis*150;
    }
}
# ---------- end c_script ----------
vdisex = VectorDisplayEx(Point=c_script.P, Vector=c_script.PX, Colour=ColourSwatch(SwatchColor=RGB(255, 0, 0)), Width=2)
vdisex_2 = VectorDisplayEx(Point=c_script.P, Vector=c_script.PY, Colour=ColourSwatch(SwatchColor=RGB(60, 255, 0)), Width=2)
vdisex_3 = VectorDisplayEx(Point=c_script.P, Vector=c_script.PZ, Colour=ColourSwatch(SwatchColor=RGB(0, 102, 255)), Width=2)
