# Grasshopper definition mobile_robot_repair_fabrication_avishek.ghx (Grasshopper 1.0.8)
# plug-ins: Human

# ----
# Protective Barrier @TUM
pipeline = GeometryPipeline(
    GroupByLayer=False,
    GroupByType=False,
    IncludeHidden=True,
    IncludeLocked=True,
    LayerFilter="Macrolon",
    NameFilter="*",
    SublayerFiltering=True,
    TypeFilter=1073741848)
pipeline_2 = GeometryPipeline(
    GroupByLayer=False,
    GroupByType=False,
    IncludeHidden=True,
    IncludeLocked=True,
    LayerFilter="Wood",
    NameFilter="*",
    SublayerFiltering=True,
    TypeFilter=1073741848)
wires = BrepWireframe(Brep=pipeline, Density=-1)
wires_2 = BrepWireframe(Brep=pipeline_2, Density=-1)

# ----
# IP Settings
# --> Set your IP address
# --> Set robot IP address
server_ip = ValueList({"192.168.0.67", "192.168.10.12", "192.168.10.11", "192.168.10.10", "192.168.10.2", "127.0.0.1", "192.168.10.111", "192.168.0.45", "192.168.0.30", "10.42.0.212", "10.42.0.133"}, selected="192.168.0.45")
server_port = ValueList({"50002", "50003", "50005", "50006", "50007", "50008", "50009", "50010", "50011", "50012", "50013", "50014", "50015", "50016", "50017", "50018", "50019", "50020", "50021", "50022", "50023", "50024", "50025", "50026", "50027", "50028"}, selected="50003")
ur_ip = ValueList({"192.168.10.10", "192.168.10.20", "192.168.10.11", "192.168.10.12", "127.0.0.1", "192.168.10.111", "192.168.0.210", "192.168.0.211", "192.168.0.235", "192.168.0.30"}, selected="192.168.0.210")
ur_port = ValueList({"30002"}, selected="30002")
globals = Python3Script(server_ip=server_ip, server_port=server_port, ur_ip=ur_ip, ur_port=ur_port, clear=Button())  # inputs server_ip: String, server_port: Int32, ur_ip: String, ur_port: Int32
# ---------- globals: Python ----------
from scriptcontext import sticky as st

st["server_ip"] = server_ip
st["server_port"] = server_port

st["ur_ip"] = ur_ip
st["ur_port"] = ur_port

if clear:
    st.clear()
# ---------- end globals ----------

# ----
# Check if UR robot
#  is available
ping = Button()
ping_2 = Python3Script(ip=ur_ip, ping=ping)  # -> out; inputs ip: String
# ---------- ping_2: Python ----------
from scriptcontext import sticky as st
from ur_fabrication_control.direct_control.utilities import is_available

guid = str(ghenv.Component.InstanceGuid)
txt_key = "txt_" + guid
if txt_key not in st:
    st[txt_key] = ""

if ping:
    
    available = is_available(ip)
    
    if available:
        st[txt_key] = "%s is up!" % ip
        trigger = True
    else:
        st[txt_key] = "%s is down!" % ip
        trigger = False

print(st[txt_key])
# ---------- end ping_2 ----------
panel = Panel(ping_2)

# ---- group: Orientation Plane
pt = ConstructPoint(XCoordinate=Slider(-1.7, range=-10..10), YCoordinate=Slider(-0.7, range=-10..10), ZCoordinate=Slider(0.7, range=-10..10))
xy = XYPlane(Origin=pt)

# ---- group: Joint Picker
value_list = ValueList({"SJ1 – Half Lap Joint": "SJ1", "SJ2 – Undersquinted Half Lap Joint": "SJ2", "SJ3 – Spear Point Half Lap Joint": "SJ3", "SJ4 – Undersquinted Spear Point Half Lap Joint": "SJ4", "SJ5 – Splayed Ccarf Joint": "SJ5", "SJ6 – Half Lap Joint with Mitered Ends": "SJ6", "SJ7 – Stoß mit Gratschnitt und keilförmigen Schwalbenschwanzzapfen": "SJ7", "SJ8 – Lapped dovetail joint": "SJ8"}, selected="SJ5 – Splayed Ccarf Joint")
refresh = Python3Script(refresh=Button(), picker=value_list)  # -> out, keys, report
# ---------- refresh: Python ----------
"""GH Python 3 -- JOINT PICKER: auto-fill a Value List from the catalogue.

Wire a Value List component INTO `picker`, set `refresh` True once.
The Value List then shows every joint in data/corpus/joints/ (label from the
datasheet's first line, value = the key). Wire that same Value List into
gh_repair's `key`. Re-run refresh after authoring a new joint.

Inputs:
    picker   (no type hint needed -- only its wire matters)
    refresh  (bool)
Outputs:
    keys, report
"""
import sys, os

REPO = r"C:\Users\avishek\workspace\projects\workshop_robarch_2026"
SRC = os.path.join(REPO, "src")
if SRC not in sys.path:
    sys.path.append(SRC)
for m in list(sys.modules):
    if m.startswith("workshop_robarch_2026"):
        sys.modules.pop(m)

from workshop_robarch_2026 import joints
import Grasshopper.Kernel.Special as ghs

keys = joints.list_keys(REPO)
report = ["{} joint(s): {}".format(len(keys), ", ".join(keys) or "-")]


def _label(key):
    md = joints.load_datasheet(REPO, key)
    for line in md.splitlines():
        line = line.strip().lstrip("#").strip()
        if line:
            return line          # e.g. "SW2 -- Half lap with mitered ends"
    return key

if refresh and keys:
    filled = False
    try:
        picker_param = None
        for prm in ghenv.Component.Params.Input:
            if prm.NickName == "picker":
                picker_param = prm
                break
        for src in (picker_param.Sources if picker_param else []):
            if isinstance(src, ghs.GH_ValueList):
                sel = None
                if src.SelectedItems.Count > 0:
                    sel = str(src.SelectedItems[0].Value).strip('"')
                src.ListItems.Clear()
                for k in keys:
                    src.ListItems.Add(
                        ghs.GH_ValueListItem(_label(k), '"{}"'.format(k)))
                # keep the previous selection if it still exists
                for i, k in enumerate(keys):
                    if k == sel:
                        src.SelectItem(i)
                        break
                src.ExpireSolution(True)
                filled = True
    except Exception as exc:
        report.append("could not fill Value List: {}".format(exc))
    report.append("dropdown filled" if filled
                  else "wire a Value List INTO `picker`")
# ---------- end refresh ----------
panel_2 = Panel(refresh.report)

# ----
steps_degrees = Panel("15")
value_list_2 = ValueList({"far end": "1", "near end": "-1"}, selected="near end")
multiplication = Multiplication(A=Slider(0, range=0..72), B=steps_degrees)

# ---- group: Run
run = BooleanToggle(True)

# ---- group: Beams
# DESIGN EXPLORATION
brep = Brep([<brep referenced from the Rhino model> x17])

# ----
# ROS client
list = ValueList({"local": "127.0.0.1", "linux computer new": "192.168.0.235", "linux computer": "192.168.0.250", "linux eduroam": "10.181.95.254", "linux ccnet": "192.168.0.102", "linux vmware": "192.168.199.36", "robot": "192.168.0.200", "robotAA_wifi": "192.168.0.111", "robotAB_wifi": "192.168.0.112", "robotAB_eduroam": "10.181.67.95"}, selected="linux computer")
connect = BooleanToggle(True)
ros = Python3Script(ip=list, port="9090", connect=connect)  # -> out, ros_client, is_connected; inputs ip: String, port: Int32, connect: Boolean
# ---------- ros: Python ----------
"""
Connect or disconnect to ROS.

COMPAS FAB v0.27.0
"""
from scriptcontext import sticky as st

from compas_fab.backends import RosClient

ros_client = None

ip = ip or '127.0.0.1'
port = port or 9090
key = "ros_client_001"
ros_client = st.get(key, None)

if ros_client:
    st[key].close()
if connect:
    st[key] = RosClient(ip, port)
    st[key].run(5)

ros_client = st.get(key, None)
is_connected = ros_client.is_connected if ros_client else False
# ---------- end ros ----------

# ----
# LOAD ROBOT LOCALLY
list_2 = ValueList({"rbvogui_xl_ur20", "rbvogui_xl_ur10e", "husky", "husky_ur10e"}, selected="rbvogui_xl_ur20")
py3 = Python3Script()  # -> mobile_robot_data_path, ur_data_path
# ---------- py3: Python ----------
import os

"""
ASSUMING THE BELOW PACKAGES ARE STORED IN THE SAME LOCATION:
    ur_fabrication_control;
    rbvogui_common; and
    mobile_additive_manufacturing.
"""

repositories_path = os.path.abspath(os.path.join(ghdoc.Path,"../../../"))

assert os.path.exists(os.path.join(repositories_path, "ur_fabrication_control/data"))
assert os.path.exists(os.path.join(repositories_path, "mobile_robot_control/data"))

ur_data_path = os.path.abspath(os.path.join(ghdoc.Path,"../../../ur_fabrication_control/data"))
mobile_robot_data_path = os.path.abspath(os.path.join(ghdoc.Path,"../../../mobile_robot_control/data"))
# ---------- end py3 ----------
load_robot = Button()
units = ValueList({"m": 1, "cm": 100, "mm": 1000}, selected="m")
py3_2 = Python3Script(mobile_robot_data_path=py3.mobile_robot_data_path, ur_data_path=py3.ur_data_path, robot_type=list_2)  # -> loaders, urdf_filename, srdf_filename
# ---------- py3_2: Python ----------
import os
from compas_robots import RobotModel
from compas_robots.resources import LocalPackageMeshLoader

import compas_fab

#loaders

ur_path = os.path.join(ur_data_path, "robot_description")
ur_packages = ["ur_e_description", "ur_description"]
ur_loaders = [LocalPackageMeshLoader(ur_path, pck) for pck in ur_packages]

mobile_robot_path = os.path.join(mobile_robot_data_path, "robot_description", robot_type)
if "rbvogui" in robot_type:
    mobile_robot_packages = ["rbvogui_description", "ewellix_description", "robotnik_sensors"]
elif "husky" in robot_type:
    mobile_robot_packages = ["a200"]
mobile_robot_loaders = [LocalPackageMeshLoader(mobile_robot_path, pck) for pck in mobile_robot_packages]

loaders = ur_loaders + mobile_robot_loaders

#files
urdf_filename = os.path.join(mobile_robot_path, r"{}.urdf".format(robot_type))

if "rbvogui" in robot_type:
    srdf_filename = os.path.join(mobile_robot_path, r"rbvogui.srdf")
elif "husky" in robot_type:
    srdf_filename = os.path.join(mobile_robot_path, r"husky.srdf")

assert os.path.isfile(urdf_filename)
assert os.path.isfile(srdf_filename)
# ---------- end py3_2 ----------
mobile_robot = Python3Script(
    robot_type=list_2,
    loaders=py3_2.loaders,
    urdf_filename=py3_2.urdf_filename,
    srdf_filename=py3_2.srdf_filename,
    scale_factor=units,
    load=load_robot)  # -> out, mobile_robot; inputs loaders: list
# ---------- mobile_robot: Python ----------
"""
Load robot directly from ROS.

COMPAS FAB v0.27.0
"""
from mobile_robot_control.mobile_robot import MobileRobot
from mobile_robot_control.mobile_robot_client import MobileRobotClient
import compas_robots.ghpython
import compas
from compas.geometry import Rotation
import math

# from ghpythonlib.componentbase import executingcomponent as component
from scriptcontext import sticky as st
import Rhino
import scriptcontext

scriptcontext.doc = Rhino.RhinoDoc.ActiveDoc

from compas_robots import RobotModel
from compas_robots.ghpython.scene import RobotModelObject
from compas_fab.robots import RobotSemantics
from compas.scene import SceneObject

scriptcontext.doc = ghdoc

compas.PRECISION = '12f'

key = 'robot_AA'


print(key)
if load:
    # Load URDF locally
    model = RobotModel.from_urdf_file(urdf_filename)
    model.load_geometry(*loaders)
    try:
        scene_object = SceneObject(item=model)
    except:
        scene_object = RobotModelObject(model)
    semantics = RobotSemantics.from_srdf_file(srdf_filename, model)
    mobile_robot = MobileRobot(model, scene_object, semantics, client=None)    

    st[key] = mobile_robot

mobile_robot = st.get(key, None)
# ---------- end mobile_robot ----------
add_client = Python3Script(mobile_robot=mobile_robot.mobile_robot, ros_client=ros.ros_client)  # -> out, mobile_robot
# ---------- add_client: Python ----------
from mobile_robot_control.mobile_robot_client import MobileRobotClient

if ros_client is not None:
    mobile_robot.mobile_client = MobileRobotClient(ros_client)
    # mobile_robot._update_RCF(online=True)
# ---------- end add_client ----------
info = Python3Script(robot=mobile_robot.mobile_robot)  # -> out, main_group_name
# ---------- info: Python ----------
if robot:
    robot.info()
    main_group_name = robot.main_group_name
# ---------- end info ----------
panel_3 = Panel(info.out)

# ----
# ROBOT CONTROL
py3_3 = Python3Script()  # -> HERE, DATA, ROBOT_DESCRIPTION
# ---------- py3_3: Python ----------
import os

HERE = os.path.dirname(ghdoc.Path)
DATA = os.path.abspath(os.path.join(HERE, "..", "data"))
ROBOT_DESCRIPTION = os.path.abspath(os.path.join(DATA, "robot_description"))

print(HERE)
print(DATA)
print(ROBOT_DESCRIPTION)
# ---------- end py3_3 ----------
reload = Python3Script(reload=Button())  # -> out
# ---------- reload: Python ----------
if reload:
    from compas_rhino import unload_modules
    unload_modules("assembly_information_model")
    unload_modules('mobile_robot_control')
    unload_modules('fabrication_manager')
    unload_modules('ur_fabrication_control')
    unload_modules('spaicr')
# ---------- end reload ----------

snapshot_poses = Python3Script(
    snap_radius=Slider(0.67, range=0..1),
    snap_amount=Slider(8, range=1..12),
    snap_height=Slider(0.18, range=-0.5..1),
    cam_angle_y=Slider(70, range=0..90),
    cam_angle_z=Slider(-10, range=-90..90))  # -> out, snap_planes; inputs snap_amount: Int32
# ---------- snapshot_poses: Python ----------
from compas.geometry import Frame, Translation, Rotation, Vector
from compas_rhino.conversions import frame_to_rhino_plane
import math

snap_angle = math.radians(360 / snap_amount)
snap_frames = []
snap_frame = Frame([snap_radius, 0, 0], -Vector.Xaxis(), Vector.Yaxis())
snap_frame = snap_frame.transformed(Rotation.from_axis_and_angle(snap_frame.yaxis, math.radians(cam_angle_y), snap_frame.point))
snap_frame = snap_frame.transformed(Rotation.from_axis_and_angle(Vector.Zaxis(), math.radians(cam_angle_z), snap_frame.point))

for snap in range(snap_amount):
    R = Rotation.from_axis_and_angle(Vector.Zaxis(), snap_angle*snap)
    T = Translation.from_vector([0.275, 0, snap_height+1.03])
    snap_frames.append(snap_frame.transformed(T*R))

snap_planes = [frame_to_rhino_plane(f) for f in snap_frames]
# ---------- end snapshot_poses ----------

python_3_script = Python3Script(beams=brep, index=Slider(10, range=0..100))  # -> out, box, selected, rest, report; inputs beams: list of Brep
# ---------- python_3_script: Python ----------
"""GH Python 3 -- SELECT BEAM: pick one member of an assembly for repair.

Takes all beams of the model, fits a tight ORIENTED bounding box to each
(correct for diagonal braces, not just axis-aligned members), and lets you
select one by index. The selected member leaves as a Box for gh_repair;
all other members pass through unchanged.

OBB strategy: for prismatic members the optimal box is aligned to one of
the planar faces and one of that face's edges -- we test those candidate
frames and keep the smallest-volume box. Exact for typical timber.

Inputs:
    beams  (Brep, list)   all members of the assembly
    index  (int)          which member to repair (see report for the list)
    run    (bool)
Outputs:
    box       oriented Box of the selected member -> gh_repair `box`
    selected  the selected member's original Brep (reference overlay)
    rest      all other members, unchanged
    report    per-member dimensions, so the index is informed
"""
import Rhino.Geometry as rg
from Grasshopper import DataTree
from Grasshopper.Kernel.Data import GH_Path

box = None
selected = None
rest = DataTree[object]()
report = []
run = 'TRUE'

def _obb_axis_first(b, tol=0.001):
    """Deterministic for prismatic members: long axis = longest edge;
    second axis = a side-face normal perpendicular to it."""
    axis = None
    best_len = 0.0
    for e in b.Edges:
        d = e.PointAtEnd - e.PointAtStart
        if d.Length > best_len:
            best_len = d.Length
            axis = d
    if axis is None or best_len < 1e-9:
        return None
    axis.Unitize()
    side_n = None
    for f in b.Faces:
        ok, plane = f.TryGetPlane(tol)
        if ok and abs(plane.Normal * axis) < 0.05:
            side_n = plane.Normal
            break
    if side_n is None:
        return None
    y = rg.Vector3d.CrossProduct(side_n, axis)
    y.Unitize()
    frame = rg.Plane(rg.Point3d.Origin, axis, y)
    bb = b.GetBoundingBox(frame)
    cand = rg.Box(frame, bb)
    return cand if cand.IsValid else None


def _obb(b, tol=0.001):
    ax = _obb_axis_first(b, tol)
    if ax is not None:
        return ax, "axis"
    best = None
    best_vol = None
    # candidate frames from planar faces + their edge directions
    for f in b.Faces:
        ok, plane = f.TryGetPlane(tol)
        if not ok:
            continue
        n = plane.Normal
        for e in b.Edges:
            d = e.PointAtEnd - e.PointAtStart
            if d.Length < 1e-9:
                continue
            d.Unitize()
            if abs(d * n) > 1e-3:      # edge not in the face plane family
                continue
            y = rg.Vector3d.CrossProduct(n, d)
            if y.Length < 1e-9:
                continue
            y.Unitize()
            frame = rg.Plane(rg.Point3d.Origin, d, y)
            bb = b.GetBoundingBox(frame)
            cand = rg.Box(frame, bb)
            if not cand.IsValid:
                continue
            vol = cand.Volume
            if best_vol is None or vol < best_vol - 1e-12:
                best_vol, best = vol, cand
    if best is None:                    # fallback: world-aligned
        return rg.Box(b.GetBoundingBox(True)), "world"
    return best, "search"


if run and beams:
    try:
        bs = beams if isinstance(beams, list) else [beams]
        bs = [b for b in bs if b is not None]
        if not bs:
            raise ValueError("no valid breps in `beams`")
        i = int(index or 0) % len(bs)
        report.append("received {} member(s)".format(len(bs)))
        for j, b in enumerate(bs):
            if j == i:
                ob, how = _obb(b)
                box = ob
                selected = b
                ext = sorted([ob.X.Length, ob.Y.Length, ob.Z.Length])
                report.append(">> [{}] SELECTED  {:.0f} x {:.0f} x {:.0f} mm"
                              "  (obb: {})".format(
                                  j, ext[0] * 1000, ext[1] * 1000,
                                  ext[2] * 1000, how))
            else:
                rest.Add(b, GH_Path(0))
        # listing for orientation
        for j, b in enumerate(bs):
            if j == i:
                continue
            bb = b.GetBoundingBox(True)
            d = bb.Diagonal
            report.append("   [{}] approx {:.0f} x {:.0f} x {:.0f} mm".format(
                j, abs(d.X) * 1000, abs(d.Y) * 1000, abs(d.Z) * 1000))
    except Exception as exc:
        report.append("ERROR: {}".format(exc))
else:
    report.append("wire all members into `beams`, choose `index`, set run")
# ---------- end python_3_script ----------
number_slider = Slider(2, range=0..5)
gh_repair = Python3Script(
    box=python_3_script.box,
    key=value_list,
    position=Slider(0.32, range=0..1),
    rotation=multiplication,
    side=value_list_2,
    interface_scale=Slider(2.05, range=0.5..5),
    run=run)  # -> out, kept, prosthesis, cut_plane, cut_lines, info; inputs box: Box
# ---------- gh_repair: Python ----------
"""LOADER for the repair component. Edit the real code in
rhino/components/gh_repair.py; re-toggle run to reload.
Inputs:  box (Box), key (str), position (float 0..1),
         rotation (float, degrees), side (int +1/-1),
         interface_scale (float), run (bool)
Outputs: kept, prosthesis, cut_plane, cut_lines, info"""
# r: roslibpy
import os
SCRIPT = "gh_repair.py"


def _find_repo():
    marker = os.path.join("src", "workshop_robarch_2026")
    p = os.environ.get("ROBARCH_REPO")
    if p and os.path.isdir(os.path.join(p, marker)):
        return p
    try:
        d = os.path.dirname(ghenv.Component.OnPingDocument().FilePath or "")
        while d and len(d) > 3:
            if os.path.isdir(os.path.join(d, marker)):
                return d
            d = os.path.dirname(d)
    except Exception:
        pass
    try:
        import workshop_robarch_2026 as _w
        return os.path.abspath(os.path.join(
            os.path.dirname(_w.__file__), "..", ".."))
    except ImportError:
        pass
    home = os.path.expanduser("~")
    for c in (os.path.join(home, "workspace", "projects",
                           "workshop_robarch_2026"),
              os.path.join(home, "Documents", "workshop_robarch_2026")):
        if os.path.isdir(os.path.join(c, marker)):
            return c
    raise RuntimeError("repo not found: save this .gh inside the repo or "
                       "set the ROBARCH_REPO environment variable")

_p = os.path.join(_find_repo(), "rhino", "components", SCRIPT)
print(_p)
exec(compile(open(_p, encoding="utf-8").read(), _p, "exec"))
# ---------- end gh_repair ----------
prosthesis = Geometry(gh_repair.prosthesis)
bbox = BoundingBox(Content=prosthesis, Plane=PlaneXY(0, 0, 0))  # -> Box, Box_2

c_script = CSharpScript(BBox=bbox.Box_2)  # -> out, C, N; inputs BBox: Box
# ---------- c_script: C# ----------
// Grasshopper Script Instance
#region Usings
using System;
using System.Linq;
using System.Collections;
using System.Collections.Generic;
using System.Drawing;

using Rhino;
using Rhino.Geometry;

using Grasshopper;
using Grasshopper.Kernel;
using Grasshopper.Kernel.Data;
using Grasshopper.Kernel.Types;
#endregion

public class Script_Instance : GH_ScriptInstance
{
    #region Notes
    /* 
      Members:
        RhinoDoc RhinoDocument
        GH_Document GrasshopperDocument
        IGH_Component Component
        int Iteration

      Methods (Virtual & overridable):
        Print(string text)
        Print(string format, params object[] args)
        Reflect(object obj)
        Reflect(object obj, string method_name)
    */
    #endregion

    private void RunScript(Box BBox, ref object C, ref object N)
    {
        // Write your logic here
        Point3d[] pts = BBox.GetCorners();
        List<int> indices = Enumerable.Range(0, pts.Length).ToList();
        C = pts;
        N = indices;
    }
}
# ---------- end c_script ----------
dot = AnnotationDot(Location=c_script.C, PrimaryText=c_script.N, Font="Jetbrains Mono")

c_script_2 = CSharpScript(BBox=bbox.Box_2, idx=number_slider)  # -> out, C, P, PL; inputs BBox: Box, idx: Int32
# ---------- c_script_2: C# ----------
// Grasshopper Script Instance
#region Usings
using System;
using System.Linq;
using System.Collections;
using System.Collections.Generic;
using System.Drawing;

using Rhino;
using Rhino.Geometry;

using Grasshopper;
using Grasshopper.Kernel;
using Grasshopper.Kernel.Data;
using Grasshopper.Kernel.Types;
#endregion

public class Script_Instance : GH_ScriptInstance
{
    #region Notes
    /* 
      Members:
        RhinoDoc RhinoDocument
        GH_Document GrasshopperDocument
        IGH_Component Component
        int Iteration

      Methods (Virtual & overridable):
        Print(string text)
        Print(string format, params object[] args)
        Reflect(object obj)
        Reflect(object obj, string method_name)
    */
    #endregion

private void RunScript(
		Box BBox,
		int idx,
		ref object C,
		ref object P,
		ref object PL)
{
  Point3d[] pts = BBox.GetCorners();

  // Output corners
  C = pts[idx];

  // Face definitions using corner indices
  List<List<int>> faces = new List<List<int>>
  {
    new List<int>{0,1,2,3}, // Bottom
    new List<int>{4,5,6,7}, // Top
    new List<int>{0,1,5,4}, // Front
    new List<int>{1,2,6,5}, // Right
    new List<int>{2,3,7,6}, // Back
    new List<int>{3,0,4,7}  // Left
  };

  List<Plane> planes = new List<Plane>();

  foreach (List<int> face in faces)
  {
    Point3d center = MeanPoint(
      pts[face[0]],
      pts[face[1]],
      pts[face[2]],
      pts[face[3]]
    );

    Vector3d xAxis = MidPoint(
      pts[face[2]],
      pts[face[3]]
    ) - center;

    Vector3d yAxis = MidPoint(
      pts[face[0]],
      pts[face[3]]
    ) - center;

    planes.Add(new Plane(center, xAxis, yAxis));
  }

  P = planes[idx];
  PL = planes;
}


// =====================
// Helper Functions
// =====================

public static Point3d MidPoint(Point3d a, Point3d b)
{
  return new Point3d(
    (a.X + b.X) * 0.5,
    (a.Y + b.Y) * 0.5,
    (a.Z + b.Z) * 0.5
  );
}

public static Point3d MeanPoint(
  Point3d a,
  Point3d b,
  Point3d c,
  Point3d d)
{
  return new Point3d(
    (a.X + b.X + c.X + d.X) / 4.0,
    (a.Y + b.Y + c.Y + d.Y) / 4.0,
    (a.Z + b.Z + c.Z + d.Z) / 4.0
  );
}
}
# ---------- end c_script_2 ----------

# ----
# State viewer
trigger = Trigger(Interval=1000, TimerInterval=1000, Target=fabrication_state)
fabrication_state = Python3Script()  # -> out, state, num_tasks, num_current_task, num_tasks_left, log_messages
# ---------- fabrication_state: Python ----------
from scriptcontext import sticky as st

fabrication = st["fabrication"]

if hasattr(fabrication, "task_thread"):
    if fabrication.task_thread.is_alive():
        state = "THREAD RUNNING"
    else:
        state = "THREAD STOPPED"
print(fabrication.current_task_key)
num_tasks = len(fabrication.tasks)
if fabrication.current_task_key is not None:
    num_current_task = fabrication.current_task_key-1
else:
    num_current_task = 0

num_tasks_left = num_tasks-num_current_task
log_messages = fabrication.log_messages

# assembly = st["assembly"]
# ---------- end fabrication_state ----------
num_current_task = Panel(fabrication_state.num_current_task)
state = Panel(fabrication_state.state)
num_tasks = Panel(fabrication_state.num_tasks)
num_tasks_left = Panel(fabrication_state.num_tasks_left)

explode = Explode(Curve=gh_repair.cut_lines, Recursive=True)  # -> Segments, Vertices
c_script_3 = CSharpScript(BBox=bbox.Box_2, Curves=explode.Segments, idx=number_slider)  # -> out, P, CRV; inputs BBox: Box, Curves: list of Curve, idx: Int32
# ---------- c_script_3: C# ----------
#region Usings
using System;
using System.Collections.Generic;
using Rhino;
using Rhino.Geometry;
#endregion

public class Script_Instance : GH_ScriptInstance
{
  private void RunScript(
		Box BBox,
		List<Curve> Curves,
		int idx,
		ref object P,
		ref object CRV)
  {
    Point3d[] pts = BBox.GetCorners();

    // Face corner indices
    List<List<int>> faces = new List<List<int>>
    {
      new List<int>{0,1,2,3}, // Bottom
      new List<int>{4,5,6,7}, // Top
      new List<int>{0,1,5,4}, // Front
      new List<int>{1,2,6,5}, // Right
      new List<int>{2,3,7,6}, // Back
      new List<int>{3,0,4,7}  // Left
    };

    // Generate planes
    List<Plane> planes = new List<Plane>();

    foreach (List<int> face in faces)
    {
      Point3d center = MeanPoint(
        pts[face[0]],
        pts[face[1]],
        pts[face[2]],
        pts[face[3]]
      );

      Vector3d xAxis =
        MidPoint(pts[face[2]], pts[face[3]]) - center;

      Vector3d yAxis =
        MidPoint(pts[face[0]], pts[face[3]]) - center;

      planes.Add(new Plane(center, xAxis, yAxis));
    }

    // Check index
    if (idx < 0 || idx >= planes.Count)
    {
      P = null;
      CRV = null;
      return;
    }

    Plane selectedPlane = planes[idx];

    List<Curve> curvesOnPlane = new List<Curve>();

    double tol = RhinoDoc.ActiveDoc.ModelAbsoluteTolerance;

    foreach (Curve crv in Curves)
    {
      if (crv == null) continue;

      Point3d center = crv.GetBoundingBox(true).Center;

      double dist = Math.Abs(
        selectedPlane.DistanceTo(center)
      );

      if (dist < tol)
        curvesOnPlane.Add(crv);
    }

    P = selectedPlane;
    CRV = curvesOnPlane;
  }

  // ==========================
  // Helper Functions
  // ==========================

  public static Point3d MidPoint(Point3d a, Point3d b)
  {
    return new Point3d(
      (a.X + b.X) * 0.5,
      (a.Y + b.Y) * 0.5,
      (a.Z + b.Z) * 0.5
    );
  }

  public static Point3d MeanPoint(
    Point3d a,
    Point3d b,
    Point3d c,
    Point3d d)
  {
    return new Point3d(
      (a.X + b.X + c.X + d.X) / 4.0,
      (a.Y + b.Y + c.Y + d.Y) / 4.0,
      (a.Z + b.Z + c.Z + d.Z) / 4.0
    );
  }
}
# ---------- end c_script_3 ----------
pflip = FlipPlane(Plane=xy, ReverseX=Toggle(True), ReverseY=Toggle(False), SwapAxes=Toggle(False))
info_2 = Panel(gh_repair.info)
prosthesis_2 = Geometry(gh_repair.prosthesis)
kept = Geometry(gh_repair.kept)
curve = Curve(gh_repair.cut_lines)
plane = Plane(gh_repair.cut_plane)
orient = Orient(Geometry=c_script_3.CRV, Source=c_script_3.P, Target=pflip)  # -> Geometry, Transform
orient_2 = Orient(Geometry=prosthesis, Source=c_script_3.P, Target=pflip)  # -> Geometry, Transform
pt_2 = Point(<point referenced from the Rhino model>)
toggle = BooleanToggle(True)
yz = YZPlane(Origin=pt_2)

# ----
# THE ROBOT
robot = Data(mobile_robot.mobile_robot)

# ----
# ATTACH TOOL
list_3 = ValueList({"measurement tool": 0, "area gripper": 1, "parallel gripper": 2, "camera": 3, "milling tool": 4, "scanning tool": 5, "AMB Milling Motor": 6}, selected="AMB Milling Motor")
attach = Button()
remove = Button()
show = BooleanToggle(True)
path = Python3Script()  # -> DATA
# ---------- path: Python ----------
import os

package_path = ghdoc.Path
DATA = os.path.abspath(os.path.join(package_path,"../../data"))

print(package_path)
print(DATA)
# ---------- end path ----------
tool = Python3Script(data_path=path, tool=list_3, show=show)  # -> tool, M, ee_plane; inputs data_path: String
# ---------- tool: Python ----------
import os, math
from compas.geometry import Frame, Rotation, Vector, Quaternion
from compas.datastructures import Mesh
from compas_rhino.conversions import mesh_to_rhino, frame_to_rhino_plane
from compas_fab.robots import Tool

tolerance = 0

if tool == 0:
    filename = 'measurement_tool_ur20_zaxis.stl'
    #ee_frame = Frame([0, 0, 0], [1, 0, 0], [0, 1, 0])
    ee_frame = Frame([0, 0, 0.122], [1, 0, 0], [0, 1, 0])

elif tool == 1:
    filename = 'vacuum_gripper_ur20_zaxis.stl'
    ee_frame = Frame([0, 0, 0.145 + tolerance], [1, 0, 0], [0, 1, 0])

elif tool == 2:
    filename = 'parallel_gripper_ur20_zaxis.stl'
    ee_frame = Frame([0, 0, 0.166 + tolerance], [0, 1, 0], [-1, 0, 0])

elif tool == 3:
    filename = 'parallel_gripper_ur20_zaxis.stl'
    ee_frame = Frame([0.0325, 0.05725, 0.08156], [-1, 0, 0], [0, 0, 1])

elif tool == 4:
    filename = 'milling_tool.stl'
    ee_frame = Frame([0.0, -0.12, 0.112], [1, 0, 0], [0, 0, 1])

elif tool == 5:
    filename = 'scanning_tool.stl'
    ee_frame = Frame([0.0, -0.2, 0.08], [1, 0, 0], [0, 0, 1])

elif tool == 6:
    filename = 'AMB1400_milling_tool.stl'
    ee_frame = Frame([0.000,0.150,0.113], [1, 0, 0], [0, 0, -1])


data_path = os.path.join(data_path, "tool_geometry")
fullfilename = os.path.join(data_path, filename)

ee_mesh = Mesh.from_stl(fullfilename)

if show:
    M = mesh_to_rhino(ee_mesh)

tool = Tool(ee_mesh, ee_frame)
ee_plane = frame_to_rhino_plane(ee_frame)
print(ee_frame.quaternion.xyzw)
ee_framek = Frame([0.0110607,0.00809854,0.41498], [0,1,0], [1,0,0])
print(ee_framek.quaternion.xyzw)
# ---------- end tool ----------
mesh = Mesh(tool.M)
attach_tool = Python3Script(robot=robot, tool=tool.tool, attach=attach, remove=remove)  # -> tool, M, ee_plane, bang
# ---------- attach_tool: Python ----------
print(robot.get_group_names_from_link_name("robot_arm_flange"))

if attach:
    for planning_group in robot.get_group_names_from_link_name("robot_arm_flange"):
        robot.attach_tool(tool, group=planning_group)

if remove:
    for planning_group in robot.get_group_names_from_link_name("robot_arm_flange"):
        robot.detach_tool(group=planning_group)
# ---------- end attach_tool ----------

# ----
# MOVE MOBILE ROBOT
list_4 = ValueList({"isaac_BCF": isaac, "origin", "set_to_BCF", "set_to_RCF"}, selected="origin")
origin = Point(Point(-1.54923138, 0.6365959027, -0.0004132609641))
angle = Slider(270, range=0..360)
plane_2 = Python3Script(origin=origin, angle=angle)  # -> plane; inputs origin: Point3d
# ---------- plane_2: Python ----------
import Rhino.Geometry as rg
import math

plane = rg.Plane(origin, rg.Vector3d.XAxis, rg.Vector3d.YAxis)
plane.Rotate(math.radians(angle), rg.Vector3d.ZAxis)
# ---------- end plane_2 ----------
set_frame = Python3Script(robot=robot, set_frame_to=list_4, target_BCF=plane_2, target_RCF=plane_2)  # -> bang; inputs target_BCF: Plane, target_RCF: Plane
# ---------- set_frame: Python ----------
from compas.geometry import Frame, Point, Vector, Transformation
from compas.datastructures import Mesh
from compas_fab.robots import CollisionMesh
from compas_rhino.conversions import plane_to_compas_frame

if set_frame_to == "set_to_BCF":
    BCF = plane_to_compas_frame(target_BCF)
elif set_frame_to == "set_to_RCF":
    RCF = plane_to_compas_frame(target_RCF)
    BCF = robot.transform_frame_from_RCF_to_BCF(RCF)
else:
    BCF = Frame.worldXY()

if robot and set_frame_to != "isaac_BCF":
    robot.BCF_slam = BCF
# ---------- end set_frame ----------

pflip_2 = FlipPlane(Plane=yz, ReverseX=toggle, ReverseY=toggle, SwapAxes=Toggle(False))
custom_preview_lineweights = CustomPreviewLineweights(Geometry=curve, Shader=ColourSwatch(SwatchColor=RGB(255, 68, 0)), Thickness=5, Absolute=False)
rad = Radians(Degrees=Slider(-88.526, range=-180..180))
rad_2 = Radians(Degrees=Slider(8.844, range=-180..180))
rad_3 = Radians(Degrees=Slider(40.721, range=-180..180))
pln = Plane(Plane(origin=(-1.190162624, -0.7832326962, 1.149802748), x=(0.006434048621, -0.9999793013, 0), y=(0, 0, -1)))

# ---- group: Move the Prosthesis
unit_y = UnitY(Factor=Slider(-0.7, range=-1..1))
move = Move(Geometry=prosthesis_2, Motion=unit_y)  # -> Geometry, Transform

# ----
c_script_4 = CSharpScript(plane=pln, x=rad, y=rad_3, z=rad_2)  # -> out, P; inputs plane: Plane, x: Double, y: Double, z: Double
# ---------- c_script_4: C# ----------
// Grasshopper Script Instance
#region Usings
using System;
using System.Linq;
using System.Collections;
using System.Collections.Generic;
using System.Drawing;

using Rhino;
using Rhino.Geometry;

using Grasshopper;
using Grasshopper.Kernel;
using Grasshopper.Kernel.Data;
using Grasshopper.Kernel.Types;
#endregion

public class Script_Instance : GH_ScriptInstance
{
    #region Notes
    /* 
      Members:
        RhinoDoc RhinoDocument
        GH_Document GrasshopperDocument
        IGH_Component Component
        int Iteration

      Methods (Virtual & overridable):
        Print(string text)
        Print(string format, params object[] args)
        Reflect(object obj)
        Reflect(object obj, string method_name)
    */
    #endregion

    private void RunScript(Plane plane, double x, double y, double z, ref object P)
    {

        plane.Rotate(x, plane.XAxis);
        plane.Rotate(y, plane.YAxis);
        plane.Rotate(z, plane.ZAxis);
        // Write your logic here
        P = plane;
    }
}
# ---------- end c_script_4 ----------
pln_2 = Plane(c_script_4.P)

# ----
# Configuration
# zero configuration
zero = Python3Script(robot=robot, group=info.main_group_name)  # -> out, configuration; inputs group: String
# ---------- zero: Python ----------
configuration = robot.zero_configuration(group)
# ---------- end zero ----------

# ----
# forward kinematics
number_slider_2 = Slider(-184.3, range=-400..400)
number_slider_3 = Slider(0, range=0..40)
forward_kinematics = Python3Script(
    robot=robot,
    lift=number_slider_3,
    j1=Slider(178.7, range=-180..180),
    j2=Slider(16.9, range=-360..360),
    j3=Slider(79.2, range=-180..180),
    j4=Slider(174.3, range=-400..400),
    j5=Slider(-90, range=-125..120),
    j6=number_slider_2)  # -> configuration
# ---------- forward_kinematics: Python ----------
import math
from compas_robots.model import Joint
from compas_robots import Configuration

if robot:
    configuration = robot.f_kinematics(lift, j1, j2, j3, j4, j5, j6)
    print(configuration)
# ---------- end forward_kinematics ----------

# ----
# Fabrication manager
list_5 = ValueList({"0. Move home": "move_home", "1. Receive BCF": "receive_bcf", "2. General anchor": "general_snapshot", "3. Close-up anchor": "closeup_snapshot", "4. Alignment": "alignment", "5. General for pick": "general_snapshot_pick", "6. Close-up for pick": "closeup_snapshot_pick", "7. Pick": "pick", "7. Static Pick": "static_pick", "8. Place": "place", "9. Move Base": "move_base", "10. Close-up reanchor": "closeup_reanchor", "11. Realignment": "realignment", "12. Correct last brick": "correct_last", "attach_meshes"}, selected="7. Static Pick")
number_slider_4 = Slider(224, range=0..360)
number_slider_5 = Slider(134, range=0..360)
number_slider_6 = Slider(44, range=0..360)
number_slider_7 = Slider(-0.03, range=-0.5..1)
pln_3 = Plane(Plane(origin=(12.31996526, 7.883060218, 0.999496023), x=(0, 1, 0), y=(1, 0, 0)))
init = Button()
snapshot_poses_2 = Python3Script(snap_radius=Slider(0.5, range=0..1), cam_angle_y=Slider(60, range=0..90), cam_angle_z=Slider(314, range=0..360))  # -> out, closeup_plane
# ---------- snapshot_poses_2: Python ----------
from compas.geometry import Frame, Translation, Rotation, Vector
from compas_rhino.conversions import frame_to_rhino_plane
import math


snap_frames = []
snap_frame = Frame([snap_radius+0.2, 0, 0], -Vector.Yaxis(), Vector.Zaxis())

snap_frame = snap_frame.transformed(Rotation.from_axis_and_angle(Vector.Yaxis(), math.radians(cam_angle_y)))
snap_frame = snap_frame.transformed(Rotation.from_axis_and_angle(Vector.Zaxis(), math.radians(cam_angle_z)))


closeup_plane = frame_to_rhino_plane(snap_frame)
# ---------- end snapshot_poses_2 ----------
fabrication = Python3Script(init=init)  # -> fabrication
# ---------- fabrication: Python ----------
from scriptcontext import sticky as st
from spaicr import DisassemblyFabricationManager
from fabrication_manager.fabrication import FabricationManager
from assembly_information_model.assembly import Assembly
import os

server_ip = st["server_ip"]
server_port = st["server_port"]

if init_:
    path = os.path.abspath(os.path.join(ghdoc.Path,"../../data/2nd_experiment/fabrication_logs"))
    print(path)
    fabrication = FabricationManager((server_ip, server_port))
    fabrication.path = path
    st["fabrication"] = fabrication

fabrication = st["fabrication"]
# ---------- end fabrication ----------
generate_tasks = Python3Script(
    routine=list_5,
    fabrication=fabrication,
    robot=robot,
    plane_WCF=pln_3,
    snap_planes=snapshot_poses.snap_planes,
    closeup_plane=snapshot_poses_2.closeup_plane,
    config=forward_kinematics,
    vel=Slider(0.2, range=0..1))  # -> out, tasks, target_planes; inputs snap_planes: list of Plane
# ---------- generate_tasks: Python ----------
import roslibpy
import time
from fabrication_manager.task import Task
from compas_robots import Configuration
from compas.geometry import Translation, Rotation, Frame, Box, Transformation, Point, Quaternion, Vector, distance_point_point
from compas.datastructures import Mesh
from compas_rhino.conversions import plane_to_compas_frame, frame_to_rhino_plane
import numpy as np
import math
from assembly_information_model import Part
import open3d
import random
from scipy.spatial.transform import Rotation as R
from mobile_robot_control.pointcloud_processing.icp import preprocess_point_cloud_icp, evaluate_local_registration, execute_icp_local_registration
from scriptcontext import sticky as st
from ur_fabrication_control.direct_control.fabrication import URTask
from ur_fabrication_control.direct_control.mixins import URScript, URScript_AreaGrip, URScript_ParallelGrip
from mobile_robot_control import MoveLinearURdirectTask, ChangeToolFrameTask, MoveJointsURdirectTask, PlaceBrickURTask, PickBrickURTask
from mobile_robot_control import AddCollisionMeshes, MotionPlanExecutePose, MotionPlanExecuteJoints, MoveBaseViaJointValuesTask, MoveBaseViaAxialMotionTask, MoveArmPoseViaActionTask, MoveArmJointsViaActionTask
from spaicr import ScanBricksTask, ScanAllBricksTask, ScanSingleBrickTask, ScanSingleBrickAddNewTask, CleanBricksTask, TriggerEstimationTask, ReceiveBCFgtTask, ReceiveBCFslamTask, ReceiveBCFslamOnResetTask
from spaicr import AlignmentTask, TransformAlignmentTask, GripperControlTask, UpdateAssemblyAttributes

# start_config = Configuration((0.000, 0.000, -1.571, -1.571, -1.571, 1.571, 3.141), (2, 0, 0, 0, 0, 0, 0),
#                                 ('robot_ewellix_lift_top_joint', 'robot_arm_shoulder_pan_joint', 'robot_arm_shoulder_lift_joint', 'robot_arm_elbow_joint', 'robot_arm_wrist_1_joint', 'robot_arm_wrist_2_joint', 'robot_arm_wrist_3_joint'))

start_config = Configuration((-0.0, -2.356, -2.356, 0.0, 1.571, 0.0), (0, 0, 0, 0, 0, 0),
                                ('robot_arm_shoulder_pan_joint', 'robot_arm_shoulder_lift_joint', 'robot_arm_elbow_joint', 'robot_arm_wrist_1_joint', 'robot_arm_wrist_2_joint', 'robot_arm_wrist_3_joint'))

target_frame = plane_to_compas_frame(target_plane)

target_planes = []

box = Box(0.1,0.1,0.1, Frame.worldXY())
a_mesh = box.to_mesh()

ur_ip = st['ur_ip']
ur_port = st['ur_port']
robot_address = (ur_ip, ur_port)

front_frame_RCF = Frame([0.8,0,0], -Vector.Yaxis(), -Vector.Xaxis())
right_frame_RCF = front_frame_RCF.transformed(Rotation.from_axis_and_angle(Vector.Zaxis(), math.radians(-90)))

def select_pick_brick(assembly, z_tol=0.01):
    available = list(assembly.graph.nodes_where({"available": True}))
    if not available:
        return None

    # --- estimate stack yaw (ignore 90°-rotated bricks) ---
    yaws = []
    for k in available:
        xaxis = assembly.part(k).frame.xaxis
        yaw = math.atan2(xaxis.y, xaxis.x)
        yaws.append(yaw % (math.pi / 2))

    stack_yaw = sorted(yaws)[len(yaws) // 2]  # median
    print(f"Estimated stack yaw: {math.degrees(stack_yaw):.2f}°")

    c = math.cos(-stack_yaw)
    s = math.sin(-stack_yaw)

    # --- rotate positions into stack frame ---
    bricks = []
    for k in available:
        p = assembly.part(k).frame.point
        rx = c * p.x - s * p.y
        rz = p.z
        bricks.append((k, rx, rz))

    # --- select top layer ---
    max_z = max(b[2] for b in bricks)
    top = [b for b in bricks if abs(b[2] - max_z) < z_tol]

    # --- select most right ---
    best = min(top, key=lambda b: b[1])

    return best[0]

def select_place_brick(assembly, robot):
    available_bricks = assembly.graph.nodes_where({"built":False, "available":True, "anchor":False})
    anchor_bricks = assembly.graph.nodes_where({"anchor":True})
    max_anchor_key = max(anchor_bricks)
    anchor_course = assembly.graph.node_attribute(max_anchor_key, 'course')
    max_course = 2

    potential_bricks = []
    for key in available_bricks:
        if robot.is_reachable(assembly.graph.node_attribute(key, 'planned_frame')):
            if assembly.graph.node_attribute(key, 'course') == anchor_course and key > max_anchor_key:
                pass
            elif assembly.graph.node_attribute(key, 'course') < max_course:
                potential_bricks.append(key)
    
    if len(potential_bricks) > 0:
        return min(potential_bricks)
        # max_key = max(
        #     potential_bricks,
        #     key=lambda n: assembly.graph.node_attribute(n, 'planned_frame').point.x
        # )
        # return max_key
    else:
        return None

def slerp_quat(q1, q2, t):
    q1 = q1 / np.linalg.norm(q1)
    q2 = q2 / np.linalg.norm(q2)
    dot = np.dot(q1, q2)
    if dot < 0.0:
        q2 = -q2
        dot = -dot
    if dot > 0.9995:
        q = q1 + t * (q2 - q1)
        return q / np.linalg.norm(q)
    theta_0 = np.arccos(dot)
    theta = theta_0 * t
    q3 = q2 - q1 * dot
    q3 = q3 / np.linalg.norm(q3)
    return q1 * np.cos(theta) + q3 * np.sin(theta)

def average_frame(frame_a, frame_b):
    # --- Average position ---
    p = Point(
        0.5 * (frame_a.point.x + frame_b.point.x),
        0.5 * (frame_a.point.y + frame_b.point.y),
        0.5 * (frame_a.point.z + frame_b.point.z),
    )

    # --- Average orientation via SLERP ---
    R_a = Rotation.from_frame(frame_a)
    R_b = Rotation.from_frame(frame_b)

    qa = np.array(R_a.quaternion)
    qb = np.array(R_b.quaternion)

    q_avg = slerp_quat(qa, qb, 0.5)
    R_avg = Rotation.from_quaternion(q_avg)

    # --- Build averaged frame ---
    avg_frame = Frame.from_rotation(R_avg)
    avg_frame.point = p
    return avg_frame

class SimplePickBrickURTask(URTask):
    def __init__(self, robot, robot_address, grip=True, key=None):
        super(SimplePickBrickURTask, self).__init__(robot, robot_address, key)
        self.robot = robot
        self.robot_address = robot_address
        self.grip = grip

    def urscript_fabrication_header(self):
        ## Initialize instance
        self.urscript = URScript_ParallelGrip(*self.robot_address)
        self.urscript.start()
        
        if self.robot:
            ## Set tool
            tool = self.robot.attached_tool
            self.urscript.set_tcp(list(tool.frame.point)+list(tool.frame.axis_angle_vector))
        self.urscript.textmessage(">> TASK {}".format(self.key), string=True)
        
        if self.server:
            self.urscript.set_socket(self.server.ip, self.server.port, self.server.name)
            self.urscript.socket_open(self.server.name)
            ## Send script received msg
            self.urscript.socket_send_line_string(self.rec_msg, self.server.name)
    
    def create_urscript(self):
        self.log("Picking started!")
        self.urscript.set_payload(5.6, [0.005, -0.022, 0.072])
        self.urscript.parallelgrip_open()

        self.urscript.move_force_mode(force_z=20.0, speed_z=0.015)
        self.urscript.stop_by_force(15.0)
        self.urscript.textmessage("Got the brick.", string=True)

        if self.grip:
            self.urscript.parallelgrip_close()

class UpdateAssemblyAttributes(Task):
    def __init__(self, assembly, brick_key, attributes={"built":False, "pick_key":0}, key=None):
        super(UpdateAssemblyAttributes, self).__init__(key)
        self.assembly = assembly
        self.brick_key = brick_key
        self.attributes = attributes
    
    def update_neighbor_availability(self, assembly, part_key=None):
        updated_keys = []
        # Determine which parts to check
        part_keys = (
            assembly.graph.neighbors_out(part_key)
            if part_key is not None
            else assembly.part_keys()
        )
        for key in part_keys:
            below = assembly.graph.neighbors_in(key)
            below_built = all(
                bool(assembly.graph.node_attribute(n, "built")) for n in below
            )

            if below_built and not assembly.graph.node_attribute(key, "available"):
                assembly.graph.node_attribute(key, "available", True)
                updated_keys.append(key)
        return updated_keys

    def run(self, stop_thread):
        # Change brick attributes:
        for attribute, value in self.attributes.items():
            self.assembly.graph.node_attribute(self.brick_key, attribute, value)
        self.update_neighbor_availability(self.assembly, self.brick_key)
        self.is_completed = True
        return True

class ChangeToolFrameTask(Task):
    def __init__(self, robot, tool_name='gripper', key=None):
        super(ChangeToolFrameTask, self).__init__(key)
        self.robot = robot
        self.tool_name = tool_name
        gripper_frame = Frame([0, 0, 0.166], [0, 1, 0], [-1, 0, 0]) 
        camera_frame = Frame([-0.0327, 0.0572, 0.0815], [-1, 0, 0], [0, 0, 1])
        if tool_name == 'gripper':
            self.tool_frame = gripper_frame
        else:
            self.tool_frame = camera_frame
        
    def run(self, stop_thread):
        self.log("ChangeToolTask")
        self.log('Changing the tool frame to {}.'.format(self.tool_name))
        self.robot.attached_tools['ur20'].frame = self.tool_frame
        self.robot.attached_tools['ur20_and_liftkit'].frame = self.tool_frame
        self.is_completed = True
        return True

class MoveBaseViaAxialMotionTask(Task):
    def __init__(self, robot, target_frame, log_distances=False, in_WCF=True, key=None):
        super(MoveBaseViaAxialMotionTask, self).__init__(key)
        self.robot = robot
        self.target_frame = target_frame
        self.log_distances = log_distances
        self.in_WCF= in_WCF

        self.result = None
        self.done = False
        self.success = False
        
    def _result_callback(self, msg):
        self.result = msg
        self.done = True
        self.success = True
        
    def _feedback_callback(self, msg):
        rem = msg["remaining"]
        if self.log_distances:
            self.log(f"Distance remaining... x: {rem['x']:.4f} m, y: {rem['y']:.4f} m, theta: {rem['theta']:.4f} rad")

    def _fail_callback(self, msg):
        self.result = msg
        self.done = True
        self.success = False

    def make_goal(self, x=0.0, y=0.0, theta=0.0):
        return roslibpy.Goal(
            {
                'goal': {
                    'x': x,
                    'y': y,
                    'theta': theta
                },
                'maximum_velocity': {
                    'linear': {
                        'x': 0.0,
                        'y': 0.0,
                        'z': 0.0
                    },
                    'angular': {
                        'x': 0.0,
                        'y': 0.0,
                        'z': 0.0
                    }
                }
            }
        )
        
    def compute_axial_motions(self):
        if self.in_WCF:
            target_frame_in_BCF = self.robot.from_WCF_to_BCF(self.target_frame)
        else:
            target_frame_in_BCF = self.target_frame

        # Extract target components from Frame
        target_x = float(target_frame_in_BCF.point.x)
        target_y = float(target_frame_in_BCF.point.y)
        target_theta = float(math.atan2(target_frame_in_BCF.xaxis.y, target_frame_in_BCF.xaxis.x))

        goals = []

        # 1) Move along y
        if abs(target_y) > 0.0:
            goals.append(self.make_goal(y=target_y))
            self.log("x")

        # 2) Move along x
        if abs(target_x) > 0.0:
            goals.append(self.make_goal(x=target_x))
            self.log("x")

        # 3) Rotate theta
        if abs(target_theta) > 0.0:
            goals.append(self.make_goal(theta=target_theta))
            self.log("x")

        return goals
    
    def run(self, stop_thread):
        self.log("Sending axial motions.")

        action_name = '/robot/move'
        if action_name not in self.robot.mobile_client.action_clients.keys():
            action_client = roslibpy.ActionClient(
                self.robot.mobile_client.ros_client,
                action_name,
                'robotnik_navigation_msgs/action/Move'
            )
        else:
            action_client = self.robot.mobile_client.action_clients[action_name]
            self.log(f"Added action client {action_client}.")

        goals = self.compute_axial_motions()
        # self.log(goals)

        for goal in goals:
            self.result = None
            self.done = False
            self.success = False
        
            goal_id = action_client.send_goal(goal, self._result_callback, self._feedback_callback, self._fail_callback)

            self.log(f'Sending goal: {goal} with ID {goal_id}')

            while not stop_thread():
                if self.done:
                    break
                time.sleep(0.1)
            
            self.log(f"Action {goal_id} result: {self.result['status']}")

        self.is_completed = True
        return True

class AlignmentTask(Task):
    def __init__(self, robot, structure_assembly, realignment=False, key=None):
        super(AlignmentTask, self).__init__(key)
        self.robot = robot
        self.structure_assembly = structure_assembly
        self.realignment = realignment

    def assembly_to_frames_and_points(self, assembly, key_list=[], attribute=None):
        frames = []
        points = []
        for key in key_list:
            if attribute is None:
                main_frame = assembly.part(key).frame
            else:
                main_frame = assembly.graph.node_attribute(key, attribute)
            frames.append(main_frame)
            points.append(main_frame.point)
            corners = assembly.part(key).shape.points
            for c in corners:
                points.append(c.transformed(Transformation.from_frame(main_frame)))
        return frames, points

    def slerp_quat(self, q1, q2, t):
        q1 = q1 / np.linalg.norm(q1)
        q2 = q2 / np.linalg.norm(q2)
        dot = np.dot(q1, q2)
        if dot < 0.0:
            q2 = -q2
            dot = -dot
        if dot > 0.9995:
            q = q1 + t * (q2 - q1)
            return q / np.linalg.norm(q)
        theta_0 = np.arccos(dot)
        theta = theta_0 * t
        q3 = q2 - q1 * dot
        q3 = q3 / np.linalg.norm(q3)
        return q1 * np.cos(theta) + q3 * np.sin(theta)

    def kabsch_wahba_alignment(self, frames_src, frames_tgt, w_orient=1.0):
        # if len(frames_src) != len(frames_tgt):
        #     self.log("Need ≥3 frame correspondences")
        #     return None, None, None

        positions_src, positions_tgt, quats_src, quats_tgt = [], [], [], []
        for f_src, f_tgt in zip(frames_src, frames_tgt):
            positions_src.append(f_src.point)
            positions_tgt.append(f_tgt.point)
            Rs = np.column_stack([f_src.xaxis, f_src.yaxis, f_src.zaxis])
            Rt = np.column_stack([f_tgt.xaxis, f_tgt.yaxis, f_tgt.zaxis])
            quats_src.append(R.from_matrix(Rs).as_quat())
            quats_tgt.append(R.from_matrix(Rt).as_quat())

        positions_src = np.array(positions_src)
        positions_tgt = np.array(positions_tgt)
        quats_src = np.array(quats_src)
        quats_tgt = np.array(quats_tgt)

        # 1. Position alignment
        Pc, Qc = positions_src - positions_src.mean(axis=0), positions_tgt - positions_tgt.mean(axis=0)
        H = Pc.T @ Qc
        U, _, Vt = np.linalg.svd(H)
        R_pos = Vt.T @ U.T
        if np.linalg.det(R_pos) < 0:
            Vt[-1, :] *= -1
            R_pos = Vt.T @ U.T

        # 2. Orientation alignment
        vec_src, vec_tgt = [], []
        for qs, qt in zip(quats_src, quats_tgt):
            Rs = R.from_quat(qs).as_matrix()
            Rt = R.from_quat(qt).as_matrix()
            vec_src.extend(Rs.T)
            vec_tgt.extend(Rt.T)
        vec_src, vec_tgt = np.array(vec_src), np.array(vec_tgt)
        R_orient, _ = R.align_vectors(vec_tgt, vec_src)
        
        # 3. Weighted blending
        q_pos = R.from_matrix(R_pos).as_quat()
        q_orient = R_orient.as_quat()
        q_blend = self.slerp_quat(q_pos, q_orient, np.clip(w_orient, 0.0, 1.0))
        R_combined = R.from_quat(q_blend).as_matrix()

        # 4. Translation
        t_opt = positions_tgt.mean(axis=0) - R_combined @ positions_src.mean(axis=0)

        # 5. Build 4x4 matrix
        T_mat = np.eye(4)
        T_mat[:3, :3] = R_combined
        T_mat[:3, 3] = t_opt
        
        # Convert numpy array to nested list before giving to COMPAS
        T = Transformation.from_matrix(T_mat.tolist())
        frame_result = Frame.from_transformation(T)

        self.log("Kabsch/Wahba algorithm gave the initial guess {}.".format(frame_result))
        return T, frame_result, T_mat

    def points_to_pointcloud(self, points):
        array = [[x,y,z] for x, y, z in iter(points)]
        pcd = open3d.geometry.PointCloud()
        pcd.points = open3d.utility.Vector3dVector(array)
        pcd.voxel_down_sample(0.0001)
        return pcd
    
    def icp_alignment(self, pcd_src, pcd_tgt, initial_guess, threshold=0.05):
        initial_guess_p = frame_to_rhino_plane(initial_guess)
        trans_init, evaluation = evaluate_local_registration(pcd_src, pcd_tgt, threshold, initial_guess_p)
        registration_icp = execute_icp_local_registration(pcd_src, pcd_tgt, threshold, trans_init)
        T_ICP = Transformation.from_matrix(list(registration_icp.transformation))
        frame_result = Frame.worldXY().transformed(T_ICP)

        return T_ICP, frame_result

    def run(self, stop_thread):
        self.log("Computing transformation between OKVIS and Rhino worlds.")

        # Compute Tokvis_to_rhino via alignment. Source frames will be the estimated frames in BCF, target frames will be the planned frames in WCF. 
        # Result will give Tokvis_to_rhino.

        if self.realignment is False: # For the initial alignment between estimated and planned brick poses.
            temporary_keys = [k for k in self.structure_assembly.graph.nodes_where({"temporary":True})]
            anchor_keys = [t for t in self.structure_assembly.graph.nodes_where({"anchor":True})]

            frames_src, points_src = self.assembly_to_frames_and_points(self.structure_assembly, temporary_keys, "estimated_frame") # temporary estimated ones
            frames_tgt, points_tgt = self.assembly_to_frames_and_points(self.structure_assembly, anchor_keys, "planned_frame") # built planned ones (in 2nd alignment, we might have to match them first and then select the keys...)

        else:
            self.log("Realignment.")

            anchor_keys = [t for t in self.structure_assembly.graph.nodes_where({"anchor":True})]

            frames_src, points_src = self.assembly_to_frames_and_points(self.structure_assembly, anchor_keys, "estimated_frame") # temporary estimated ones
            frames_tgt, points_tgt = self.assembly_to_frames_and_points(self.structure_assembly, anchor_keys, "planned_frame")  # built planned ones

        T, initial_guess, T_mat = self.kabsch_wahba_alignment(frames_src, frames_tgt)

        pcd_src = self.points_to_pointcloud(points_src)
        pcd_tgt = self.points_to_pointcloud(points_tgt)

        Tokvis_to_rhino, frame_result = self.icp_alignment(pcd_src, pcd_tgt, initial_guess)
        
        self.log("ICP computed Tokvisrhino is {}".format(Tokvis_to_rhino))
        WCF_slam = self.robot.WCF_slam
        self.robot.WCF_slam = WCF_slam.transformed(Tokvis_to_rhino)
        # self.robot.WCF_slam = Tokvis_to_rhino
        self.robot.is_aligned = True # Should be false once robot starts moving.
        self.robot._record_state("WCF_slam update")

        if self.realignment:
            #realignment
            anchor_keys = list(self.structure_assembly.graph.nodes_where({"anchor":True}))

            for a in anchor_keys:

                estimated_frame = self.structure_assembly.graph.node_attribute(a, 'estimated_frame').copy()
                estimated_frame_t = estimated_frame.transformed(Tokvis_to_rhino)
                self.structure_assembly.part(a).frame = estimated_frame_t
                self.structure_assembly.graph.node_attribute(a, 'estimated_frame', estimated_frame_t)

                estimated_frame = self.structure_assembly.graph.node_attribute(a, 'estimated_frame_BCF').copy()
                estimated_frame_t = estimated_frame.transformed(Tokvis_to_rhino)
                self.structure_assembly.graph.node_attribute(a, 'estimated_frame_BCF', estimated_frame_t)

        self.is_completed = True
        return True

class ScanSingleBrickTask(ScanBricksTask):
    def __init__(self, robot, assembly, brick_key_to_update, frame_attribute="estimated_frame", average=False, key=None):
        super(ScanSingleBrickTask, self).__init__(robot, key=key)
        self.assembly = assembly
        self.brick_key_to_update = brick_key_to_update
        self.frame_attribute = frame_attribute
        self.average = average

        self.brick_shape = Box(xsize=0.24, ysize=0.115, zsize=0.05)
    
    def slerp_quat(self, q1, q2, t):
        q1 = q1 / np.linalg.norm(q1)
        q2 = q2 / np.linalg.norm(q2)
        dot = np.dot(q1, q2)
        if dot < 0.0:
            q2 = -q2
            dot = -dot
        if dot > 0.9995:
            q = q1 + t * (q2 - q1)
            return q / np.linalg.norm(q)
        theta_0 = np.arccos(dot)
        theta = theta_0 * t
        q3 = q2 - q1 * dot
        q3 = q3 / np.linalg.norm(q3)
        return q1 * np.cos(theta) + q3 * np.sin(theta)

    def average_frame(self, frame_a, frame_b):
        # --- Average position ---
        p = Point(
            0.5 * (frame_a.point.x + frame_b.point.x),
            0.5 * (frame_a.point.y + frame_b.point.y),
            0.5 * (frame_a.point.z + frame_b.point.z),
        )

        # --- Average orientation via SLERP ---
        R_a = Rotation.from_frame(frame_a)
        R_b = Rotation.from_frame(frame_b)

        qa = np.array(R_a.quaternion)
        qb = np.array(R_b.quaternion)

        q_avg = self.slerp_quat(qa, qb, 0.5)
        R_avg = Rotation.from_quaternion(q_avg)

        # --- Build averaged frame ---
        avg_frame = Frame.from_rotation(R_avg)
        avg_frame.point = p
        return avg_frame

    def run(self, stop_thread):
        brick_dict = self.get_detected_bricks(stop_thread)

        self.log("Updating only the brick {}...".format(self.brick_key_to_update))

        # Compare the pose to each pose in assembly by seeing the distance.
        target_key = None
        closest_distance = 0.15

        for brick_id, pose in brick_dict.items():
            pose_BCF = pose
            pose = self.robot.from_BCF_to_WCF(pose_BCF) # Pre-alignment it is same with from_BCF_slam_to_WCF_slam() cause WCF_slam is World.XY()

            distance = distance_point_point(self.assembly.part(self.brick_key_to_update).frame.point, pose.point)
            self.log("Distance is {}".format(distance))
            if distance < closest_distance:
                closest_distance = distance
                target_key = brick_id

        if target_key is None:
            self.log(f"No match found for brick {self.brick_key_to_update}")
        # Update pose
        else:
            self.log("Updating the pose of the brick key {} with id {}".format(self.brick_key_to_update, target_key))
            pose_BCF = brick_dict[target_key]
            pose = self.robot.from_BCF_to_WCF(brick_dict[target_key])

            if self.average:
                self.log("Averaging the pose with the current pose in assembly.")
                if self.frame_attribute is not None:
                    current_pose = self.assembly.graph.node_attribute(self.brick_key_to_update, self.frame_attribute)
                else:
                    current_pose = self.assembly.part(self.brick_key_to_update).frame
                # find average:
                self.log("Current_Pose is {}".format(current_pose))

                average_pose = self.average_frame(current_pose, pose)

                self.log("average_pose is {}".format(average_pose))
                pose = average_pose
                pose_BCF = self.robot.from_WCF_to_BCF(pose)
            
            part = self.assembly.part(self.brick_key_to_update)
            part.frame = pose.copy()

            if self.frame_attribute is not None:
                self.assembly.graph.node_attribute(self.brick_key_to_update, self.frame_attribute, pose.copy())
                self.assembly.graph.node_attribute(self.brick_key_to_update, self.frame_attribute + '_BCF', pose_BCF.copy())

            # # Append a collision mesh.
            # if self.scene != None:
            #     pose_WCF = self.robot.from_RCF_to_BCF(pose)
            #     collision_mesh = CollisionMesh(self.assembly.find_by_key(brick_key).mesh.transformed(Transformation.from_frame(pose_WCF)), str(brick_key))
            #     self.scene.remove_collision_mesh(str(brick_key))
            #     self.scene.add_collision_mesh(collision_mesh)
            #     self.log('Updated collision mesh with key {}.'.format(brick_key))
                
        self.is_completed = True
        return True

temporary_keys = [k for k in building_structure.graph.nodes_where({"temporary":True})]
anchor_keys = [t for t in building_structure.graph.nodes_where({"anchor":True})]
print(temporary_keys)
print(anchor_keys)

if routine == "receive_bcf":
    tasks = [ReceiveBCFslamTask(robot)]
                # ReceiveBCFgtTask(robot)]

elif routine == "move_home":
    tasks = []
    # tasks.append(MoveArmJointsViaActionTask(robot, start_config, execute=True))
    tasks.append(MoveArmPoseViaActionTask(robot, target_frame, execute=True))

elif routine == "general_snapshot":
    tasks = [ChangeToolFrameTask(robot, "gripper")]
    # tasks.append(MotionPlanExecuteJoints(robot, start_config))

    anchor_snap_planes = snap_planes[-1:] + snap_planes[0:2]
    for snap_plane in anchor_snap_planes:
        frame_BCF = plane_to_compas_frame(snap_plane).transformed(Translation.from_vector([0,-0.05,0]))
        frame_RCF = robot.from_BCF_to_RCF(frame_BCF)
        target_planes.append(frame_to_rhino_plane(robot.from_BCF_to_WCF(frame_BCF)))

        tasks.append(MoveLinearURdirectTask(robot, robot_address, frame_RCF, in_RCF=True))
        # tasks.append(MotionPlanExecutePose(robot, frame_BCF, frame_in_WCF=False))

        tasks.append(CleanBricksTask(robot))
        tasks.append(TriggerEstimationTask(robot, trigger=True, sleep=20))
        tasks.append(ScanAllBricksTask(robot, assembly=building_structure, anchor=True))
        tasks.append(TriggerEstimationTask(robot, trigger=False, sleep=0))

    # tasks.append(MotionPlanExecuteJoints(robot, start_config))

elif routine == "closeup_snapshot":
    tasks = [ChangeToolFrameTask(robot, "camera")]
    # tasks.append(MotionPlanExecuteJoints(robot, start_config))

    temporary_keys = list(building_structure.graph.nodes_where({"temporary":True}))
    print(temporary_keys)

    for temporary_key in temporary_keys:
        estimated_frame_BCF = building_structure.graph.node_attribute(temporary_key, 'estimated_frame_BCF')
        closeup_snapshot = plane_to_compas_frame(closeup_plane)
        snapshot_frame_BCF = closeup_snapshot.transformed(Transformation.from_frame(estimated_frame_BCF))
        
        target_planes.append(frame_to_rhino_plane(robot.from_BCF_to_WCF(snapshot_frame_BCF)))

        snapshot_frame_RCF = robot.from_BCF_to_RCF(snapshot_frame_BCF)
        tasks.append(MoveLinearURdirectTask(robot, robot_address, snapshot_frame_RCF, in_RCF=True))
        # tasks.append(MotionPlanExecutePose(robot, snapshot_frame_BCF, frame_in_WCF=False))

        tasks.append(CleanBricksTask(robot))
        tasks.append(TriggerEstimationTask(robot, trigger=True, sleep=10))
        tasks.append(ScanSingleBrickTask(robot, assembly=building_structure, brick_key_to_update=temporary_key))
        tasks.append(TriggerEstimationTask(robot, trigger=False, sleep=0))

    # tasks.append(TriggerEstimationTask(robot, trigger=False, cuda_off=True, sleep=0))
    # tasks.append(MotionPlanExecuteJoints(robot, start_config))

elif routine == "alignment":
    tasks = []
    tasks.append(AlignmentTask(robot, structure_assembly=building_structure))
    tasks.append(TransformAlignmentTask(robot, stack_assembly=material_stack, structure_assembly=building_structure))

elif routine == "general_snapshot_pick":
    tasks = [ChangeToolFrameTask(robot, "gripper")]
    # tasks.append(MotionPlanExecuteJoints(robot, start_config))
    tasks.append(MoveLinearURdirectTask(robot, robot_address, front_frame_RCF, in_RCF=True))
    tasks.append(MoveLinearURdirectTask(robot, robot_address, right_frame_RCF, in_RCF=True))

    left_stack = False
    if left_stack:
        stack_snap_planes = snap_planes[-1:] + snap_planes[0:2]
    else:
        stack_snap_planes = snap_planes[-3:-1]

    for snap_plane in stack_snap_planes:
        frame_BCF = plane_to_compas_frame(snap_plane).transformed(Translation.from_vector([0,-0.05,0]))
        frame_RCF = robot.from_BCF_to_RCF(frame_BCF)
        target_planes.append(frame_to_rhino_plane(robot.from_BCF_to_WCF(frame_BCF)))

        tasks.append(MoveLinearURdirectTask(robot, robot_address, frame_RCF, in_RCF=True))
        # tasks.append(MotionPlanExecutePose(robot, frame_BCF, frame_in_WCF=False))

        tasks.append(CleanBricksTask(robot))
        tasks.append(TriggerEstimationTask(robot, trigger=True, sleep=20))
        tasks.append(ScanAllBricksTask(robot, assembly=material_stack, anchor=False))
        tasks.append(TriggerEstimationTask(robot, trigger=False, sleep=0))

elif routine == "closeup_snapshot_pick":
    tasks = []
    pick_key = select_pick_brick(material_stack)
    print(pick_key)
    st['current_pick_key'] = pick_key
    pick_estimated_frame_BCF = material_stack.graph.node_attribute(pick_key, 'estimated_frame_BCF')

    # closeup_snapshot = Frame(point=Point(x=0.390, y=-0.298, z=-0.325), xaxis=Vector(x=-0.471, y=-0.879, z=0.076), yaxis=Vector(x=0.570, y=-0.238, z=0.786))
    # planned_snapshot_frame_BCF = closeup_snapshot.transformed(Transformation.from_frame(pick_estimated_frame_BCF))
    # planned_snapshot_frame_BCF = planned_snapshot_frame_BCF.transformed(Rotation.from_axis_and_angle(pick_estimated_frame_BCF.zaxis, math.radians(180), pick_estimated_frame_BCF.point))

    closeup_snapshot = plane_to_compas_frame(closeup_plane)

    planned_snapshot_frame_BCF = closeup_snapshot.transformed(Transformation.from_frame(pick_estimated_frame_BCF))
    planned_snapshot_frame_BCF = planned_snapshot_frame_BCF.transformed(Rotation.from_axis_and_angle(pick_estimated_frame_BCF.zaxis, math.radians(0), pick_estimated_frame_BCF.point))
    planned_snapshot_frame_RCF = robot.from_BCF_to_RCF(planned_snapshot_frame_BCF)

    target_planes.append(frame_to_rhino_plane(robot.from_RCF_to_WCF(right_frame_RCF)))
    target_planes.append(frame_to_rhino_plane(robot.from_BCF_to_WCF(planned_snapshot_frame_BCF)))

    tasks = [ChangeToolFrameTask(robot, "gripper")]
    tasks.append(MoveLinearURdirectTask(robot, robot_address, right_frame_RCF, in_RCF=True))
    tasks.append(ChangeToolFrameTask(robot, "camera"))
    tasks.append(MoveLinearURdirectTask(robot, robot_address, planned_snapshot_frame_RCF, in_RCF=True))
    # tasks.append(MotionPlanExecutePose(robot, planned_snapshot_frame_BCF, frame_in_WCF=False))

    tasks.append(CleanBricksTask(robot))
    tasks.append(TriggerEstimationTask(robot, trigger=True, sleep=20))
    tasks.append(ScanSingleBrickAddNewTask(robot, assembly=material_stack, brick_key_to_update=pick_key, average=False))
    tasks.append(TriggerEstimationTask(robot, trigger=False, sleep=0))

elif routine in ["pick", "pick_place"]:   
    pick_key = st['current_pick_key']
    print(pick_key)

    #pick_estimated_frame_BCF = material_stack.graph.node_attribute(pick_key, 'estimated_frame_BCF').transformed(Translation.from_vector([0,0,0.03]))
    pick_estimated_frame = material_stack.part(pick_key).frame.transformed(Translation.from_vector([0,0,0.025]))
    mid_pick_estimated_frame = pick_estimated_frame.transformed(Translation.from_vector([0,0,0.1]))
    safe_pick_estimated_frame = pick_estimated_frame.transformed(Translation.from_vector([0,0,0.3]))

    safe_pick_estimated_frame_RCF = robot.from_WCF_to_RCF(safe_pick_estimated_frame)
    mid_pick_estimated_frame_RCF = robot.from_WCF_to_RCF(mid_pick_estimated_frame)

    target_planes.append(frame_to_rhino_plane(safe_pick_estimated_frame))
    target_planes.append(frame_to_rhino_plane(mid_pick_estimated_frame))
    target_planes.append(frame_to_rhino_plane(pick_estimated_frame))
    target_planes.append(frame_to_rhino_plane(robot.from_RCF_to_WCF(right_frame_RCF)))

    tasks = [ChangeToolFrameTask(robot, "gripper")]
    tasks.append(MoveLinearURdirectTask(robot, robot_address, safe_pick_estimated_frame_RCF, in_RCF=True))
    tasks.append(MoveLinearURdirectTask(robot, robot_address, mid_pick_estimated_frame_RCF, in_RCF=True))
    tasks.append(PickBrickURTask(robot, robot_address, material_stack, pick_key, grip=True))
    tasks.append(MoveLinearURdirectTask(robot, robot_address, mid_pick_estimated_frame_RCF, in_RCF=True))
    tasks.append(MoveLinearURdirectTask(robot, robot_address, right_frame_RCF, in_RCF=True))
    tasks.append(UpdateAssemblyAttributes(material_stack, pick_key, attributes={"built":False, "available":False}))

elif routine == "static_pick":   
    pick_estimated_frame = target_frame.transformed(Translation.from_vector([0,0,0.025]))
    mid_pick_estimated_frame = pick_estimated_frame.transformed(Translation.from_vector([0,0,0.1]))
    safe_pick_estimated_frame = pick_estimated_frame.transformed(Translation.from_vector([0,0,0.6]))

    safe_pick_estimated_frame_RCF = robot.from_WCF_to_RCF(safe_pick_estimated_frame)
    mid_pick_estimated_frame_RCF = robot.from_WCF_to_RCF(mid_pick_estimated_frame)

    target_planes.append(frame_to_rhino_plane(safe_pick_estimated_frame))
    target_planes.append(frame_to_rhino_plane(mid_pick_estimated_frame))
    target_planes.append(frame_to_rhino_plane(pick_estimated_frame))
    target_planes.append(frame_to_rhino_plane(robot.from_RCF_to_WCF(front_frame_RCF)))

    tasks = [ChangeToolFrameTask(robot, "gripper")]
    tasks.append(MoveLinearURdirectTask(robot, robot_address, front_frame_RCF, in_RCF=True, velocity=vel))
    tasks.append(MoveLinearURdirectTask(robot, robot_address, safe_pick_estimated_frame_RCF, in_RCF=True, velocity=vel))
    tasks.append(MoveLinearURdirectTask(robot, robot_address, mid_pick_estimated_frame_RCF, in_RCF=True, velocity=vel))
    tasks.append(SimplePickBrickURTask(robot, robot_address, grip=True))
    tasks.append(MoveLinearURdirectTask(robot, robot_address, mid_pick_estimated_frame_RCF, in_RCF=True, velocity=vel))
    tasks.append(MoveLinearURdirectTask(robot, robot_address, front_frame_RCF, in_RCF=True, velocity=vel))

# elif routine == "place":
#     tasks = []
    
    place_key = 53#select_place_brick(building_structure, robot)
    print(place_key)

    place_planned_frame = building_structure.graph.node_attribute(place_key, 'planned_frame').transformed(
                                                                Translation.from_vector([0,0,0.05]))
    mid_place_planned_frame = place_planned_frame.transformed(Translation.from_vector([0,0,0.15]))
    safe_place_planned_frame = place_planned_frame.transformed(Translation.from_vector([0,0,0.5]))

    safe_place_planned_frame_RCF = robot.from_WCF_to_RCF(safe_place_planned_frame)
    mid_place_planned_frame_RCF = robot.from_WCF_to_RCF(mid_place_planned_frame)

    target_planes.append(frame_to_rhino_plane(robot.from_RCF_to_WCF(front_frame_RCF)))
    target_planes.append(frame_to_rhino_plane((safe_place_planned_frame)))
    target_planes.append(frame_to_rhino_plane((mid_place_planned_frame)))
    target_planes.append(frame_to_rhino_plane((place_planned_frame)))

    tasks.append(ChangeToolFrameTask(robot, "gripper"))
    tasks.append(MoveLinearURdirectTask(robot, robot_address, front_frame_RCF, in_RCF=True, velocity=vel))
    tasks.append(MoveLinearURdirectTask(robot, robot_address, safe_place_planned_frame_RCF, in_RCF=True, velocity=vel))
    tasks.append(MoveLinearURdirectTask(robot, robot_address, mid_place_planned_frame_RCF, in_RCF=True, velocity=vel))
    tasks.append(PlaceBrickURTask(robot, robot_address))
    tasks.append(MoveLinearURdirectTask(robot, robot_address, mid_place_planned_frame_RCF, in_RCF=True, velocity=vel))
    tasks.append(MoveLinearURdirectTask(robot, robot_address, front_frame_RCF, in_RCF=True, velocity=vel))
    tasks.append(UpdateAssemblyAttributes(building_structure, place_key, attributes={"built":True, "available":False}))

elif routine == "move_base":
    target_frame = Frame(Point(0,-0.4,0))
    print(target_frame)
    tasks = [MoveBaseViaAxialMotionTask(robot, target_frame=target_frame, in_WCF=False)]

elif routine == "closeup_reanchor":
    frame_attribute = "estimated_frame"
    parts_keys = [p for p in building_structure.part_keys()]
    anchor_keys = [p for p in parts_keys if building_structure.graph.node_attribute(p, "anchor")]
    print(anchor_keys)
    tasks = []
    tasks.append(ChangeToolFrameTask(robot, "gripper"))
    tasks.append(MoveLinearURdirectTask(robot, robot_address, front_frame_RCF, in_RCF=True, velocity=vel))
    
    for p in anchor_keys:
        planned_frame_WCF = building_structure.graph.node_attribute(p, 'planned_frame')
        safe_planned_frame_WCF = planned_frame_WCF.transformed(Translation.from_vector([0,0,0.6]))
        target_planes.append(frame_to_rhino_plane(safe_planned_frame_WCF))

        closeup_snapshot = plane_to_compas_frame(closeup_plane)
        planned_snapshot_frame_WCF = closeup_snapshot.transformed(Transformation.from_frame(planned_frame_WCF))

        for i in range(4):
            if i == 0:
                averaging = False
            else:
                averaging = True

            # if p == 18 and i == 3:
            #     ex_angle=-20
            # else:
            ex_angle=0

            safe_planned_frame_RCF = robot.from_WCF_to_RCF(safe_planned_frame_WCF)
            tasks.append(ChangeToolFrameTask(robot, "gripper"))
            tasks.append(MoveLinearURdirectTask(robot, robot_address, safe_planned_frame_RCF, in_RCF=True))

            snapshot_frame_WCF = planned_snapshot_frame_WCF.transformed(Rotation.from_axis_and_angle(planned_frame_WCF.zaxis, math.radians((90*i)+ex_angle), planned_frame_WCF.point))
            target_planes.append(frame_to_rhino_plane(snapshot_frame_WCF))
            snapshot_frame_RCF = robot.from_WCF_to_RCF(snapshot_frame_WCF)
            tasks.append(ChangeToolFrameTask(robot, "camera"))
            tasks.append(MoveLinearURdirectTask(robot, robot_address, snapshot_frame_RCF, in_RCF=True))

            tasks.append(CleanBricksTask(robot))
            tasks.append(TriggerEstimationTask(robot, trigger=True, sleep=10))
            tasks.append(ScanSingleBrickTask(robot, assembly=building_structure, brick_key_to_update=p, frame_attribute=frame_attribute, average=averaging))
            tasks.append(TriggerEstimationTask(robot, trigger=False, sleep=0))
    
    tasks.append(ChangeToolFrameTask(robot, "gripper"))
    tasks.append(MoveLinearURdirectTask(robot, robot_address, front_frame_RCF, in_RCF=True, velocity=vel))

elif routine == "realignment":
    tasks = []
    tasks.append(AlignmentTask(robot, structure_assembly=building_structure, realignment=True))

elif routine == "correct_last":
    p = 7
    frame_attribute = "estimated_frame"
    planned_frame_WCF = building_structure.graph.node_attribute(p, 'planned_frame')
    closeup_snapshot = plane_to_compas_frame(closeup_plane)
    # closeup_snapshot = Frame(point=Point(x=0.390, y=-0.298, z=-0.325), xaxis=Vector(x=-0.471, y=-0.879, z=0.076), yaxis=Vector(x=0.570, y=-0.238, z=0.786))
    planned_snapshot_frame_WCF = closeup_snapshot.transformed(Transformation.from_frame(planned_frame_WCF))
    planned_snapshot_frame_WCF = planned_snapshot_frame_WCF.transformed(Rotation.from_axis_and_angle(planned_frame_WCF.zaxis, math.radians(0), planned_frame_WCF.point))
    # target_planes.append(frame_to_rhino_plane(planned_snapshot_frame_WCF))

    # tasks = [ChangeToolFrameTask(robot, "camera")]
    # tasks.append(CleanBricksTask(robot))
    # tasks.append(MotionPlanExecutePose(robot, planned_snapshot_frame_WCF, frame_in_WCF=True))
    # tasks.append(TriggerEstimationTask(robot, trigger=True, sleep=30))
    # tasks.append(ScanSingleBrickTask(robot, assembly=building_structure, brick_key_to_update=p, frame_attribute=frame_attribute, average=True))
    # tasks.append(TriggerEstimationTask(robot, trigger=False, sleep=0))

    ########

    pick_estimated_frame_BCF = building_structure.graph.node_attribute(p, 'estimated_frame_BCF').transformed(Translation.from_vector([0,0,0.04]))
    mid_estimated_frame_BCF = pick_estimated_frame_BCF.transformed(Translation.from_vector([0,0,0.04]))
    safe_pick_estimated_frame_BCF = pick_estimated_frame_BCF.transformed(Translation.from_vector([0,0,0.15]))

    target_planes.append(frame_to_rhino_plane(robot.from_BCF_to_WCF(safe_pick_estimated_frame_BCF)))
    target_planes.append(frame_to_rhino_plane(robot.from_BCF_to_WCF(pick_estimated_frame_BCF)))
    
    estimated_frame = building_structure.graph.node_attribute(p, 'estimated_frame')
    planned_frame = building_structure.graph.node_attribute(p, 'planned_frame')

    av_frame = average_frame(planned_frame, estimated_frame)
    # building_structure.part(p).frame = av_frame

    print(av_frame)
    place_planned_frame = av_frame.transformed(Translation.from_vector([0,0,0.04]))
    mid_place_planned_frame = place_planned_frame.transformed(Translation.from_vector([0,0,0.04]))
    safe_place_planned_frame = place_planned_frame.transformed(Translation.from_vector([0,0,0.15]))

    target_planes.append(frame_to_rhino_plane((safe_place_planned_frame)))
    target_planes.append(frame_to_rhino_plane((place_planned_frame)))

    # tasks = [ChangeToolFrameTask(robot, "gripper"),
    #             MotionPlanExecutePose(robot, safe_pick_estimated_frame_BCF, frame_in_WCF=False),
    #             GripperControlTask(robot, open_grip=True),
    #             MotionPlanExecutePose(robot, mid_estimated_frame_BCF, frame_in_WCF=False, tool_constraint=True),
    #             MotionPlanExecutePose(robot, pick_estimated_frame_BCF, frame_in_WCF=False, tool_constraint=True),
    #             GripperControlTask(robot, open_grip=False),
    #             MotionPlanExecutePose(robot, safe_pick_estimated_frame_BCF, frame_in_WCF=False, tool_constraint=True)]

    tasks = [ChangeToolFrameTask(robot, "gripper"),
                MotionPlanExecutePose(robot, safe_place_planned_frame, frame_in_WCF=True, tool_constraint=False),
                MotionPlanExecutePose(robot, mid_place_planned_frame, frame_in_WCF=True, tool_constraint=True),
                MotionPlanExecutePose(robot, place_planned_frame, frame_in_WCF=True, tool_constraint=True),
                GripperControlTask(robot, open_grip=True),
                MotionPlanExecutePose(robot, mid_place_planned_frame, frame_in_WCF=True, tool_constraint=True),
                MotionPlanExecutePose(robot, safe_place_planned_frame, frame_in_WCF=True, tool_constraint=True),
                GripperControlTask(robot, open_grip=False)]

elif routine == "attach_meshes":
    if material_stack is not None:
        material_stack_t = material_stack.transformed(robot.transformation_WCF_BCF())
        meshes = []
        mesh_ids = []
        frames = []
        for key in material_stack_t.part_keys():
            part_mesh = material_stack_t.part(key).mesh
            meshes.append(part_mesh)
            vertices = [part_mesh.vertex_coordinates(i) for i in part_mesh.vertices()]
            mesh_id = "brick_"+str(key)
            mesh_ids.append(mesh_id)
            frames.append(Frame.worldXY())
        tasks = [AddCollisionMeshes(robot, meshes, frames, mesh_ids, attached=False)]

    # if assemblies[0] is not None:
    #     stack_assembly = assemblies[0]
    #     t_stack_assembly = stack_assembly.transformed(robot.transformation_WCF_BCF())
    #     tasks = []
    #     for key in t_stack_assembly.part_keys():
    #         part_mesh = t_stack_assembly.part(key).mesh
    #         vertices = [part_mesh.vertex_coordinates(i) for i in part_mesh.vertices()]
    #         tasks.append(AddCollisionMesh(robot, mesh=part_mesh, mesh_id="brick_"+str(key), attached=False))
    # tasks = [AddCollisionMesh(robot, mesh = a_mesh, mesh_id="thing", attached=False)]
    # tasks = [RemoveCollisionMesh(robot, mesh_id="thing")]


# place_key = 168
# print(place_key)

# # place_planned_frame = building_structure.graph.node_attribute(place_key, 'estimated_frame').transformed(
# #                                                             Translation.from_vector([0,0,0.05]))
# place_planned_frame = Frame(point=Point(x=1.118, y=-0.548, z=-0.028), xaxis=Vector(x=-0.033, y=-0.998, z=0.062), yaxis=Vector(x=0.998, y=-0.036, z=-0.042))

# place_planned_frame = place_planned_frame.transformed(Rotation.from_axis_and_angle(place_planned_frame.xaxis, math.radians(180), place_planned_frame.point))
# mid_place_planned_frame = place_planned_frame.transformed(Translation.from_vector([0,0,0.15]))
# safe_place_planned_frame = place_planned_frame.transformed(Translation.from_vector([0,0,0.5]))

# safe_place_planned_frame_RCF = robot.from_BCF_to_RCF(safe_place_planned_frame)
# mid_place_planned_frame_RCF = robot.from_BCF_to_RCF(mid_place_planned_frame)

# target_planes=[]
# target_planes.append(frame_to_rhino_plane((safe_place_planned_frame)))
# target_planes.append(frame_to_rhino_plane((mid_place_planned_frame)))
# target_planes.append(frame_to_rhino_plane((place_planned_frame)))
# # target_planes.append(frame_to_rhino_plane((robot.from_RCF_to_WCF(front_frame_RCF))))
# # target_planes.append(frame_to_rhino_plane((robot.from_RCF_to_WCF(right_frame_RCF))))

# tasks = [ChangeToolFrameTask(robot, "gripper"),
#             MoveLinearURdirectTask(robot, robot_address, mid_place_planned_frame_RCF, in_RCF=True)]

print(tasks)
# ---------- end generate_tasks ----------
pln_4 = Plane(generate_tasks.target_planes)
next_task = Button()
reset_task = Button()
prev_task = Button()
reset = Button()
panel_4 = Panel(generate_tasks.out)
bang = Button()
start_fabrication = Button()
stop_fabrication = Button()
fabrication_manager = Python3Script(
    tasks=generate_tasks.tasks,
    fabrication=fabrication,
    set_tasks=Toggle(True),
    start=start_fabrication,
    stop=stop_fabrication,
    reset=reset,
    next_task=next_task,
    reset_task=reset_task,
    prev_task=prev_task)  # -> out, server; inputs tasks: list
# ---------- fabrication_manager: Python ----------
def task_state_set(state, t):
    t.is_completed = state
    t.is_running = False
    
if set_tasks:
    print("setting tasks")   
    fabrication.clear_tasks()
    fabrication.set_tasks(tasks)

if start:
    #if robot.is_connected(): #and arduino.is_connected():
    print("starting process")
    fabrication.start()

if stop:
    print("stopping process")
    fabrication.stop()
    
if reset:
    print("resetting process")
    fabrication.reset()

if next_task:
    t = fabrication.get_next_task()
    task_state_set(True, t)
    
if reset_task:
    t = fabrication.get_next_task()
    task_state_set(False, t)

if prev_task:
    t = fabrication.get_next_task()
    task_state_set(False, t)
    t = fabrication.tasks[fabrication.current_task_key-1]
    task_state_set(False, t)
    fabrication.get_next_task()
# ---------- end fabrication_manager ----------
data = Data(fabrication_state.log_messages)
panel_5 = Panel(fabrication_state.log_messages)

# ----
# real robot values
unsubscribe = Button()
subscribe = Button()
get_joint_states = Python3Script(robot=robot, subscribe=subscribe, unsubscribe=unsubscribe)
# ---------- get_joint_states: Python ----------
def _receive_joint_states(message):
    print(message)
    joint_list = ['robot_arm_elbow_joint', 'robot_arm_shoulder_lift_joint', 'robot_arm_shoulder_pan_joint', 'robot_arm_wrist_1_joint', 'robot_arm_wrist_2_joint', 'robot_arm_wrist_3_joint']
    for key, joint_name in enumerate(message.get("name")):
        if joint_name in joint_list:
            robot.mobile_client.current_joint_values[joint_name] = message.get("position")[key]
def joint_states_subscribe(m):
    m.topic_subscribe(
        "/robot/joint_states", "sensor_msgs/JointState", _receive_joint_states
    )

def joint_states_unsubscribe(m):
    m.topic_unsubscribe("/robot/joint_states")

if subscribe:
    joint_states_subscribe(robot.mobile_client)

if unsubscribe:
    print(robot.mobile_client)
# ---------- end get_joint_states ----------
trigger_2 = Trigger(Interval=5000, TimerInterval=5000, Target=draw)  # disabled
draw = Python3Script(robot=robot, bang=bang)  # -> configuration; disabled
# ---------- draw: Python ----------
from compas_robots import Configuration

configuration = robot.mobile_client.get_current_configuration()
print(configuration)

print(robot.mobile_client.current_joint_values)
# ---------- end draw ----------

# ----
# analytical inverse kinematics
select_configuration = Slider(0, range=0..7)
plane_3 = Plane(c_script_4.P)
analytic_inverse = Python3Script(robot=robot, lift=number_slider_3, plane=pln_2, idx=select_configuration, refresh=Button())  # -> out, configuration; inputs plane: Plane, idx: Int32
# ---------- analytic_inverse: Python ----------
import Rhino.Geometry as rg
import math
from compas.geometry import Frame, Transformation, Rotation
from compas_robots import Configuration
from ur_fabrication_control.kinematics.ur_kinematics import inverse_kinematics
from ur_fabrication_control.kinematics.ur_params import ur_params
from compas_rhino.conversions import plane_to_compas_frame

frame_WCF = plane_to_compas_frame(plane)

print(robot.is_reachable(frame_WCF))
configuration, solutions = robot.i_kinematics(frame_WCF, lift=lift, idx=idx)
print(configuration)
# ---------- end analytic_inverse ----------

# ----
# inverse kinematics
list_6 = ValueList({"ur20", "ur20_and_liftkit"}, selected="ur20")
compute = Button()
inverse = Python3Script(robot=robot, plane=plane_3, start_configuration=forward_kinematics, group=list_6, compute=compute)  # -> out, configuration
# ---------- inverse: Python ----------
"""
Calculate the robot's inverse kinematic for a given plane.

COMPAS FAB v1.0.2
"""
from compas_robots import Configuration
from compas_rhino.conversions import plane_to_compas_frame
from ghpythonlib.componentbase import executingcomponent as component
from scriptcontext import sticky as st



class InverseKinematics(component):
    def RunScript(self, robot, plane, start_configuration, group, compute):

        key = "inverse_solution"
        configuration = None
        if robot and robot.client and robot.client.is_connected and plane and compute:
            frame = plane_to_compas_frame(plane)
            configuration = robot.inverse_kinematics(frame, start_configuration, group)
            st["inverse_solution"] = configuration
        configuration = st.get("inverse_solution", None)
        print(configuration)
        return configuration
# ---------- end inverse ----------

# ---- group: Grain Visualisation / Run
run_2 = BooleanToggle(True)

# ---- group: Grain Visualisation
number_slider_8 = Slider(0.0001, range=0..0.005)
illustration = Python3Script(pieces=[kept, move.Geometry], density=Slider(0.6, range=0..5), lift=number_slider_8, run=run_2)  # -> out, visible, hidden, grain, report; inputs pieces: list of Brep
# ---------- illustration: Python ----------
"""GH Python 3 -- GRAIN v3: 3D wood-grain curves for the catalogue look.

Live companion to the "Katalog" display mode (white shading, black edges,
dashed hidden lines): generates real 3D grain curves ON the faces of the
pieces, lifted a hair off the surface. Solids occlude their own back-face
grain naturally -- nothing is view-dependent.

Grain by face type (angle between face normal and beam axis):
    |dot| >  end_threshold [0.15] -> growth-ring CYLINDERS around the piece's
        pith line, intersected with the face plane: circles on square cuts,
        stretched ovals on miters and scarf cheeks (anatomically continuous)
    |dot| <= end_threshold        -> longitudinal flowing lines

v3: clipping fully vectorized in 2D face space (numpy) -- no per-point
RhinoCommon calls; expect ~5-10x faster than v2.

Inputs:
    pieces        (Brep, list)
    axis          (Vector)  beam axis; empty -> longest bbox direction
    density       (float) [1.0]
    lift          (float) [auto = 0.0004 x bbox diagonal]
    end_threshold (float) [0.85] faces with |dot| above this get rings
    run           (bool)
Outputs:
    grain, report
"""
import sys, os, math, random

REPO = r"C:\Users\tizian\workspace\projects\workshop_robarch_2026"
SRC = os.path.join(REPO, "src")
if SRC not in sys.path:
    sys.path.append(SRC)

import numpy as np
import Rhino
import Rhino.Geometry as rg
from Grasshopper import DataTree
from Grasshopper.Kernel.Data import GH_Path

GRAIN_V = "14"
grain = DataTree[object]()
report = []


def _face_plane(face):
    ok, plane = face.TryGetPlane(0.001)
    return plane if ok else None


def _loops_2d(face, plane):
    loops = []
    for lp in face.Loops:
        c = lp.To3dCurve()
        if c is None:
            continue
        div = c.DivideByCount(96, True)
        if not div:
            continue
        pts = [c.PointAt(t) for t in div]
        arr = np.array([[(p - plane.Origin) * plane.XAxis,
                         (p - plane.Origin) * plane.YAxis] for p in pts])
        loops.append(arr)
    return loops


def _segments(loops):
    a, b = [], []
    for L in loops:
        a.append(L)
        b.append(np.roll(L, -1, axis=0))
    return np.vstack(a), np.vstack(b)


def _mask_points(P, seg_a, seg_b):
    if len(P) == 0:
        return np.zeros(0, bool)
    px, py = P[:, 0:1], P[:, 1:2]
    x1, y1 = seg_a[:, 0][None, :], seg_a[:, 1][None, :]
    x2, y2 = seg_b[:, 0][None, :], seg_b[:, 1][None, :]
    cond = (y1 > py) != (y2 > py)
    xin = x1 + (py - y1) * (x2 - x1) / (y2 - y1 + 1e-30)
    return (np.sum(cond & (px < xin), axis=1) % 2) == 1


def _snap_to_boundary(p_out, p_in, seg_a, seg_b):
    """Exact crossing of segment p_out->p_in with the face boundary (2D).
    Returns the crossing closest to the inside point, or None."""
    dd = p_in - p_out
    e = seg_b - seg_a
    w = seg_a - p_out[None, :]
    denom = dd[0] * (-e[:, 1]) - dd[1] * (-e[:, 0])
    denom = np.where(np.abs(denom) < 1e-30, 1e-30, denom)
    t = (w[:, 0] * (-e[:, 1]) - w[:, 1] * (-e[:, 0])) / denom
    u = (dd[0] * w[:, 1] - dd[1] * w[:, 0]) / denom
    ok = (t >= -1e-9) & (t <= 1 + 1e-9) & (u >= -1e-9) & (u <= 1 + 1e-9)
    if not ok.any():
        return None
    tbest = t[ok].max()
    return p_out + np.clip(tbest, 0, 1) * dd


def _face_inner_point(seg_a, seg_b, u0, u1, v0, v1, rnd):
    """A 2D point strictly inside the face polygon (centroid, then random)."""
    cands = [np.array([[(u0 + u1) / 2.0, (v0 + v1) / 2.0]])]
    for _ in range(24):
        cands.append(np.array([[u0 + rnd.random() * (u1 - u0),
                                v0 + rnd.random() * (v1 - v0)]]))
    for c in cands:
        if _mask_points(c, seg_a, seg_b)[0]:
            return c[0]
    return None


def _runs_to_curves(pts2d, mask, plane, lift_vec, seg_a, seg_b, min_pts=2):
    out = []
    if len(pts2d) == 0:
        return out
    idx = np.where(mask)[0]
    if len(idx) == 0:
        return out
    breaks = np.where(np.diff(idx) > 1)[0]
    starts = np.r_[0, breaks + 1]
    ends = np.r_[breaks, len(idx) - 1]
    for s, e in zip(starts, ends):
        run = idx[s:e + 1]
        if len(run) < min_pts:
            continue
        chain = [pts2d[i] for i in run]
        i0, i1 = run[0], run[-1]
        if i0 > 0:  # entered the face: snap start onto the boundary
            q = _snap_to_boundary(pts2d[i0 - 1], pts2d[i0], seg_a, seg_b)
            if q is not None:
                chain.insert(0, q)
        if i1 < len(pts2d) - 1:  # left the face: snap end onto the boundary
            q = _snap_to_boundary(pts2d[i1 + 1], pts2d[i1], seg_a, seg_b)
            if q is not None:
                chain.append(q)
        pts = [plane.Origin + plane.XAxis * float(u) + plane.YAxis * float(v)
               + lift_vec for u, v in chain]
        out.append(rg.PolylineCurve(pts))
    return out


def _rings_conic(plane, pith, a, allpts, du, dv, ring_base, dens, rnd, dot):
    """Growth-ring cylinders around the pith line intersected with the face
    plane. One system for ALL faces: circles (square cuts) -> stretched
    ovals (miters, scarfs) -> pairs of parallel lines (axis-parallel faces,
    i.e. tangential grain), all from the same ring radii."""
    A = np.array([a.X, a.Y, a.Z])
    X = np.array([plane.XAxis.X, plane.XAxis.Y, plane.XAxis.Z])
    Y = np.array([plane.YAxis.X, plane.YAxis.Y, plane.YAxis.Z])
    O = np.array([plane.Origin.X, plane.Origin.Y, plane.Origin.Z])
    P = np.array([pith.X, pith.Y, pith.Z])

    def rej(v):
        return v - (v @ A) * A

    e1, e2 = rej(X), rej(Y)
    c0p = rej(O - P)
    # radii ladder shared by every branch
    def radii():
        r = ring_base / dens * (0.4 + 0.4 * rnd.random())
        while True:
            yield r
            r += ring_base / dens * (0.75 + 0.5 * rnd.random())
    # farthest loop point from the pith line
    rmax = 0.0
    for uu, vv in allpts:
        wp = c0p + uu * e1 + vv * e2
        rmax = max(rmax, float(np.sqrt(wp @ wp)))

    polys = []
    if dot < 0.06:
        # Axis-parallel faces: COVERAGE-driven lines, evenly jittered across
        # the face's true perpendicular extent. (Radius-ladder line pairs
        # starve narrow faces far from the pith -- a tall beam's thin faces
        # got 0-2 lines. The book fills narrow faces evenly; so do we.)
        pu, pv = -dv, du
        proj_s = allpts[:, 0] * du + allpts[:, 1] * dv
        proj_p = allpts[:, 0] * pu + allpts[:, 1] * pv
        s0, s1 = float(proj_s.min()), float(proj_s.max())
        p0, p1 = float(proj_p.min()), float(proj_p.max())
        span, perp = s1 - s0, p1 - p0
        if span < 1e-9 or perp < 1e-9:
            return []
        step = span / 90.0
        svals = np.arange(s0 - step, s1 + 2 * step, step)
        n_lines = max(3, int(4 + 5 * dens))
        amp = min(perp * 0.06, ring_base * 0.2)
        for i in range(n_lines):
            f = (i + 0.5) / n_lines + rnd.uniform(-0.3, 0.3) / n_lines
            pval = p0 + f * perp
            off = amp * np.sin(2 * 6.28 * (svals - s0) / span
                               + rnd.random() * 6.28)
            pp = pval + off
            polys.append(np.column_stack([svals * du + pp * pu,
                                          svals * dv + pp * pv]))
        return polys

    # CONIC: well-conditioned quadratic -> (possibly very long) ellipses
    G = np.array([[e1 @ e1, e1 @ e2], [e1 @ e2, e2 @ e2]])
    bv = 2.0 * np.array([c0p @ e1, c0p @ e2])
    try:
        m = np.linalg.solve(G, -bv / 2.0)
    except Exception:
        return []
    lam, vec = np.linalg.eigh(G)
    if lam[0] < 1e-12:
        return []
    npts = int(np.clip(97 * (lam[1] / lam[0]) ** 0.25, 97, 641))
    t = np.linspace(0, 2 * math.pi, npts)
    cc = float(c0p @ c0p)
    for r in radii():
        if r > rmax + ring_base:
            break
        k = -(float(m @ (G @ m)) + float(bv @ m) + (cc - r * r))
        if k > 1e-14:
            r1, r2 = math.sqrt(k / lam[0]), math.sqrt(k / lam[1])
            wob = 1.0 + 0.04 * np.sin(3 * t + rnd.random() * 6)
            d = (np.outer(np.cos(t) * r1 * wob, vec[:, 0]) +
                 np.outer(np.sin(t) * r2 * wob, vec[:, 1]))
            polys.append(d + m[None, :])
    return polys


if run and pieces:
    try:
        breps = pieces if isinstance(pieces, list) else [pieces]
        breps = [b for b in breps if b is not None]
        bb = rg.BoundingBox.Empty
        for b in breps:
            bb.Union(b.GetBoundingBox(True))
        diag = bb.Diagonal.Length

        ax = axis
        if ax is None or (hasattr(ax, "Length") and ax.Length < 1e-9):
            d = bb.Diagonal
            ax = rg.Vector3d(1, 0, 0)
            best = -1
            for cand in (rg.Vector3d(1, 0, 0), rg.Vector3d(0, 1, 0),
                         rg.Vector3d(0, 0, 1)):
                ext = abs(d * cand)
                if ext > best:
                    best, ax = ext, cand
        a = rg.Vector3d(ax)
        a.Unitize()

        lift_v = float(lift) if lift else diag * 0.0008
        thr = float(end_threshold) if end_threshold else 0.15
        dens = float(density or 1.0)
        n_curves = 0
        face_lines = []

        # section frame perpendicular to the axis (shared by all pieces)
        e1 = rg.Vector3d.CrossProduct(a, rg.Vector3d(0, 0, 1))
        if e1.Length < 1e-6:
            e1 = rg.Vector3d.CrossProduct(a, rg.Vector3d(1, 0, 0))
        e1.Unitize()
        e2 = rg.Vector3d.CrossProduct(a, e1)
        e2.Unitize()

        for bi, b in enumerate(breps):
            # an Inward-oriented solid flips every face normal: lift must
            # respect the BREP's orientation, not only the face's
            ssign = -1.0 if b.SolidOrientation == \
                rg.BrepSolidOrientation.Inward else 1.0
            pbb = b.GetBoundingBox(True)
            pc = pbb.Center
            pd = pbb.Diagonal
            ext1 = abs(pd * e1) / 2.0
            ext2 = abs(pd * e2) / 2.0
            prnd = random.Random(0xA5 ^ (bi * 7919) ^
                                 (hash(round(pc.X + pc.Y + pc.Z, 3)) & 0xFFFF))
            pith = (rg.Point3d(pc) +
                    e1 * (ext1 * prnd.uniform(-0.45, 0.45)) +
                    e2 * (ext2 * prnd.uniform(-0.45, 0.45)))
            ring_base = min(ext1, ext2) / 4.0 * (0.9 + 0.2 * prnd.random())
            for fi, f in enumerate(b.Faces):
                plane = _face_plane(f)
                if plane is None:
                    continue
                n = rg.Vector3d(plane.Normal)
                n.Unitize()
                # OUTWARD normal from the surface itself -- TryGetPlane's
                # normal sign is arbitrary and must not be trusted for lift
                um = f.Domain(0).Mid
                vm = f.Domain(1).Mid
                out_n = f.NormalAt(um, vm)
                if f.OrientationIsReversed:
                    out_n.Reverse()
                out_n.Unitize()
                dot = abs(n * a)
                kind = "lines" if dot < 0.06 else "rings"

                loops = _loops_2d(f, plane)
                if not loops:
                    continue
                seg_a, seg_b = _segments(loops)
                allpts = np.vstack(loops)
                u0, u1 = allpts[:, 0].min(), allpts[:, 0].max()
                v0, v1 = allpts[:, 1].min(), allpts[:, 1].max()
                if (u1 - u0) < 1e-9 or (v1 - v0) < 1e-9:
                    continue

                dvec = a - n * (a * n)
                if dvec.Length < 1e-9:
                    dvec = plane.XAxis
                dvec.Unitize()
                du = dvec * plane.XAxis
                dv = dvec * plane.YAxis

                seed = hash((bi, fi, round(plane.Origin.X, 4),
                             round(plane.Origin.Y, 4),
                             round(plane.Origin.Z, 4))) & 0xFFFF
                rnd = random.Random(seed)
                # EMPIRICAL outward check: probe a point off the face along
                # the assumed normal; if it lands inside the solid, flip.
                # Immune to every orientation convention.
                flipped = ""
                ip = _face_inner_point(seg_a, seg_b, u0, u1, v0, v1, rnd)
                if ip is not None:
                    p3 = plane.Origin + plane.XAxis * float(ip[0]) \
                         + plane.YAxis * float(ip[1])
                    # two-sided probe, SMALL so it cannot pass through thin
                    # members; retry closer if both sides read outside
                    d0 = max(lift_v * 2.0, diag * 0.0003)
                    try:
                        for dp in (d0, d0 * 0.25):
                            fwd = b.IsPointInside(p3 + out_n * dp, 1e-9, True)
                            bwd = b.IsPointInside(p3 - out_n * dp, 1e-9, True)
                            if fwd and not bwd:
                                out_n = -out_n
                                flipped = " !"
                                break
                            if bwd and not fwd:
                                break            # normal confirmed outward
                            # both inside or both outside: probe again closer
                    except Exception:
                        pass
                lift_vec = out_n * lift_v

                polys2d = _rings_conic(plane, pith, a, allpts, du, dv,
                                       ring_base, dens, rnd, dot)
                n_face = 0
                for pts2d in polys2d:
                    mask = _mask_points(pts2d, seg_a, seg_b)
                    crvs = _runs_to_curves(pts2d, mask, plane, lift_vec,
                                           seg_a, seg_b)
                    for c in crvs:
                        grain.Add(c, GH_Path(bi))
                    n_face += len(crvs)
                n_curves += n_face
                face_lines.append("p{} f{}: dot={:.2f} -> {} ({} crv){}".format(
                    bi, fi, dot, kind, n_face, flipped))

        report.append("grain v{}: {} curves on {} piece(s)  lift {:.4f}  "
                      "end_threshold {:.2f}".format(
                          GRAIN_V, n_curves, len(breps), lift_v, thr))
        if len(face_lines) <= 28:
            report += face_lines
    except Exception as exc:
        report.append("ERROR: {}".format(exc))
else:
    report.append("wire kept + prosthesis into `pieces`, set run")
# ---------- end illustration ----------
edges_prosthesis = Python3Script(pieces=move.Geometry, lift=number_slider_8)  # -> out, edges, report; inputs pieces: Brep
# ---------- edges_prosthesis: Python ----------
"""GH Python 3 -- EDGES: brep edges lifted off the solid, catalogue-style.

Extracts every edge of the pieces and offsets it outward along the bisector
of its adjacent faces' normals, orientation verified EMPIRICALLY per edge
(probe point + Brep.IsPointInside), same as the grain component. Feed the
result into Custom Preview Lineweights (black, thickness 3-4) for the thick
book edges -- fully visible, never swallowed by the white shading.

Inputs:
    pieces  (Brep, list)
    lift    (float) [auto = 0.0008 x bbox diagonal, matching the grain]
    run     (bool)
Outputs:
    edges   lifted edge curves, one branch per piece
    report
"""
import Rhino.Geometry as rg
from Grasshopper import DataTree
from Grasshopper.Kernel.Data import GH_Path

EDGES_V = "1"
edges = DataTree[object]()
report = []
run = 'TRUE'

if run and pieces:
    try:
        breps = pieces if isinstance(pieces, list) else [pieces]
        breps = [b for b in breps if b is not None]
        bb = rg.BoundingBox.Empty
        for b in breps:
            bb.Union(b.GetBoundingBox(True))
        diag = bb.Diagonal.Length
        lift_v = float(lift) if lift else diag * 0.0008
        probe_d = max(lift_v * 4.0, diag * 0.002)

        n_edges = 0
        n_flip = 0
        for bi, b in enumerate(breps):
            for e in b.Edges:
                # outward-ish direction: bisector of adjacent face normals
                d = rg.Vector3d(0, 0, 0)
                for fidx in e.AdjacentFaces():
                    f = b.Faces[fidx]
                    um = f.Domain(0).Mid
                    vm = f.Domain(1).Mid
                    n = f.NormalAt(um, vm)
                    if f.OrientationIsReversed:
                        n.Reverse()
                    d += n
                if d.Length < 1e-9:
                    d = rg.Vector3d(0, 0, 1)
                d.Unitize()
                # empirical check at the edge midpoint
                tmid = e.Domain.Mid
                m = e.PointAt(tmid)
                try:
                    if b.IsPointInside(m + d * probe_d, 1e-6, True):
                        d = -d
                        n_flip += 1
                except Exception:
                    pass
                c = e.DuplicateCurve()
                c.Translate(d * lift_v)
                edges.Add(c, GH_Path(bi))
                n_edges += 1
        report.append("edges v{}: {} edge(s) on {} piece(s)  lift {:.4f}  "
                      "({} empirically flipped)".format(
                          EDGES_V, n_edges, len(breps), lift_v, n_flip))
    except Exception as exc:
        report.append("ERROR: {}".format(exc))
else:
    report.append("wire kept + prosthesis into `pieces`, set run")
# ---------- end edges_prosthesis ----------
panel_6 = Panel(illustration.report)
custom_preview = CustomPreview(Geometry=[illustration.grain, edges_prosthesis.edges], Material=ColourSwatch(SwatchColor=RGB(145, 145, 145)))

# ---- group: Prosthesis Visualisation
create_material = CreateMaterial(
    Diffuse=ColourSwatch(SwatchColor=RGB(0, 0, 0)),
    Specular=RGB(255, 255, 255),
    Emission=RGB(0, 0, 0),
    Transparency=0,
    Shine=0)
custom_preview_lineweights_2 = CustomPreviewLineweights(Geometry=move.Geometry, Shader=create_material, Thickness=Slider(7.1, range=0..10), Absolute=False)

# ---- group: Kept Visualisation
custom_preview_2 = CustomPreview(Geometry=[kept, python_3_script.rest], Material=ColourSwatch(SwatchColor=RGBA(0, 0, 0, 0)))

# ----
show_robot_collision = BooleanToggle(False)
show_rcf = BooleanToggle(False)

# ----
# Move Cartesian
# Move Joints
list_7 = ValueList({"send ik configuration": 0, "send one motion configuration": 1, "send all motion configurations": 2}, selected="send ik configuration")
filter = StreamFilter(Gate=list_7, Stream0=analytic_inverse.configuration, Stream1=analytic_inverse.configuration)
movej = Python3Script(configurations=analytic_inverse.configuration, velocity=Slider(0.038, range=0..0.5))  # -> urscript, lift, values; inputs configurations: list
# ---------- movej: Python ----------
from ur_fabrication_control.direct_control import URScript
from compas_robots import Configuration
import math

urscript = URScript()
urscript.start()
for configuration in configurations:
    joint_configuration = Configuration.from_revolute_values(configuration.revolute_values)
    print(joint_configuration)
    lift = configuration
    urscript.move_joint(joint_configuration, velocity)
urscript.end()

urscript = urscript.generate()

print(urscript)
# ---------- end movej ----------
send = Button()
ur_send = Python3Script(urscript=movej.urscript, send=send)  # -> out
# ---------- ur_send: Python ----------
from scriptcontext import sticky as st
from ur_fabrication_control.direct_control import send_script

ur_ip = st["ur_ip"]
ur_port = st["ur_port"]

print(urscript)

if send:
    send_script(urscript, ur_ip, ur_port)
# ---------- end ur_send ----------

# ----
# Move Cartesian
list_8 = ValueList({"send one cartesian position": 0, "send all cartesian positions": 1}, selected="send one cartesian position")
filter_2 = StreamFilter(Gate=list_8, Stream0=plane_3)
radius = Slider(0.003, range=0..0.5)
movel = Python3Script(robot=robot, planes_WCS=filter_2, velocity=Slider(0.05, range=0..0.5), radius=radius)  # -> urscript; inputs planes_WCS: list of Plane
# ---------- movel: Python ----------
import Rhino.Geometry as rg
from compas.geometry import Frame
from compas.geometry import Transformation, Rotation
from compas_rhino.conversions import plane_to_compas_frame
from compas_ghpython import draw_frame
from ur_fabrication_control import direct_control 
import math

from scriptcontext import sticky as st
from ur_fabrication_control.direct_control import URScript

# retrieve the current tool frame in axis angle format
if robot.attached_tool:
    tool_angle_axis = list(robot.attached_tool.frame.point) + list(robot.attached_tool.frame.axis_angle_vector)
else:
    tool0_frame = Frame([0, 0, 0], [1, 0, 0], [0, 1, 0])
    tool_angle_axis = list(tool0_frame.point) + list(tool0_frame.axis_angle_vector)

frames_RCS = []
for plane_WCS in planes_WCS:
    frame_WCS = plane_to_compas_frame(plane_WCS)
    pose = frame_WCS.point.__data__ + frame_WCS.axis_angle_vector.__data__
    x = "p[{}, {}, {}, {}, {}, {}]".format(*pose)
    print(x)
    frame_RCS = frame_WCS # Transform the frame if the robot is not at WCF. In this case, it is not necessary.
    frames_RCS.append(frame_RCS)

urscript = URScript()
urscript.start()
urscript.set_tcp(tool_angle_axis)
for frame_RCS in frames_RCS:
    urscript.move_linear(frame=frame_RCS, velocity=velocity, radius=radius)
urscript.end()

urscript = urscript.generate()

print(urscript)
# ---------- end movel ----------
send_2 = Button()
ur_send_2 = Python3Script(urscript=movel, send=send_2)  # -> out
# ---------- ur_send_2: Python ----------
from scriptcontext import sticky as st
from ur_fabrication_control.direct_control import send_script

ur_ip = st["ur_ip"]
ur_port = st["ur_port"]

if send:
    send_script(urscript, ur_ip, ur_port)
# ---------- end ur_send_2 ----------

number_slider_9 = Slider(0.05, range=0..0.5)
radius_2 = Slider(0.003, range=0..0.5)
py3_4 = Python3Script()  # -> out, urscript
# ---------- py3_4: Python ----------
from __future__ import absolute_import
from ur_fabrication_control.direct_control.urscript import URScript
import os

class AMBMotorMixins:
    def drill_on(self, sleep=1.0, indent=1):
        """Turn on the drill.
        """
        self.add_digital_out(4, True, indent=indent)
        self.add_line("\tsleep({})".format(sleep), indent=indent)

    def speed_control(self, voltage=.5, indent=1):
        self.add_analog_out(1, voltage, indent=indent)

    def drill_off(self, sleep=1.0, indent=1):
        """Turn off the drill.
        """
        self.add_digital_out(4, False, indent=indent)
        self.add_line("\tsleep({})".format(sleep), indent=indent)

class URScript_AMBMotor(URScript, AMBMotorMixins):
    pass


urscript = URScript_AMBMotor()
urscript.start()
urscript.drill_on()
urscript.speed_control()
urscript.end()
urscript = urscript.generate()

print(urscript)
# ---------- end py3_4 ----------
send_3 = Button()
movep = Python3Script(robot=robot, planes_WCS=pln, velocity=number_slider_9, radius=radius_2)  # -> urscript; inputs planes_WCS: list of Plane
# ---------- movep: Python ----------
import Rhino.Geometry as rg
from compas.geometry import Frame
from compas.geometry import Transformation, Rotation
from compas_rhino.conversions import plane_to_compas_frame
from ur_fabrication_control import direct_control 
import math

from scriptcontext import sticky as st
from ur_fabrication_control.direct_control import URScript

# retrieve the current tool frame in axis angle format
if robot.attached_tool:
    tool_angle_axis = list(robot.attached_tool.frame.point) + list(robot.attached_tool.frame.axis_angle_vector)
else:
    tool0_frame = Frame([0, 0, 0], [1, 0, 0], [0, 1, 0])
    tool_angle_axis = list(tool0_frame.point) + list(tool0_frame.axis_angle_vector)

def planes_to_frames_rcs(planes_WCS, transform_to_rcs=None, print_poses=True):
    """
    Convert WCS planes to COMPAS frames and optionally transform them to RCS.

    Parameters
    ----------
    planes_WCS : list
        List of planes in the World Coordinate System.
    transform_to_rcs : callable, optional
        Function that takes a frame_WCS and returns a frame_RCS.
        If None, no transformation is applied.
    print_poses : bool, optional
        Print UR-style pose strings.

    Returns
    -------
    list
        List of frames in Robot Coordinate System.
    """
    
    frames_RCS = []

    for plane_WCS in planes_WCS:
        frame_WCS = plane_to_compas_frame(plane_WCS)

        pose = (
            frame_WCS.point.__data__
            + frame_WCS.axis_angle_vector.__data__
        )

        if print_poses:
            print("p[{}, {}, {}, {}, {}, {}]".format(*pose))

        frame_RCS = (
            transform_to_rcs(frame_WCS)
            if transform_to_rcs
            else frame_WCS
        )

        frames_RCS.append(frame_RCS)

    return frames_RCS

frames_RCS = planes_to_frames_rcs(planes_WCS)

"""
frames_RCS = []
for plane_WCS in planes_WCS:
    frame_WCS = plane_to_compas_frame(plane_WCS)
    pose = frame_WCS.point.__data__ + frame_WCS.axis_angle_vector.__data__
    x = "p[{}, {}, {}, {}, {}, {}]".format(*pose)
    print(x)
    frame_RCS = frame_WCS # Transform the frame if the robot is not at WCF. In this case, it is not necessary.
    frames_RCS.append(frame_RCS)
"""

urscript = URScript()
urscript.start()
urscript.set_tcp(tool_angle_axis)
for frame_RCS in frames_RCS:
    urscript.move_process(frame=frame_RCS, velocity=velocity, radius=radius)
urscript.end()

urscript = urscript.generate()

print(urscript)
# ---------- end movep ----------
milling_tool = Python3Script(robot=robot, planes_WCS=pln, velocity=number_slider_9, radius=radius_2)  # -> urscript; inputs planes_WCS: list of Plane
# ---------- milling_tool: Python ----------
import Rhino.Geometry as rg
from compas.geometry import Frame
from compas.geometry import Transformation, Rotation
from compas_rhino.conversions import plane_to_compas_frame
from ur_fabrication_control import direct_control 
import math

from scriptcontext import sticky as st
from ur_fabrication_control.direct_control import URScript

# retrieve the current tool frame in axis angle format
if robot.attached_tool:
    tool_angle_axis = list(robot.attached_tool.frame.point) + list(robot.attached_tool.frame.axis_angle_vector)
else:
    tool0_frame = Frame([0, 0, 0], [1, 0, 0], [0, 1, 0])
    tool_angle_axis = list(tool0_frame.point) + list(tool0_frame.axis_angle_vector)

def planes_to_frames_rcs(planes_WCS, transform_to_rcs=None, print_poses=True):
    """
    Convert WCS planes to COMPAS frames and optionally transform them to RCS.

    Parameters
    ----------
    planes_WCS : list
        List of planes in the World Coordinate System.
    transform_to_rcs : callable, optional
        Function that takes a frame_WCS and returns a frame_RCS.
        If None, no transformation is applied.
    print_poses : bool, optional
        Print UR-style pose strings.

    Returns
    -------
    list
        List of frames in Robot Coordinate System.
    """
    
    frames_RCS = []

    for plane_WCS in planes_WCS:
        frame_WCS = plane_to_compas_frame(plane_WCS)

        pose = (
            frame_WCS.point.__data__
            + frame_WCS.axis_angle_vector.__data__
        )

        if print_poses:
            print("p[{}, {}, {}, {}, {}, {}]".format(*pose))

        frame_RCS = (
            transform_to_rcs(frame_WCS)
            if transform_to_rcs
            else frame_WCS
        )

        frames_RCS.append(frame_RCS)

    return frames_RCS


class AMBMotorMixins:
    def drill_on(self, sleep=1.0, indent=1):
        """Turn on the drill.
        """
        self.add_digital_out(4, True, indent=indent)
        self.add_line("\tsleep({})".format(sleep), indent=indent)

    def speed_control(self, voltage=.5, indent=1):
        self.add_analog_out(1, voltage, indent=indent)

    def drill_off(self, sleep=1.0, indent=1):
        """Turn off the drill.
        """
        self.add_digital_out(4, False, indent=indent)
        self.add_line("\tsleep({})".format(sleep), indent=indent)

class URScript_AMBMotor(URScript, AMBMotorMixins):
    pass

frames_RCS = planes_to_frames_rcs(planes_WCS)

"""
frames_RCS = []
for plane_WCS in planes_WCS:
    frame_WCS = plane_to_compas_frame(plane_WCS)
    pose = frame_WCS.point.__data__ + frame_WCS.axis_angle_vector.__data__
    x = "p[{}, {}, {}, {}, {}, {}]".format(*pose)
    print(x)
    frame_RCS = frame_WCS # Transform the frame if the robot is not at WCF. In this case, it is not necessary.
    frames_RCS.append(frame_RCS)
"""

urscript = URScript_AMBMotor()
urscript.start()
urscript.drill_on()
urscript.speed_control()
urscript.set_tcp(tool_angle_axis)
for frame_RCS in frames_RCS:
    urscript.move_process(frame=frame_RCS, velocity=velocity, radius=radius)
urscript.drill_off()
urscript.end()

urscript = urscript.generate()

print(urscript)
# ---------- end milling_tool ----------
ur_send_3 = Python3Script(urscript=py3_4.urscript, send=send_3)  # -> out; same code as ur_send_2
send_4 = Button()
ur_send_4 = Python3Script(urscript=movep, send=send_4)  # -> out; same code as ur_send_2

# ----
# Stop
stop = Button()
stop_2 = Python3Script(stop=stop)
# ---------- stop_2: Python ----------
from scriptcontext import sticky as st
from ur_fabrication_control.direct_control.common import send_stop

ur_ip = st["ur_ip"]
ur_port = st["ur_port"]

if stop:
    send_stop(ur_ip, ur_port)
# ---------- end stop_2 ----------

panel_7 = Panel(movej.urscript)

# ----
# Get Pose Joint
get = Button()
pose = Python3Script(get=get)  # -> out, configuration, pose_joints
# ---------- pose: Python ----------
from scriptcontext import sticky as st
from ur_fabrication_control.direct_control.common import get_current_pose_joints
from compas.geometry import Frame
from compas_robots import Configuration


server_ip = st["server_ip"]
server_port = st["server_port"]
ur_port = st["ur_port"]
ur_ip = st["ur_ip"]
print(ur_ip)

guid = str(ghenv.Component.InstanceGuid)
pose_joints_key = "pose_joints" + guid

if pose_joints_key not in st:
    st[pose_joints_key] = None

# retrieve the current tool frame in axis angle format
if robot.attached_tool:
    tool_angle_axis = list(robot.attached_tool.frame.point) + list(robot.attached_tool.frame.axis_angle_vector)
else:
    tool0_frame = Frame([0, 0, 0], [1, 0, 0], [0, 1, 0])
    tool_angle_axis = list(tool0_frame.point) + list(tool0_frame.axis_angle_vector)

print(tool_angle_axis)

# send script to the robot to receive the current joint configuration
if get:
    st[pose_joints_key] = get_current_pose_joints(server_ip, server_port, ur_ip, ur_port, tool_angle_axis)

if st[pose_joints_key] is not None:
    print(st[pose_joints_key])
    configuration = Configuration.from_revolute_values(st[pose_joints_key])
    pose_joints = configuration.joint_values
"""
if pose_joints_key not in st:
    configuration = Configuration.from_revolute_values([0,0,0,0,0,0])
else:
    configuration = Configuration.from_revolute_values(st[pose_joints_key])

pose_joints = configuration.values
"""
# ---------- end pose ----------
panel_8 = Panel(pose.pose_joints)

# ----
# Visualisation
list_9 = ValueList({"0 zero_configuration": 0, "1 forward_kinematics": 1, "2 analytic_inverse_kinematics": 2, "3 inverse_kinematics": 3, "4 motion_planning": 4, "5 real_configuration": 5, "6 assembly": 6}, selected="2 analytic_inverse_kinematics")
filter_3 = StreamFilter(
    Gate=list_9,
    Stream0=zero.configuration,
    Stream1=forward_kinematics,
    Stream2=analytic_inverse.configuration,
    Stream3=inverse.configuration,
    Stream5=draw)
show_collision = BooleanToggle(False)
show_eef = BooleanToggle(True)
show_frames = BooleanToggle(True)
show_visual = BooleanToggle(True)
show_attached_collision = BooleanToggle(False)
show_bcf = BooleanToggle(True)
visualise = Python3Script(
    robot=robot,
    configuration=filter_3,
    show_frames=show_frames,
    show_visual_meshes=show_visual,
    show_robot_collision_meshes=show_robot_collision,
    show_collision_meshes=show_collision,
    show_attached_collision_meshes=show_attached_collision,
    show_BCF=show_bcf,
    show_RCF=show_rcf,
    show_EEF=show_eef,
    bang=[set_frame, attach_tool.bang])  # -> out, joint_planes, visual_meshes, robot_collision_meshes, collision_meshes, attached_meshes, BCF, RCF, EEF, EEF_in_RCF; inputs bang: list
# ---------- visualise: Python ----------
from scriptcontext import sticky as st
import time
from compas_ghpython import create_id
from compas.geometry import Frame
from compas.geometry import Transformation
from compas_rhino.conversions import frame_to_rhino, mesh_to_compas, mesh_to_rhino, frame_to_rhino_plane
from compas.scene import SceneObject
from compas_fab.robots import PlanningScene
import Rhino.Geometry as rg
import ghpythonlib.components as ghcomp

robot.update(configuration)
print(configuration)

if show_visual_meshes == True:
    visual_meshes = robot.draw_visual()
    # orient the robot to its base plane:
    robot_BCF = frame_to_rhino_plane(robot.BCF) 
    init_robot_plane = rg.Plane.WorldXY
    #visual_meshes = ghcomp.Orient(visual_meshes, init_robot_plane, robot_BCF)[0]

if show_frames == True: 
    joint_frames = robot.model.transformed_frames(configuration)
    joint_planes = [frame_to_rhino(a) for a in joint_frames]

if show_BCF:
    BCF = frame_to_rhino(robot.BCF)

if show_RCF:
    RCF = frame_to_rhino(robot.from_BCF_to_WCF(robot.RCF))

if show_EEF:
    # EEF_in_RCF = frame_to_rhino(robot.from_BCF_to_RCF(robot.forward_kinematics(
    #     configuration, options=dict())))
    EEF = frame_to_rhino(robot.from_BCF_to_WCF(robot.forward_kinematics(
        configuration, options=dict())))
    print(EEF)


if show_robot_collision_meshes == True:
    robot_collision_meshes = robot.draw_collision()

cached_scene_key = "cached_scene"

if show_collision_meshes or show_attached_collision_meshes:
    cached_scene = st.get(cached_scene_key)
    if not cached_scene:
        cached_scene = {"time": 0}

    update_scene = True

    if update_scene:
        scene = PlanningScene(robot)
        scene = robot.client.get_planning_scene()

    if update_scene and show_collision_meshes:
        collision_meshes = []

        for co in scene.world.collision_objects:
            print(co)
            header = co.header
            frame_id = header.frame_id
            cms = co.to_collision_meshes()

            for cm in cms:
                if cm.frame != Frame.worldXY():
                    t = Transformation.from_frame(cm.frame)
                    mesh = cm.mesh.transformed(t)
                else:
                    mesh = cm.mesh
                collision_meshes.extend(SceneObject(item=mesh).draw())

        cached_scene["cm"] = collision_meshes

        collision_meshes = cached_scene.get("cm", [])

    if update_scene and show_attached_collision_meshes:
        attached_meshes = []

        for aco in scene.robot_state.attached_collision_objects:
            for acm in aco.to_attached_collision_meshes():
                print(acm)
                frame_id = aco.object["header"]["frame_id"]
                frame = robot.forward_kinematics(configuration, options=dict(link=frame_id))
                t = Transformation.from_frame(frame)

                # Local CM frame
                if acm.collision_mesh.frame and acm.collision_mesh.frame != Frame.worldXY():
                    t = t * Transformation.from_frame(acm.collision_mesh.frame)

                mesh = acm.collision_mesh.mesh.transformed(t)

                attached_meshes.extend(SceneObject(item=mesh).draw())

        cached_scene["acm"] = attached_meshes

        attached_meshes = cached_scene.get("acm", [])
    
    cached_scene["time"] = time.time()
    st[cached_scene_key] = cached_scene
# ---------- end visualise ----------
pln_5 = Plane(visualise.joint_planes)
mesh_2 = Mesh(visualise.visual_meshes)
mesh_3 = Mesh(visualise.collision_meshes)
py3_5 = Python3Script(planes=[visualise.EEF, visualise.BCF, visualise.RCF], scale=Slider(0.2, range=0..1))  # -> P, V, C, W; inputs planes: list of Plane, scale: Double
# ---------- py3_5: Python ----------
from Rhino.Display import ColorRGBA
from ghpythonlib.components import ColourRGBf


red = ColourRGBf(255, 255, 0, 0)
green = ColourRGBf(255, 0, 255, 0)
blue = ColourRGBf(255, 0, 0, 255)

P = []
V = []
C = []

# scale = float(scale)

for plane in planes:
    if not plane:
        continue
    P += [plane.Origin] * 3
    V.append(plane.XAxis * scale)
    V.append(plane.YAxis * scale)
    V.append(plane.ZAxis * scale)
    C += [red, green, blue]

W = 3
# ---------- end py3_5 ----------
vdisex = VectorDisplayEx(Point=py3_5.P, Vector=py3_5.V, Colour=py3_5.C, Width=py3_5.W)

item = ListItem(List=pln_5, Index=Slider(18, range=0..37), Wrap=True)
mesh_4 = Mesh(visualise.attached_meshes)
eef_in_rcf = Plane(visualise.EEF_in_RCF)
eef = Plane(visualise.EEF)
mesh_5 = Mesh(visualise.robot_collision_meshes)

orient_3 = Orient(Geometry=mesh_2, Source=PlaneXY(0, 0, 0), Target=visualise.BCF)  # -> Geometry, Transform

preview = CustomPreview(Geometry=orient_3.Geometry, Material=ColourSwatch(SwatchColor=RGB(0, 0, 0)))

# ----
# Get Pose Cartesian
get_2 = Button()
pose_2 = Python3Script(get=get_2)  # -> out, pose_cartesian
# ---------- pose_2: Python ----------
from scriptcontext import sticky as st
#from ur_fabrication_control.online_control.ur_direct import get_current_pose_cartesian

from ur_fabrication_control.direct_control.common import get_current_pose_cartesian
from compas.geometry import Frame
#from compas_ghpython import draw_frame


server_ip = st["server_ip"]
server_port = st["server_port"]
ur_port = st["ur_port"]
ur_ip = st["ur_ip"]
pose_cartesian_meter = []

# retrieve the current tool frame in axis angle format
if robot.attached_tool:
    print("attached")
    tool_angle_axis = list(robot.attached_tool.frame.point) + list(robot.attached_tool.frame.axis_angle_vector)
    
else:
    tool0_frame = Frame([0, 0, 0], [1, 0, 0], [0, 1, 0])
    tool_angle_axis = list(tool0_frame.point) + list(tool0_frame.axis_angle_vector)

guid = str(ghenv.Component.InstanceGuid)
pose_cartesian_key = "pose_cartesian" + guid

if pose_cartesian_key not in st:
    st[pose_cartesian_key] = None

if get:
    print("getting pose")
    st[pose_cartesian_key] = get_current_pose_cartesian(tool_angle_axis, server_ip, server_port, ur_ip, ur_port, send=True)
    
pose_cartesian = st[pose_cartesian_key]
# ---------- end pose_2 ----------
python = Python3Script(pose=pose_2.pose_cartesian)  # -> out, plane
# ---------- python: Python ----------
__author__ = "Gido"
__version__ = "2023.07.05"

import rhinoscriptsyntax as rs
from compas.geometry import Frame
from compas_ghpython import draw_frame

if pose is not None:
    frame_RCS = Frame.from_axis_angle_vector(pose[3:6], pose[0:3])
    T = Transformation.from_change_of_basis(robot.RCF, Frame.worldXY())
    frame_WCS = frame_RCS.transformed(T)
    plane = draw_frame(frame_WCS)
# ---------- end python ----------

# ----
# Direct UR control
rec = DataRecorder(pose_2.out, DataLimit=-10, RecordData=True)

panel_9 = Panel(rec)
