# Grasshopper definition mobile_robot_repair_scanning.gh (Grasshopper 1.0.8)
# plug-ins: RhinoCodePluginGH

# ----
# IP Settings
# --> Set your IP address
# --> Set robot IP address
server_ip = ValueList({"192.168.0.67", "192.168.10.12", "192.168.10.11", "192.168.10.10", "192.168.10.2", "127.0.0.1", "192.168.10.111", "192.168.0.45", "192.168.0.30", "10.42.0.212", "10.42.0.133"}, selected="192.168.0.45")
ur_ip = ValueList({"192.168.10.10", "192.168.10.20", "192.168.10.11", "192.168.10.12", "127.0.0.1", "192.168.10.111", "192.168.0.210", "192.168.0.211", "192.168.0.235", "192.168.0.30"}, selected="192.168.0.210")
server_port = ValueList({"50002", "50003", "50005", "50006", "50007", "50008", "50009", "50010", "50011", "50012", "50013", "50014", "50015", "50016", "50017", "50018", "50019", "50020", "50021", "50022", "50023", "50024", "50025", "50026", "50027", "50028"}, selected="50005")
ur_port = ValueList({"30002"}, selected="30002")
globals = Python3Script(server_ip=server_ip, server_port=server_port, ur_ip=ur_ip, ur_port=ur_port, clear=Button())  # inputs server_ip: String, server_port: Int32, ur_ip: String, ur_port: Int32
# ---------- globals: Python ----------
from scriptcontext import sticky as st

st["server_ip"] = server_ip
st["server_port"] = server_port

st["ur_ip"] = ur_ip
st["ur_port"] = ur_port

if clear:
    st.clear()
# ---------- end globals ----------

# ----
# Check if UR robot
#  is available
ping = Button()
ping_2 = Python3Script(ip=ur_ip, ping=ping)  # -> out; inputs ip: String
# ---------- ping_2: Python ----------
from scriptcontext import sticky as st
from ur_fabrication_control.direct_control.utilities import is_available

guid = str(ghenv.Component.InstanceGuid)
txt_key = "txt_" + guid
if txt_key not in st:
    st[txt_key] = ""

if ping:
    
    available = is_available(ip)
    
    if available:
        st[txt_key] = "%s is up!" % ip
        trigger = True
    else:
        st[txt_key] = "%s is down!" % ip
        trigger = False

print(st[txt_key])
# ---------- end ping_2 ----------
panel = Panel(ping_2)

# ---- group: save_paths
savedirectory = Python3Script(folder_name="patches", patch_id=Slider(0, range=0..10), create_dir=Button())  # -> out, dir_exists, DATA, DIR; inputs patch_id: Int32
# ---------- savedirectory: Python ----------
import os

#package_path = os.path.dirname(mobile_fabrication_control.__file__)
#DATA = os.path.abspath(os.path.join(package_path,"../../data"))

package_path = ghdoc.Path
# package_path = os.path.dirname(ur_fabrication_control.__file__)
#DATA = os.path.abspath(os.path.join(package_path,"../../data"))

# .stl files not stored in am_hackathon repo. but in mobile_fabrication_control
DATA = os.path.abspath(os.path.join(package_path,"../../data"))

DIR = os.path.join(DATA, folder_name, f"patch_{patch_id}")
print(DIR)
if os.path.isdir(DIR):
    dir_exists = "true"
else:
    dir_exists = "false"
    if create_dir:
        os.mkdir(DIR)
print(package_path)
print(DATA)
# ---------- end savedirectory ----------
file = Python3Script(DIR=savedirectory.DIR, filename="measurements", ext="ply")  # -> PATH
# ---------- file: Python ----------
import os
import datetime

date = today = datetime.date.today()
# print(date.year, date.month, date.day)

name = f"{filename}_{date}.{ext}"
PATH = os.path.join(DIR, name)
# ---------- end file ----------
panel_2 = Panel(file)
file_2 = Python3Script(DIR=savedirectory.DIR, filename="reference_points", ext="ply")  # -> PATH; same code as file
panel_3 = Panel(file_2)
panel_4 = Panel(savedirectory.dir_exists)

# ----
# ROBOT
button = Button()
py3 = Python3Script()  # -> HERE, DATA, ROBOT_DESCRIPTION
# ---------- py3: Python ----------
import os

HERE = os.path.dirname(ghdoc.Path)
DATA = os.path.abspath(os.path.join(HERE, "..", "data"))
ROBOT_DESCRIPTION = os.path.abspath(os.path.join(DATA, "robot_description"))

print(HERE)
print(DATA)
print(ROBOT_DESCRIPTION)
# ---------- end py3 ----------
reload = Python3Script(reload=button)  # -> out
# ---------- reload: Python ----------
if reload:
    from compas_rhino import unload_modules
    unload_modules("assembly_information_model")
    unload_modules('mobile_robot_control')
    unload_modules('fabrication_manager')
    unload_modules('ur_fabrication_control')
    unload_modules('spaicr')
    unload_modules('workshop_robarch_2026')
# ---------- end reload ----------

ros2 = BooleanToggle(True)

# ----
# ROS client
list = ValueList({"local": "127.0.0.1", "linux computer new": "192.168.0.235", "linux computer": "192.168.0.88", "linux eduroam": "10.181.95.254", "linux ccnet": "192.168.0.102", "linux vmware": "192.168.199.36", "robot": "192.168.0.200", "robotAA_wifi": "192.168.0.111", "robotAB_wifi": "192.168.0.112", "robotAB_eduroam": "10.181.67.95"}, selected="robot")
connect = BooleanToggle(True)
ros = Python3Script(ip=list, port="9090", connect=connect)  # -> out, ros_client, is_connected; inputs ip: String, port: Int32, connect: Boolean
# ---------- ros: Python ----------
"""
Connect or disconnect to ROS.

COMPAS FAB v0.27.0
"""
from scriptcontext import sticky as st

from compas_fab.backends import RosClient

ros_client = None

ip = ip or '127.0.0.1'
port = port or 9090
key = "ros_client_001"
ros_client = st.get(key, None)

if ros_client:
    st[key].close()
if connect:
    st[key] = RosClient(ip, port)
    st[key].run(5)

ros_client = st.get(key, None)
is_connected = ros_client.is_connected if ros_client else False
# ---------- end ros ----------
panel_5 = Panel(ros.is_connected)

# ----
# Load robot from ROS
load = Button()
# Make sure that ros bridge, file server, tf2_web_republisher and moveit config is running on the robot!
mobile_robot = Python3Script(ros_client=ros.ros_client, prefix="robot", ros2=ros2, load=load)  # -> out, mobile_robot; inputs prefix: String; disabled
# ---------- mobile_robot: Python ----------
"""
Load robot directly from ROS.

COMPAS FAB v0.27.0
"""
from mobile_robot_control.mobile_robot import MobileRobot
from mobile_robot_control.mobile_robot_client import MobileRobotClient
import compas_robots.ghpython

# from ghpythonlib.componentbase import executingcomponent as component
from scriptcontext import sticky as st
import Rhino
import scriptcontext

scriptcontext.doc = Rhino.RhinoDoc.ActiveDoc

from compas_robots import RobotModel
from compas_robots.ghpython.scene import RobotModelObject
from compas.scene import SceneObject

scriptcontext.doc = ghdoc

key = 'robot_AA'

if ros2:
    rst = "robot_state_publisher:"
    mg = "move_group:"
else:
    rst = ""
    mg = ""

print(key)
if ros_client and ros_client.is_connected and load:
    # Load URDF from ROS
    robot = ros_client.load_robot(
            load_geometry=True, 
            urdf_param_name= '{}/{}robot_description'.format(prefix, rst),
            srdf_param_name= '{}robot_description_semantic'.format(mg))
    try:
        robot.scene_object = SceneObject(item=robot.model)
    except:
        robot.scene_object = RobotModelObject(robot.model)
    #mobile_robot = MobileRobot(robot.model, robot.scene_object, robot.semantics, client=None)
    st[key] = robot

mobile_robot = st.get(key, None)
if mobile_robot:  # client sometimes need to be restarted, without needing to reload geometry
    mobile_robot.mobile_client = MobileRobotClient(ros_client)
    mobile_robot.client = ros_client
# ---------- end mobile_robot ----------

# ----
# Load robot locally
list_2 = ValueList({"rbvogui_xl_ur20", "rbvogui_xl_ur10e", "husky", "husky_ur10e"}, selected="rbvogui_xl_ur20")
py3_2 = Python3Script()  # -> mobile_robot_data_path, ur_data_path
# ---------- py3_2: Python ----------
import os

"""
ASSUMING THE BELOW PACKAGES ARE STORED IN THE SAME LOCATION:
    ur_fabrication_control;
    rbvogui_common; and
    mobile_additive_manufacturing.
"""

repositories_path = os.path.abspath(os.path.join(ghdoc.Path,"../../../"))

assert os.path.exists(os.path.join(repositories_path, "ur_fabrication_control/data"))
assert os.path.exists(os.path.join(repositories_path, "mobile_robot_control/data"))

ur_data_path = os.path.abspath(os.path.join(ghdoc.Path,"../../../ur_fabrication_control/data"))
mobile_robot_data_path = os.path.abspath(os.path.join(ghdoc.Path,"../../../mobile_robot_control/data"))
# ---------- end py3_2 ----------
py3_3 = Python3Script(mobile_robot_data_path=py3_2.mobile_robot_data_path, ur_data_path=py3_2.ur_data_path, robot_type=list_2)  # -> loaders, urdf_filename, srdf_filename
# ---------- py3_3: Python ----------
import os
from compas_robots import RobotModel
from compas_robots.resources import LocalPackageMeshLoader

import compas_fab

#loaders

ur_path = os.path.join(ur_data_path, "robot_description")
ur_packages = ["ur_e_description", "ur_description"]
ur_loaders = [LocalPackageMeshLoader(ur_path, pck) for pck in ur_packages]

mobile_robot_path = os.path.join(mobile_robot_data_path, "robot_description", robot_type)
if "rbvogui" in robot_type:
    mobile_robot_packages = ["rbvogui_description", "ewellix_description", "robotnik_sensors"]
elif "husky" in robot_type:
    mobile_robot_packages = ["a200"]
mobile_robot_loaders = [LocalPackageMeshLoader(mobile_robot_path, pck) for pck in mobile_robot_packages]

loaders = ur_loaders + mobile_robot_loaders

#files
urdf_filename = os.path.join(mobile_robot_path, r"{}.urdf".format(robot_type))

if "rbvogui" in robot_type:
    srdf_filename = os.path.join(mobile_robot_path, r"rbvogui.srdf")
elif "husky" in robot_type:
    srdf_filename = os.path.join(mobile_robot_path, r"husky.srdf")

assert os.path.isfile(urdf_filename)
assert os.path.isfile(srdf_filename)
# ---------- end py3_3 ----------
units = ValueList({"m": 1, "cm": 100, "mm": 1000}, selected="m")
load_2 = Button()
mobile_robot_2 = Python3Script(
    robot_type=list_2,
    loaders=py3_3.loaders,
    urdf_filename=py3_3.urdf_filename,
    srdf_filename=py3_3.srdf_filename,
    scale_factor=units,
    load=load_2)  # -> out, mobile_robot; inputs loaders: list
# ---------- mobile_robot_2: Python ----------
"""
Load robot directly from ROS.

COMPAS FAB v0.27.0
"""
from mobile_robot_control.mobile_robot import MobileRobot
from mobile_robot_control.mobile_robot_client import MobileRobotClient
import compas_robots.ghpython
import compas
from compas.geometry import Rotation
import math

# from ghpythonlib.componentbase import executingcomponent as component
from scriptcontext import sticky as st
import Rhino
import scriptcontext

scriptcontext.doc = Rhino.RhinoDoc.ActiveDoc

from compas_robots import RobotModel
from compas_robots.ghpython.scene import RobotModelObject
from compas_fab.robots import RobotSemantics
from compas.scene import SceneObject

scriptcontext.doc = ghdoc

compas.PRECISION = '12f'

key = 'robot_AA'


print(key)
if load:
    # Load URDF locally
    model = RobotModel.from_urdf_file(urdf_filename)
    model.load_geometry(*loaders)
    try:
        scene_object = SceneObject(item=model)
    except:
        scene_object = RobotModelObject(model)
    semantics = RobotSemantics.from_srdf_file(srdf_filename, model)
    mobile_robot = MobileRobot(model, scene_object, semantics, client=None)    

    st[key] = mobile_robot

mobile_robot = st.get(key, None)
# ---------- end mobile_robot_2 ----------
add_client = Python3Script(mobile_robot=mobile_robot_2.mobile_robot, ros_client=ros.ros_client)  # -> out, mobile_robot
# ---------- add_client: Python ----------
from mobile_robot_control.mobile_robot_client import MobileRobotClient

if ros_client is not None:
    mobile_robot.mobile_client = MobileRobotClient(ros_client)
    # mobile_robot._update_RCF(online=True)
# ---------- end add_client ----------

number_slider = Slider(2, range=0..10)
# Load pointcloud from ROS
panel_6 = Panel("profile_sensor_pointcloud_printed")
py3_4 = Python3Script(name=panel_6, version=number_slider)  # -> out, filename; inputs segment_nr: Int32, version: Int32
# ---------- py3_4: Python ----------
import datetime
dt = str(datetime.date.today())
filename = dt+'_'+name+'_seg'+str(segment_nr)+'_v'+str(version)+'.json'
# ---------- end py3_4 ----------

save_to_file = Button()
reference_points = Point([<point referenced from the Rhino model> x9])
filepath = FilePath(file_2)

# ----
# Service calls
start = Button()
stop = Button()
py3_5 = Python3Script(ros_client=ros.ros_client, start_assembly=start, stop_assembly=stop)  # -> out
# ---------- py3_5: Python ----------
from roslibpy import Service, ServiceRequest

if start_assembly:
    start_srv = Service(ros_client, "/line_scanner/assemble/start", "std_srvs/Trigger")
    start_srv.call(ServiceRequest())

if stop_assembly:
    finish_srv = Service(ros_client, "/line_scanner/assemble/finish", "std_srvs/Trigger")
    finish_srv.call(ServiceRequest())
# ---------- end py3_5 ----------

# ----
# Load pointcloud from file
toggle = BooleanToggle(False)
path = FilePath("C:\Users\Gido\Documents\workspace\development\mobile_part_based_am\data\2024-07-04_depth_camera_pointcloud_seg0_v0.json")
from_file = Python3Script(json_cloud=path, show_points=toggle)  # -> out, points_out
# ---------- from_file: Python ----------
from compas.geometry import Point
from compas_rhino.conversions import point_to_rhino
from workshop_robarch_2026.pointcloud_publisher import PointCloud2

import csv
import json

def load_points_from_file(list_file):
    with open(list_file, "r") as f:
        data = json.load(f)
    return data


if show_points:
    msg = load_points_from_file(json_cloud)
    pointcloud = PointCloud2.from_msg(msg)
    points_out = [point_to_rhino(pt) for pt in pointcloud.points]
# ---------- end from_file ----------

# ----
# add tcp and payload
number_slider_2 = Slider(0.05, range=0..1)
py3_6 = Python3Script(robot=mobile_robot.mobile_robot, ros_client=ros.ros_client)  # -> out, mobile_robot; disabled
# ---------- py3_6: Python ----------
from mobile_robot_control.mobile_robot import MobileRobot
from mobile_robot_control.mobile_robot_client import MobileRobotClient

mobile_robot = MobileRobot(robot.model, robot.scene_object, robot.semantics, client=None)
mobile_robot.mobile_client = MobileRobotClient(ros_client)
#mobile_robot.client = ros_client
# ---------- end py3_6 ----------
toggle_2 = BooleanToggle(True)

points_to_pcd = Python3Script(points=reference_points, filepath=filepath, write=save_to_file)  # -> out, pcd; inputs points: list of Point3d
# ---------- points_to_pcd: Python ----------
import open3d

array = [[x,y,z] for x, y, z in iter(points)]
pcd = open3d.geometry.PointCloud()
pcd.points = open3d.utility.Vector3dVector(array)
pcd.voxel_down_sample(0.0001)


if write:
    open3d.io.write_point_cloud(filepath, pcd, write_ascii=True)
    print("file written to ", str(filepath))
# ---------- end points_to_pcd ----------
reference_target = Data(points_to_pcd.pcd)

robot = Data(add_client.mobile_robot)
info = Python3Script(robot=robot)  # -> out, main_group_name
# ---------- info: Python ----------
if robot:
    robot.info()
    main_group_name = robot.main_group_name
# ---------- end info ----------
panel_7 = Panel(info.out)

# ----
# Attach tool
list_3 = ValueList({"measurement tool": 0, "area gripper": 1, "parallel gripper": 2, "camera": 3, "milling tool": 4, "baumer scanning tool": 5, "realsense scanning tool": 6}, selected="measurement tool")
show = BooleanToggle(False)
path_2 = Python3Script()  # -> DATA
# ---------- path_2: Python ----------
import os

package_path = ghdoc.Path
DATA = os.path.abspath(os.path.join(package_path,"../../data"))

print(package_path)
print(DATA)
# ---------- end path_2 ----------
tool = Python3Script(data_path=path_2, tool=list_3, show=show)  # -> tool, M, ee_plane; inputs data_path: String
# ---------- tool: Python ----------
import os, math
from compas.geometry import Frame, Rotation, Vector, Quaternion
from compas.datastructures import Mesh
from compas_rhino.conversions import mesh_to_rhino, frame_to_rhino_plane
from compas_fab.robots import Tool

tolerance = 0

if tool == 0:
    filename = 'scanning_tool.stl'
    ee_frame = Frame([-0.00074, 0.00062, 0.29663], [1, 0, 0], [0, 1, 0])

elif tool == 1:
    filename = 'vacuum_gripper_ur20_zaxis.stl'
    ee_frame = Frame([0, 0, 0.145 + tolerance], [1, 0, 0], [0, 1, 0])

elif tool == 2:
    filename = 'parallel_gripper_ur20_zaxis.stl'
    ee_frame = Frame([0, 0, 0.166 + tolerance], [0, 1, 0], [-1, 0, 0])

elif tool == 3:
    cam_dist = 0.4
    filename = 'parallel_gripper_ur20_zaxis.stl'
    ee_frame = Frame([0.0325, 0.05725+cam_dist, 0.08156], [-1, 0, 0], [0, 0, 1])

elif tool == 4:
    filename = 'milling_tool.stl'
    ee_frame = Frame([0.0, -0.12, 0.112], [1, 0, 0], [0, 0, 1])

elif tool == 5:
    scan_distance = 0.17
    filename = 'scanning_tool.stl'
    ee_frame = Frame([0.046, 0.039+scan_distance, 0.213], [1, 0, 0], [0, 0, -1])

elif tool == 6:
    scan_distance = 0.10
    filename = 'scanning_tool.stl'
    ee_frame = Frame([-0.051-scan_distance, 0.0, 0.203], [0, 1, 0], [0, 0, -1])

data_path = os.path.join(data_path, "tool_geometry")
fullfilename = os.path.join(data_path, filename)

ee_mesh = Mesh.from_stl(fullfilename)

if show:
    M = mesh_to_rhino(ee_mesh)

tool = Tool(ee_mesh, ee_frame)
ee_plane = frame_to_rhino_plane(ee_frame)
print(ee_frame.quaternion.xyzw)
ee_framek = Frame([0.0110607,0.00809854,0.41498], [0,1,0], [1,0,0])
print(ee_framek.quaternion.xyzw)
# ---------- end tool ----------
remove = Button()
attach = Button()
mesh = Mesh(tool.M)
attach_tool = Python3Script(robot=robot, tool=tool.tool, attach=attach, remove=remove)  # -> tool, M, ee_plane, bang
# ---------- attach_tool: Python ----------
print(robot.get_group_names_from_link_name("robot_arm_flange"))

if attach:
    for planning_group in robot.get_group_names_from_link_name("robot_arm_flange"):
        robot.attach_tool(tool, group=planning_group)

if remove:
    for planning_group in robot.get_group_names_from_link_name("robot_arm_flange"):
        robot.detach_tool(group=planning_group)
# ---------- end attach_tool ----------

# ----
# Move mobile robot base
list_4 = ValueList({"isaac_BCF": isaac, "origin", "set_to_BCF", "set_to_RCF"}, selected="origin")
angle = Slider(0, range=0..360)
origin = Point(Point(3.311353666, 1.904534889, -0.0004132609641))
plane = Python3Script(origin=origin, angle=angle)  # -> plane; inputs origin: Point3d
# ---------- plane: Python ----------
import Rhino.Geometry as rg
import math

plane = rg.Plane(origin, rg.Vector3d.XAxis, rg.Vector3d.YAxis)
plane.Rotate(math.radians(angle), rg.Vector3d.ZAxis)
# ---------- end plane ----------
set_frame = Python3Script(robot=robot, set_frame_to=list_4, target_BCF=plane, target_RCF=plane)  # -> bang; inputs target_BCF: Plane, target_RCF: Plane
# ---------- set_frame: Python ----------
from compas.geometry import Frame, Point, Vector, Transformation
from compas.datastructures import Mesh
from compas_fab.robots import CollisionMesh
from compas_rhino.conversions import plane_to_compas_frame

if set_frame_to == "set_to_BCF":
    BCF = plane_to_compas_frame(target_BCF)
elif set_frame_to == "set_to_RCF":
    RCF = plane_to_compas_frame(target_RCF)
    BCF = robot.transform_frame_from_RCF_to_BCF(RCF)
else:
    BCF = Frame.worldXY()

if robot and set_frame_to != "isaac_BCF":
    robot.BCF_slam = BCF
# ---------- end set_frame ----------

# ----
# 1. Scanning Path
mesh_2 = Mesh(<mesh referenced from the Rhino model>)
scanning_path = Python3Script(mesh=mesh_2, robot=robot)  # -> out, planes, path; inputs mesh: Mesh
# ---------- scanning_path: Python ----------
from workshop_robarch_2026 import mesh_to_scanframes
from compas_rhino.conversions import frame_to_rhino_plane, polyline_to_rhino

planes = []
rows, path_compas = mesh_to_scanframes(mesh, robot.BCF)

for row in rows:
    for frame in row:
        planes.append(frame_to_rhino_plane(frame))

path = polyline_to_rhino(path_compas)
# ---------- end scanning_path ----------
crv = Curve(scanning_path.path)
pln = Plane(scanning_path.planes)
start_2 = Button()
stop_2 = Button()
step = Button()
back = Button()
reset = Button()
full = Button()
list_5 = ValueList({"20", "50", "100", "500", "1000", "5000"}, selected="50")
counter = Python3Script(planes=pln, start=start_2, stop=stop_2, step=step, step_back=back, reset=reset, full=full, interval=list_5)  # -> out, counter; inputs planes: list
# ---------- counter: Python ----------
from scriptcontext import sticky as st
import Grasshopper

def update_component(ghenv, delay):
    """Schedule an update of the Grasshopper component.

    After the specified delay, the GH component will be automatically updated.

    Parameters
    ----------
    ghenv : :class:`GhPython.Component.PythonEnvironment`
        The current GHPython environment.
    delay : :obj:`int`
        Time in milliseconds until the update is performed.

    Raises
    ------
    ValueError
        If the delay is less than zero.

    """
    if delay <= 0:
        raise ValueError("Delay must be greater than zero")

    ghcomp = ghenv.Component
    ghdoc = ghcomp.OnPingDocument()

    def callback(ghdoc):
        if ghdoc.SolutionState != Grasshopper.Kernel.GH_ProcessStep.Process:
            ghcomp.ExpireSolution(False)

    ghdoc.ScheduleSolution(delay, Grasshopper.Kernel.GH_Document.GH_ScheduleDelegate(callback))

L = planes

# store data in component
guid = str(ghenv.Component.InstanceGuid)
counter_key = "counter_" + guid
running_key = "running_" + guid

if counter_key not in st:
    st[counter_key] = 0

if running_key not in st:
    st[running_key] = False
    

if st[running_key]:
    if st[counter_key] < len(L) - 1:
        st[counter_key] += 1
        update_component(ghenv, interval)
    else:
        st[counter_key] = 0
        st[running_key] = False
    
if start:
    st[running_key] = True

if stop:
    st[running_key] = False

if step:
    if st[counter_key] < len(L) - 1:
        st[counter_key] += 1

if step_back:
    if st[counter_key] > 0:
        st[counter_key] -= 1

if reset:
    st[counter_key] = 0
    st[running_key] = False

if full:
    st[counter_key] = len(L)-1

if len(L):
    item = L[st[counter_key]]

counter = st[counter_key]
# ---------- end counter ----------
item = ListItem(List=scanning_path.planes, Index=counter.counter, Wrap=True)
panel_8 = Panel(counter.counter)
pln_2 = Plane(item)

# ----
# Get Pose Cartesian
get = Button()
pose = Python3Script(robot=robot, get=get)  # -> out, pose_cartesian
# ---------- pose: Python ----------
from scriptcontext import sticky as st

from ur_fabrication_control.direct_control.common import get_current_pose_cartesian
from compas.geometry import Frame


server_ip = st["server_ip"]
server_port = st["server_port"]
ur_port = st["ur_port"]
ur_ip = st["ur_ip"]
pose_cartesian_meter = []
print (ur_ip)

# retrieve the current tool frame in axis angle format
if robot.attached_tool:
    print ("attached")
    tool_angle_axis = list(robot.attached_tool.frame.point) + list(robot.attached_tool.frame.axis_angle_vector)
    
else:
    tool0_frame = Frame([0, 0, 0], [1, 0, 0], [0, 1, 0])
    tool_angle_axis = list(tool0_frame.point) + list(tool0_frame.axis_angle_vector)

guid = str(ghenv.Component.InstanceGuid)
pose_cartesian_key = "pose_cartesian" + guid


if get:
    print ("getting pose")
    st[pose_cartesian_key] = get_current_pose_cartesian(tool_angle_axis, server_ip, server_port, ur_ip, ur_port, send=True)
    

if pose_cartesian_key not in st:
    pose_cartesian = []
else:
    pose_cartesian = st[pose_cartesian_key]
# ---------- end pose ----------
panel_9 = Panel(pose.out)
record = Button()
clear = Button()
rec = Python3Script(msg=pose.pose_cartesian, rec=record, clear=clear)  # -> out, record, planes; inputs msg: list
# ---------- rec: Python ----------
from scriptcontext import sticky as st
from compas.geometry import Frame
from compas_rhino.conversions import frame_to_rhino_plane

guid = str(ghenv.Component.InstanceGuid)
recorded_key =  "recorded_" + guid

if recorded_key not in st:
    st[recorded_key] = []

if clear:
    st[recorded_key] = []
else:
    if len(msg):
        if msg != [None] and rec:
            st[recorded_key].append(msg)


record = st[recorded_key]
planes = []
for pose in st[recorded_key]:
    frame = Frame.from_axis_angle_vector(pose[3:6], pose[0:3])
    planes.append(frame_to_rhino_plane(frame))
print (rec)
# ---------- end rec ----------
panel_10 = Panel(rec.record)

list_6 = ValueList({"get_pose_cartesian": 0, "manual_input": 1, "from_file": 2}, selected="get_pose_cartesian")
save_to_file_2 = Button()
pose_cartesian_planes = Point(rec.planes)
manual_points = Point([<point referenced from the Rhino model> x5])
filepath_2 = FilePath(file)

filter = StreamFilter(Gate=list_6, Stream0=pose_cartesian_planes, Stream1=manual_points)
# Data
# Evaluation
# EXP1-move
# EXP2-alignment+perception
# EXP3-static-integrated
# EXP3.2-move-integrated
equals = Equality(FirstNumber=list_6, SecondNumber=2)  # -> Equality, Inequality
points_to_pcd_2 = Python3Script(points=filter, filepath=filepath_2, write=save_to_file_2)  # -> out, pcd; inputs points: list of Point3d; same code as points_to_pcd
pcd_from_file = Python3Script(filepath=filepath_2, read=equals.Equality)  # -> out, pcd
# ---------- pcd_from_file: Python ----------
from compas.datastructures import Mesh
from compas.files import PLY, STL
import os
import open3d

# filepath = os.path.join(data, filename)

if read:
    pcd = open3d.io.read_point_cloud(filepath)
    print("file read from ", str(filepath))
# ---------- end pcd_from_file ----------
filter_2 = StreamFilter(Gate=list_6, Stream0=points_to_pcd_2.pcd, Stream1=points_to_pcd_2.pcd, Stream2=pcd_from_file.pcd)
measurements_source = Data(filter_2)

safe_pick_ins = Plane(Plane(origin=(-0.3080850653, -0.490257, 0.9959386961), x=(-0.9998992939, 0.01147089169, -0.008355877906), y=(0.006346696753, 0.8880700988, 0.459664246)))
pln_3 = Plane(rec.planes)
pick_ins = Plane(Plane(origin=(-0.3098920653, -0.420815, 0.8716041961), x=(-0.999999554, 0.0004388141119, -0.0008362993977), y=(8.565167786e-05, 0.9239926749, 0.3824101586)))
pick_full = Plane(Plane(origin=(-0.04657506534, 0.438278, 0.8680221961), x=(0.9990995178, -0.01710013652, 0.03882961427), y=(-0.03130593779, -0.9148258031, 0.4026334416)))

measurements_source_2 = Data(measurements_source)
reference_target_2 = Data(reference_target)

cullpt = CullDuplicates(Tolerance=0.001, CullMode=3)  # -> Points, Indices, Valence

# ----
# ROS real robot values
unsubscribe = Button()
subscribe = Button()
get_joint_states = Python3Script(robot=robot, subscribe=subscribe, unsubscribe=unsubscribe)
# ---------- get_joint_states: Python ----------
def _receive_joint_states(message):
    print(message)
    joint_list = ['robot_arm_elbow_joint', 'robot_arm_shoulder_lift_joint', 'robot_arm_shoulder_pan_joint', 'robot_arm_wrist_1_joint', 'robot_arm_wrist_2_joint', 'robot_arm_wrist_3_joint']
    for key, joint_name in enumerate(message.get("name")):
        if joint_name in joint_list:
            robot.mobile_client.current_joint_values[joint_name] = message.get("position")[key]
def joint_states_subscribe(m):
    m.topic_subscribe(
        "/robot/joint_states", "sensor_msgs/JointState", _receive_joint_states
    )

def joint_states_unsubscribe(m):
    m.topic_unsubscribe("/robot/joint_states")

if subscribe:
    joint_states_subscribe(robot.mobile_client)

if unsubscribe:
    print(robot.mobile_client)
# ---------- end get_joint_states ----------
trigger = Trigger(Interval=5000, TimerInterval=5000, Target=draw)  # disabled
draw = Python3Script(robot=robot)  # -> configuration
# ---------- draw: Python ----------
from compas_robots import Configuration

configuration = robot.mobile_client.get_current_configuration()
print(configuration)

print(robot.mobile_client.current_joint_values)
# ---------- end draw ----------

number_slider_3 = Slider(0, range=0..40)

# ----
# Configuration
# zero configuration
zero = Python3Script(robot=robot, group=info.main_group_name)  # -> out, configuration; inputs group: String
# ---------- zero: Python ----------
configuration = robot.zero_configuration(group)
# ---------- end zero ----------

# ----
# forward kinematics
number_slider_4 = Slider(0, range=-180..180)
forward_kinematics = Python3Script(
    robot=robot,
    lift=number_slider_3,
    j1=number_slider_4,
    j2=Slider(-135, range=-360..360),
    j3=Slider(-96.4, range=-180..180),
    j4=Slider(277.2, range=-400..400),
    j5=Slider(83.8, range=-125..120),
    j6=Slider(-1, range=-400..400))  # -> configuration
# ---------- forward_kinematics: Python ----------
import math
from compas_robots.model import Joint
from compas_robots import Configuration

if robot:
    configuration = robot.f_kinematics(lift, j1, j2, j3, j4, j5, j6)
    print(configuration)
# ---------- end forward_kinematics ----------

send = Button()
send_2 = Button()
subscribe_2 = Button()
unsubscribe_2 = Button()
unsubscribe_3 = Button()
subscribe_3 = Button()
get_tf_frames = Python3Script(robot=robot, subscribe=subscribe_2, unsubscribe=unsubscribe_2)  # -> pose_frame
# ---------- get_tf_frames: Python ----------
from compas_fab.backends.ros.messages import Header

from roslibpy import Service, ServiceRequest
from compas.geometry import Point, Frame, Quaternion
from scriptcontext import sticky as st

if subscribe:
    robot.mobile_client.tf_subscribe(
                    "marker_0",
                    "robot_base_footprint"
                )

if unsubscribe:
    robot.mobile_client.tf_unsubscribe(
                    "marker_0",
                    "robot_base_footprint"
                )
    robot.mobile_client.clean_tf_frame()

pose_frame = robot.mobile_client.tf_frame
print(pose_frame)
print(robot.mobile_client.tf_actions)
# ---------- end get_tf_frames ----------
action_calls = Python3Script(robot=robot, subscribe=subscribe_3, unsubscribe=unsubscribe_3)  # -> result
# ---------- action_calls: Python ----------
import roslibpy
import scriptcontext as sc

ACTION_NAME = "/tf2_web_republisher"
ACTION_TYPE = "tf2_web_republisher_interfaces/action/TFSubscription"

if "actions" not in sc.sticky:
    sc.sticky["actions"] = {}

actions = sc.sticky["actions"]

if ACTION_NAME not in actions:
    actions[ACTION_NAME] = {
        "action_client": roslibpy.ActionClient(
            robot.mobile_client.ros_client,
            ACTION_NAME,
            ACTION_TYPE
        ),
        "goals": {}
    }


def send_action_goal(actions, action_name, goal_msg):
    action = actions[action_name]
    action_client = action["action_client"]
    goals = action["goals"]

    # Do not create a second active goal for the same action
    for gid, goal_state in goals.items():
        if goal_state.get("active"):
            print("Already active:", gid)
            return gid

    goal = roslibpy.Goal(goal_msg)
    goal_id_holder = {}

    def _result_callback(msg):
        goal_id = goal_id_holder.get("goal_id")
        if goal_id in goals:
            goals[goal_id]["response"] = msg
            goals[goal_id]["success"] = True
            goals[goal_id]["active"] = False

    def _feedback_callback(msg):
        goal_id = goal_id_holder.get("goal_id")
        if goal_id in goals:
            goals[goal_id]["response"] = msg

    def _fail_callback(msg):
        goal_id = goal_id_holder.get("goal_id")
        if goal_id in goals:
            goals[goal_id]["response"] = msg
            goals[goal_id]["success"] = False
            goals[goal_id]["active"] = False

    goal_id = action_client.send_goal(
        goal,
        _result_callback,
        _feedback_callback,
        _fail_callback
    )

    goal_id_holder["goal_id"] = goal_id

    goals[goal_id] = {
        "response": None,
        "success": False,
        "active": True
    }

    print("Sent goal:", goal_id)
    return goal_id


def cancel_action_goals(actions, action_name):
    action = actions[action_name]
    action_client = action["action_client"]
    goals = action["goals"]

    for goal_id, goal_state in list(goals.items()):
        if goal_state.get("active"):
            action_client.cancel_goal(goal_id)
            goal_state["active"] = False
            print("Cancelled goal:", goal_id)


if subscribe:
    goal_id = send_action_goal(actions, ACTION_NAME, {
        "source_frames": ["robot_arm_base"],
        "target_frame": "robot_base_footprint",
        "angular_thres": 0.01,
        "trans_thres": 0.01,
        "rate": 10.0
    })

if unsubscribe:
    cancel_action_goals(actions, ACTION_NAME)

# latest response from latest goal
response = None
active = False
success = False

goals = actions[ACTION_NAME]["goals"]
if goals:
    latest_goal_id = list(goals.keys())[-1]
    latest_goal = goals[latest_goal_id]
    response = latest_goal["response"]
    active = latest_goal["active"]
    success = latest_goal["success"]

print(actions)
# ---------- end action_calls ----------
send_joint_values = Python3Script(robot=robot, config=forward_kinematics, send=send)  # -> out
# ---------- send_joint_values: Python ----------
import roslibpy
import time

def configuration_to_joint_state_msg(config):
    msg = {
        'name': config.joint_names,
        'position': config.joint_values,
    }
    return msg

def publish_one_time_joint_state(client, config):
    publisher = roslibpy.Topic(client, '/isaac_joint_command', 'sensor_msgs/JointState')
    publisher.publish(configuration_to_joint_state_msg(config))
    print("Published one JointState message.")
    time.sleep(0.5)
    # publisher.unadvertise()

print(config)

if send:
    publish_one_time_joint_state(robot.client, config)


# joint_names = ['robot_ewellix_lift_top_joint',
#                 'robot_arm_shoulder_pan_joint', 
#                'robot_arm_shoulder_lift_joint', 
#                'robot_arm_elbow_joint', 
#                'robot_arm_wrist_1_joint', 
#                'robot_arm_wrist_2_joint', 
#                'robot_arm_wrist_3_joint']
# joint_positions = [0.2, 0.0, 0.0, 0.0, 0.0, 5.0, 0.0]

# msg = {
#     'name': joint_names,
#     'position': joint_positions,
# }
# ---------- end send_joint_values ----------
send_nav_action = Python3Script(robot=robot, send=send_2)  # -> out
# ---------- send_nav_action: Python ----------
import roslibpy
import time


# Create the NavigateToPose action client
action_client = roslibpy.ActionClient(
    robot.mobile_client.ros_client,
    '/robot/navigate_to_pose',
    'nav2_msgs/action/NavigateToPose'
)

print(action_client)
# Create the goal message (same structure as the ROS 2 CLI)
goal = roslibpy.Goal(
    {
        'pose': {
            'header': {
                'frame_id': 'robot_map'
            },
            'pose': {
                'position': {'x': 3.0, 'y': 0.0, 'z': 0.0},
                'orientation': {'x': 0.0, 'y': 0.0, 'z': 0.0, 'w': 1.0}
            }
        }
    }
)

def result_callback(msg):
    print("Action result:" + msg)

def feedback_callback(msg):
    print(f"Action feedback: {msg['sequence']}")

def fail_callback(msg):
    print(f"Action failed: {msg}")

# goal_msg.on('feedback', feedback_callback)

if send:
    print('Sending goal...')
    action_client.send_goal(goal, result_callback, feedback_callback, fail_callback)

# # Wait for result (non-blocking versions also possible)
# result = goal_msg.wait(timeout=60)
# print('Result:', result)
# ---------- end send_nav_action ----------
panel_11 = Panel(send_nav_action)
panel_12 = Panel(send_joint_values)
panel_13 = Panel(action_calls)
panel_14 = Panel(get_tf_frames)

# ----
# State viewer
trigger_2 = Trigger(Interval=1000, TimerInterval=1000, Target=fabrication_state)
fabrication_state = Python3Script()  # -> out, state, num_tasks, num_current_task, num_tasks_left, log_messages
# ---------- fabrication_state: Python ----------
from scriptcontext import sticky as st

fabrication = st["fabrication"]

if hasattr(fabrication, "task_thread"):
    if fabrication.task_thread.is_alive():
        state = "THREAD RUNNING"
    else:
        state = "THREAD STOPPED"
print(fabrication.current_task_key)
num_tasks = len(fabrication.tasks)
if fabrication.current_task_key is not None:
    num_current_task = fabrication.current_task_key-1
else:
    num_current_task = 0

num_tasks_left = num_tasks-num_current_task
log_messages = fabrication.log_messages

# assembly = st["assembly"]
# ---------- end fabrication_state ----------
state = Panel(fabrication_state.state)
num_tasks = Panel(fabrication_state.num_tasks)
num_current_task = Panel(fabrication_state.num_current_task)
num_tasks_left = Panel(fabrication_state.num_tasks_left)

# ----
# 2. Fabrication manager
list_7 = ValueList({"scan with realsense": "scan_realsense", "scan with baumer": "scan_baumer"}, selected="scan with baumer")
init = Button()
fabrication = Python3Script(init=init)  # -> fabrication
# ---------- fabrication: Python ----------
from scriptcontext import sticky as st
from spaicr import DisassemblyFabricationManager
from fabrication_manager.fabrication import FabricationManager
from assembly_information_model.assembly import Assembly
import os

server_ip = st["server_ip"]
server_port = st["server_port"]

if init_:
    path = os.path.abspath(os.path.join(ghdoc.Path,"../../data/2nd_experiment/fabrication_logs"))
    print(path)
    fabrication = FabricationManager((server_ip, server_port))
    fabrication.path = path
    st["fabrication"] = fabrication

fabrication = st["fabrication"]
# ---------- end fabrication ----------
generate_tasks = Python3Script(routine=list_7, fabrication=fabrication, robot=robot, vel=number_slider_2, scan_planes=pln)  # -> out, tasks, target_planes; inputs scan_planes: list
# ---------- generate_tasks: Python ----------
import roslibpy
import time
from fabrication_manager.task import Task
from compas_robots import Configuration
from compas.geometry import Translation, Rotation, Frame, Box, Transformation, Point, Quaternion, Vector, distance_point_point
from compas.datastructures import Mesh
from compas_rhino.conversions import plane_to_compas_frame, frame_to_rhino_plane
import numpy as np
import math
from assembly_information_model import Part
import open3d
import random
from scipy.spatial.transform import Rotation as R
from mobile_robot_control.pointcloud_processing.icp import preprocess_point_cloud_icp, evaluate_local_registration, execute_icp_local_registration
from scriptcontext import sticky as st
from ur_fabrication_control.direct_control.fabrication import URTask
from ur_fabrication_control.direct_control.mixins import URScript, URScript_AreaGrip, URScript_ParallelGrip
from mobile_robot_control import MoveLinearURdirectTask, MoveJointsURdirectTask, PlaceBrickURTask, PickBrickURTask
from mobile_robot_control import AddCollisionMeshes, MotionPlanExecutePose, MotionPlanExecuteJoints, MoveBaseViaJointValuesTask, MoveBaseViaAxialMotionTask, MoveArmPoseViaActionTask, MoveArmJointsViaActionTask

ur_ip = st['ur_ip']
ur_port = st['ur_port']
robot_address = (ur_ip, ur_port)

tasks = []
target_planes = []

# Payload and CoG for scanning tool.
payload = 2.57
CoG = [0.005, -0.003, 0.06]

class TriggerAccumulatedCaptureTask(Task):
    def __init__(self, robot, sleep=0, key=None):
        super(TriggerAccumulatedCaptureTask, self).__init__(key)
        self.robot = robot
        self.sleep = sleep

    def run(self, stop_thread):
        self.log('Accumulated point cloud capture is triggered.')
        service_name = '/capture_averaged'

        while not stop_thread():
            if self.robot.mobile_client.is_service_available(service_name):
                result = self.robot.mobile_client.service_call(service_name, 'std_srvs/Trigger', {})
                success = result['success']
                message = result['message']
                self.log('Capture message: {}'.format(message))
                if success:
                    break
            else:
                self.log("Capture averaged service is not available.")
                break
            time.sleep(0.1)

        self.log("Sleeping for {} seconds...".format(str(self.sleep)))
        time.sleep(self.sleep)

        self.is_completed = True
        return True

class TriggerSweepCaptureTask(Task):
    def __init__(self, robot, start=True, sleep=0, key=None):
        super(TriggerSweepCaptureTask, self).__init__(key)
        self.robot = robot
        self.sleep = sleep
        self.start = start

    def run(self, stop_thread):
        if self.start:
            self.log('Triggering the start of the sweeping capture.')
            service_name = '/start_sweep_capture'
        else:
            self.log('Triggering the stop of the sweeping capture.')
            service_name = '/stop_sweep_capture'

        while not stop_thread():
            if self.robot.mobile_client.is_service_available(service_name):
                result = self.robot.mobile_client.service_call(service_name, 'std_srvs/Trigger', {})
                success = result['success']
                message = result['message']
                self.log('Capture message: {}'.format(message))
                if success:
                    break
            else:
                self.log("Capture sweep service is not available.")
                break
            time.sleep(0.1)

        self.log("Sleeping for {} seconds...".format(str(self.sleep)))
        time.sleep(self.sleep)

        self.is_completed = True
        return True

class ChangeToolFrameTask(Task):
    def __init__(self, robot, tool_name='gripper', key=None):
        super(ChangeToolFrameTask, self).__init__(key)
        self.robot = robot
        self.tool_name = tool_name
        gripper_frame = Frame([0, 0, 0.166], [0, 1, 0], [-1, 0, 0]) 
        camera_frame = Frame([-0.0327, 0.0572, 0.0815], [-1, 0, 0], [0, 0, 1])
        if tool_name == 'gripper':
            self.tool_frame = gripper_frame
        else:
            self.tool_frame = camera_frame
        
    def run(self, stop_thread):
        self.log("ChangeToolTask")
        self.log('Changing the tool frame to {}.'.format(self.tool_name))
        self.robot.attached_tools['ur20'].frame = self.tool_frame
        self.robot.attached_tools['ur20_and_liftkit'].frame = self.tool_frame
        self.is_completed = True
        return True

if routine == "scan_realsense":
    for scan_plane in scan_planes:
        frame_WCF = plane_to_compas_frame(scan_plane)
        frame_RCF = robot.from_WCF_to_RCF(frame_WCF)
        target_planes.append(frame_to_rhino_plane(frame_WCF))

        tasks.append(MoveLinearURdirectTask(robot, robot_address, frame_RCF, in_RCF=True, velocity=vel, payload=payload, CoG=CoG))
        tasks.append(TriggerAccumulatedCaptureTask(robot, sleep=2))
        
elif routine == "scan_baumer":
    tasks.append(TriggerSweepCaptureTask(robot, start=True, sleep=0))
    for scan_plane in scan_planes:
        frame_WCF = plane_to_compas_frame(scan_plane)
        frame_RCF = robot.from_WCF_to_RCF(frame_WCF)
        target_planes.append(frame_to_rhino_plane(frame_WCF))

        tasks.append(MoveLinearURdirectTask(robot, robot_address, frame_RCF, in_RCF=True, velocity=vel, payload=payload, CoG=CoG))
    tasks.append(TriggerSweepCaptureTask(robot, start=False, sleep=0))
    
print(tasks)
# ---------- end generate_tasks ----------
pln_4 = Plane(generate_tasks.target_planes)
next_task = Button()
reset_task = Button()
prev_task = Button()
reset_2 = Button()
# Profile scanner .pcd file
start_fabrication = Button()
stop_fabrication = Button()
fabrication_manager = Python3Script(
    tasks=generate_tasks.tasks,
    fabrication=fabrication,
    set_tasks=Toggle(True),
    start=start_fabrication,
    stop=stop_fabrication,
    reset=reset_2,
    next_task=next_task,
    reset_task=reset_task,
    prev_task=prev_task)  # -> out, server; inputs tasks: list
# ---------- fabrication_manager: Python ----------
def task_state_set(state, t):
    t.is_completed = state
    t.is_running = False
    
if set_tasks:
    print("setting tasks")   
    fabrication.clear_tasks()
    fabrication.set_tasks(tasks)

if start:
    #if robot.is_connected(): #and arduino.is_connected():
    print("starting process")
    fabrication.start()

if stop:
    print("stopping process")
    fabrication.stop()
    
if reset:
    print("resetting process")
    fabrication.reset()

if next_task:
    t = fabrication.get_next_task()
    task_state_set(True, t)
    
if reset_task:
    t = fabrication.get_next_task()
    task_state_set(False, t)

if prev_task:
    t = fabrication.get_next_task()
    task_state_set(False, t)
    t = fabrication.tasks[fabrication.current_task_key-1]
    task_state_set(False, t)
    fabrication.get_next_task()
# ---------- end fabrication_manager ----------
panel_15 = Panel(fabrication_state.log_messages)

save_to_file_3 = Button()
clear_2 = Button()
get_2 = Button()
data = Python3Script()  # -> DATA
# ---------- data: Python ----------
import os

package_path = ghdoc.Path
DATA = os.path.abspath(os.path.join(package_path,"../../data/scans"))

print(package_path)
print(DATA)
# ---------- end data ----------
sub_point_cloud = Python3Script(
    robot=robot,
    sensor_type=list_7,
    ros_client=ros.ros_client,
    get=get_2,
    save_to_file=save_to_file_3,
    clear=clear_2,
    show=Toggle(True),
    data=data,
    filename=py3_4.filename)  # -> out, pc, points
# ---------- sub_point_cloud: Python ----------
from scriptcontext import sticky
from roslibpy import Topic
from workshop_robarch_2026.pointcloud_publisher import PointCloud2
from compas_rhino.conversions import point_to_rhino
import time
import os
import json

filepath = os.path.join(data, filename)

pc_key = 'pc_' + "baumer"
mr_key = 'mr_' + "baumer_msg"

if sensor_type == "scan_baumer":
    topic_name = "scanner"
else:
    topic_name = "camera"

def pointcloud_callback(msg):
    sticky[pc_key] = msg
    sticky[mr_key] = True

if ros_client and ros_client.is_connected:
    print("ROSClient Connected!")
    topic = Topic(ros_client, "/{}/points_accumulated".format(topic_name), "sensor_msgs/PointCloud2")

if clear:
    pc = sticky[pc_key]
    pc.clear()

if get:
    # pcr = sticky[pcr_key]
    sticky[mr_key] = False
    topic.subscribe(pointcloud_callback)
    d0 = time.time()
    while not sticky[mr_key]:
        if time.time()-d0 > 30:
            break
        pass
    topic.unsubscribe()  

if save_to_file:
    pc = sticky[pc_key]
    with open(filepath, 'w') as f:
        json.dump(pc, f)
    # pc.save_to_file(filepath)
    
if show:
    pc = sticky[pc_key]
    pointcloud = PointCloud2.from_msg(pc)
    if robot:
        points = [point_to_rhino(robot.from_RCF_to_BCF(pt)) for pt in pointcloud.points]
    else:
        points = [point_to_rhino(pt) for pt in pointcloud.points]
# ---------- end sub_point_cloud ----------

# ----
# 3. PointCloud from Sensor
list_8 = ValueList({"from_ROS": 0, "from_file": 1}, selected="from_ROS")
filter_3 = StreamFilter(Gate=list_8, Stream0=sub_point_cloud.points, Stream1=from_file.points_out)
pt = Point(filter_3)

cullpt_2 = CullDuplicates(Points=pt, Tolerance=0.001, CullMode=3)  # -> Points, Indices, Valence; disabled
pt_2 = Point(cullpt_2.Points)
del = DelaunayMesh(Points=pt_2, Plane=PlaneXY(0, 0, 0))

# ----
# from_robot
number_slider_5 = Slider(0.015, range=0..0.1)
data_2 = Python3Script()  # -> DATA
# ---------- data_2: Python ----------
import os

package_path = ghdoc.Path
DATA = os.path.abspath(os.path.join(package_path,"../../../mobile_part_based_am/data"))

print(package_path)
print(DATA)
# ---------- end data_2 ----------
pt_3 = Point(pt)
py3_7 = Python3Script(name=panel_6, version=number_slider)  # -> out, filename; inputs segment_nr: Int32, version: Int32
# ---------- py3_7: Python ----------
import datetime
dt = str(datetime.date.today())
filename = dt+'_'+name+'_seg'+str(segment_nr)+'_v'+str(version)+'.ply'
# ---------- end py3_7 ----------
py3_8 = Python3Script(
    data=data_2,
    filename=py3_7.filename,
    points=pt_3,
    write=Toggle(True),
    remove_outliers=Toggle(True),
    remove_floor=Toggle(False),
    distance_threshold=number_slider_5,
    resolution=Slider(0.00025, range=0..0.1))  # -> out, pcd_raw, pcd_pp; inputs points: list of Point3d
# ---------- py3_8: Python ----------
from compas.datastructures import Mesh
from compas.files import PLY, STL
import os
import open3d

filepath = os.path.join(data, filename)

array = [[x,y,z] for x, y, z in iter(points)]
pcd_raw = open3d.geometry.PointCloud()
pcd_raw.points = open3d.utility.Vector3dVector(array)
pcd_raw = pcd_raw.voxel_down_sample(resolution)

if write:
    open3d.io.write_point_cloud(filepath, pcd_raw, write_ascii=True)
    print("file written to ", str(filepath))

if remove_outliers:
    pcd_pp, ind = pcd_raw.remove_statistical_outlier(nb_neighbors=20, std_ratio=2.0)
else:
    pcd_pp = pcd_raw

if remove_floor:
    plane_model, inliers = pcd_pp.segment_plane(distance_threshold, ransac_n=3, num_iterations=1000)
    pcd_pp = pcd_pp.select_by_index(inliers, invert=True)
# ---------- end py3_8 ----------
panel_16 = Panel(py3_8.out)

path_3 = FilePath("C:\Users\Gido\Documents\workspace\development\mobile_part_based_am\data\2024-07-04_depth_camera_pointcloud_seg1_v0.ply")
pln_5 = Plane(pln_2)

# ----
# analytical inverse kinematics
select_configuration = Slider(0, range=0..7)
plane_2 = Plane(pln_4)
analytic_inverse = Python3Script(robot=robot, lift=number_slider_3, plane=pln_5, idx=select_configuration)  # -> out, configuration; inputs plane: Plane, idx: Int32
# ---------- analytic_inverse: Python ----------
import Rhino.Geometry as rg
import math
from compas.geometry import Frame, Transformation, Rotation
from compas_robots import Configuration
from ur_fabrication_control.kinematics.ur_kinematics import inverse_kinematics
from ur_fabrication_control.kinematics.ur_params import ur_params
from compas_rhino.conversions import plane_to_compas_frame

frame_WCF = plane_to_compas_frame(plane)

print(robot.is_reachable(frame_WCF))
configuration, solutions = robot.i_kinematics(frame_WCF, lift=lift, idx=idx)
print(configuration)
# ---------- end analytic_inverse ----------

# ----
# from_file
toggle_3 = BooleanToggle(True)
path_4 = FilePath("C:\Users\Gido\Documents\workspace\development\mobile_part_based_am\data\2024-08-05_profile_sensor_pointcloud_seg11_v0.ply")
py3_9 = Python3Script(filepath=path_4, read=toggle_3)  # -> out, pcd
# ---------- py3_9: Python ----------
from compas.datastructures import Mesh
from compas.files import PLY, STL
import os
import open3d

# filepath = os.path.join(data, filename)

if read:
    # mesh = Mesh()
    # array = [[x,y,z] for x, y, z in iter(points)]
    # pcd = open3d.geometry.PointCloud()
    # pcd.points = open3d.utility.Vector3dVector(array)
    # open3d.io.write_point_cloud(filepath, pcd, write_ascii=True)
    pcd = open3d.io.read_point_cloud(filepath)
    cl, ind = pcd.remove_statistical_outlier(nb_neighbors=20, std_ratio=2.0)
        # mesh.add_vertex(x=x, y=y, z=z)
    # stl = STL(filepath)
    # stl.write(mesh, precision="3f")
    # ply = PLY(filepath)
    # ply.write(mesh, precision="6f")
    
    print("file read from ", str(filepath))
# ---------- end py3_9 ----------

py3_10 = Python3Script(filepath=path_3, read=Toggle(False))  # -> out, pcd; same code as py3_9
generate_tasks_2 = Python3Script(routine=list_7, fabrication=fabrication, robot=robot, vel=number_slider_2, scan_planes=pln)  # -> out, tasks, target_planes; disabled
# ---------- generate_tasks_2: Python ----------
import roslibpy
import time
from fabrication_manager.task import Task
from compas_robots import Configuration
from compas.geometry import Translation, Rotation, Frame, Box, Transformation, Point, Quaternion, Vector, distance_point_point
from compas.datastructures import Mesh
from compas_rhino.conversions import plane_to_compas_frame, frame_to_rhino_plane
import numpy as np
import math
from assembly_information_model import Part
import open3d
import random
from scipy.spatial.transform import Rotation as R
from mobile_robot_control.pointcloud_processing.icp import preprocess_point_cloud_icp, evaluate_local_registration, execute_icp_local_registration
from scriptcontext import sticky as st
from ur_fabrication_control.direct_control.fabrication import URTask
from ur_fabrication_control.direct_control.mixins import URScript, URScript_AreaGrip, URScript_ParallelGrip
from mobile_robot_control import MoveLinearURdirectTask, ChangeToolFrameTask, MoveJointsURdirectTask, PlaceBrickURTask, PickBrickURTask
from mobile_robot_control import AddCollisionMeshes, MotionPlanExecutePose, MotionPlanExecuteJoints, MoveBaseViaJointValuesTask, MoveBaseViaAxialMotionTask, MoveArmPoseViaActionTask, MoveArmJointsViaActionTask
from spaicr import ScanBricksTask, ScanAllBricksTask, ScanSingleBrickTask, ScanSingleBrickAddNewTask, CleanBricksTask, TriggerEstimationTask, ReceiveBCFgtTask, ReceiveBCFslamTask, ReceiveBCFslamOnResetTask
from spaicr import AlignmentTask, TransformAlignmentTask, GripperControlTask, UpdateAssemblyAttributes

# start_config = Configuration((0.000, 0.000, -1.571, -1.571, -1.571, 1.571, 3.141), (2, 0, 0, 0, 0, 0, 0),
#                                 ('robot_ewellix_lift_top_joint', 'robot_arm_shoulder_pan_joint', 'robot_arm_shoulder_lift_joint', 'robot_arm_elbow_joint', 'robot_arm_wrist_1_joint', 'robot_arm_wrist_2_joint', 'robot_arm_wrist_3_joint'))

start_config = Configuration((-0.0, -2.356, -2.356, 0.0, 1.571, 0.0), (0, 0, 0, 0, 0, 0),
                                ('robot_arm_shoulder_pan_joint', 'robot_arm_shoulder_lift_joint', 'robot_arm_elbow_joint', 'robot_arm_wrist_1_joint', 'robot_arm_wrist_2_joint', 'robot_arm_wrist_3_joint'))

target_frame = plane_to_compas_frame(target_plane)

target_planes = []

box = Box(0.1,0.1,0.1, Frame.worldXY())
a_mesh = box.to_mesh()

ur_ip = st['ur_ip']
ur_port = st['ur_port']
robot_address = (ur_ip, ur_port)

front_frame_RCF = Frame([0.8,0,0], -Vector.Yaxis(), -Vector.Xaxis())
right_frame_RCF = front_frame_RCF.transformed(Rotation.from_axis_and_angle(Vector.Zaxis(), math.radians(-90)))

def select_pick_brick(assembly, z_tol=0.01):
    available = list(assembly.graph.nodes_where({"available": True}))
    if not available:
        return None

    # --- estimate stack yaw (ignore 90°-rotated bricks) ---
    yaws = []
    for k in available:
        xaxis = assembly.part(k).frame.xaxis
        yaw = math.atan2(xaxis.y, xaxis.x)
        yaws.append(yaw % (math.pi / 2))

    stack_yaw = sorted(yaws)[len(yaws) // 2]  # median
    print(f"Estimated stack yaw: {math.degrees(stack_yaw):.2f}°")

    c = math.cos(-stack_yaw)
    s = math.sin(-stack_yaw)

    # --- rotate positions into stack frame ---
    bricks = []
    for k in available:
        p = assembly.part(k).frame.point
        rx = c * p.x - s * p.y
        rz = p.z
        bricks.append((k, rx, rz))

    # --- select top layer ---
    max_z = max(b[2] for b in bricks)
    top = [b for b in bricks if abs(b[2] - max_z) < z_tol]

    # --- select most right ---
    best = min(top, key=lambda b: b[1])

    return best[0]

def select_place_brick(assembly, robot):
    available_bricks = assembly.graph.nodes_where({"built":False, "available":True, "anchor":False})
    anchor_bricks = assembly.graph.nodes_where({"anchor":True})
    max_anchor_key = max(anchor_bricks)
    anchor_course = assembly.graph.node_attribute(max_anchor_key, 'course')
    max_course = 2

    potential_bricks = []
    for key in available_bricks:
        if robot.is_reachable(assembly.graph.node_attribute(key, 'planned_frame')):
            if assembly.graph.node_attribute(key, 'course') == anchor_course and key > max_anchor_key:
                pass
            elif assembly.graph.node_attribute(key, 'course') < max_course:
                potential_bricks.append(key)
    
    if len(potential_bricks) > 0:
        return min(potential_bricks)
        # max_key = max(
        #     potential_bricks,
        #     key=lambda n: assembly.graph.node_attribute(n, 'planned_frame').point.x
        # )
        # return max_key
    else:
        return None

def slerp_quat(q1, q2, t):
    q1 = q1 / np.linalg.norm(q1)
    q2 = q2 / np.linalg.norm(q2)
    dot = np.dot(q1, q2)
    if dot < 0.0:
        q2 = -q2
        dot = -dot
    if dot > 0.9995:
        q = q1 + t * (q2 - q1)
        return q / np.linalg.norm(q)
    theta_0 = np.arccos(dot)
    theta = theta_0 * t
    q3 = q2 - q1 * dot
    q3 = q3 / np.linalg.norm(q3)
    return q1 * np.cos(theta) + q3 * np.sin(theta)

def average_frame(frame_a, frame_b):
    # --- Average position ---
    p = Point(
        0.5 * (frame_a.point.x + frame_b.point.x),
        0.5 * (frame_a.point.y + frame_b.point.y),
        0.5 * (frame_a.point.z + frame_b.point.z),
    )

    # --- Average orientation via SLERP ---
    R_a = Rotation.from_frame(frame_a)
    R_b = Rotation.from_frame(frame_b)

    qa = np.array(R_a.quaternion)
    qb = np.array(R_b.quaternion)

    q_avg = slerp_quat(qa, qb, 0.5)
    R_avg = Rotation.from_quaternion(q_avg)

    # --- Build averaged frame ---
    avg_frame = Frame.from_rotation(R_avg)
    avg_frame.point = p
    return avg_frame

class SimplePickBrickURTask(URTask):
    def __init__(self, robot, robot_address, grip=True, key=None):
        super(SimplePickBrickURTask, self).__init__(robot, robot_address, key)
        self.robot = robot
        self.robot_address = robot_address
        self.grip = grip

    def urscript_fabrication_header(self):
        ## Initialize instance
        self.urscript = URScript_ParallelGrip(*self.robot_address)
        self.urscript.start()
        
        if self.robot:
            ## Set tool
            tool = self.robot.attached_tool
            self.urscript.set_tcp(list(tool.frame.point)+list(tool.frame.axis_angle_vector))
        self.urscript.textmessage(">> TASK {}".format(self.key), string=True)
        
        if self.server:
            self.urscript.set_socket(self.server.ip, self.server.port, self.server.name)
            self.urscript.socket_open(self.server.name)
            ## Send script received msg
            self.urscript.socket_send_line_string(self.rec_msg, self.server.name)
    
    def create_urscript(self):
        self.log("Picking started!")
        self.urscript.set_payload(5.6, [0.005, -0.022, 0.072])
        self.urscript.parallelgrip_open()

        self.urscript.move_force_mode(force_z=20.0, speed_z=0.015)
        self.urscript.stop_by_force(15.0)
        self.urscript.textmessage("Got the brick.", string=True)

        if self.grip:
            self.urscript.parallelgrip_close()

class UpdateAssemblyAttributes(Task):
    def __init__(self, assembly, brick_key, attributes={"built":False, "pick_key":0}, key=None):
        super(UpdateAssemblyAttributes, self).__init__(key)
        self.assembly = assembly
        self.brick_key = brick_key
        self.attributes = attributes
    
    def update_neighbor_availability(self, assembly, part_key=None):
        updated_keys = []
        # Determine which parts to check
        part_keys = (
            assembly.graph.neighbors_out(part_key)
            if part_key is not None
            else assembly.part_keys()
        )
        for key in part_keys:
            below = assembly.graph.neighbors_in(key)
            below_built = all(
                bool(assembly.graph.node_attribute(n, "built")) for n in below
            )

            if below_built and not assembly.graph.node_attribute(key, "available"):
                assembly.graph.node_attribute(key, "available", True)
                updated_keys.append(key)
        return updated_keys

    def run(self, stop_thread):
        # Change brick attributes:
        for attribute, value in self.attributes.items():
            self.assembly.graph.node_attribute(self.brick_key, attribute, value)
        self.update_neighbor_availability(self.assembly, self.brick_key)
        self.is_completed = True
        return True

class ChangeToolFrameTask(Task):
    def __init__(self, robot, tool_name='gripper', key=None):
        super(ChangeToolFrameTask, self).__init__(key)
        self.robot = robot
        self.tool_name = tool_name
        gripper_frame = Frame([0, 0, 0.166], [0, 1, 0], [-1, 0, 0]) 
        camera_frame = Frame([-0.0327, 0.0572, 0.0815], [-1, 0, 0], [0, 0, 1])
        if tool_name == 'gripper':
            self.tool_frame = gripper_frame
        else:
            self.tool_frame = camera_frame
        
    def run(self, stop_thread):
        self.log("ChangeToolTask")
        self.log('Changing the tool frame to {}.'.format(self.tool_name))
        self.robot.attached_tools['ur20'].frame = self.tool_frame
        self.robot.attached_tools['ur20_and_liftkit'].frame = self.tool_frame
        self.is_completed = True
        return True

class MoveBaseViaAxialMotionTask(Task):
    def __init__(self, robot, target_frame, log_distances=False, in_WCF=True, key=None):
        super(MoveBaseViaAxialMotionTask, self).__init__(key)
        self.robot = robot
        self.target_frame = target_frame
        self.log_distances = log_distances
        self.in_WCF= in_WCF

        self.result = None
        self.done = False
        self.success = False
        
    def _result_callback(self, msg):
        self.result = msg
        self.done = True
        self.success = True
        
    def _feedback_callback(self, msg):
        rem = msg["remaining"]
        if self.log_distances:
            self.log(f"Distance remaining... x: {rem['x']:.4f} m, y: {rem['y']:.4f} m, theta: {rem['theta']:.4f} rad")

    def _fail_callback(self, msg):
        self.result = msg
        self.done = True
        self.success = False

    def make_goal(self, x=0.0, y=0.0, theta=0.0):
        return roslibpy.Goal(
            {
                'goal': {
                    'x': x,
                    'y': y,
                    'theta': theta
                },
                'maximum_velocity': {
                    'linear': {
                        'x': 0.0,
                        'y': 0.0,
                        'z': 0.0
                    },
                    'angular': {
                        'x': 0.0,
                        'y': 0.0,
                        'z': 0.0
                    }
                }
            }
        )
        
    def compute_axial_motions(self):
        if self.in_WCF:
            target_frame_in_BCF = self.robot.from_WCF_to_BCF(self.target_frame)
        else:
            target_frame_in_BCF = self.target_frame

        # Extract target components from Frame
        target_x = float(target_frame_in_BCF.point.x)
        target_y = float(target_frame_in_BCF.point.y)
        target_theta = float(math.atan2(target_frame_in_BCF.xaxis.y, target_frame_in_BCF.xaxis.x))

        goals = []

        # 1) Move along y
        if abs(target_y) > 0.0:
            goals.append(self.make_goal(y=target_y))
            self.log("x")

        # 2) Move along x
        if abs(target_x) > 0.0:
            goals.append(self.make_goal(x=target_x))
            self.log("x")

        # 3) Rotate theta
        if abs(target_theta) > 0.0:
            goals.append(self.make_goal(theta=target_theta))
            self.log("x")

        return goals
    
    def run(self, stop_thread):
        self.log("Sending axial motions.")

        action_name = '/robot/move'
        if action_name not in self.robot.mobile_client.action_clients.keys():
            action_client = roslibpy.ActionClient(
                self.robot.mobile_client.ros_client,
                action_name,
                'robotnik_navigation_msgs/action/Move'
            )
        else:
            action_client = self.robot.mobile_client.action_clients[action_name]
            self.log(f"Added action client {action_client}.")

        goals = self.compute_axial_motions()
        # self.log(goals)

        for goal in goals:
            self.result = None
            self.done = False
            self.success = False
        
            goal_id = action_client.send_goal(goal, self._result_callback, self._feedback_callback, self._fail_callback)

            self.log(f'Sending goal: {goal} with ID {goal_id}')

            while not stop_thread():
                if self.done:
                    break
                time.sleep(0.1)
            
            self.log(f"Action {goal_id} result: {self.result['status']}")

        self.is_completed = True
        return True

class AlignmentTask(Task):
    def __init__(self, robot, structure_assembly, realignment=False, key=None):
        super(AlignmentTask, self).__init__(key)
        self.robot = robot
        self.structure_assembly = structure_assembly
        self.realignment = realignment

    def assembly_to_frames_and_points(self, assembly, key_list=[], attribute=None):
        frames = []
        points = []
        for key in key_list:
            if attribute is None:
                main_frame = assembly.part(key).frame
            else:
                main_frame = assembly.graph.node_attribute(key, attribute)
            frames.append(main_frame)
            points.append(main_frame.point)
            corners = assembly.part(key).shape.points
            for c in corners:
                points.append(c.transformed(Transformation.from_frame(main_frame)))
        return frames, points

    def slerp_quat(self, q1, q2, t):
        q1 = q1 / np.linalg.norm(q1)
        q2 = q2 / np.linalg.norm(q2)
        dot = np.dot(q1, q2)
        if dot < 0.0:
            q2 = -q2
            dot = -dot
        if dot > 0.9995:
            q = q1 + t * (q2 - q1)
            return q / np.linalg.norm(q)
        theta_0 = np.arccos(dot)
        theta = theta_0 * t
        q3 = q2 - q1 * dot
        q3 = q3 / np.linalg.norm(q3)
        return q1 * np.cos(theta) + q3 * np.sin(theta)

    def kabsch_wahba_alignment(self, frames_src, frames_tgt, w_orient=1.0):
        # if len(frames_src) != len(frames_tgt):
        #     self.log("Need ≥3 frame correspondences")
        #     return None, None, None

        positions_src, positions_tgt, quats_src, quats_tgt = [], [], [], []
        for f_src, f_tgt in zip(frames_src, frames_tgt):
            positions_src.append(f_src.point)
            positions_tgt.append(f_tgt.point)
            Rs = np.column_stack([f_src.xaxis, f_src.yaxis, f_src.zaxis])
            Rt = np.column_stack([f_tgt.xaxis, f_tgt.yaxis, f_tgt.zaxis])
            quats_src.append(R.from_matrix(Rs).as_quat())
            quats_tgt.append(R.from_matrix(Rt).as_quat())

        positions_src = np.array(positions_src)
        positions_tgt = np.array(positions_tgt)
        quats_src = np.array(quats_src)
        quats_tgt = np.array(quats_tgt)

        # 1. Position alignment
        Pc, Qc = positions_src - positions_src.mean(axis=0), positions_tgt - positions_tgt.mean(axis=0)
        H = Pc.T @ Qc
        U, _, Vt = np.linalg.svd(H)
        R_pos = Vt.T @ U.T
        if np.linalg.det(R_pos) < 0:
            Vt[-1, :] *= -1
            R_pos = Vt.T @ U.T

        # 2. Orientation alignment
        vec_src, vec_tgt = [], []
        for qs, qt in zip(quats_src, quats_tgt):
            Rs = R.from_quat(qs).as_matrix()
            Rt = R.from_quat(qt).as_matrix()
            vec_src.extend(Rs.T)
            vec_tgt.extend(Rt.T)
        vec_src, vec_tgt = np.array(vec_src), np.array(vec_tgt)
        R_orient, _ = R.align_vectors(vec_tgt, vec_src)
        
        # 3. Weighted blending
        q_pos = R.from_matrix(R_pos).as_quat()
        q_orient = R_orient.as_quat()
        q_blend = self.slerp_quat(q_pos, q_orient, np.clip(w_orient, 0.0, 1.0))
        R_combined = R.from_quat(q_blend).as_matrix()

        # 4. Translation
        t_opt = positions_tgt.mean(axis=0) - R_combined @ positions_src.mean(axis=0)

        # 5. Build 4x4 matrix
        T_mat = np.eye(4)
        T_mat[:3, :3] = R_combined
        T_mat[:3, 3] = t_opt
        
        # Convert numpy array to nested list before giving to COMPAS
        T = Transformation.from_matrix(T_mat.tolist())
        frame_result = Frame.from_transformation(T)

        self.log("Kabsch/Wahba algorithm gave the initial guess {}.".format(frame_result))
        return T, frame_result, T_mat

    def points_to_pointcloud(self, points):
        array = [[x,y,z] for x, y, z in iter(points)]
        pcd = open3d.geometry.PointCloud()
        pcd.points = open3d.utility.Vector3dVector(array)
        pcd.voxel_down_sample(0.0001)
        return pcd
    
    def icp_alignment(self, pcd_src, pcd_tgt, initial_guess, threshold=0.05):
        initial_guess_p = frame_to_rhino_plane(initial_guess)
        trans_init, evaluation = evaluate_local_registration(pcd_src, pcd_tgt, threshold, initial_guess_p)
        registration_icp = execute_icp_local_registration(pcd_src, pcd_tgt, threshold, trans_init)
        T_ICP = Transformation.from_matrix(list(registration_icp.transformation))
        frame_result = Frame.worldXY().transformed(T_ICP)

        return T_ICP, frame_result

    def run(self, stop_thread):
        self.log("Computing transformation between OKVIS and Rhino worlds.")

        # Compute Tokvis_to_rhino via alignment. Source frames will be the estimated frames in BCF, target frames will be the planned frames in WCF. 
        # Result will give Tokvis_to_rhino.

        if self.realignment is False: # For the initial alignment between estimated and planned brick poses.
            temporary_keys = [k for k in self.structure_assembly.graph.nodes_where({"temporary":True})]
            anchor_keys = [t for t in self.structure_assembly.graph.nodes_where({"anchor":True})]

            frames_src, points_src = self.assembly_to_frames_and_points(self.structure_assembly, temporary_keys, "estimated_frame") # temporary estimated ones
            frames_tgt, points_tgt = self.assembly_to_frames_and_points(self.structure_assembly, anchor_keys, "planned_frame") # built planned ones (in 2nd alignment, we might have to match them first and then select the keys...)

        else:
            self.log("Realignment.")

            anchor_keys = [t for t in self.structure_assembly.graph.nodes_where({"anchor":True})]

            frames_src, points_src = self.assembly_to_frames_and_points(self.structure_assembly, anchor_keys, "estimated_frame") # temporary estimated ones
            frames_tgt, points_tgt = self.assembly_to_frames_and_points(self.structure_assembly, anchor_keys, "planned_frame")  # built planned ones

        T, initial_guess, T_mat = self.kabsch_wahba_alignment(frames_src, frames_tgt)

        pcd_src = self.points_to_pointcloud(points_src)
        pcd_tgt = self.points_to_pointcloud(points_tgt)

        Tokvis_to_rhino, frame_result = self.icp_alignment(pcd_src, pcd_tgt, initial_guess)
        
        self.log("ICP computed Tokvisrhino is {}".format(Tokvis_to_rhino))
        WCF_slam = self.robot.WCF_slam
        self.robot.WCF_slam = WCF_slam.transformed(Tokvis_to_rhino)
        # self.robot.WCF_slam = Tokvis_to_rhino
        self.robot.is_aligned = True # Should be false once robot starts moving.
        self.robot._record_state("WCF_slam update")

        if self.realignment:
            #realignment
            anchor_keys = list(self.structure_assembly.graph.nodes_where({"anchor":True}))

            for a in anchor_keys:

                estimated_frame = self.structure_assembly.graph.node_attribute(a, 'estimated_frame').copy()
                estimated_frame_t = estimated_frame.transformed(Tokvis_to_rhino)
                self.structure_assembly.part(a).frame = estimated_frame_t
                self.structure_assembly.graph.node_attribute(a, 'estimated_frame', estimated_frame_t)

                estimated_frame = self.structure_assembly.graph.node_attribute(a, 'estimated_frame_BCF').copy()
                estimated_frame_t = estimated_frame.transformed(Tokvis_to_rhino)
                self.structure_assembly.graph.node_attribute(a, 'estimated_frame_BCF', estimated_frame_t)

        self.is_completed = True
        return True

class ScanSingleBrickTask(ScanBricksTask):
    def __init__(self, robot, assembly, brick_key_to_update, frame_attribute="estimated_frame", average=False, key=None):
        super(ScanSingleBrickTask, self).__init__(robot, key=key)
        self.assembly = assembly
        self.brick_key_to_update = brick_key_to_update
        self.frame_attribute = frame_attribute
        self.average = average

        self.brick_shape = Box(xsize=0.24, ysize=0.115, zsize=0.05)
    
    def slerp_quat(self, q1, q2, t):
        q1 = q1 / np.linalg.norm(q1)
        q2 = q2 / np.linalg.norm(q2)
        dot = np.dot(q1, q2)
        if dot < 0.0:
            q2 = -q2
            dot = -dot
        if dot > 0.9995:
            q = q1 + t * (q2 - q1)
            return q / np.linalg.norm(q)
        theta_0 = np.arccos(dot)
        theta = theta_0 * t
        q3 = q2 - q1 * dot
        q3 = q3 / np.linalg.norm(q3)
        return q1 * np.cos(theta) + q3 * np.sin(theta)

    def average_frame(self, frame_a, frame_b):
        # --- Average position ---
        p = Point(
            0.5 * (frame_a.point.x + frame_b.point.x),
            0.5 * (frame_a.point.y + frame_b.point.y),
            0.5 * (frame_a.point.z + frame_b.point.z),
        )

        # --- Average orientation via SLERP ---
        R_a = Rotation.from_frame(frame_a)
        R_b = Rotation.from_frame(frame_b)

        qa = np.array(R_a.quaternion)
        qb = np.array(R_b.quaternion)

        q_avg = self.slerp_quat(qa, qb, 0.5)
        R_avg = Rotation.from_quaternion(q_avg)

        # --- Build averaged frame ---
        avg_frame = Frame.from_rotation(R_avg)
        avg_frame.point = p
        return avg_frame

    def run(self, stop_thread):
        brick_dict = self.get_detected_bricks(stop_thread)

        self.log("Updating only the brick {}...".format(self.brick_key_to_update))

        # Compare the pose to each pose in assembly by seeing the distance.
        target_key = None
        closest_distance = 0.15

        for brick_id, pose in brick_dict.items():
            pose_BCF = pose
            pose = self.robot.from_BCF_to_WCF(pose_BCF) # Pre-alignment it is same with from_BCF_slam_to_WCF_slam() cause WCF_slam is World.XY()

            distance = distance_point_point(self.assembly.part(self.brick_key_to_update).frame.point, pose.point)
            self.log("Distance is {}".format(distance))
            if distance < closest_distance:
                closest_distance = distance
                target_key = brick_id

        if target_key is None:
            self.log(f"No match found for brick {self.brick_key_to_update}")
        # Update pose
        else:
            self.log("Updating the pose of the brick key {} with id {}".format(self.brick_key_to_update, target_key))
            pose_BCF = brick_dict[target_key]
            pose = self.robot.from_BCF_to_WCF(brick_dict[target_key])

            if self.average:
                self.log("Averaging the pose with the current pose in assembly.")
                if self.frame_attribute is not None:
                    current_pose = self.assembly.graph.node_attribute(self.brick_key_to_update, self.frame_attribute)
                else:
                    current_pose = self.assembly.part(self.brick_key_to_update).frame
                # find average:
                self.log("Current_Pose is {}".format(current_pose))

                average_pose = self.average_frame(current_pose, pose)

                self.log("average_pose is {}".format(average_pose))
                pose = average_pose
                pose_BCF = self.robot.from_WCF_to_BCF(pose)
            
            part = self.assembly.part(self.brick_key_to_update)
            part.frame = pose.copy()

            if self.frame_attribute is not None:
                self.assembly.graph.node_attribute(self.brick_key_to_update, self.frame_attribute, pose.copy())
                self.assembly.graph.node_attribute(self.brick_key_to_update, self.frame_attribute + '_BCF', pose_BCF.copy())

            # # Append a collision mesh.
            # if self.scene != None:
            #     pose_WCF = self.robot.from_RCF_to_BCF(pose)
            #     collision_mesh = CollisionMesh(self.assembly.find_by_key(brick_key).mesh.transformed(Transformation.from_frame(pose_WCF)), str(brick_key))
            #     self.scene.remove_collision_mesh(str(brick_key))
            #     self.scene.add_collision_mesh(collision_mesh)
            #     self.log('Updated collision mesh with key {}.'.format(brick_key))
                
        self.is_completed = True
        return True

temporary_keys = [k for k in building_structure.graph.nodes_where({"temporary":True})]
anchor_keys = [t for t in building_structure.graph.nodes_where({"anchor":True})]
print(temporary_keys)
print(anchor_keys)

if routine == "receive_bcf":
    tasks = [ReceiveBCFslamTask(robot)]
                # ReceiveBCFgtTask(robot)]

elif routine == "move_home":
    tasks = []
    # tasks.append(MoveArmJointsViaActionTask(robot, start_config, execute=True))
    tasks.append(MoveArmPoseViaActionTask(robot, target_frame, execute=True))

elif routine == "general_snapshot":
    tasks = [ChangeToolFrameTask(robot, "gripper")]
    # tasks.append(MotionPlanExecuteJoints(robot, start_config))

    anchor_snap_planes = snap_planes[-1:] + snap_planes[0:2]
    for snap_plane in anchor_snap_planes:
        frame_BCF = plane_to_compas_frame(snap_plane).transformed(Translation.from_vector([0,-0.05,0]))
        frame_RCF = robot.from_BCF_to_RCF(frame_BCF)
        target_planes.append(frame_to_rhino_plane(robot.from_BCF_to_WCF(frame_BCF)))

        tasks.append(MoveLinearURdirectTask(robot, robot_address, frame_RCF, in_RCF=True))
        # tasks.append(MotionPlanExecutePose(robot, frame_BCF, frame_in_WCF=False))

        tasks.append(CleanBricksTask(robot))
        tasks.append(TriggerEstimationTask(robot, trigger=True, sleep=20))
        tasks.append(ScanAllBricksTask(robot, assembly=building_structure, anchor=True))
        tasks.append(TriggerEstimationTask(robot, trigger=False, sleep=0))

    # tasks.append(MotionPlanExecuteJoints(robot, start_config))

elif routine == "closeup_snapshot":
    tasks = [ChangeToolFrameTask(robot, "camera")]
    # tasks.append(MotionPlanExecuteJoints(robot, start_config))

    temporary_keys = list(building_structure.graph.nodes_where({"temporary":True}))
    print(temporary_keys)

    for temporary_key in temporary_keys:
        estimated_frame_BCF = building_structure.graph.node_attribute(temporary_key, 'estimated_frame_BCF')
        closeup_snapshot = plane_to_compas_frame(closeup_plane)
        snapshot_frame_BCF = closeup_snapshot.transformed(Transformation.from_frame(estimated_frame_BCF))
        
        target_planes.append(frame_to_rhino_plane(robot.from_BCF_to_WCF(snapshot_frame_BCF)))

        snapshot_frame_RCF = robot.from_BCF_to_RCF(snapshot_frame_BCF)
        tasks.append(MoveLinearURdirectTask(robot, robot_address, snapshot_frame_RCF, in_RCF=True))
        # tasks.append(MotionPlanExecutePose(robot, snapshot_frame_BCF, frame_in_WCF=False))

        tasks.append(CleanBricksTask(robot))
        tasks.append(TriggerEstimationTask(robot, trigger=True, sleep=10))
        tasks.append(ScanSingleBrickTask(robot, assembly=building_structure, brick_key_to_update=temporary_key))
        tasks.append(TriggerEstimationTask(robot, trigger=False, sleep=0))

    # tasks.append(TriggerEstimationTask(robot, trigger=False, cuda_off=True, sleep=0))
    # tasks.append(MotionPlanExecuteJoints(robot, start_config))

elif routine == "alignment":
    tasks = []
    tasks.append(AlignmentTask(robot, structure_assembly=building_structure))
    tasks.append(TransformAlignmentTask(robot, stack_assembly=material_stack, structure_assembly=building_structure))

elif routine == "general_snapshot_pick":
    tasks = [ChangeToolFrameTask(robot, "gripper")]
    # tasks.append(MotionPlanExecuteJoints(robot, start_config))
    tasks.append(MoveLinearURdirectTask(robot, robot_address, front_frame_RCF, in_RCF=True))
    tasks.append(MoveLinearURdirectTask(robot, robot_address, right_frame_RCF, in_RCF=True))

    left_stack = False
    if left_stack:
        stack_snap_planes = snap_planes[-1:] + snap_planes[0:2]
    else:
        stack_snap_planes = snap_planes[-3:-1]

    for snap_plane in stack_snap_planes:
        frame_BCF = plane_to_compas_frame(snap_plane).transformed(Translation.from_vector([0,-0.05,0]))
        frame_RCF = robot.from_BCF_to_RCF(frame_BCF)
        target_planes.append(frame_to_rhino_plane(robot.from_BCF_to_WCF(frame_BCF)))

        tasks.append(MoveLinearURdirectTask(robot, robot_address, frame_RCF, in_RCF=True))
        # tasks.append(MotionPlanExecutePose(robot, frame_BCF, frame_in_WCF=False))

        tasks.append(CleanBricksTask(robot))
        tasks.append(TriggerEstimationTask(robot, trigger=True, sleep=20))
        tasks.append(ScanAllBricksTask(robot, assembly=material_stack, anchor=False))
        tasks.append(TriggerEstimationTask(robot, trigger=False, sleep=0))

elif routine == "closeup_snapshot_pick":
    tasks = []
    pick_key = select_pick_brick(material_stack)
    print(pick_key)
    st['current_pick_key'] = pick_key
    pick_estimated_frame_BCF = material_stack.graph.node_attribute(pick_key, 'estimated_frame_BCF')

    # closeup_snapshot = Frame(point=Point(x=0.390, y=-0.298, z=-0.325), xaxis=Vector(x=-0.471, y=-0.879, z=0.076), yaxis=Vector(x=0.570, y=-0.238, z=0.786))
    # planned_snapshot_frame_BCF = closeup_snapshot.transformed(Transformation.from_frame(pick_estimated_frame_BCF))
    # planned_snapshot_frame_BCF = planned_snapshot_frame_BCF.transformed(Rotation.from_axis_and_angle(pick_estimated_frame_BCF.zaxis, math.radians(180), pick_estimated_frame_BCF.point))

    closeup_snapshot = plane_to_compas_frame(closeup_plane)

    planned_snapshot_frame_BCF = closeup_snapshot.transformed(Transformation.from_frame(pick_estimated_frame_BCF))
    planned_snapshot_frame_BCF = planned_snapshot_frame_BCF.transformed(Rotation.from_axis_and_angle(pick_estimated_frame_BCF.zaxis, math.radians(0), pick_estimated_frame_BCF.point))
    planned_snapshot_frame_RCF = robot.from_BCF_to_RCF(planned_snapshot_frame_BCF)

    target_planes.append(frame_to_rhino_plane(robot.from_RCF_to_WCF(right_frame_RCF)))
    target_planes.append(frame_to_rhino_plane(robot.from_BCF_to_WCF(planned_snapshot_frame_BCF)))

    tasks = [ChangeToolFrameTask(robot, "gripper")]
    tasks.append(MoveLinearURdirectTask(robot, robot_address, right_frame_RCF, in_RCF=True))
    tasks.append(ChangeToolFrameTask(robot, "camera"))
    tasks.append(MoveLinearURdirectTask(robot, robot_address, planned_snapshot_frame_RCF, in_RCF=True))
    # tasks.append(MotionPlanExecutePose(robot, planned_snapshot_frame_BCF, frame_in_WCF=False))

    tasks.append(CleanBricksTask(robot))
    tasks.append(TriggerEstimationTask(robot, trigger=True, sleep=20))
    tasks.append(ScanSingleBrickAddNewTask(robot, assembly=material_stack, brick_key_to_update=pick_key, average=False))
    tasks.append(TriggerEstimationTask(robot, trigger=False, sleep=0))

elif routine in ["pick", "pick_place"]:   
    pick_key = st['current_pick_key']
    print(pick_key)

    #pick_estimated_frame_BCF = material_stack.graph.node_attribute(pick_key, 'estimated_frame_BCF').transformed(Translation.from_vector([0,0,0.03]))
    pick_estimated_frame = material_stack.part(pick_key).frame.transformed(Translation.from_vector([0,0,0.025]))
    mid_pick_estimated_frame = pick_estimated_frame.transformed(Translation.from_vector([0,0,0.1]))
    safe_pick_estimated_frame = pick_estimated_frame.transformed(Translation.from_vector([0,0,0.3]))

    safe_pick_estimated_frame_RCF = robot.from_WCF_to_RCF(safe_pick_estimated_frame)
    mid_pick_estimated_frame_RCF = robot.from_WCF_to_RCF(mid_pick_estimated_frame)

    target_planes.append(frame_to_rhino_plane(safe_pick_estimated_frame))
    target_planes.append(frame_to_rhino_plane(mid_pick_estimated_frame))
    target_planes.append(frame_to_rhino_plane(pick_estimated_frame))
    target_planes.append(frame_to_rhino_plane(robot.from_RCF_to_WCF(right_frame_RCF)))

    tasks = [ChangeToolFrameTask(robot, "gripper")]
    tasks.append(MoveLinearURdirectTask(robot, robot_address, safe_pick_estimated_frame_RCF, in_RCF=True))
    tasks.append(MoveLinearURdirectTask(robot, robot_address, mid_pick_estimated_frame_RCF, in_RCF=True))
    tasks.append(PickBrickURTask(robot, robot_address, material_stack, pick_key, grip=True))
    tasks.append(MoveLinearURdirectTask(robot, robot_address, mid_pick_estimated_frame_RCF, in_RCF=True))
    tasks.append(MoveLinearURdirectTask(robot, robot_address, right_frame_RCF, in_RCF=True))
    tasks.append(UpdateAssemblyAttributes(material_stack, pick_key, attributes={"built":False, "available":False}))

elif routine == "static_pick":   
    pick_estimated_frame = target_frame.transformed(Translation.from_vector([0,0,0.025]))
    mid_pick_estimated_frame = pick_estimated_frame.transformed(Translation.from_vector([0,0,0.1]))
    safe_pick_estimated_frame = pick_estimated_frame.transformed(Translation.from_vector([0,0,0.6]))

    safe_pick_estimated_frame_RCF = robot.from_WCF_to_RCF(safe_pick_estimated_frame)
    mid_pick_estimated_frame_RCF = robot.from_WCF_to_RCF(mid_pick_estimated_frame)

    target_planes.append(frame_to_rhino_plane(safe_pick_estimated_frame))
    target_planes.append(frame_to_rhino_plane(mid_pick_estimated_frame))
    target_planes.append(frame_to_rhino_plane(pick_estimated_frame))
    target_planes.append(frame_to_rhino_plane(robot.from_RCF_to_WCF(front_frame_RCF)))

    tasks = [ChangeToolFrameTask(robot, "gripper")]
    tasks.append(MoveLinearURdirectTask(robot, robot_address, front_frame_RCF, in_RCF=True, velocity=vel))
    tasks.append(MoveLinearURdirectTask(robot, robot_address, safe_pick_estimated_frame_RCF, in_RCF=True, velocity=vel))
    tasks.append(MoveLinearURdirectTask(robot, robot_address, mid_pick_estimated_frame_RCF, in_RCF=True, velocity=vel))
    tasks.append(SimplePickBrickURTask(robot, robot_address, grip=True))
    tasks.append(MoveLinearURdirectTask(robot, robot_address, mid_pick_estimated_frame_RCF, in_RCF=True, velocity=vel))
    tasks.append(MoveLinearURdirectTask(robot, robot_address, front_frame_RCF, in_RCF=True, velocity=vel))

# elif routine == "place":
#     tasks = []
    
    place_key = 53#select_place_brick(building_structure, robot)
    print(place_key)

    place_planned_frame = building_structure.graph.node_attribute(place_key, 'planned_frame').transformed(
                                                                Translation.from_vector([0,0,0.05]))
    mid_place_planned_frame = place_planned_frame.transformed(Translation.from_vector([0,0,0.15]))
    safe_place_planned_frame = place_planned_frame.transformed(Translation.from_vector([0,0,0.5]))

    safe_place_planned_frame_RCF = robot.from_WCF_to_RCF(safe_place_planned_frame)
    mid_place_planned_frame_RCF = robot.from_WCF_to_RCF(mid_place_planned_frame)

    target_planes.append(frame_to_rhino_plane(robot.from_RCF_to_WCF(front_frame_RCF)))
    target_planes.append(frame_to_rhino_plane((safe_place_planned_frame)))
    target_planes.append(frame_to_rhino_plane((mid_place_planned_frame)))
    target_planes.append(frame_to_rhino_plane((place_planned_frame)))

    tasks.append(ChangeToolFrameTask(robot, "gripper"))
    tasks.append(MoveLinearURdirectTask(robot, robot_address, front_frame_RCF, in_RCF=True, velocity=vel))
    tasks.append(MoveLinearURdirectTask(robot, robot_address, safe_place_planned_frame_RCF, in_RCF=True, velocity=vel))
    tasks.append(MoveLinearURdirectTask(robot, robot_address, mid_place_planned_frame_RCF, in_RCF=True, velocity=vel))
    tasks.append(PlaceBrickURTask(robot, robot_address))
    tasks.append(MoveLinearURdirectTask(robot, robot_address, mid_place_planned_frame_RCF, in_RCF=True, velocity=vel))
    tasks.append(MoveLinearURdirectTask(robot, robot_address, front_frame_RCF, in_RCF=True, velocity=vel))
    tasks.append(UpdateAssemblyAttributes(building_structure, place_key, attributes={"built":True, "available":False}))

elif routine == "move_base":
    target_frame = Frame(Point(0,-0.4,0))
    print(target_frame)
    tasks = [MoveBaseViaAxialMotionTask(robot, target_frame=target_frame, in_WCF=False)]

elif routine == "closeup_reanchor":
    frame_attribute = "estimated_frame"
    parts_keys = [p for p in building_structure.part_keys()]
    anchor_keys = [p for p in parts_keys if building_structure.graph.node_attribute(p, "anchor")]
    print(anchor_keys)
    tasks = []
    tasks.append(ChangeToolFrameTask(robot, "gripper"))
    tasks.append(MoveLinearURdirectTask(robot, robot_address, front_frame_RCF, in_RCF=True, velocity=vel))
    
    for p in anchor_keys:
        planned_frame_WCF = building_structure.graph.node_attribute(p, 'planned_frame')
        safe_planned_frame_WCF = planned_frame_WCF.transformed(Translation.from_vector([0,0,0.6]))
        target_planes.append(frame_to_rhino_plane(safe_planned_frame_WCF))

        closeup_snapshot = plane_to_compas_frame(closeup_plane)
        planned_snapshot_frame_WCF = closeup_snapshot.transformed(Transformation.from_frame(planned_frame_WCF))

        for i in range(4):
            if i == 0:
                averaging = False
            else:
                averaging = True

            # if p == 18 and i == 3:
            #     ex_angle=-20
            # else:
            ex_angle=0

            safe_planned_frame_RCF = robot.from_WCF_to_RCF(safe_planned_frame_WCF)
            tasks.append(ChangeToolFrameTask(robot, "gripper"))
            tasks.append(MoveLinearURdirectTask(robot, robot_address, safe_planned_frame_RCF, in_RCF=True))

            snapshot_frame_WCF = planned_snapshot_frame_WCF.transformed(Rotation.from_axis_and_angle(planned_frame_WCF.zaxis, math.radians((90*i)+ex_angle), planned_frame_WCF.point))
            target_planes.append(frame_to_rhino_plane(snapshot_frame_WCF))
            snapshot_frame_RCF = robot.from_WCF_to_RCF(snapshot_frame_WCF)
            tasks.append(ChangeToolFrameTask(robot, "camera"))
            tasks.append(MoveLinearURdirectTask(robot, robot_address, snapshot_frame_RCF, in_RCF=True))

            tasks.append(CleanBricksTask(robot))
            tasks.append(TriggerEstimationTask(robot, trigger=True, sleep=10))
            tasks.append(ScanSingleBrickTask(robot, assembly=building_structure, brick_key_to_update=p, frame_attribute=frame_attribute, average=averaging))
            tasks.append(TriggerEstimationTask(robot, trigger=False, sleep=0))
    
    tasks.append(ChangeToolFrameTask(robot, "gripper"))
    tasks.append(MoveLinearURdirectTask(robot, robot_address, front_frame_RCF, in_RCF=True, velocity=vel))

elif routine == "realignment":
    tasks = []
    tasks.append(AlignmentTask(robot, structure_assembly=building_structure, realignment=True))

elif routine == "correct_last":
    p = 7
    frame_attribute = "estimated_frame"
    planned_frame_WCF = building_structure.graph.node_attribute(p, 'planned_frame')
    closeup_snapshot = plane_to_compas_frame(closeup_plane)
    # closeup_snapshot = Frame(point=Point(x=0.390, y=-0.298, z=-0.325), xaxis=Vector(x=-0.471, y=-0.879, z=0.076), yaxis=Vector(x=0.570, y=-0.238, z=0.786))
    planned_snapshot_frame_WCF = closeup_snapshot.transformed(Transformation.from_frame(planned_frame_WCF))
    planned_snapshot_frame_WCF = planned_snapshot_frame_WCF.transformed(Rotation.from_axis_and_angle(planned_frame_WCF.zaxis, math.radians(0), planned_frame_WCF.point))
    # target_planes.append(frame_to_rhino_plane(planned_snapshot_frame_WCF))

    # tasks = [ChangeToolFrameTask(robot, "camera")]
    # tasks.append(CleanBricksTask(robot))
    # tasks.append(MotionPlanExecutePose(robot, planned_snapshot_frame_WCF, frame_in_WCF=True))
    # tasks.append(TriggerEstimationTask(robot, trigger=True, sleep=30))
    # tasks.append(ScanSingleBrickTask(robot, assembly=building_structure, brick_key_to_update=p, frame_attribute=frame_attribute, average=True))
    # tasks.append(TriggerEstimationTask(robot, trigger=False, sleep=0))

    ########

    pick_estimated_frame_BCF = building_structure.graph.node_attribute(p, 'estimated_frame_BCF').transformed(Translation.from_vector([0,0,0.04]))
    mid_estimated_frame_BCF = pick_estimated_frame_BCF.transformed(Translation.from_vector([0,0,0.04]))
    safe_pick_estimated_frame_BCF = pick_estimated_frame_BCF.transformed(Translation.from_vector([0,0,0.15]))

    target_planes.append(frame_to_rhino_plane(robot.from_BCF_to_WCF(safe_pick_estimated_frame_BCF)))
    target_planes.append(frame_to_rhino_plane(robot.from_BCF_to_WCF(pick_estimated_frame_BCF)))
    
    estimated_frame = building_structure.graph.node_attribute(p, 'estimated_frame')
    planned_frame = building_structure.graph.node_attribute(p, 'planned_frame')

    av_frame = average_frame(planned_frame, estimated_frame)
    # building_structure.part(p).frame = av_frame

    print(av_frame)
    place_planned_frame = av_frame.transformed(Translation.from_vector([0,0,0.04]))
    mid_place_planned_frame = place_planned_frame.transformed(Translation.from_vector([0,0,0.04]))
    safe_place_planned_frame = place_planned_frame.transformed(Translation.from_vector([0,0,0.15]))

    target_planes.append(frame_to_rhino_plane((safe_place_planned_frame)))
    target_planes.append(frame_to_rhino_plane((place_planned_frame)))

    # tasks = [ChangeToolFrameTask(robot, "gripper"),
    #             MotionPlanExecutePose(robot, safe_pick_estimated_frame_BCF, frame_in_WCF=False),
    #             GripperControlTask(robot, open_grip=True),
    #             MotionPlanExecutePose(robot, mid_estimated_frame_BCF, frame_in_WCF=False, tool_constraint=True),
    #             MotionPlanExecutePose(robot, pick_estimated_frame_BCF, frame_in_WCF=False, tool_constraint=True),
    #             GripperControlTask(robot, open_grip=False),
    #             MotionPlanExecutePose(robot, safe_pick_estimated_frame_BCF, frame_in_WCF=False, tool_constraint=True)]

    tasks = [ChangeToolFrameTask(robot, "gripper"),
                MotionPlanExecutePose(robot, safe_place_planned_frame, frame_in_WCF=True, tool_constraint=False),
                MotionPlanExecutePose(robot, mid_place_planned_frame, frame_in_WCF=True, tool_constraint=True),
                MotionPlanExecutePose(robot, place_planned_frame, frame_in_WCF=True, tool_constraint=True),
                GripperControlTask(robot, open_grip=True),
                MotionPlanExecutePose(robot, mid_place_planned_frame, frame_in_WCF=True, tool_constraint=True),
                MotionPlanExecutePose(robot, safe_place_planned_frame, frame_in_WCF=True, tool_constraint=True),
                GripperControlTask(robot, open_grip=False)]

elif routine == "attach_meshes":
    if material_stack is not None:
        material_stack_t = material_stack.transformed(robot.transformation_WCF_BCF())
        meshes = []
        mesh_ids = []
        frames = []
        for key in material_stack_t.part_keys():
            part_mesh = material_stack_t.part(key).mesh
            meshes.append(part_mesh)
            vertices = [part_mesh.vertex_coordinates(i) for i in part_mesh.vertices()]
            mesh_id = "brick_"+str(key)
            mesh_ids.append(mesh_id)
            frames.append(Frame.worldXY())
        tasks = [AddCollisionMeshes(robot, meshes, frames, mesh_ids, attached=False)]

    # if assemblies[0] is not None:
    #     stack_assembly = assemblies[0]
    #     t_stack_assembly = stack_assembly.transformed(robot.transformation_WCF_BCF())
    #     tasks = []
    #     for key in t_stack_assembly.part_keys():
    #         part_mesh = t_stack_assembly.part(key).mesh
    #         vertices = [part_mesh.vertex_coordinates(i) for i in part_mesh.vertices()]
    #         tasks.append(AddCollisionMesh(robot, mesh=part_mesh, mesh_id="brick_"+str(key), attached=False))
    # tasks = [AddCollisionMesh(robot, mesh = a_mesh, mesh_id="thing", attached=False)]
    # tasks = [RemoveCollisionMesh(robot, mesh_id="thing")]


# place_key = 168
# print(place_key)

# # place_planned_frame = building_structure.graph.node_attribute(place_key, 'estimated_frame').transformed(
# #                                                             Translation.from_vector([0,0,0.05]))
# place_planned_frame = Frame(point=Point(x=1.118, y=-0.548, z=-0.028), xaxis=Vector(x=-0.033, y=-0.998, z=0.062), yaxis=Vector(x=0.998, y=-0.036, z=-0.042))

# place_planned_frame = place_planned_frame.transformed(Rotation.from_axis_and_angle(place_planned_frame.xaxis, math.radians(180), place_planned_frame.point))
# mid_place_planned_frame = place_planned_frame.transformed(Translation.from_vector([0,0,0.15]))
# safe_place_planned_frame = place_planned_frame.transformed(Translation.from_vector([0,0,0.5]))

# safe_place_planned_frame_RCF = robot.from_BCF_to_RCF(safe_place_planned_frame)
# mid_place_planned_frame_RCF = robot.from_BCF_to_RCF(mid_place_planned_frame)

# target_planes=[]
# target_planes.append(frame_to_rhino_plane((safe_place_planned_frame)))
# target_planes.append(frame_to_rhino_plane((mid_place_planned_frame)))
# target_planes.append(frame_to_rhino_plane((place_planned_frame)))
# # target_planes.append(frame_to_rhino_plane((robot.from_RCF_to_WCF(front_frame_RCF))))
# # target_planes.append(frame_to_rhino_plane((robot.from_RCF_to_WCF(right_frame_RCF))))

# tasks = [ChangeToolFrameTask(robot, "gripper"),
#             MoveLinearURdirectTask(robot, robot_address, mid_place_planned_frame_RCF, in_RCF=True)]

print(tasks)
# ---------- end generate_tasks_2 ----------
list_9 = ValueList({"0 zero_configuration": 0, "1 forward_kinematics": 1, "2 analytic_inverse_kinematics": 2, "3 inverse_kinematics": 3, "4 motion_planning": 4, "5 real_configuration_ros": 5, "6 real_configuration_ur": 6}, selected="6 real_configuration_ur")
show_rcf = BooleanToggle(True)
show_robot_collision = BooleanToggle(False)

list_10 = ValueList({"from_robot": 0, "from_file": 1}, selected="from_robot")
list_11 = ValueList({"worldXY": 0, "robot_base_plane": 1}, selected="worldXY")
filter_4 = StreamFilter(Gate=list_10, Stream0=py3_8.pcd_pp, Stream1=py3_9.pcd)
py3_11 = Python3Script(source=filter_4, anchor=list_11)  # -> out, cloud_out
# ---------- py3_11: Python ----------
from compas.geometry import Point, Frame, Transformation
from compas_rhino.conversions import point_to_rhino, frame_to_rhino_plane

if anchor == 1:
    robot_frame = frame_to_rhino_plane(base_plane)
    transformation = Transformation.from_change_of_basis(Frame.worldXY(), robot_frame)
    points = [Point(*pt).transformed(transformation) for pt in source.points]
elif anchor == 0:
    points = [Point(*pt) for pt in source.points]

cloud_out = [point_to_rhino(pt) for pt in points]
# ---------- end py3_11 ----------
pt_4 = Point(py3_11.cloud_out)

lift_height_at_measuring = Panel("0.0")

# ----
# Move Joints
list_12 = ValueList({"send ik configuration": 0, "send one motion configuration": 1, "send all motion configurations": 2}, selected="send ik configuration")
filter_5 = StreamFilter(Gate=list_12, Stream0=forward_kinematics)
movej = Python3Script(configurations=filter_5, velocity=Slider(0.079, range=0..0.5))  # -> urscript, lift, values; inputs configurations: list
# ---------- movej: Python ----------
from ur_fabrication_control.direct_control import URScript
from compas_robots import Configuration
import math

urscript = URScript()
urscript.start()
for configuration in configurations:
    joint_configuration = Configuration.from_revolute_values(configuration.revolute_values)
    print(joint_configuration)
    lift = configuration
    urscript.move_joint(joint_configuration, velocity)
urscript.end()

urscript = urscript.generate()

print(urscript)
# ---------- end movej ----------
send_3 = Button()
ur_send = Python3Script(urscript=movej.urscript, send=send_3)  # -> out
# ---------- ur_send: Python ----------
from scriptcontext import sticky as st
from ur_fabrication_control.direct_control import send_script

ur_ip = st["ur_ip"]
ur_port = st["ur_port"]

print(urscript)

if send:
    send_script(urscript, ur_ip, ur_port)
# ---------- end ur_send ----------

# ----
# Stop
stop_3 = Button()
X = Python3Script(stop=stop_3)
# ---------- X: Python ----------
from scriptcontext import sticky as st
from ur_fabrication_control.direct_control.common import send_stop

ur_ip = st["ur_ip"]
ur_port = st["ur_port"]

if stop:
    send_stop(ur_ip, ur_port)
# ---------- end X ----------

pln_6 = Plane()
pln_7 = Plane(Plane(origin=(0.6518296253, -3.586848964, 1.284552012), x=(0, -1, 0), y=(-1, 0, 0)))
pln_8 = Plane(Plane(origin=(-0.4380949354, -2.48856446, 1.209501014), x=(0, 1, 0), y=(1, 0, 0)))
reload_2 = Button()

# ----
# Move Cartesian
list_13 = ValueList({"send one cartesian position": 0, "send all cartesian positions": 1, "send camera position": 2, "send print layer": 3}, selected="send print layer")
radius = Slider(0.01, range=0..0.5)
filter_6 = StreamFilter(Gate=list_13, Stream0=pln_8)
movel = Python3Script(robot=robot, planes_WCS=filter_6, velocity=Slider(0.03, range=0..0.5), radius=radius, reload=reload_2)  # -> urscript, plane_RCS; inputs planes_WCS: list of Plane
# ---------- movel: Python ----------
import Rhino.Geometry as rg
from compas.geometry import Frame
from compas.geometry import Transformation, Rotation
from compas_rhino.conversions import plane_to_compas_frame, frame_to_rhino_plane
from compas_ghpython import draw_frame
from ur_fabrication_control import direct_control 
import math

from scriptcontext import sticky as st
from ur_fabrication_control.direct_control import URScript

# retrieve the current tool frame in axis angle format
if robot.attached_tool:
    tool_angle_axis = list(robot.attached_tool.frame.point) + list(robot.attached_tool.frame.axis_angle_vector)
else:
    tool0_frame = Frame([0, 0, 0], [1, 0, 0], [0, 1, 0])
    tool_angle_axis = list(tool0_frame.point) + list(tool0_frame.axis_angle_vector)

frames_RCS = []
for plane_WCS in planes_WCS:
    frame_WCS = plane_to_compas_frame(plane_WCS)
    # transform frame to robot coordinate system
    T = Transformation.from_change_of_basis(Frame.worldXY(), robot.RCF)
    frame_RCS = robot.from_WCF_to_RCF(frame_WCS)
    frames_RCS.append(frame_RCS)

plane_RCS = frame_to_rhino_plane(frame_RCS)

urscript = URScript()
urscript.start()
urscript.set_tcp(tool_angle_axis)
for frame_RCS in frames_RCS:
    if frame_RCS == frames_RCS[0]:
        urscript.move_linear(frame=frame_RCS, velocity=velocity, radius=radius)
    else:
        urscript.move_process(frame=frame_RCS, velocity=velocity, radius=radius)
urscript.end()

urscript = urscript.generate()

print(urscript)
# ---------- end movel ----------
send_4 = Button()
ur_send_2 = Python3Script(urscript=movel.urscript, send=send_4)  # -> out
# ---------- ur_send_2: Python ----------
from scriptcontext import sticky as st
from ur_fabrication_control.direct_control import send_script

ur_ip = st["ur_ip"]
ur_port = st["ur_port"]

if send:
    send_script(urscript, ur_ip, ur_port)
# ---------- end ur_send_2 ----------

pln_9 = Plane(movel.plane_RCS)

# ----
# Get Pose Joint
get_3 = Button()
pose_2 = Python3Script(robot=robot, get=get_3)  # -> out, configuration, pose_joints
# ---------- pose_2: Python ----------
from scriptcontext import sticky as st
from ur_fabrication_control.direct_control.common import get_current_pose_joints
from compas.geometry import Frame
from compas_robots import Configuration


server_ip= st["server_ip"]
server_port = st["server_port"]
ur_port = st["ur_port"]
ur_ip = st["ur_ip"]
print(ur_ip)

guid = str(ghenv.Component.InstanceGuid)
pose_joints_key = "pose_joints" + guid

if pose_joints_key not in st:
    st[pose_joints_key] = None

# retrieve the current tool frame in axis angle format
if robot.attached_tool:
    tool_angle_axis = list(robot.attached_tool.frame.point) + list(robot.attached_tool.frame.axis_angle_vector)
else:
    tool0_frame = Frame([0, 0, 0], [1, 0, 0], [0, 1, 0])
    tool_angle_axis = list(tool0_frame.point) + list(tool0_frame.axis_angle_vector)

print(tool_angle_axis)

# send script to the robot to receive the current joint configuration
if get:
    st[pose_joints_key] = get_current_pose_joints(server_ip, server_port, ur_ip, ur_port, tool_angle_axis)

if st[pose_joints_key] is not None:
    print(st[pose_joints_key])
    # configuration = Configuration.from_revolute_values(st[pose_joints_key])
    configuration = Configuration.from_prismatic_and_revolute_values([0.0], st[pose_joints_key])
    pose_joints = configuration.joint_values
# ---------- end pose_2 ----------
panel_17 = Panel(pose_2.pose_joints)

# ----
# Visualisation
filter_7 = StreamFilter(
    Gate=list_9,
    Stream0=zero.configuration,
    Stream1=forward_kinematics,
    Stream2=analytic_inverse.configuration,
    Stream5=draw,
    Stream6=pose_2.configuration)
show_collision = BooleanToggle(False)
show_eef = BooleanToggle(True)
show_frames = BooleanToggle(False)
show_visual = BooleanToggle(True)
show_attached_collision = BooleanToggle(False)
show_bcf = BooleanToggle(True)
visualise = Python3Script(
    robot=robot,
    configuration=filter_7,
    show_frames=show_frames,
    show_visual_meshes=show_visual,
    show_robot_collision_meshes=show_robot_collision,
    show_collision_meshes=show_collision,
    show_attached_collision_meshes=show_attached_collision,
    show_BCF=show_bcf,
    show_RCF=show_rcf,
    show_EEF=show_eef,
    bang=[set_frame, attach_tool.bang])  # -> out, joint_planes, visual_meshes, robot_collision_meshes, collision_meshes, attached_meshes, BCF, RCF, EEF, EEF_in_RCF; inputs bang: list
# ---------- visualise: Python ----------
from scriptcontext import sticky as st
import time
from compas_ghpython import create_id
from compas.geometry import Frame
from compas.geometry import Transformation
from compas_rhino.conversions import frame_to_rhino, mesh_to_compas, mesh_to_rhino, frame_to_rhino_plane
from compas.scene import SceneObject
from compas_fab.robots import PlanningScene
import Rhino.Geometry as rg
import ghpythonlib.components as ghcomp

robot.update(configuration)
print(configuration)

if show_visual_meshes == True:
    visual_meshes = robot.draw_visual()
    # orient the robot to its base plane:
    robot_BCF = frame_to_rhino_plane(robot.BCF) 
    init_robot_plane = rg.Plane.WorldXY
    #visual_meshes = ghcomp.Orient(visual_meshes, init_robot_plane, robot_BCF)[0]

if show_frames == True: 
    joint_frames = robot.model.transformed_frames(configuration)
    joint_planes = [frame_to_rhino(a) for a in joint_frames]

if show_BCF:
    BCF = frame_to_rhino(robot.BCF)

if show_RCF:
    RCF = frame_to_rhino(robot.from_BCF_to_WCF(robot.RCF))

if show_EEF:
    # EEF_in_RCF = frame_to_rhino(robot.from_BCF_to_RCF(robot.forward_kinematics(
    #     configuration, options=dict())))
    EEF = frame_to_rhino(robot.from_BCF_to_WCF(robot.forward_kinematics(
        configuration, options=dict())))
    print(EEF)


if show_robot_collision_meshes == True:
    robot_collision_meshes = robot.draw_collision()

cached_scene_key = "cached_scene"

if show_collision_meshes or show_attached_collision_meshes:
    cached_scene = st.get(cached_scene_key)
    if not cached_scene:
        cached_scene = {"time": 0}

    update_scene = True

    if update_scene:
        scene = PlanningScene(robot)
        scene = robot.client.get_planning_scene()

    if update_scene and show_collision_meshes:
        collision_meshes = []

        for co in scene.world.collision_objects:
            print(co)
            header = co.header
            frame_id = header.frame_id
            cms = co.to_collision_meshes()

            for cm in cms:
                if cm.frame != Frame.worldXY():
                    t = Transformation.from_frame(cm.frame)
                    mesh = cm.mesh.transformed(t)
                else:
                    mesh = cm.mesh
                collision_meshes.extend(SceneObject(item=mesh).draw())

        cached_scene["cm"] = collision_meshes

        collision_meshes = cached_scene.get("cm", [])

    if update_scene and show_attached_collision_meshes:
        attached_meshes = []

        for aco in scene.robot_state.attached_collision_objects:
            for acm in aco.to_attached_collision_meshes():
                print(acm)
                frame_id = aco.object["header"]["frame_id"]
                frame = robot.forward_kinematics(configuration, options=dict(link=frame_id))
                t = Transformation.from_frame(frame)

                # Local CM frame
                if acm.collision_mesh.frame and acm.collision_mesh.frame != Frame.worldXY():
                    t = t * Transformation.from_frame(acm.collision_mesh.frame)

                mesh = acm.collision_mesh.mesh.transformed(t)

                attached_meshes.extend(SceneObject(item=mesh).draw())

        cached_scene["acm"] = attached_meshes

        attached_meshes = cached_scene.get("acm", [])
    
    cached_scene["time"] = time.time()
    st[cached_scene_key] = cached_scene
# ---------- end visualise ----------
pln_10 = Plane(visualise.joint_planes)
mesh_3 = Mesh(visualise.visual_meshes)
mesh_4 = Mesh(visualise.collision_meshes)
py3_12 = Python3Script(planes=[visualise.EEF, visualise.BCF, visualise.RCF], scale=Slider(0.2, range=0..1))  # -> P, V, C, W; inputs planes: list of Plane, scale: Double
# ---------- py3_12: Python ----------
from Rhino.Display import ColorRGBA
from ghpythonlib.components import ColourRGBf


red = ColourRGBf(255, 255, 0, 0)
green = ColourRGBf(255, 0, 255, 0)
blue = ColourRGBf(255, 0, 0, 255)

P = []
V = []
C = []

# scale = float(scale)

for plane in planes:
    if not plane:
        continue
    P += [plane.Origin] * 3
    V.append(plane.XAxis * scale)
    V.append(plane.YAxis * scale)
    V.append(plane.ZAxis * scale)
    C += [red, green, blue]

W = 3
# ---------- end py3_12 ----------
vdisex = VectorDisplayEx(Point=py3_12.P, Vector=py3_12.V, Colour=py3_12.C, Width=py3_12.W)
orient = Orient(Geometry=mesh_3, Source=PlaneXY(0, 0, 0), Target=visualise.BCF)  # -> Geometry, Transform
preview = CustomPreview(Geometry=orient.Geometry, Material=ColourSwatch(SwatchColor=RGB(0, 0, 0)))

mesh_5 = Mesh(visualise.attached_meshes)
eef_in_rcf = Plane(visualise.EEF_in_RCF)
eef = Plane(visualise.EEF)
mesh_6 = Mesh(visualise.robot_collision_meshes)

# ----
# RANSAC Global registration
toggle_4 = BooleanToggle(True)
number_slider_6 = Slider(0.1, range=0..0.1)

# ----
# Localisation: Point measuring
number_slider_7 = Slider(0.25, range=0..10)
number_slider_8 = Slider(0.1, range=0..0.1)

py3_13 = Python3Script(source=measurements_source_2, target=reference_target_2, threshold=number_slider_7, compute=toggle_4)  # -> out, source_out, target_out, source_at_target, plane_out, T_RANSAC
# ---------- py3_13: Python ----------
from compas.geometry import Transformation

import open3d as o3d
import Rhino.Geometry as rg

from compas.geometry import Point, Frame
from compas_rhino.conversions import point_to_rhino, frame_to_rhino_plane

from mobile_robot_control.pointcloud_processing.ransac import preprocess_point_cloud_global, execute_global_registration2

if compute: 
    source, source_fpfh = preprocess_point_cloud_global(source, threshold)
    target, target_fpfh = preprocess_point_cloud_global(target, threshold)

    result_ransac = execute_global_registration2(source, target,
                                                source_fpfh, target_fpfh,
                                                threshold)
    print(result_ransac)

    T_RANSAC = Transformation.from_matrix(list(result_ransac.transformation))
    print(T_RANSAC)
    source_out = [rg.Point3d(*pt) for pt in source.points]
    target_out = [rg.Point3d(*pt) for pt in target.points]
    source_at_target = [point_to_rhino(Point(*pt).transformed(T_RANSAC)) for pt in source.points]
    frame_out = Frame.worldXY().transformed(T_RANSAC)
    plane_out = frame_to_rhino_plane(frame_out)
# ---------- end py3_13 ----------
panel_18 = Panel(py3_13.out)
dots = DotDisplay(Point=py3_13.source_out, Colour=ColourSwatch(SwatchColor=RGB(0, 204, 255)), Size=number_slider_6)
dots_2 = DotDisplay(Point=py3_13.target_out, Colour=ColourSwatch(SwatchColor=RGB(255, 0, 0)), Size=number_slider_6)

# ----
# ICP
toggle_5 = BooleanToggle(True)
py3_14 = Python3Script(
    source=measurements_source_2,
    target=reference_target_2,
    initial_guess=py3_13.plane_out,
    threshold=Slider(0.05, range=0..1),
    compute=toggle_5)  # -> out, source_out, target_out, source_at_target, plane_out, T_ICP
# ---------- py3_14: Python ----------
from compas.geometry import Point, Frame, Transformation
from compas_rhino.conversions import point_to_rhino, frame_to_rhino_plane
import Rhino.Geometry as rg

from mobile_robot_control.pointcloud_processing.icp import preprocess_point_cloud_icp, evaluate_local_registration, execute_icp_local_registration

# source_down = preprocess_point_cloud_icp(source, voxel_size)
# target_down = preprocess_point_cloud_icp(target, voxel_size)

trans_init, evaluation = evaluate_local_registration(source, target, threshold, initial_guess)
print(evaluation)

if compute:
    registration_icp = execute_icp_local_registration(source, target, threshold, trans_init)

    print("Inlier Fitness: ", registration_icp.fitness)
    print("Inlier RMSE: ", registration_icp.inlier_rmse)

    print("Transformation: \n", registration_icp.transformation)

source_out = [rg.Point3d(*pt) for pt in source.points]
target_out = [rg.Point3d(*pt) for pt in target.points]
T_ICP = Transformation.from_matrix(list(registration_icp.transformation))
source_at_target = [point_to_rhino(Point(*pt).transformed(T_ICP)) for pt in source.points]
frame_out = Frame.worldXY().transformed(T_ICP)
plane_out = frame_to_rhino_plane(frame_out)
# ---------- end py3_14 ----------
panel_19 = Panel(py3_14.out)

dots_3 = DotDisplay(Point=py3_13.source_at_target, Colour=ColourSwatch(SwatchColor=RGB(255, 144, 0)), Size=number_slider_6)
dots_4 = DotDisplay(Point=py3_14.source_out, Colour=ColourSwatch(SwatchColor=RGB(0, 204, 255)), Size=number_slider_8)
dots_5 = DotDisplay(Point=py3_14.target_out, Colour=ColourSwatch(SwatchColor=RGB(255, 0, 0)), Size=number_slider_8)
dots_6 = DotDisplay(Point=py3_14.source_at_target, Colour=ColourSwatch(SwatchColor=RGB(255, 144, 0)), Size=number_slider_8)

# ----
# Measured RCF
# (robot plane)
pln_11 = Plane(py3_14.plane_out)

# ----
# BCF from RCF (measured)
py3_15 = Python3Script(robot=robot, lift=lift_height_at_measuring, robot_plane=pln_11)  # -> out, RCF, RCF0, BCF, RCP, robot_BCP; inputs lift: Double, robot_plane: Plane
# ---------- py3_15: Python ----------
from compas.geometry import Transformation, Translation
from compas.geometry import Frame, Vector
from compas_rhino.conversions import plane_to_compas_frame, frame_to_rhino_plane

import ghpythonlib.components as ghcomp
import Rhino.Geometry as rg


#### This was annoying....
# Frames are always transforming in Global worldXY, if you want the transformation locally, this is the way >>>

## Normal RCF (no lift)
RCF0 = robot.RCF 
## Adjusted RCF (with lift)
RCF = robot.RCF.translated([0,0,lift])

## Convert measured plane to COMPAS
robot_frame = plane_to_compas_frame(robot_plane)

''' OPTION A'''
## Get the BCF in local coordinates from RCF
# base = RCF.to_local_coordinates(Frame.worldXY())
## Get the BCF at the measured plane
# BCF = robot_frame.to_world_coordinates(base)

''' OPTION B'''
# Transformation of the RCF to the measured plane (also RCF)
T = Transformation.from_frame_to_frame(RCF, robot_frame)
# Transforming the robot_footprint(worldxy)
BCF = Frame.worldXY().transformed(T)

## Visualisation
RCP = frame_to_rhino_plane(RCF)
robot_BCP = frame_to_rhino_plane(BCF)
# ---------- end py3_15 ----------
pln_12 = Plane(py3_15.robot_BCP)
pln_13 = Plane(py3_15.RCP)
save_json = Python3Script(
    RCF=py3_15.RCF,
    RCF0=py3_15.RCF0,
    BCF=py3_15.BCF,
    lift_height=lift_height_at_measuring,
    filepath=savedirectory.DIR,
    save=Button())  # -> out, a; inputs lift_height: Double
# ---------- save_json: Python ----------
import os
import math
import datetime
from compas.data import Data
from compas_rhino.conversions import plane_to_compas_frame
today = datetime.date.today()

lift = int(round(lift_height*1000, ndigits=0))
print(lift)
if save:
    rcf_filepath = os.path.join(filepath, f"RCF_lh{lift}{suffix}_{today}.json")
    rcf0_filepath = os.path.join(filepath, f"RCF0_lh{lift}{suffix}_{today}.json")
    bcf_filepath = os.path.join(filepath, f"BCF_lh{lift}{suffix}_{today}.json")
    RCF.to_json(rcf_filepath, pretty=True)
    RCF0.to_json(rcf0_filepath, pretty=True)
    BCF.to_json(bcf_filepath, pretty=True)
# ---------- end save_json ----------

# ----
# Get Pose Cartesian
get_4 = Button()
pose_3 = Python3Script(robot=robot, get=get_4)  # -> out, pose_cartesian
# ---------- pose_3: Python ----------
from scriptcontext import sticky as st
from ur_fabrication_control.direct_control.common import get_current_pose_cartesian
from compas.geometry import Frame
from ur_fabrication_control.direct_control import URScript
from ur_fabrication_control.direct_control.communication import TCPFeedbackServer
import time

def get_current_pose_cartesian(tcp, server_ip, server_port, ur_ip, ur_port, send=False):
    """Get the current cartesian coordinates of the UR Robot.

    Parameters
    ----------
    tcp : sequence of float
        Tool center point in a form of list.
        tcp = [x, y, z, dx, dy, dz]

    server_ip : string
        IP of the server.

    server_port : integer
        Port number of the server.

    ur_ip : string
        IP of the UR Robot.

    ur_port : integer
        Port number of the UR Robot.

    send: boolean
        Set to "True" to also send the current pose from the UR Robot to the server.
        Default set to "False" to only print out on the UR Robot's display.

    Returns
    -------
    msg : float

    """
    ur_cmds = URScript(ur_ip=ur_ip, ur_port=ur_port)
    ur_cmds.start()
    ur_cmds.set_tcp(tcp)
    ur_cmds.set_socket(server_ip, server_port, "Feedbackserver")
    ur_cmds.socket_open("Feedbackserver")
    ur_cmds.get_current_pose_cartesian(socket_name="Feedbackserver", send=send)
    ur_cmds.socket_close(name="Feedbackserver")
    ur_cmds.end()
    ur_cmds.generate()
    with TCPFeedbackServer(ip=server_ip, port=server_port) as server:
        ur_cmds.send_script()
        ms = 0
        while len(server.msgs)==0 and ms<1000:
            time.sleep(0.001)
            ms += 1
    return server.msgs.get(0, "Timed out")

server_ip = st["server_ip"]
server_port = st["server_port"]
ur_port = st["ur_port"]
ur_ip = st["ur_ip"]
pose_cartesian_meter = []

# retrieve the current tool frame in axis angle format
if robot.attached_tool:
    print("attached")
    tool_angle_axis = list(robot.attached_tool.frame.point) + list(robot.attached_tool.frame.axis_angle_vector)
    
else:
    tool0_frame = Frame([0, 0, 0], [1, 0, 0], [0, 1, 0])
    tool_angle_axis = list(tool0_frame.point) + list(tool0_frame.axis_angle_vector)

guid = str(ghenv.Component.InstanceGuid)
pose_cartesian_key = "pose_cartesian" + guid

if pose_cartesian_key not in st:
    st[pose_cartesian_key] = None

if get:
    print("getting pose")
    st[pose_cartesian_key] = get_current_pose_cartesian(tool_angle_axis, server_ip, server_port, ur_ip, ur_port, send=True)
    
pose_cartesian = st[pose_cartesian_key]
# ---------- end pose_3 ----------
python = Python3Script(robot=robot, pose=pose_3.pose_cartesian)  # -> out, plane_RCF, plane_WCF; inputs pose: list
# ---------- python: Python ----------
from compas.geometry import Frame, Transformation
from compas_rhino.conversions import plane_to_compas_frame, frame_to_rhino_plane

if pose is not None:
    frame_RCF = Frame.from_axis_angle_vector(pose[3:6], pose[0:3])
    frame_WCF = robot.from_RCF_to_WCF(frame_RCF)

    plane_RCF = frame_to_rhino_plane(frame_RCF)
    plane_WCF = frame_to_rhino_plane(frame_WCF)
# ---------- end python ----------

# ----
# Direct UR control
rec_2 = DataRecorder(pose_3.out, DataLimit=-10, RecordData=True)

pln_14 = Plane(python.plane_WCF)

panel_20 = Panel(rec_2)
