# Grasshopper definition repair_joint_author_V2.gh (Grasshopper 1.0.8)

# AUTHOR A JOINT
panel = Panel("SJ5")

# ---- group: CURVES_SJ3
curve = Curve([<curve referenced from the Rhino model> x2])

# ----
geometry = Geometry(Tree({0}: [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], {1}: [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], {2}: [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], {3}: [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], {4}: [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], {5}: [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], {6}: [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], {7}: [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]))
gh_joint_author = Python3Script(cutters=curve, depths=Slider(3, range=-5..5), key=panel, aspect=Slider(3, range=0..10), save=Button())  # -> out, stock, kept, prosthesis, report; inputs cutters: list of Curve
# ---------- gh_joint_author: Python ----------
"""LOADER for the joint author. Real code:
rhino/components/gh_joint_author.py.
Inputs:  cutters (Curve, LIST), depths (float, LIST), key (str),
         aspect (float), save (bool)
Outputs: stock, kept, prosthesis, report"""
import os
SCRIPT = "gh_joint_author.py"


def _find_repo():
    marker = os.path.join("src", "workshop_robarch_2026")
    p = os.environ.get("ROBARCH_REPO")
    if p and os.path.isdir(os.path.join(p, marker)):
        return p
    try:
        d = os.path.dirname(ghenv.Component.OnPingDocument().FilePath or "")
        while d and len(d) > 3:
            if os.path.isdir(os.path.join(d, marker)):
                return d
            d = os.path.dirname(d)
    except Exception:
        pass
    try:
        import workshop_robarch_2026 as _w
        return os.path.abspath(os.path.join(
            os.path.dirname(_w.__file__), "..", ".."))
    except ImportError:
        pass
    home = os.path.expanduser("~")
    for c in (os.path.join(home, "workspace", "projects",
                           "workshop_robarch_2026"),
              os.path.join(home, "Documents", "workshop_robarch_2026")):
        if os.path.isdir(os.path.join(c, marker)):
            return c
    raise RuntimeError("repo not found: save this .gh inside the repo or "
                       "set the ROBARCH_REPO environment variable")

_p = os.path.join(_find_repo(), "rhino", "components", SCRIPT)
exec(compile(open(_p, encoding="utf-8").read(), _p, "exec"))
# ---------- end gh_joint_author ----------
geometry_2 = Geometry(gh_joint_author.stock)
geometry_3 = Geometry(gh_joint_author.kept)
geometry_4 = Geometry(gh_joint_author.prosthesis)
deconstruct_brep = DeconstructBrep(Brep=geometry_2)  # -> Faces, Edges, Vertices
lines = CustomPreview(Geometry=deconstruct_brep.Edges, Material=ColourSwatch(SwatchColor=RGBA(255, 204, 0, 0)))
panel_2 = Panel(gh_joint_author.report)

# ---- group: Prosthesis Visualisation
custom_preview = CustomPreview(Geometry=geometry_4, Material=ColourSwatch(SwatchColor=RGBA(255, 0, 0, 64)))

# ---- group: Kept Visualisation
custom_preview_2 = CustomPreview(Geometry=geometry_3, Material=ColourSwatch(SwatchColor=RGBA(60, 255, 0, 64)))
