# Grasshopper definition repair_joint_inspection.gh (Grasshopper 1.0.8)

# ---- group: Select Joint
value_list = ValueList({"SW1", "SW2 – Stehendes gerades Blatt mit beidseitig schrägem Stoß": "SW2"}, selected="SW1")
# INSPECT A JOINT
refresh = Python3Script(refresh=Button(), picker=value_list)  # -> out, keys, report
# ---------- refresh: Python ----------
"""GH Python 3 -- JOINT PICKER: auto-fill a Value List from the catalogue.

Wire a Value List component INTO `picker`, set `refresh` True once.
The Value List then shows every joint in data/corpus/joints/ (label from the
datasheet's first line, value = the key). Wire that same Value List into
gh_repair's `key`. Re-run refresh after authoring a new joint.

Inputs:
    picker   (no type hint needed -- only its wire matters)
    refresh  (bool)
Outputs:
    keys, report
"""
import sys, os

REPO = r"C:\Users\tizian\workspace\projects\workshop_robarch_2026"
SRC = os.path.join(REPO, "src")
if SRC not in sys.path:
    sys.path.append(SRC)
for m in list(sys.modules):
    if m.startswith("workshop_robarch_2026"):
        sys.modules.pop(m)

from workshop_robarch_2026 import joints
import Grasshopper.Kernel.Special as ghs

keys = joints.list_keys(REPO)
report = ["{} joint(s): {}".format(len(keys), ", ".join(keys) or "-")]


def _label(key):
    md = joints.load_datasheet(REPO, key)
    for line in md.splitlines():
        line = line.strip().lstrip("#").strip()
        if line:
            return line          # e.g. "SW2 -- Half lap with mitered ends"
    return key

if refresh and keys:
    filled = False
    try:
        picker_param = None
        for prm in ghenv.Component.Params.Input:
            if prm.NickName == "picker":
                picker_param = prm
                break
        for src in (picker_param.Sources if picker_param else []):
            if isinstance(src, ghs.GH_ValueList):
                sel = None
                if src.SelectedItems.Count > 0:
                    sel = str(src.SelectedItems[0].Value).strip('"')
                src.ListItems.Clear()
                for k in keys:
                    src.ListItems.Add(
                        ghs.GH_ValueListItem(_label(k), '"{}"'.format(k)))
                # keep the previous selection if it still exists
                for i, k in enumerate(keys):
                    if k == sel:
                        src.SelectItem(i)
                        break
                src.ExpireSolution(True)
                filled = True
    except Exception as exc:
        report.append("could not fill Value List: {}".format(exc))
    report.append("dropdown filled" if filled
                  else "wire a Value List INTO `picker`")
# ---------- end refresh ----------
panel = Panel(refresh.report)

# ---- group: Run
run = BooleanToggle(True)

# ---- group: Inspector of Joints
gh_joint_inspector = Python3Script(key=value_list, run=run)  # -> out, curves, stock, cutters, kept, prosthesis, report
# ---------- gh_joint_inspector: Python ----------
"""LOADER for the joint inspector. Real code:
rhino/components/gh_joint_inspect.py.
Inputs:  key (str), run (bool)
Outputs: stock, curves, cutters, kept, prosthesis, report"""
import os
SCRIPT = "gh_joint_inspect.py"


def _find_repo():
    marker = os.path.join("src", "workshop_robarch_2026")
    p = os.environ.get("ROBARCH_REPO")
    if p and os.path.isdir(os.path.join(p, marker)):
        return p
    try:
        d = os.path.dirname(ghenv.Component.OnPingDocument().FilePath or "")
        while d and len(d) > 3:
            if os.path.isdir(os.path.join(d, marker)):
                return d
            d = os.path.dirname(d)
    except Exception:
        pass
    try:
        import workshop_robarch_2026 as _w
        return os.path.abspath(os.path.join(
            os.path.dirname(_w.__file__), "..", ".."))
    except ImportError:
        pass
    home = os.path.expanduser("~")
    for c in (os.path.join(home, "workspace", "projects",
                           "workshop_robarch_2026"),
              os.path.join(home, "Documents", "workshop_robarch_2026")):
        if os.path.isdir(os.path.join(c, marker)):
            return c
    raise RuntimeError("repo not found: save this .gh inside the repo or "
                       "set the ROBARCH_REPO environment variable")

_p = os.path.join(_find_repo(), "rhino", "components", SCRIPT)
exec(compile(open(_p, encoding="utf-8").read(), _p, "exec"))
# ---------- end gh_joint_inspector ----------

# ----
geometry = Geometry(gh_joint_inspector.stock)
geometry_2 = Geometry(gh_joint_inspector.curves)
geometry_3 = Geometry(gh_joint_inspector.cutters)
geometry_4 = Geometry(gh_joint_inspector.kept)
geometry_5 = Geometry(gh_joint_inspector.prosthesis)

# ---- group: Prosthesis Visualisation
custom_preview = CustomPreview(Geometry=geometry_5, Material=ColourSwatch(SwatchColor=RGBA(255, 0, 0, 64)))

# ---- group: Kept Visualisation
custom_preview_2 = CustomPreview(Geometry=geometry_4, Material=ColourSwatch(SwatchColor=RGBA(60, 255, 0, 64)))

# ----
panel_2 = Panel(gh_joint_inspector.report)
