# Grasshopper definition repair_joint_selection_01.gh (Grasshopper 1.0.8)

value_list = ValueList({"low", "medium", "high": "fine"}, selected="medium")

# ---- group: EXAMPLES / corner_post_01_geometry
prosthesis = Geometry(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)
kept = Geometry(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)
planes = Plane([Plane(origin=(0.1038918701, 0.09739905279, 0.4545104803), x=(0, -0.9821512621, -0.1880927919), y=(-0.9877730035, 0.02932347538, -0.1531163851)), Plane(origin=(0.1000874394, -0.006987642311, 0.3781372303), x=(-0.7660446937, 0.6427873111, 0), y=(0.1847035385, 0.2201212799, -0.9578263021)), Plane(origin=(0.1240829597, -0.02586085811, 0.3006495979), x=(0, 0.9821512621, 0.1880927919), y=(-0.9877730035, 0.02932347538, -0.1531163851)), Plane(origin=(0.1240829597, 0.1214618312, 0.3288635167), x=(0, -0.9821512621, -0.1880927919), y=(-0.9877730035, 0.02932347538, -0.1531163851)), Plane(origin=(0.110954477, 0.005963199067, 0.3832090643), x=(-0.7660446937, 0.6427873111, 0), y=(0.1847035385, 0.2201212799, -0.9578263021)), Plane(origin=(0.1442740492, 0.1455246096, 0.203216553), x=(0, -0.9821512621, -0.1880927919), y=(-0.9877730035, 0.02932347538, -0.1531163851))])

# ---- group: EXAMPLES / corner_post_02_geometry
prosthesis_2 = Geometry(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)
kept_2 = Geometry(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)
planes_2 = Plane([Plane(origin=(0.06669997549, 0.1249997658, 0.2117272769), x=(3.267948965e-07, -1, 0), y=(0, 0, 1)), Plane(origin=(0.0522532726, 0.02093197186, 0.4142928293), x=(-0.819231885, 0, -0.5734623951), y=(0.2749809749, 0.8775363944, -0.3928299123)), Plane(origin=(0.09350044352, -0.05256290525, 0.3553683343), x=(-0.8192321702, 0, -0.5734619877), y=(-0.2749806986, 0.8775364714, 0.3928299335)), Plane(origin=(0.06670002451, -0.02500023417, 0.2117272769), x=(-3.267948965e-07, 1, 0), y=(0, 0, 1)), Plane(origin=(0.1706314365, 0.02093190733, 0.2451810994), x=(-0.8192321702, 0, -0.5734619877), y=(-0.2749806986, 0.8775364714, 0.3928299335)), Plane(origin=(0.1293843136, -0.05256286233, 0.3041056424), x=(-0.819231885, 0, -0.5734623951), y=(0.2749809749, 0.8775363944, -0.3928299123))])

# ---- group: EXAMPLES / corner_post_03_geometry
prosthesis_3 = Geometry(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)
kept_3 = Geometry(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)
curve = Curve(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)
planes_3 = Plane([Plane(origin=(0.1149519282, 0.01249984371, 0.4955454587), x=(-0.8660255672, 0.499999717, 0), y=(-1.41506261e-07, -2.450962187e-07, -1)), Plane(origin=(0.05988254413, 0.00334927465, 0.5508859343), x=(-0.8600522143, 0, -0.5102060256), y=(0.1441656472, 0.9592485687, -0.2430194429)), Plane(origin=(0.1475004671, -0.0472369154, 0.4379021706), x=(-0.8600522645, 0, 0.5102059412), y=(0.1441653482, 0.9592487275, 0.2430189933)), Plane(origin=(-0.01495190693, 0.08749980126, 0.4955454587), x=(0.8660255672, -0.499999717, 0), y=(-1.41506261e-07, -2.450962187e-07, -1)), Plane(origin=(0.05988266819, 0.003349157958, 0.2902051716), x=(-0.8600522645, 0, 0.5102059412), y=(0.1441653482, 0.9592487275, 0.2430189933)), Plane(origin=(0.1475003431, -0.04723689524, 0.4031889683), x=(-0.8600522143, 0, -0.5102060256), y=(0.1441656472, 0.9592485687, -0.2430194429))])

# ----
panel = Panel("C:\Users\tizian\Downloads\timber-frame-corner__tizian__rail-end-splice-repair__2026-08-22.zip")
refresh = Button()
value_list_2 = ValueList({"Corner Post": "corner_post", "End Post Right": "end_post_right", "Intermediate Post Right": "intermediate_post_right", "Diagonal Brace Right": "diagonal_brace_right", "Lower Rail Outer Right": "lower_rail_outer_right", "Upper Rail Outer Right": "upper_rail_outer_right", "Upper Rail Inner Right": "upper_rail_inner_right", "Upper Rail Middle Right": "upper_rail_middle_right", "Lower Rail Middle Right": "lower_rail_middle_right", "Lower Rail Inner Right": "lower_rail_inner_right", "End Post Left": "end_post_left", "Intermediate Post Left": "intermediate_post_left", "Diagonal Brace Left": "diagonal_brace_left", "Lower Rail Outer Left": "lower_rail_outer_left", "Upper Rail Outer Left": "upper_rail_outer_left", "Upper Rail Inner Left": "upper_rail_inner_left", "Upper Rail Middle Left": "upper_rail_middle_left", "Lower Rail Middle Left": "lower_rail_middle_left", "Lower Rail Inner Left": "lower_rail_inner_left", "Top Plate Right": "top_plate_right", "Top Plate Left": "top_plate_left", "Sill Beam Left": "sill_beam_left", "Sill Beam Right": "sill_beam_right"}, selected="Upper Rail Middle Left")
run_genmodel = Button()
box = Box([{Plane=Plane(origin=(0.05, 0.05, 1.02), x=(0, -3.267948965e-07, -1), y=(3.267948965e-07, -1, 3.267948965e-07)), X=Domain(-0.92, 0.92), Y=Domain(-0.05, 0.05), Z=Domain(-0.05, 0.05)}, {Plane=Plane(origin=(1.93, 0.05, 1.02), x=(0, -3.267948965e-07, -1), y=(3.267948965e-07, -1, 3.267948965e-07)), X=Domain(-0.92, 0.92), Y=Domain(-0.05, 0.05), Z=Domain(-0.05, 0.05)}, {Plane=Plane(origin=(1.03, 0.05, 1.02), x=(0, -3.267948965e-07, -1), y=(3.267948965e-07, -1, 3.267948965e-07)), X=Domain(-0.92, 0.92), Y=Domain(-0.05, 0.05), Z=Domain(-0.04, 0.04)}, {Plane=Plane(origin=(0.530471, 0.05, 1.02), x=(0.2840150316, -2.339802337e-07, -0.9588198276), y=(2.339802337e-07, -1, 3.133374264e-07)), X=Domain(-0.971824, 0.971824), Y=Domain(-0.05, 0.05), Z=Domain(-0.04156, 0.04156)}, {Plane=Plane(origin=(1.475, 0.05, 0.61), x=(0, -3.267948965e-07, -1), y=(3.267948965e-07, -1, 3.267948965e-07)), X=Domain(-0.04, 0.04), Y=Domain(-0.05, 0.05), Z=Domain(-0.405, 0.405)}, {Plane=Plane(origin=(1.475, 0.05, 1.43), x=(0, -3.267948965e-07, -1), y=(3.267948965e-07, -1, 3.267948965e-07)), X=Domain(-0.04, 0.04), Y=Domain(-0.05, 0.05), Z=Domain(-0.405, 0.405)}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])
box_2 = Box({Plane=Plane(origin=(0.05, 1.475, 0.61), x=(0, -3.267948965e-07, -1), y=(3.267948965e-07, -1, 3.267948965e-07)), X=Domain(-0.04, 0.04), Y=Domain(-0.405, 0.405), Z=Domain(-0.05, 0.05)})
threshold = Slider(0.5, range=0..1)

# ---- group: Cellurize Beam with LLM
_00_cells = Python3Script(workspace_json=panel, picker=value_list_2, refresh=refresh, resolution=value_list, run=run_genmodel)  # -> out, timber, plane, box, boxes, labels, conditions, centers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
# ---------- _00_cells: Python ----------
"""GH Python 3, 00 CELLS: divide the selected beam into cells and read its damage.

  1. Divide the member into cells. Box mode is always used, so a cell is a plain
     box and a point belongs to whichever cell its centroid falls in. The
     oriented box is taken from the Workspace part record rather than from Rhino
     geometry, so the cells, the member frame and the neighbouring parts all end
     up in the same coordinate system.
  2. Read the survey. One model call turns the recorded conditions, their
     evidence and the photographs into regions expressed in the member's own
     coordinates. Those regions are then painted onto the cells.

Needs
-----
assembly_information_model (CellularizedPart), compas and compas_rhino,
installed in Rhino's Python. The component cannot run without them.
src/workshop_robarch_2026: context, neighbours, damagemap, agents. Found from
the .gh file's folder, or wire `repo`.
data/prompts/damage.md, and a Gemini key in gemini_api_key.txt or GEMINI_API_KEY.

Inputs
------
workspace_json str    the exported Workspace ZIP (path) or JSON
picker         str    wire a Grasshopper Value List here
refresh        bool   fill that Value List from the Workspace parts
nu, nv, nw     int    subdivisions across width, along length, across height
resolution     str    "low", "medium" or "fine"; overrides nu/nv/nw
threshold      float  damage at or above this counts as decayed [0.50]
model          str    optional Gemini model
temperature    float  optional [0.2]
run            bool   press to read the damage; press again to ask afresh
repo           str    the repository folder, if it cannot be found on its own

Outputs
-------
timber       CellularizedPart, with damage set from the survey
plane        the member frame; Y is the beam axis
box          the oriented beam box, used by 01 and 03
centers      cell centroids in world coordinates
damage       one 0..1 value per cell, in the same order
boxes        every other part as an oriented box, in the same coordinates
labels       a TextDot per other part, at its centre, carrying its name
conditions   a TextDot per condition on this part, where the surveyor marked it
regions_json the model's regions and its reading, for a panel
report       str[]

TextDots carry their own text and position, so `labels` and `conditions` draw
themselves. Leave them previewing: a box in an implausible place, or a marker
floating off the timber, means the coordinates are wrong.
"""

import json
import os
import sys

PRESETS = {"low": 2, "medium": 3, "fine": 4}


def _repo_root():
    """The repository folder: the `repo` input, the .gh file, cwd, or sys.path."""
    tries = [globals().get("repo"), os.environ.get("ROBARCH_REPO")]
    try:
        tries.append(str(ghenv.Component.OnPingDocument().FilePath or ""))
    except Exception:
        pass
    for start in tries + [os.getcwd()] + list(sys.path):
        if not start or "://" in str(start):
            continue
        folder = os.path.abspath(os.path.expanduser(str(start)))
        for _ in range(9):
            if os.path.isdir(os.path.join(folder, "src", "workshop_robarch_2026")):
                return folder
            folder, before = os.path.dirname(folder), folder
            if folder == before:
                break
    raise RuntimeError("workshop repository not found; connect its folder to repo")


def _grid(extents, asked):
    """Roughly cubic cells, from a word or a number.

    Cubic matters: a fixed subdivision along a 1.84 m post makes 150 mm cells
    against 33 mm across it, and counting cells that shape measures the
    member's length far more than its section.
    """
    number = PRESETS.get(str(asked).strip().lower())
    if number is None:
        number = int(asked)
    size = min(extents) / float(number)
    return tuple(max(1, int(round(e / size))) for e in extents)


def _dot(text, point, height, rg):
    dot = rg.TextDot(str(text), rg.Point3d(*[float(c) for c in point]))
    try:
        dot.FontHeight = height
    except Exception:
        pass
    return dot


timber = plane = box = None
centers, damage, boxes, labels, conditions = [], [], [], [], []
regions_json = ""
report = ["00 Cells"]

try:
    root = _repo_root()
    if os.path.join(root, "src") not in sys.path:
        sys.path.append(os.path.join(root, "src"))
    import scriptcontext as sc

    # Do not reload the package while a background thread is still using it.
    live = sc.sticky.get("joinery.jobs.%s" % ghenv.Component.InstanceGuid, {})
    if not any(isinstance(j, dict) and not j.get("done") for j in live.values()):
        for name in [n for n in sys.modules if n.startswith("workshop_robarch_2026")]:
            sys.modules.pop(name)

    import numpy as np
    import Rhino.Geometry as rg
    from compas.geometry import Frame, Point, Transformation, transform_points
    from compas_rhino.conversions import frame_to_rhino, mesh_to_compas, point_to_rhino
    from assembly_information_model import CellularizedPart
    from workshop_robarch_2026 import agents, context, damagemap, neighbours

    # ---- the part, and its frame -----------------------------------------
    workspace = context.load_workspace(globals().get("workspace_json"))
    options = context.part_options(workspace)
    if not options:
        raise ValueError("the Workspace contains no parts")

    beam_id = str(globals().get("picker") or "").strip()
    if bool(globals().get("refresh")):
        beam_id, rewritten = context.fill_picker(ghenv.Component, options)
        report.append("dropdown filled" if rewritten else "dropdown already current")
    elif beam_id not in [item["id"] for item in options]:
        beam_id = options[0]["id"]
        report.append("press refresh once to fill the connected Value List")
    part = context.find_part(workspace, beam_id)

    to_rhino = neighbours.world_matrix(workspace)
    frame = neighbours.member_frame(part, to_rhino)
    if frame is None:
        raise ValueError("part %s carries no usable origin or dimensions. "
                         "It has: %s"
                         % (beam_id, ", ".join(sorted(part.keys()))))
    extents = (frame["width"], frame["length"], frame["height"])
    origin = np.asarray(frame["origin"], float)
    basis = neighbours.basis_of(frame)
    member = Frame(Point(*(origin + basis @ (np.array(extents) / 2.0))),
                   frame["u"], frame["v"])
    plane = frame_to_rhino(member)
    box = rg.Box(plane, *[rg.Interval(-e / 2.0, e / 2.0) for e in extents])

    # ---- the rest of the frame, before any early exit --------------------
    for other in context.parts(workspace):
        packed = (None if str(other.get("id")) == str(beam_id)
                  else neighbours.part_box(other, to_rhino))
        if packed is None:
            continue
        at, axes, half = packed
        where = rg.Plane(rg.Point3d(*[float(c) for c in at]),
                         rg.Vector3d(*[float(c) for c in axes[:, 0]]),
                         rg.Vector3d(*[float(c) for c in axes[:, 1]]))
        boxes.append(rg.Box(where, *[rg.Interval(-h, h) for h in half]))
        labels.append(_dot(other.get("label") or other.get("id"), at, 11, rg))

    # ---- cellularize, in the member's own frame --------------------------
    # build_cell_grid subdivides the world bounding box and ignores the frame,
    # so the member is moved into its own frame first and back afterwards.
    asked = str(globals().get("resolution") or "").strip()
    if not asked and any(globals().get(k) for k in ("nu", "nv", "nw")):
        grid = tuple(int(globals().get(k) or d)
                     for k, d in (("nu", 3), ("nv", 12), ("nw", 3)))
    else:
        grid = _grid(extents, asked or "medium")

    forward = Transformation.from_frame_to_frame(member, Frame.worldXY())
    backward = Transformation.from_frame_to_frame(Frame.worldXY(), member)
    timber = CellularizedPart.from_mesh(
        mesh_to_compas(rg.Mesh.CreateFromBox(box, 1, 1, 1)).transformed(forward),
        grid=grid, box_mode=True, name="timber", frame=Frame.worldXY())
    timber.mesh.transform(backward)
    network = timber.cell_network
    for vertex in network.vertices():          # CellNetwork.transform() raises
        network.vertex_attributes(vertex, "xyz", transform_points(
            [network.vertex_coordinates(vertex)], backward)[0])
    for cell in network.cells():
        piece = network.cell_attribute(cell, "cell_mesh")
        if piece is not None:
            piece.transform(backward)
    timber.frame = member

    world = np.array([list(network.cell_centroid(c)) for c in network.cells()], float)
    centers = [point_to_rhino(Point(*p)) for p in world]
    local = (world - origin) @ basis          # metres from the member's corner
    damage = [0.0] * len(world)
    timber.set_damage_scores(list(damage))
    gate = 0.5 if globals().get("threshold") is None else float(threshold)

    cell_mm = tuple(1000.0 * extents[i] / grid[i] for i in range(3))
    axis = frame["v"]
    confirmed, missed = neighbours.confirm_connections(workspace)
    around = neighbours.around(workspace, beam_id, frame)
    report += [
        "selected: %s (%s)" % (part.get("label") or beam_id, beam_id),
        "member %.3f x %.3f x %.3f m, axis = frame Y" % extents,
        "workspace is %s-up; the axis points (%+.2f, %+.2f, %+.2f) here, so the "
        "member is %s"
        % (neighbours.WORLD_UP.upper(), axis[0], axis[1], axis[2],
           "upright" if abs(axis[2]) > 0.9 else
           "horizontal" if abs(axis[2]) < 0.1 else "raking"),
        "grid %d x %d x %d = %d cells, %.0f x %.0f x %.0f mm"
        % (grid + (timber.num_cells,) + cell_mm),
        "%d other part(s) as boxes; %d touch this member" % (len(boxes), len(around)),
        "%d declared connection(s) confirmed geometrically%s"
        % (confirmed, "" if not missed else
           ", %d NOT touching: %s. The coordinate convention is wrong somewhere."
           % (len(missed), ", ".join(missed[:4]))),
    ]
    if max(cell_mm) / min(cell_mm) > 3.0:
        report.append("WARNING: cells are %.1f:1 elongated, so counting them "
                      "measures length far more than section"
                      % (max(cell_mm) / min(cell_mm)))

    # ---- what the survey says --------------------------------------------
    recorded = context.conditions_for(workspace, beam_id)
    evidence = context.evidence_for(workspace, recorded, beam_id)
    report.append("%d condition(s) recorded here, %d piece(s) of evidence"
                  % (len(recorded), len(evidence)))

    pinned = damagemap.marks(recorded, frame, to_rhino)
    for pin in pinned:
        conditions.append(_dot(pin["label"], pin["world"], 14, rg))
        report.append("   %s at u %.3f  v %.3f  w %.3f%s\n      %s"
                      % (pin["label"], pin["atMemberUVW"][0], pin["atMemberUVW"][1],
                         pin["atMemberUVW"][2],
                         "" if pin["insideTheMember"] else
                         "  (WARNING: outside this member)", pin["says"]))
    if not recorded:
        report.append("nothing recorded, so damage stays 0.0 on every cell. "
                      "Add a condition to the part in the Workspace, then "
                      "press run.")
        raise SystemExit

    model = str(globals().get("model") or agents.DEFAULT_MODEL).strip()
    warmth = globals().get("temperature")
    warmth = 0.2 if warmth is None else float(warmth)
    pictures, notes = context.evidence_images(globals().get("workspace_json"), evidence)
    report.extend(notes)

    payload = {
        "part": {k: part.get(k) for k in ("id", "label", "dimensions", "material",
                                          "function", "notes") if part.get(k)},
        "member": {"widthMm": round(1000 * extents[0], 1),
                   "lengthMm": round(1000 * extents[1], 1),
                   "heightMm": round(1000 * extents[2], 1),
                   "grid": list(grid), "cellCount": int(len(world)),
                   "cellMm": [round(c, 1) for c in cell_mm]},
        "orientation": damagemap.orientation(frame, around),
        "neighbours": around,
        "conditions": recorded,
        "conditionPoints": pinned,
        "evidence": evidence,
    }
    answer, lines = agents.ask(
        ghenv.Component, "damage",
        agents.signature("damage-v1", payload, len(pictures), model, warmth),
        lambda: agents.call(root, "damage.md", payload, model=model,
                            temperature=warmth, attachments=pictures),
        bool(globals().get("run")), "read the damage from the survey")
    report.extend(lines)
    if answer is None:
        raise SystemExit

    # ---- paint the regions onto the cells --------------------------------
    regions = answer.get("regions") or []
    values = damagemap.paint(regions, local, extents)
    damage = [float(v) for v in values]
    timber.set_damage_scores(list(damage))
    regions_json = json.dumps(dict(answer, memberExtentsM=list(extents)),
                              indent=2, ensure_ascii=False)
    report.extend(damagemap.read_report(answer, local, extents, gate, pinned,
                                        [p["id"] for p in pictures]))
    report.append(damagemap.summary(values, gate))
except SystemExit:
    pass
except Exception as exc:
    report.append("ERROR: {}".format(exc))
# ---------- end _00_cells ----------

# ----
box_3 = Box(_00_cells.boxes)
box_4 = Box(_00_cells.boxes)

# ----
# Visualise a cellularized part
toggle = BooleanToggle(True)
multiplication = Multiplication(A=_00_cells.damage, B=100)
show = Python3Script(part=_00_cells.timber, show=toggle)  # -> out, plane, mesh, cell_meshes, cell_centers, cell_bins, cell_damage, report
# ---------- show: Python ----------
"""GH Python 3, 00b SHOW CELLS: display the damage 00 read, on the cell part."""

plane = []
mesh = []
cell_meshes = []
cell_centers = []
cell_bins = []
cell_damage = []
cell_colours = []
report = ["00b Show cells"]


def _colour(value, gate):
    from System.Drawing import Color

    value = max(0.0, min(1.0, float(value)))
    if value <= 0.0:
        return Color.FromArgb(50, 205, 205, 195)
    if value < gate:
        t = value / max(gate, 1e-6)
        return Color.FromArgb(150, int(205 + 50 * t), int(205 - 25 * t),
                              int(195 - 130 * t))
    t = (value - gate) / max(1.0 - gate, 1e-6)
    return Color.FromArgb(235, int(255 - 85 * t), int(180 - 150 * t),
                          int(65 - 45 * t))


try:
    from compas_rhino.conversions import (frame_to_rhino, mesh_to_rhino,
                                          point_to_rhino)

    if part is None:
        raise ValueError("connect `timber` from 00 to part")
    gate = 0.5 if globals().get("threshold") is None else float(threshold)
    if globals().get("show") is None:
        show = True

    net = part.cell_network
    keys = list(net.cells())
    if not keys:
        raise ValueError("this part has no cells")

    spare = [float(v) for v in (globals().get("damage") or [])]
    if spare and len(spare) != len(keys):
        report.append("WARNING: %d damage value(s) for %d cell(s), which "
                      "different run; ignoring it" % (len(spare), len(keys)))
        spare = []

    scores = []
    for index, key in enumerate(keys):
        value = net.cell_attribute(key, "damage_score")
        if value is None and index < len(spare):
            value = spare[index]
        scores.append(float(value or 0.0))

    hot = sum(1 for v in scores if v >= gate)
    report.append("%d cell(s), %d at or above %.2f, peak %.2f"
                  % (len(keys), hot, gate, max(scores) if scores else 0.0))
    if hot == 0:
        report.append("nothing at or above the threshold. Either 00 has not been "
                      "run, or the survey put no damage on this member")

    if show:
        mesh = [mesh_to_rhino(part.mesh)]
        plane = [frame_to_rhino(part.frame)]
        empty = 0
        for key, value in zip(keys, scores):
            if bool(globals().get("only_damaged")) and value < gate:
                continue
            # The clipped irregular mesh if the part was built with
            # box_mode=False, otherwise the plain grid box.
            cell = net.cell_attribute(key, "cell_mesh") or net.cell_to_mesh(key)
            rhino_cell = mesh_to_rhino(cell) if cell is not None else None
            if rhino_cell is None:
                empty += 1
            cell_meshes.append(rhino_cell)
            cell_centers.append(point_to_rhino(net.cell_centroid(key)))
            cell_damage.append(value)
            cell_bins.append(0 if value <= 0.0 else (1 if value < gate else 2))
            cell_colours.append(_colour(value, gate))
        report.append("showing %d cell(s)%s" % (len(cell_meshes),
                      " (damaged only)" if globals().get("only_damaged") else ""))
        if empty:
            report.append("WARNING: %d cell(s) gave no mesh; cell_to_mesh "
                          "returned nothing for them" % empty)
except Exception as exc:
    report.append("ERROR: {}".format(exc))
# ---------- end show ----------
gradient = Gradient(
    LowerLimit=0,
    UpperLimit=1,
    Parameter=show.cell_damage,
    stops=[0: RGB(192, 192, 0), 0.508: RGB(255, 192, 128), 1: RGB(220, 0, 40)])
round = Round(Number=multiplication)  # -> Nearest, Floor, Ceiling
geo = Geometry(show.mesh)
geo_2 = Geometry(show.cell_meshes)
pln = Plane(show.plane)
preview = CustomPreview(Geometry=geo_2, Material=gradient)
tag = TextTag(Location=show.cell_centers, Text=show.cell_bins, Colour=ColourSwatch(SwatchColor=RGB(255, 255, 255)))
tag_2 = TextTag(Location=show.cell_centers, Text=round.Nearest, Colour=ColourSwatch(SwatchColor=RGB(36, 0, 0)))

# ---- group: Select the Setup
_01_select = Python3Script(
    workspace_json=panel,
    picker=value_list_2,
    refresh=refresh,
    box=_00_cells.box,
    centers=_00_cells.centers,
    damage=_00_cells.damage,
    threshold=threshold)  # -> out, setup_json, beam_id, capabilities_json, report; inputs box: Box, centers: list of Point3d, damage: list of Double
# ---------- _01_select: Python ----------
"""GH Python 3, 01 SELECT: bind the chosen member to its cells and write the bundle.

There is no model call here. The component checks that the cells 00 produced
really belong to the member you picked, and then writes the single record that
02, 03 and 04 all read: the part, the repair plan, the recorded conditions, the
damage as numbers, and what touches the member.

Needs
-----
src/workshop_robarch_2026: context, neighbours, joinery. Found from the .gh
file's folder, or wire `repo`.
No prompt file and no API key, because this component never calls a model.

Inputs
------
workspace_json  str        the exported Workspace ZIP (path) or JSON
picker          str        wire the same Value List as 00
refresh         bool       fill that Value List from the Workspace parts
centers         Point3d[]  cell centroids, from 00
damage          float[]    one 0..1 value per cell, from 00
threshold       float      damage at or above this must be removed [0.50]
repo            str        the repository folder, if it cannot be found on its own

Outputs
-------
setup_json      str        the bundle, for 02 and 03
beam_id         str        the selected part id
damage_grid     str        the damage as numbers, for a panel
report          str[]
"""

import json
import os
import sys


def _repo_root():
    """The repository folder: the `repo` input, the .gh file, cwd, or sys.path."""
    tries = [globals().get("repo"), os.environ.get("ROBARCH_REPO")]
    try:
        tries.append(str(ghenv.Component.OnPingDocument().FilePath or ""))
    except Exception:
        pass
    for start in tries + [os.getcwd()] + list(sys.path):
        if not start or "://" in str(start):
            continue
        folder = os.path.abspath(os.path.expanduser(str(start)))
        for _ in range(9):
            if os.path.isdir(os.path.join(folder, "src", "workshop_robarch_2026")):
                return folder
            folder, before = os.path.dirname(folder), folder
            if folder == before:
                break
    raise RuntimeError("workshop repository not found; connect its folder to repo")


setup_json = beam_id = damage_grid = ""
report = ["01 Select"]

try:
    root = _repo_root()
    if os.path.join(root, "src") not in sys.path:
        sys.path.append(os.path.join(root, "src"))
    for name in [n for n in sys.modules if n.startswith("workshop_robarch_2026")]:
        sys.modules.pop(name)

    import numpy as np
    import Rhino
    from workshop_robarch_2026 import context, joinery, neighbours

    # ---- the part ---------------------------------------------------------
    workspace = context.load_workspace(globals().get("workspace_json"))
    options = context.part_options(workspace)
    if not options:
        raise ValueError("the Workspace contains no parts")

    beam_id = str(globals().get("picker") or "").strip()
    if bool(globals().get("refresh")):
        beam_id, rewritten = context.fill_picker(ghenv.Component, options)
        report.append("dropdown filled" if rewritten else "dropdown already current")
    elif beam_id not in [item["id"] for item in options]:
        beam_id = options[0]["id"]
        report.append("press refresh once to fill the connected Value List")
    part = context.find_part(workspace, beam_id)

    # The same call 00 makes, so the cells and the frame cannot disagree.
    frame = neighbours.member_frame(part, neighbours.world_matrix(workspace))
    if frame is None:
        raise ValueError("part %s carries no usable origin or dimensions. "
                         "It has: %s"
                         % (beam_id, ", ".join(sorted(part.keys()))))

    # ---- the cells, and whether they are this member's --------------------
    centres = list(globals().get("centers") or [])
    values = [float(v) for v in (globals().get("damage") or [])]
    if not centres:
        raise ValueError("connect `centers` and `damage` from 00")
    points = np.array([[float(p.X), float(p.Y), float(p.Z)] for p in centres], float)

    # Containment, not span: centroids reach only (n-1)/n of the member.
    size = np.array([frame["width"], frame["length"], frame["height"]], float)
    local = (points - np.asarray(frame["origin"], float)) @ neighbours.basis_of(frame)
    lo, hi = local.min(axis=0), local.max(axis=0)
    if (np.any(lo < -0.05 * size) or np.any(hi > 1.05 * size)
            or np.any(np.abs(0.5 * (lo + hi) - 0.5 * size) > 0.1 * size)):
        raise ValueError(
            "these cells do not belong to this member. %s measures "
            "%.2f x %.2f x %.2f m "
            "and the cells run %.2f..%.2f, %.2f..%.2f, %.2f..%.2f inside it. Check "
            "that 00 and 01 have the same part selected."
            % ((beam_id,) + tuple(size) + tuple(v for pair in zip(lo, hi) for v in pair)))

    mem = joinery.member(frame, points, values)
    gate = 0.5 if globals().get("threshold") is None else float(threshold)

    # ---- the bundle -------------------------------------------------------
    around = neighbours.around(workspace, beam_id, frame)
    document = Rhino.RhinoDoc.ActiveDoc
    bundle = context.setup(workspace, beam_id, mem, gate,
                           float(document.ModelAbsoluteTolerance),
                           str(document.ModelUnitSystem), around=around)
    bundle["member"]["frame"] = frame        # carried, so 03 need not re-derive it
    setup_json = json.dumps(bundle, indent=2, ensure_ascii=False)
    damage_grid = bundle["damage"]["grid"]

    steps = (bundle.get("plan") or {}).get("stepsForThisMember") or []
    report += [
        "selected: %s (%s)" % (part.get("label") or beam_id, beam_id),
        "grid %dx%dx%d = %d cells, %d at or above %.2f"
        % (mem["grid"] + (len(points), bundle["damage"]["cellsAtOrAbove"], gate)),
        "plan: %s, %d step(s) touch this member"
        % ((bundle.get("plan") or {}).get("label") or "none", len(steps)),
    ]
    report += ["   %s  %s" % (s.get("id"), s.get("title")) for s in steps]
    report.append("%d part(s) touch this member" % len(around))
    report += ["   " + line for line in neighbours.summary(around)]
    if not around:
        report += ["   " + line for line
                   in neighbours.why_empty(workspace, beam_id, frame)]
    undeclared = [item["id"] for item in around if not item["declared"]]
    if undeclared:
        report.append("WARNING: touching but not listed as connections: %s"
                      % ", ".join(undeclared))
except Exception as exc:
    report.append("ERROR: {}".format(exc))
# ---------- end _01_select ----------

# ----
llm_output = Panel(_00_cells.regions_json)
report = Panel(_00_cells.report)
geometry = Geometry(_00_cells.labels)
geometry_2 = Geometry(_00_cells.conditions)
report_2 = Panel(_01_select.report)

custom_preview = CustomPreview(Geometry=[geometry, box], Material=ColourSwatch(SwatchColor=RGBA(105, 105, 105, 150)))
custom_preview_2 = CustomPreview(Geometry=geometry_2, Material=ColourSwatch(SwatchColor=RGB(255, 0, 0)))

run_genmodel_2 = Button()

# ---- group: Write the Repair Brief
_02_brief = Python3Script(setup_json=_01_select.setup_json, run=run_genmodel_2)  # -> out, brief_json, report; inputs run: Boolean
# ---------- _02_brief: Python ----------
"""GH Python 3, 02 BRIEF: state in words what this joint has to do.

One model call, on the repair plan, the recorded conditions, the evidence, the
damage grid and the participant's own notes. It states the job and designs
nothing. It is never shown a coordinate, so this stage reasons in words and 03
reasons in planes.

Needs
-----
src/workshop_robarch_2026/agents.py, for the model call and the corpus.
data/prompts/brief.md, data/corpus/joints/*.md, and a Gemini key in
gemini_api_key.txt or GEMINI_API_KEY.

Inputs
------
setup_json   str    from 01 SELECT
notes        str    the participant's own notes; anything they want considered
model        str    optional Gemini model
temperature  float  optional [0.4]
run          bool   press to write it; press again to ask afresh
repo         str    the repository folder, if it cannot be found on its own

Outputs
-------
brief_json   str    the brief plus repairKind, mustResist and openQuestions
brief        str    the prose, for a panel
report       str[]
"""

import json
import os
import sys


def _repo_root():
    """The repository folder: the `repo` input, the .gh file, cwd, or sys.path."""
    tries = [globals().get("repo"), os.environ.get("ROBARCH_REPO")]
    try:
        tries.append(str(ghenv.Component.OnPingDocument().FilePath or ""))
    except Exception:
        pass
    for start in tries + [os.getcwd()] + list(sys.path):
        if not start or "://" in str(start):
            continue
        folder = os.path.abspath(os.path.expanduser(str(start)))
        for _ in range(9):
            if os.path.isdir(os.path.join(folder, "src", "workshop_robarch_2026")):
                return folder
            folder, before = os.path.dirname(folder), folder
            if folder == before:
                break
    raise RuntimeError("workshop repository not found; connect its folder to repo")


brief_json = brief = ""
report = ["02 Brief"]

try:
    root = _repo_root()
    if os.path.join(root, "src") not in sys.path:
        sys.path.append(os.path.join(root, "src"))
    import scriptcontext as sc

    # Do not reload the package while a background thread is still using it.
    live = sc.sticky.get("joinery.jobs.%s" % ghenv.Component.InstanceGuid, {})
    if not any(isinstance(j, dict) and not j.get("done") for j in live.values()):
        for name in [n for n in sys.modules if n.startswith("workshop_robarch_2026")]:
            sys.modules.pop(name)

    from workshop_robarch_2026 import agents

    setup = json.loads(str(globals().get("setup_json") or "").strip() or "{}")
    if not setup:
        raise ValueError("connect setup_json from 01 SELECT")
    notes = str(globals().get("notes") or "").strip()
    model = str(globals().get("model") or agents.DEFAULT_MODEL).strip()
    warmth = globals().get("temperature")
    warmth = 0.4 if warmth is None else float(warmth)

    # Families only, no coordinates: this stage reasons in words.
    examples, corpus_notes = agents.corpus_examples(root)
    report.extend(corpus_notes)
    families = [{"key": e["key"], "what": e.get("what"), "faces": len(e["planes"]),
                 "datasheet": e.get("datasheet")}
                for e in examples if e.get("datasheet")]

    payload = {k: setup.get(k) for k in
               ("part", "connectedParts", "plan", "conditions", "evidence",
                "neighbours", "member", "damage")}
    payload.update(families=families, notes=notes)

    answer, lines = agents.ask(
        ghenv.Component, "brief",
        agents.signature("brief-v2", setup, notes, len(families), model, warmth),
        lambda: agents.call(root, "brief.md", payload, model=model,
                            temperature=warmth),
        bool(globals().get("run")), "write the brief")
    report.extend(lines)
    if answer is None:
        raise SystemExit

    brief = str(answer.get("brief") or "")
    brief_json = json.dumps(answer, indent=2, ensure_ascii=False)
    report.append("repair kind: %s" % (answer.get("repairKind") or "not stated"))
    report += ["must resist: %s" % line for line in answer.get("mustResist") or []]
    report += ["open question: %s" % line for line in answer.get("openQuestions") or []]
    report.append("%d character(s) of participant notes were included" % len(notes)
                  if notes else "no participant notes, so the brief rests on "
                                "the plan alone")
except SystemExit:
    pass
except Exception as exc:
    report.append("ERROR: {}".format(exc))
# ---------- end _02_brief ----------

# ----
llm_output_2 = Panel(_02_brief.brief_json)
report_3 = Panel(_02_brief.report)

value_list_3 = ValueList({"0", "1", "2", "3", "4", "5", "6", "7", "8", "9"}, selected="7")
run_genmodel_3 = Button()

# ---- group: Write the Repair Joinery
_03_joint = Python3Script(
    workspace_json=panel,
    setup_json=_01_select.setup_json,
    brief_json=_02_brief.brief_json,
    box=_00_cells.box,
    centers=_00_cells.centers,
    damage=_00_cells.damage,
    threshold=threshold,
    sweep_degrees=Slider(15, range=0..15),
    variant=value_list_3,
    run=run_genmodel_3)  # -> out, kept, prosthesis, planes, removed_cells, summary, flatten(variants_json), cuts_json, report; inputs box: Box, centers: list of Point3d, damage: list of Double
# ---------- _03_joint: Python ----------
"""GH Python 3, 03 JOINT: design the repair joints, then measure them.

The model reads the brief, picks joints from the corpus that suit it, and
returns a set of variations based on assumptions about the repair.

Each joint is rotated around the member and slid along it until it sits where it
destroys the least sound timber, and it is then measured: how much rot it leaves
behind, how much sound wood it spends, which directions it locks, and whether it
cuts the joinery of another member. Each variation is measured against the corpus
joint it came from, so the report can show what the change actually bought.

Where there are several damages, one repair is taken from each and the group is
measured together as a scheme.

Needs
-----
src/workshop_robarch_2026: agents, context, evaluator, joinery, kernel,
neighbours. data/prompts/joint.md, data/corpus/joints/*.json, and a Gemini key
in gemini_api_key.txt or GEMINI_API_KEY.

Inputs
------
setup_json     str        from 01 SELECT; it carries the member frame
brief_json     str        from 02 BRIEF
workspace_json str        the same ZIP as 01, so the neighbouring parts are known
centers        Point3d[]  cell centroids, from 00
damage         float[]    one 0..1 value per cell, from 00
threshold      float      damage at or above this must be removed [0.50]
variant        int        which scheme to show; 0 is the best ranked
sweep_degrees  int        how fine the rotation sweep is, 5..45 [15]
joint_json     str        paste a joint, or a list of them, to skip the model
model          str        optional Gemini model
temperature    float      optional [0.7]
run            bool       press to design; press again to ask afresh
repo           str        the repository folder, if it cannot be found on its own

Outputs
-------
kept           Brep[]     the historic timber that stays, all repairs removed
prosthesis     Brep[]     the replacement pieces, one per repair
planes         Curve[]    the cutting planes of the scheme shown
removed_cells  Point3d[]  cell centres inside the replacement
summary        str[]      the schemes, ranked, with a line per repair
variants_json  str        all of them with their measurements, for 04 COMPARE
report         str[]
"""

import json
import os
import sys


def _repo_root():
    """The repository folder: the `repo` input, the .gh file, cwd, or sys.path."""
    tries = [globals().get("repo"), os.environ.get("ROBARCH_REPO")]
    try:
        tries.append(str(ghenv.Component.OnPingDocument().FilePath or ""))
    except Exception:
        pass
    for start in tries + [os.getcwd()] + list(sys.path):
        if not start or "://" in str(start):
            continue
        folder = os.path.abspath(os.path.expanduser(str(start)))
        for _ in range(9):
            if os.path.isdir(os.path.join(folder, "src", "workshop_robarch_2026")):
                return folder
            folder, before = os.path.dirname(folder), folder
            if folder == before:
                break
    raise RuntimeError("workshop repository not found; connect its folder to repo")


def _designs(answer, catalogue, notes, cap=10):
    """Return the corpus joints the model chose, then its variations of them.

    A chosen joint is loaded from the corpus by its key, so it is identical to
    the catalogue entry. That makes the comparison that follows exact: the
    question is whether a variation beats the real SJ4, not whether it beats the
    model's redrawing of SJ4. Variations carry their own planes and name the
    base they came from.
    """
    out = []
    for pick in answer.get("chosen") or []:
        key = str(pick.get("key") or "").strip()
        found = catalogue.get(key)
        if found is None:
            notes.append("chose %r, which is not in the corpus, so it was "
                         "skipped" % key)
            continue
        out.append(dict(found, fromKey=key, base=None, why=pick.get("why"),
                        id=str(found.get("what") or key)))
    for item in answer.get("variations") or []:
        base = str(item.get("from") or "").strip()
        if base and base not in catalogue:
            notes.append("%s says it varies %r, which is not in the corpus"
                         % (item.get("name") or "a variation", base))
        out.append(dict(item, fromKey=None, base=base or None,
                        id=str(item.get("name") or "variation")))
    if len(out) != cap:
        notes.append("%d joints offered, %d asked for" % (len(out), cap))
    return out[:cap]


kept = []
prosthesis = []
planes = []
removed_cells = []
summary = []
variants_json = ""
report = ["03 Joint"]

try:
    root = _repo_root()
    source_path = os.path.join(root, "src")
    if source_path not in sys.path:
        sys.path.append(source_path)
    import scriptcontext as sc

    # Do not reload the package while a background thread is still using it.
    _live = sc.sticky.get("joinery.jobs.%s" % ghenv.Component.InstanceGuid, {})
    if not any(isinstance(j, dict) and not j.get("done") for j in _live.values()):
        for name in list(sys.modules):
            if name.startswith("workshop_robarch_2026"):
                sys.modules.pop(name)

    import numpy as np
    import Rhino
    import Rhino.Geometry as rg
    from workshop_robarch_2026 import (agents, context, evaluator, joinery,
                                       kernel, neighbours)

    setup = json.loads(str(globals().get("setup_json") or "{}"))
    frame = (setup.get("member") or {}).get("frame")
    if not frame:
        raise ValueError("connect setup_json from 01 SELECT")
    centres = list(globals().get("centers") or [])
    values = [float(v) for v in (globals().get("damage") or [])]
    if not centres:
        raise ValueError("connect `centers` and `damage` from 00 CELLS")

    # From 01, which derived it as 00 did. Re-deriving here would not agree.
    built = (setup.get("member") or {}).get("cellCount")
    if built and built != len(centres):
        raise ValueError("00 built %d cells and %d are wired in, so 01 and 03 "
                         "are not looking at the same run" % (built, len(centres)))
    points = [[float(p.X), float(p.Y), float(p.Z)] for p in centres]
    mem = joinery.member(frame, points, values)
    report.append("grid %dx%dx%d = %d cells" % (mem["grid"] + (len(points),)))

    gate = 0.5 if globals().get("threshold") is None else float(threshold)
    if not joinery.damaged(mem, gate).any():
        raise ValueError("no cell reaches %.2f, so there is nothing to repair"
                         % gate)

    # ---- how many separate damages are there? ----------------------------
    aspect = 3.0
    window = joinery.extents(mem)
    found = joinery.clusters(mem, gate)
    if not found:
        raise ValueError("no cell reaches %.2f, so there is nothing to repair"
                         % gate)
    report.append("%d separate damage(s) on this member:" % len(found))
    for index, item in enumerate(found):
        report.append("   %d  v %.3f..%.3f m, %d cell(s), %s -> %s"
                      % (index, item["vRange"][0], item["vRange"][1],
                         item["cells"],
                         "reaches an end" if item["reachesTheEnd"]
                         else "sound timber both sides",
                         "a splice replaces everything past it"
                         if item["reachesTheEnd"] else
                         "a patch, so the timber beyond it stays"))

    report.append("window reaches x +-%.3f, z +-%.3f   (1.0 = %.0f mm, "
                  "one cell = %.0f mm, which is the finest anything is "
                  "measured at)"
                  % (window["xHalf"], window["zHalf"], window["unitMm"],
                     window["cellMm"]))

    # ---- the frame around it --------------------------------------------
    # The model cannot keep clear of a seat it has not been shown, so the
    # report always says where the neighbouring parts came from.
    around, boxes, source = [], [], None
    try:
        wired = str(globals().get("workspace_json") or "").strip()
        workspace = context.load_workspace(globals().get("workspace_json")) if wired else None
        if workspace is not None:
            around = neighbours.around(workspace, setup.get("beamId"), frame)
            to_rhino = neighbours.world_matrix(workspace)
            boxes = [b for b in (neighbours.part_box(p, to_rhino)
                                 for p in context.parts(workspace)
                                 if str(p.get("id")) != str(setup.get("beamId")))
                     if b is not None]
            source = "workspace_json"
        elif setup.get("neighbours"):
            around = list(setup.get("neighbours"))
            source = "setup_json, from 01"
    except Exception as exc:
        report.append("NEIGHBOURS: could not be read (%s), so the model is "
                      "being told nothing about the frame" % exc)

    tasks = []
    for index, item in enumerate(found):
        kind = "splice" if item["reachesTheEnd"] else "patch"
        at, side, note = joinery.anchor(mem, gate, aspect, straddle=True,
                                        kind=kind, within=item["vRange"])
        tasks.append({
            "cluster": item, "kind": kind, "side": side, "station": at,
            "note": note,
            "decay": joinery.decay(mem, gate, at, side, aspect,
                                   within=item["vRange"]),
            "bearing": joinery.nearby(mem, around, at, side, aspect),
        })
    inside = [n for n in tasks[0]["bearing"]["parts"] if n["insideTheJoint"]]
    if not around:
        report.append("NEIGHBOURS: none. %s The model cannot keep clear of a "
                      "seat it has not been shown."
                      % ("setup_json carries no neighbours and workspace_json is "
                         "not connected" if not setup.get("beamId")
                         else "connect workspace_json to 03, or check 01's report "
                              "for how many parts it found"))
    else:
        report.append("%d part(s) touch this member (%s); %d bear inside the "
                      "joint window" % (len(around), source, len(inside)))
        for n in inside:
            report.append("   %s bears on %s over y %.2f..%.2f, so a face "
                          "placed there cuts its seat" % (n["label"] or n["id"],
                                             " ".join(n["bearsOn"]) or "the member",
                                             n["y"][0], n["y"][1]))
        if not inside:
            report.append("   none of them fall within the joint, so none "
                          "constrains it")

    # ---- the joints: pasted, or designed, ONE SET PER DAMAGE -------------
    pasted = str(globals().get("joint_json") or "").strip()
    if pasted:
        parsed = json.loads(pasted)
        designs = parsed if isinstance(parsed, list) else [parsed]
        report.append("%d joint(s) pasted in, so the model was not called"
                      % len(designs))
        for task in tasks:
            task["designs"] = designs
    else:
        brief = json.loads(str(globals().get("brief_json") or "{}"))
        if not brief:
            raise ValueError("connect brief_json from 02 BRIEF")
        model = str(globals().get("model") or agents.DEFAULT_MODEL).strip()
        temperature = globals().get("temperature")
        temperature = 0.7 if temperature is None else float(temperature)
        examples, corpus_notes = agents.corpus_examples(root)
        report.extend(corpus_notes)
        catalogue = {e["key"]: {"aspect": e.get("aspect") or aspect,
                                "planes": e["planes"], "groups": e["groups"],
                                "what": e.get("what")} for e in examples}
        # One call per damage: asked about two at once it averages them.
        waiting, failed = [], []
        for index, task in enumerate(tasks):
            payload = {
                "brief": brief,
                "part": setup.get("part"),
                "plan": setup.get("plan"),
                "member": dict(setup.get("member") or {}, window=window),
                "damage": {"threshold": gate, "decay": task["decay"],
                           "grid": (setup.get("damage") or {}).get("grid"),
                           "repair": task["kind"],
                           "thisIsOneOf": len(tasks),
                           "theOthers": [t["cluster"]["vRange"] for j, t
                                         in enumerate(tasks) if j != index]},
                "neighbours": task["bearing"],
                "examples": examples,
            }
            key = agents.signature("joint-v10", brief, setup.get("part"),
                                   setup.get("plan"), task["decay"], window,
                                   task["bearing"], model, temperature)
            state = agents.background(
                ghenv.Component, "joint-%d" % index, key,
                lambda payload=payload: agents.call(
                    root, "joint.md", payload, model=model,
                    temperature=temperature),
                bool(globals().get("run")))
            task["state"] = state
            if state["status"] == "running":
                waiting.append((index, state))
            elif state["status"] == "error":
                failed.append((index, state))

        if any(t["state"]["status"] == "idle" for t in tasks):
            report.append("press run to design the repairs (%d damage(s))" % len(tasks))
            raise SystemExit
        if waiting:
            report.append("Gemini working on %d of %d damage(s), %.0f s"
                          % (len(waiting), len(tasks),
                             max(s["seconds"] for _, s in waiting)))
            raise SystemExit
        if failed:
            for index, state in failed:
                report.append("ERROR on damage %d: %s" % (index, state["error"]))
            raise SystemExit

        for index, task in enumerate(tasks):
            answer, notes_out = task["state"]["result"]
            if index == 0:
                report.extend(notes_out)
            task["designs"] = _designs(answer, catalogue, report)
            report.append("damage %d (%s): %d chosen, %d varied, in %.0f s"
                          % (index, task["kind"],
                             len(answer.get("chosen") or []),
                             len(answer.get("variations") or []),
                             task["state"]["seconds"]))
    if not any(task.get("designs") for task in tasks):
        raise ValueError("the model returned no joints")

    # ---- place each repair, inside its own damage ------------------------
    step = max(5, min(45, int(globals().get("sweep_degrees") or 15)))
    sample_key = agents.signature(
        "scheme-v6", [t.get("designs") for t in tasks],
        [t["cluster"]["vRange"] for t in tasks], gate, step, mem["grid"],
        len(points), [item["id"] for item in around])
    store = sc.sticky.setdefault("joinery_placed", {})
    picked = store.get(sample_key)
    mark = len(report)          # everything the placing pass says, replayed below

    if picked is None:
        for number, task in enumerate(tasks):
            span = task["cluster"]["vRange"]
            placed = []
            for design in task.get("designs") or []:
                joint = dict(design)
                joint.setdefault("id", "d%d-%d" % (number, len(placed)))
                joint.setdefault("aspect", aspect)
                # The kind the model drew, not the kind this damage calls for.
                joint["kind"] = str(design.get("kind") or task["kind"]).lower()
                if joint["kind"] != task["kind"]:
                    report.append("%s is a %s, but this damage has sound timber "
                                  "on both sides and needs a %s; skipped"
                                  % (joint["id"], joint["kind"], task["kind"]))
                    continue
                try:
                    loose = joinery.open_at_kept_side(joint)
                    if loose:
                        report.append("%s has a group unbounded on the %s "
                                      "side, so it would sweep the whole "
                                      "member. Skipped."
                                      % (joint["id"],
                                         "/".join(sorted({g["side"] for g in loose}))))
                        continue
                    rough, at_side, _ = joinery.anchor(mem, gate, joint["aspect"],
                                                       kind=joint["kind"],
                                                       within=span)
                    best = joinery.place(joint, mem, gate, rough, at_side,
                                         around=around, degrees=step, within=span)
                    full = joinery.measure(best["joint"], mem, best["station"],
                                           at_side, gate, boxes=boxes,
                                           around=around, within=span)
                    asked = joinery.claimed_locks(design.get("locksClaimed"),
                                                  best["twist"], at_side)
                    full.update(id=joint["id"], kind=joint["kind"],
                                what=design.get("what"), why=design.get("why"),
                                twist=best["twist"], station=best["station"],
                                spent=best["spent"], joint=best["joint"],
                                side=at_side, damage=number,
                                # As drawn: the diff compares shape, not twist.
                                drawn=joint,
                                fromKey=design.get("fromKey"),
                                base=design.get("base"),
                                changed=design.get("changed"),
                                expect=design.get("expect"),
                                resists=design.get("resists"),
                                doesNotResist=design.get("doesNotResist"),
                                locksClaimed=asked,
                                locksNotDelivered=[d for d in asked
                                                   if d not in full["locks"]])
                    placed.append(full)
                except Exception as exc:
                    report.append("%s could not be placed: %s"
                                  % (joint.get("id"), exc))
            # ---- did the variations earn their place? ---------------------
            # Printed as families: the chosen corpus joint is the control,
            # its variations under it, each one a single change from it.
            control = {r["fromKey"]: r for r in placed if r.get("fromKey")}
            families = {}
            for one in placed:
                if one.get("base"):
                    families.setdefault(one["base"], []).append(one)
            if families:
                report.append("damage %d, each family against its control:"
                              % number)
            for key in sorted(families):
                against = control.get(key)
                if against is None:
                    report.append("   %s was varied but never chosen, so its "
                                  "variations have nothing to be measured against"
                                  % key)
                    continue
                report.append("   %-38s %5.2f%%   the control, from the corpus"
                              % (against["id"][:38], 100 * against["spent"]))
                for one in sorted(families[key], key=lambda r: r["spent"]):
                    delta = 100 * (one["spent"] - against["spent"])
                    won = [d for d in one["locks"] if d not in against["locks"]]
                    lost = [d for d in against["locks"] if d not in one["locks"]]
                    # `changed` is claimed, `did` is what the planes show.
                    report += [
                        "     %-36s %5.2f%%  %+.2f%%  %-9s%s%s"
                        % (one["id"][:36], 100 * one["spent"], delta,
                           "BETTER" if delta < -0.01 else
                           "worse" if delta > 0.01 else "no change",
                           "  locks %s more" % " ".join(won) if won else "",
                           "  loses %s" % " ".join(lost) if lost else ""),
                        "        says: %s" % (one.get("changed") or "nothing"),
                        "        did:  %s" % joinery.differences(against["drawn"],
                                                                 one["drawn"])["did"],
                    ]
                    if one.get("expect"):
                        report.append("        expected: %s" % one["expect"])
            if placed:
                best = min(placed, key=lambda r: r["spent"])
                line = ("damage %d, best of %d placed: %s at %.2f%%"
                        % (number, len(placed), best["id"][:36], 100 * best["spent"]))
                if control:
                    par = min(control.values(), key=lambda r: r["spent"])
                    line += ("; best corpus joint %.2f%%, so %s"
                             % (100 * par["spent"],
                                "the model beat the corpus"
                                if best["spent"] < par["spent"] - 1e-5
                                else "the corpus still wins"))
                report.append(line)

            placed.sort(key=lambda r: (r["rotLeft"],
                                       len(r.get("cutsConnections") or []),
                                       r["spent"]))
            task["placed"] = placed
            if not placed:
                report.append("WARNING: no repair could be placed for damage %d "
                              "(%s, v %.3f..%.3f). Its %d cell(s) stay in the "
                              "wall and are counted in rotLeft."
                              % (number, task["kind"], span[0], span[1],
                                 task["cluster"]["cells"]))

        # ---- combine into schemes -----------------------------------------
        # One repair per damage, paired by rank, then re-measured together.
        working = [t for t in tasks if t.get("placed")]
        if not working:
            raise ValueError("no repair could be placed for any damage; see above")
        depth = min(len(t["placed"]) for t in working)
        schemes = []
        for rank in range(depth):
            chosen = [t["placed"][rank] for t in working]
            whole = joinery.scheme(
                [{"joint": c["joint"], "station": c["station"], "side": c["side"]}
                 for c in chosen], mem, gate, boxes=boxes, around=around)
            whole["parts"] = chosen
            whole["id"] = " + ".join(str(c["id"]) for c in chosen)
            schemes.append(whole)
        schemes.sort(key=lambda s: (s["rotLeft"],
                                    len(s.get("cutsConnections") or []),
                                    s["overlap"], s["spent"]))
        picked = {"schemes": schemes, "said": report[mark:]}
        store[sample_key] = picked
    else:
        # Replayed, so moving `variant` does not drop the comparison.
        report.extend(picked.get("said") or [])
        report.append("placements cached, so `variant` can be moved freely "
                      "without recomputing anything")

    ranked = picked["schemes"]
    if not ranked:
        raise ValueError("no scheme could be built; see the messages above")
    report.append("%d scheme(s) of %d repair(s); each was rotated through %d "
                  "angles around the member and slid along it to the position "
                  "that spends least sound timber"
                  % (len(ranked), len(tasks), 360 // step))

    for index, item in enumerate(ranked):
        line = ("%d  %-24s oak %5.2f%%  rot left %-3d"
                % (index, str(item["id"])[:24], 100 * item["spent"],
                   item["rotLeft"]))
        if item.get("rotPartly"):
            line += "  %d only part-taken" % item["rotPartly"]
        if item.get("cutsConnections"):
            line += "  CUTS %s" % ", ".join(item["cutsConnections"])
        if item.get("betweenMm") is not None:
            line += ("  repairs OVERLAP by %.0f mm" % -item["betweenMm"]
                     if item["overlap"] else
                     "  %.0f mm of sound timber between them" % item["betweenMm"])
        summary.append(line)
        for one in item["parts"]:
            note = ("      %-6s %-14s turned %+4.0f at %.3f m  locks %s"
                    % (one.get("kind"), str(one["id"])[:14], one["twist"],
                       one["station"], " ".join(one["locks"]) or "none"))
            note += ("  [corpus %s]" % one["fromKey"] if one.get("fromKey")
                     else "  [var of %s]" % one["base"] if one.get("base") else "")
            if one.get("locksNotDelivered"):
                note += "  CLAIMS %s and does not" % " ".join(one["locksNotDelivered"])
            if one.get("insertionBlocked"):
                note += "  cannot fit along %s" % " ".join(one["insertionBlocked"])
            summary.append(note)
            if one.get("what"):
                summary.append("         %s" % one["what"])

    variants_json = json.dumps({
        "damages": [{"vRange": t["cluster"]["vRange"], "cells": t["cluster"]["cells"],
                     "kind": t["kind"], "decay": t["decay"]} for t in tasks],
        "variants": [{
            "id": v["id"],
            "soundTimberSpentPct": round(100 * v["spent"], 3),
            "rotLeft": v["rotLeft"], "rotTotal": v["rotTotal"],
            "rotPartly": v.get("rotPartly"),
            "soundTaken": v["soundTaken"], "soundTotal": v["soundTotal"],
            "locks": v["locks"],
            "cutsConnections": v.get("cutsConnections"),
            "betweenMm": v.get("betweenMm"), "overlap": v.get("overlap"),
            "repairs": [{"id": r["id"], "kind": r.get("kind"),
                         "what": r.get("what"), "why": r.get("why"),
                         # where it came from, so 04 can group the families
                         "fromCorpus": r.get("fromKey"), "variationOf": r.get("base"),
                         "changed": r.get("changed"), "expected": r.get("expect"),
                         "turnedDeg": r["twist"],
                         "stationM": round(r["station"], 4),
                         "extent": r["extent"], "locks": r["locks"],
                         "locksClaimed": r.get("locksClaimed"),
                         "locksNotDelivered": r.get("locksNotDelivered"),
                         "insertionBlocked": r.get("insertionBlocked"),
                         "nearestSeatMm": r.get("nearestSeatMm"),
                         "resists": r.get("resists"),
                         "doesNotResist": r.get("doesNotResist")}
                        for r in v["parts"]],
        } for v in ranked],
    }, indent=2, ensure_ascii=False)

    # ---- the geometry, for the one scheme being shown --------------------
    pick = max(0, min(len(ranked) - 1, int(globals().get("variant") or 0)))
    shown = ranked[pick]
    report.append("showing %d of %d: %s" % (pick, len(ranked), shown["id"]))

    # Rhino's default on a metre document is 10 mm, too coarse for joinery.
    document = float(Rhino.RhinoDoc.ActiveDoc.ModelAbsoluteTolerance)
    section = min(float(frame["width"]), float(frame["height"]))
    tolerance = min(document, section / 1000.0)
    if tolerance < document:
        report.append("cutting at %.5f; the document is set to %.5f, which is "
                      "too coarse for a %.0f mm section"
                      % (tolerance, document, 1000 * section))
    try:
        kept.extend(evaluator.evaluate_part(joinery.merge_kept(shown["parts"]),
                                            tolerance))
    except Exception as exc:
        report.append("the retained timber would not cut: %s" % exc)
    for one in shown["parts"]:
        try:
            prosthesis.extend(evaluator.evaluate_part(one["repair"]["parts"][1],
                                                      tolerance))
        except Exception as exc:
            report.append("%s: the replacement piece would not cut: %s"
                          % (one["id"], exc))

    size = 0.75 * max(frame["width"], frame["height"])
    for one in shown["parts"]:
        for cut_json in one["repair"]["parts"][0]["cuts"][1:-1]:
            item = kernel.Cut.from_json(cut_json)
            origin = item.origin()
            normal = np.asarray(item.normal, float)
            normal /= np.linalg.norm(normal)
            surface = rg.Plane(rg.Point3d(*[float(c) for c in origin]),
                               rg.Vector3d(*[float(c) for c in normal]))
            planes.append(rg.Rectangle3d(surface, rg.Interval(-size, size),
                                         rg.Interval(-size, size)).ToNurbsCurve())

    removed_cells = [centres[i] for i, flag in enumerate(shown["removed"]) if flag]
    report.append("kept %d Brep(s), prosthesis %d Brep(s), %d plane(s), "
                  "%d cell(s) replaced"
                  % (len(kept), len(prosthesis), len(planes), len(removed_cells)))
    if not prosthesis or not kept:
        # Measuring uses no boolean, so the numbers stand.
        report.append("%s measures but will not cut at this tolerance (%.4f). "
                      "Its planes are on the `planes` output; the measurements "
                      "in summary and variants_json are unaffected. A thinner "
                      "feature than the tolerance can do this."
                      % (shown["id"], tolerance))
except SystemExit:
    pass
except Exception as exc:
    report.append("ERROR: {}".format(exc))
# ---------- end _03_joint ----------

# ----
report_4 = Panel(_03_joint.report)
llm_output_3 = Panel(_03_joint.summary)
llm_output_4 = Panel(_03_joint.variants_json)
volume = Volume(Geometry=_03_joint.prosthesis)  # -> Volume, Centroid
scale = Scale(Geometry=_03_joint.prosthesis, Center=volume.Centroid, Factor=1.001)  # -> Geometry, Transform
custom_preview_3 = CustomPreview(Geometry=scale.Geometry, Material=ColourSwatch(SwatchColor=RGB(0, 221, 255)))
geometry_3 = Geometry(_03_joint.prosthesis)

run_genmodel_4 = Button()
_04_compare = Python3Script(variants_json=_03_joint.variants_json, brief_json=_02_brief.brief_json, run=run_genmodel_4)  # -> out, comparison, recommendation, against_brief, compare_json, report
# ---------- _04_compare: Python ----------
"""GH Python 3, 04 COMPARE: say what each joint does and does not do.

One model call, made on the measurements alone. The model is not shown the
planes, so it cannot describe geometry it has not seen. It can only describe
what that geometry achieved.

Needs
-----
src/workshop_robarch_2026/agents.py, for the model call.
data/prompts/compare.md, and a Gemini key in gemini_api_key.txt or
GEMINI_API_KEY.

Inputs
------
variants_json  str    from 03 JOINT
brief_json     str    from 02 BRIEF
model          str    optional Gemini model
temperature    float  optional [0.3]
run            bool   press to compare
repo           str    the repository folder, if it cannot be found on its own

Outputs
-------
comparison      str[]  one block per variation: what it does, what it does not
recommendation  str    which one to use, and why, argued against the brief
against_brief   str[]  where a variation fails something the brief asked for
compare_json    str
report          str[]
"""

import json
import os
import sys


def _repo_root():
    starts = [globals().get("repo"), os.environ.get("ROBARCH_REPO")]
    try:
        starts.append(os.path.dirname(str(ghenv.Component.OnPingDocument().FilePath or "")))
    except Exception:
        pass
    starts.extend([os.getcwd(), *sys.path])
    for start in starts:
        if not start or "://" in str(start):
            continue
        folder = os.path.abspath(os.path.expanduser(str(start)))
        if os.path.isfile(folder):
            folder = os.path.dirname(folder)
        for _ in range(9):
            if os.path.isdir(os.path.join(folder, "src", "workshop_robarch_2026")):
                return folder
            parent = os.path.dirname(folder)
            if parent == folder:
                break
            folder = parent
    raise RuntimeError("workshop repository not found; connect its folder to repo")


comparison = []
against_brief = []
recommendation = compare_json = ""
report = ["04 Compare"]

try:
    root = _repo_root()
    source_path = os.path.join(root, "src")
    if source_path not in sys.path:
        sys.path.append(source_path)
    import scriptcontext as sc

    # Do not reload the package while a background thread is still using it.
    _live = sc.sticky.get("joinery.jobs.%s" % ghenv.Component.InstanceGuid, {})
    if not any(isinstance(j, dict) and not j.get("done") for j in _live.values()):
        for name in list(sys.modules):
            if name.startswith("workshop_robarch_2026"):
                sys.modules.pop(name)

    from workshop_robarch_2026 import agents

    raw = str(globals().get("variants_json") or "").strip()
    if not raw:
        raise ValueError("connect variants_json from 03 JOINT")
    variants = json.loads(raw)
    brief = json.loads(str(globals().get("brief_json") or "{}"))
    if not brief:
        raise ValueError("connect brief_json from 02 BRIEF")

    model = str(globals().get("model") or agents.DEFAULT_MODEL).strip()
    temperature = globals().get("temperature")
    temperature = 0.3 if temperature is None else float(temperature)

    # The measurements only. The planes are deliberately left out.
    payload = {
        "brief": brief,
        "claimed": {"resists": variants.get("resists"),
                    "doesNotResist": variants.get("doesNotResist")},
        "variants": variants.get("variants"),
    }
    key = agents.signature("compare-v1", variants.get("variants"), brief, model, temperature)
    state = agents.background(
        ghenv.Component, "compare", key,
        lambda: agents.call(root, "compare.md", payload, model=model,
                            temperature=temperature),
        bool(globals().get("run")))

    if state["status"] == "idle":
        report.append("press run to compare")
        raise SystemExit
    if state["status"] == "running":
        report.append("Gemini working, %.0f s%s" % (
        state["seconds"],
        "" if state["attempt"] < 2 else "  (run %d)" % state["attempt"]))
        raise SystemExit
    if state["status"] == "error":
        report.append("ERROR: %s" % state["error"])
        raise SystemExit

    cached, notes_out = state["result"]
    report.extend(notes_out)
    report.append("answered in %.0f s%s" % (
        state["seconds"],
        "" if state["attempt"] < 2 else "  (run %d; press again to ask afresh)"
        % state["attempt"]))

    for item in cached.get("variants") or []:
        comparison.append(
            "%s\n   does:      %s\n   does not:  %s\n   choose when: %s"
            % (item.get("id"), item.get("does"), item.get("doesNot"),
               item.get("chooseWhen")))
    if cached.get("comparison"):
        comparison.append("")
        comparison.append(str(cached["comparison"]))

    recommendation = str(cached.get("recommendation") or "")
    against_brief = [str(v) for v in (cached.get("againstTheBrief") or [])]
    compare_json = json.dumps(cached, indent=2, ensure_ascii=False)

    report.append("%d variation(s) compared" % len(cached.get("variants") or []))
    if against_brief:
        for line in against_brief:
            report.append("AGAINST THE BRIEF: %s" % line)
    else:
        report.append("no variation contradicts the brief")
except SystemExit:
    pass
except Exception as exc:
    report.append("ERROR: {}".format(exc))
# ---------- end _04_compare ----------
report_5 = Panel(_04_compare.report)
llm_output_5 = Panel(_04_compare.comparison)
llm_output_6 = Panel(_04_compare.against_brief)
llm_output_7 = Panel(_04_compare.recommendation)

value_list_4 = ValueList({"waste", "cycle"}, selected="cycle")
python_3_script = Python3Script(
    cuts_json=_03_joint.cuts_json,
    prosthesis=_03_joint.prosthesis,
    mark_side=value_list_4,
    stepover_mm=Slider(10, range=0..10),
    run=Button())  # -> out, blank, waste, outline, strokes, passes, order, sequence_json, a, report; inputs prosthesis: list of Brep
# ---------- python_3_script: Python ----------
"""GH Python 3 -- 05 MARK: the joint line round the blank, and the order to cut it.

The replacement piece is milled from a rectangular blank of the member's own
section. This component draws where the joint faces surface on that blank -- the
line that wraps round all four sides -- and two kinds of offset from it.

The first is the tally. Beside each face sits a group of strokes, and the number
of strokes is that face's place in the cutting order: four strokes means cut this
one fourth. It is the carpenter's own way of numbering work, it survives being
photographed and scribed 2 mm deep, and it needs no legend. The second is the
roughing passes at the cutter's stepover, which say how the waste comes off.

The order is not a rule of mine. A model is given the faces, their roles, which
way the waste lies and what the tool is, and it decides the sequence and where
the piece is turned over. What it returns is then checked against the geometry,
and anything it got wrong is printed rather than hidden.

Inputs
------
cuts_json    str      from 03 JOINT
prosthesis   Brep[]   from 03 JOINT -- the replacement piece
mark_side    str      piece | waste  [piece]  which side of the line the tally
                      sits on. `piece` keeps every mark on the material that
                      becomes the prosthesis and off the timber that stays.
stroke_mm    float    length of one tally stroke [12]
tally_gap_mm float    spacing between strokes in a group [6]
stepover_mm  float    roughing stepover; 0 turns the passes off [3]
model        str      optional Gemini model
temperature  float    optional [0.2]
run          bool     press to ask for the cutting order
repo         str      optional repository override

Outputs
-------
blank        Brep     the stock the piece is milled from
waste        Brep[]   what comes off it
outline      Curve[]  the joint line on the blank's four long faces, in cut order
strokes      Curve[]  the tally: N strokes beside the face that is cut Nth, so
                      the count on the timber is the step number
passes       Curve[]  roughing passes, deepest first, finish pass last
order        str[]    the sequence in words
sequence_json str
report       str[]
"""

import json
import os
import sys


def _repo_root():
    starts = [globals().get("repo"), os.environ.get("ROBARCH_REPO")]
    try:
        starts.append(os.path.dirname(str(ghenv.Component.OnPingDocument().FilePath or "")))
    except Exception:
        pass
    starts.extend([os.getcwd(), *sys.path])
    for start in starts:
        if not start or "://" in str(start):
            continue
        folder = os.path.abspath(os.path.expanduser(str(start)))
        if os.path.isfile(folder):
            folder = os.path.dirname(folder)
        for _ in range(9):
            if os.path.isdir(os.path.join(folder, "src", "workshop_robarch_2026")):
                return folder
            parent = os.path.dirname(folder)
            if parent == folder:
                break
            folder = parent
    raise RuntimeError("workshop repository not found; connect its folder to repo")


blank = None
waste = []
outline = []
strokes = []
passes = []
order = []
sequence_json = ""
report = ["05 Mark"]

try:
    root = _repo_root()
    source_path = os.path.join(root, "src")
    if source_path not in sys.path:
        sys.path.append(source_path)
    import scriptcontext as sc
    import time as _time

    _live = sc.sticky.get("joinery.jobs.%s" % ghenv.Component.InstanceGuid, {})
    for _job in _live.values():
        if (isinstance(_job, dict) and not _job.get("done")
                and _time.time() - float(_job.get("started") or 0) > 300.0):
            _job["done"] = True
    if not any(isinstance(j, dict) and not j.get("done") for j in _live.values()):
        for name in list(sys.modules):
            if name.startswith("workshop_robarch_2026"):
                sys.modules.pop(name)

    import numpy as np
    import Rhino
    import Rhino.Geometry as rg
    from workshop_robarch_2026 import agents, joinery, marking

    if int(getattr(marking, "VERSION", 0)) < 1:
        raise RuntimeError("marking.py is missing or old; loaded from %s"
                           % getattr(marking, "__file__", "nowhere"))

    doc = Rhino.RhinoDoc.ActiveDoc
    tol = float(doc.ModelAbsoluteTolerance)
    per_metre = Rhino.RhinoMath.UnitScale(Rhino.UnitSystem.Meters, doc.ModelUnitSystem)

    def mm(value):
        return float(value) / 1000.0 * per_metre

    raw = str(globals().get("cuts_json") or "").strip()
    if not raw:
        raise ValueError("connect cuts_json from 03 JOINT")
    data = json.loads(raw)
    frame = data["frame"]
    faces = data["faces"]
    solids = [b for b in (globals().get("prosthesis") or []) if b is not None]
    if not solids:
        raise ValueError("connect the prosthesis Breps from 03 JOINT")

    def vec(key):
        return rg.Vector3d(*[float(v) for v in frame[key]])

    u_axis, v_axis, w_axis = vec("u"), vec("v"), vec("w")
    corner = rg.Point3d(*[float(v) for v in frame["origin"]])
    basis = np.column_stack([np.asarray(frame[k], float) for k in ("u", "v", "w")])
    origin = np.asarray(frame["origin"], float)

    # ---- the blank ------------------------------------------------------
    # full section, and along the member exactly as far as the piece reaches
    section_plane = rg.Plane(corner, u_axis, v_axis)
    box = rg.BoundingBox.Empty
    for solid in solids:
        box = rg.BoundingBox.Union(box, solid.GetBoundingBox(section_plane))
    lo = section_plane.PointAt(box.Min.X, box.Min.Y, box.Min.Z)
    hi = section_plane.PointAt(box.Max.X, box.Max.Y, box.Max.Z)
    v_lo = float((np.asarray([lo.X, lo.Y, lo.Z]) - origin) @ basis[:, 1])
    v_hi = float((np.asarray([hi.X, hi.Y, hi.Z]) - origin) @ basis[:, 1])
    blank_box = rg.Box(rg.Plane(corner, u_axis, v_axis),
                       rg.Interval(0.0, float(frame["width"])),
                       rg.Interval(min(v_lo, v_hi), max(v_lo, v_hi)),
                       rg.Interval(0.0, float(frame["height"])))
    blank = blank_box.ToBrep()
    report.append("blank %.0f x %.0f x %.0f mm"
                  % (1000 * frame["width"] / per_metre,
                     1000 * abs(v_hi - v_lo) / per_metre,
                     1000 * frame["height"] / per_metre))

    joined = rg.Brep.CreateBooleanUnion(solids, tol) or solids
    cut_away = rg.Brep.CreateBooleanDifference(
        [blank], list(joined), tol) or []
    waste = list(cut_away)

    # ---- which cut plane each surfaced edge belongs to -------------------
    def plane_of(item):
        normal = rg.Vector3d(*[float(c) for c in item["normal"]])
        return normal, float(item["offset"])

    long_faces = {"+u": (basis[:, 0], float(frame["width"])),
                  "-u": (-basis[:, 0], 0.0),
                  "+w": (basis[:, 2], float(frame["height"])),
                  "-w": (-basis[:, 2], 0.0)}

    def on_blank_surface(point):
        """Which of the four long faces this point lies on, if any."""
        local = (np.array([point.X, point.Y, point.Z]) - origin) @ basis
        for name, (direction, _) in long_faces.items():
            axis = 0 if "u" in name else 2
            edge_value = float(frame["width"] if axis == 0 else frame["height"])
            want = edge_value if name[0] == "+" else 0.0
            if abs(local[axis] - want) <= 5.0 * tol:
                return name, direction
        return None, None

    edges_for_face = {item["id"]: [] for item in faces}
    for solid in joined:
        for edge in solid.Edges:
            curve = edge.EdgeCurve.Trim(edge.Domain) or edge.EdgeCurve
            middle = curve.PointAtNormalizedLength(0.5)
            face_name, _ = on_blank_surface(middle)
            if face_name is None:
                continue
            best, best_gap = None, 5.0 * tol
            for item in faces:
                normal, offset = plane_of(item)
                gap = abs(normal.X * middle.X + normal.Y * middle.Y
                          + normal.Z * middle.Z - offset)
                if gap < best_gap:
                    best, best_gap = item["id"], gap
            if best is not None:
                edges_for_face[best].append((face_name, curve.DuplicateCurve()))

    found = sum(len(v) for v in edges_for_face.values())
    report.append("%d edge(s) of the joint surface on the blank, across %d face(s)"
                  % (found, sum(1 for v in edges_for_face.values() if v)))
    for item in faces:
        if not edges_for_face[item["id"]]:
            report.append("%s (%s) never reaches the outside of the blank -- it is "
                          "an internal face and cannot be scribed"
                          % (item["id"], item["role"]))

    # ---- the sequence ---------------------------------------------------
    stepover = float(globals().get("stepover_mm") or 3.0)
    built = (data.get("fabrication") or {}).get("built") or {}
    sequence = None
    payload = marking.sequence_payload(data["joint"], faces, frame, built,
                                       joinery.TOOL_MM, stepover)
    model = str(globals().get("model") or agents.DEFAULT_MODEL).strip()
    temperature = globals().get("temperature")
    temperature = 0.2 if temperature is None else float(temperature)
    state = agents.background(
        ghenv.Component, "sequence",
        agents.signature("sequence-v1", payload, model, temperature),
        lambda: agents.call(root, "sequence.md", payload, model=model,
                            temperature=temperature),
        bool(globals().get("run")))

    if state["status"] == "running":
        report.append("Gemini working on the order, %.0f s" % state["seconds"])
    elif state["status"] == "error":
        report.append("ERROR from the sequence agent: %s" % state["error"])
    elif state["status"] == "done":
        sequence, notes = state["result"]
        report.extend(notes)
        problems = marking.check_sequence(sequence.get("order") or [], faces, frame)
        for line in problems:
            report.append("SEQUENCE: %s" % line)
        if not problems:
            report.append("the sequence reaches every face from a direction it "
                          "actually looks toward")
    else:
        report.append("press run for the cutting order; the geometry below is in "
                      "the order the joint was authored")

    steps = (sequence or {}).get("order") or [{"face": item["id"]} for item in faces]
    ordered = []
    for position, step in enumerate(steps):
        item = next((f for f in faces if f["id"] == str(step.get("face"))), None)
        if item is not None:
            ordered.append((position, step, item))
    for item in faces:                       # anything the model forgot, at the end
        if not any(o[2]["id"] == item["id"] for o in ordered):
            ordered.append((len(ordered), {"face": item["id"]}, item))

    # ---- outline, strokes, passes, in that order -------------------------
    side = str(globals().get("mark_side") or "piece").strip().lower()
    if side not in ("waste", "piece"):
        side = "piece"
    stroke_len = mm(float(globals().get("stroke_mm") or 12.0))
    gap = mm(float(globals().get("tally_gap_mm") or 6.0))
    want_waste = side == "waste"
    report.append("tally marks on the %s side, %.0f mm strokes %.0f mm apart"
                  % (side, 1000 * stroke_len / per_metre, 1000 * gap / per_metre))

    corners = np.array([[a, b, c]
                        for a in (0.0, float(frame["width"]))
                        for b in (min(v_lo, v_hi), max(v_lo, v_hi))
                        for c in (0.0, float(frame["height"]))])
    world_corners = corners @ basis.T + origin

    for position, step, item in ordered:
        normal_v = rg.Vector3d(*[float(c) for c in item["normal"]])
        normal = np.asarray(item["normal"], float)
        offset = float(item["offset"])

        for face_name, curve in edges_for_face[item["id"]]:
            outline.append(curve)

        # The tally: as many strokes as this face's place in the sequence, so
        # the count on the timber IS the step number. Four strokes means cut
        # this one fourth. Written once per face, on its longest surfaced edge,
        # running off the line into the material -- never across the line.
        number = position + 1
        edges = edges_for_face[item["id"]]
        face_name, curve = (max(edges, key=lambda pair: pair[1].GetLength())
                            if edges else (None, None))
        length = curve.GetLength() if curve else 0.0
        span = (number - 1) * gap
        if curve is not None and length <= span + gap:
            report.append("%s: %d tally strokes will not fit on a %.0f mm edge -- "
                          "reduce tally_gap_mm or cut this face earlier"
                          % (item["id"], number, 1000 * length / per_metre))
            curve = None

        face_normal = (rg.Vector3d(*[float(c) for c in long_faces[face_name][0]])
                       if curve is not None else None)
        for index in range(number if curve is not None else 0):
            ok, t = curve.NormalizedLengthParameter(
                min(1.0, max(0.0, (0.5 * (length - span) + index * gap) / length)))
            if not ok:
                continue
            point = curve.PointAt(t)
            tangent = curve.TangentAt(t)
            across = rg.Vector3d.CrossProduct(face_normal, tangent)
            if not across.Unitize():
                continue
            # n . p >= offset is the piece, below it is the waste
            probe = point + across * (0.25 * stroke_len)
            on_waste = (normal_v.X * probe.X + normal_v.Y * probe.Y
                        + normal_v.Z * probe.Z - offset) < 0
            if on_waste != want_waste:
                across = -across
            end = point + across * stroke_len
            local = (np.array([end.X, end.Y, end.Z]) - origin) @ basis
            inside = (-tol <= local[0] <= frame["width"] + tol
                      and -tol <= local[2] <= frame["height"] + tol
                      and min(v_lo, v_hi) - tol <= local[1] <= max(v_lo, v_hi) + tol)
            if inside:
                strokes.append(rg.LineCurve(point, end))

        if stepover > 0 and waste:
            reach = float((world_corners @ normal).max() - offset)
            for constant in marking.roughing(offset, max(0.0, reach), mm(stepover)):
                seed = constant * normal
                plane = rg.Plane(rg.Point3d(float(seed[0]), float(seed[1]),
                                            float(seed[2])), normal_v)
                for solid in waste:
                    ok, curves, _ = rg.Intersect.Intersection.BrepPlane(
                        solid, plane, tol)
                    if ok and curves:
                        passes.extend(curves)

        order.append("%d  %-4s %-28s tool from %-3s  %s"
                     % (position + 1, item["id"], item["role"][:28],
                        str(step.get("toolFrom") or "-"),
                        str(step.get("why") or "")))

    for setup in (sequence or {}).get("setups") or []:
        order.append("   setup: tool from %-3s  %s  -- %s"
                     % (setup.get("toolFrom"), " ".join(setup.get("faces") or []),
                        setup.get("note") or ""))
    for line in (sequence or {}).get("risk") or []:
        report.append("RISK: %s" % line)

    sequence_json = json.dumps({"variant": data.get("variant"),
                                "sequence": sequence,
                                "faces": data.get("inMember")},
                               indent=2, ensure_ascii=False)
    report.append("%d outline curve(s), %d stroke(s), %d roughing pass(es)"
                  % (len(outline), len(strokes), len(passes)))
except SystemExit:
    pass
except Exception as exc:
    report.append("ERROR: {}".format(exc))
# ---------- end python_3_script ----------
panel_2 = Panel(python_3_script.report)
geometry_4 = Geometry([python_3_script.outline, python_3_script.strokes])
geometry_5 = Geometry(python_3_script.outline)
pipe = Pipe(Curve=geometry_4, Radius=Slider(0.002, range=0..0.01), Caps=2, FitRail=False)
custom_preview_4 = CustomPreview(Geometry=pipe, Material=ColourSwatch(SwatchColor=RGB(0, 0, 0)))
