# Grasshopper definition repair_joint_selection_AGENTIC.gh (Grasshopper 1.0.8)
# plug-ins: Human

# ---- group: Joint Picker
value_list = ValueList({"SJ1 – Half Lap Joint": "SJ1", "SJ2 – Undersquinted Half Lap Joint": "SJ2", "SJ3 – Spear Point Half Lap Joint": "SJ3", "SJ4 – Undersquinted Spear Point Half Lap Joint": "SJ4", "SJ5 – Splayed Scarf Joint": "SJ5", "SJ6 – Half Lap Joint with Mitered Ends": "SJ6", "SJ7 – Tapered Dovetail Tenon Joint with Mitered Shoulders": "SJ7", "SJ8 – Lapped Dovetail Joint": "SJ8"}, selected="SJ4 – Undersquinted Spear Point Half Lap Joint")  # disabled
button = Button()  # disabled
refresh = Python3Script(refresh=button, picker=value_list)  # -> out, keys, report; disabled
# ---------- refresh: Python ----------
"""GH Python 3 -- JOINT PICKER: auto-fill a Value List from the catalogue.

Wire a Value List component INTO `picker`, set `refresh` True once.
The Value List then shows every joint in data/corpus/joints/ (label from the
datasheet's first line, value = the key). Wire that same Value List into
gh_repair's `key`. Re-run refresh after authoring a new joint.

Inputs:
    picker   (no type hint needed -- only its wire matters)
    refresh  (bool)
Outputs:
    keys, report
"""
import sys, os

REPO = r"C:\Users\tizian\workspace\projects\workshop_robarch_2026"
SRC = os.path.join(REPO, "src")
if SRC not in sys.path:
    sys.path.append(SRC)
for m in list(sys.modules):
    if m.startswith("workshop_robarch_2026"):
        sys.modules.pop(m)

from workshop_robarch_2026 import joints
import Grasshopper.Kernel.Special as ghs

keys = joints.list_keys(REPO)
report = ["{} joint(s): {}".format(len(keys), ", ".join(keys) or "-")]


def _label(key):
    md = joints.load_datasheet(REPO, key)
    for line in md.splitlines():
        line = line.strip().lstrip("#").strip()
        if line:
            return line          # e.g. "SW2 -- Half lap with mitered ends"
    return key

if refresh and keys:
    filled = False
    try:
        picker_param = None
        for prm in ghenv.Component.Params.Input:
            if prm.NickName == "picker":
                picker_param = prm
                break
        for src in (picker_param.Sources if picker_param else []):
            if isinstance(src, ghs.GH_ValueList):
                sel = None
                if src.SelectedItems.Count > 0:
                    sel = str(src.SelectedItems[0].Value).strip('"')
                src.ListItems.Clear()
                for k in keys:
                    src.ListItems.Add(
                        ghs.GH_ValueListItem(_label(k), '"{}"'.format(k)))
                # keep the previous selection if it still exists
                for i, k in enumerate(keys):
                    if k == sel:
                        src.SelectItem(i)
                        break
                src.ExpireSolution(True)
                filled = True
    except Exception as exc:
        report.append("could not fill Value List: {}".format(exc))
    report.append("dropdown filled" if filled
                  else "wire a Value List INTO `picker`")
# ---------- end refresh ----------
panel = Panel(refresh.report)  # disabled

# ----
value_list_2 = ValueList({"low", "medium", "high"}, selected="medium")

# ---- group: Beams
brep = Brep([<brep referenced from the Rhino model> x23])

# ----
number_slider = Slider(10, range=0..100)  # disabled

# ---- group: Beams
brep_2 = Brep([<brep referenced from the Rhino model> x17])  # disabled

# ----
number_slider_2 = Slider(0, range=0..72)  # disabled
steps_degrees = Panel("15")  # disabled
number_slider_3 = Slider(0.21, range=0..1)  # disabled
number_slider_4 = Slider(1, range=0.5..5)  # disabled
value_list_3 = ValueList({"far end": "1", "near end": "-1"}, selected="near end")  # disabled
multiplication = Multiplication(A=number_slider_2, B=steps_degrees)  # disabled

select_beam = Python3Script(beams=brep, index=Slider(2, range=0..100))  # -> out, box, selected, rest, report; inputs beams: list of Brep
# ---------- select_beam: Python ----------
"""GH Python 3 -- SELECT BEAM: pick one member of an assembly for repair.

Takes all beams of the model, fits a tight ORIENTED bounding box to each
(correct for diagonal braces, not just axis-aligned members), and lets you
select one by index. The selected member leaves as a Box for gh_repair;
all other members pass through unchanged.

OBB strategy: for prismatic members the optimal box is aligned to one of
the planar faces and one of that face's edges -- we test those candidate
frames and keep the smallest-volume box. Exact for typical timber.

Inputs:
    beams  (Brep, list)   all members of the assembly
    index  (int)          which member to repair (see report for the list)
    run    (bool)
Outputs:
    box       oriented Box of the selected member -> gh_repair `box`
    selected  the selected member's original Brep (reference overlay)
    rest      all other members, unchanged
    report    per-member dimensions, so the index is informed
"""
import Rhino.Geometry as rg
from Grasshopper import DataTree
from Grasshopper.Kernel.Data import GH_Path

box = None
selected = None
rest = DataTree[object]()
report = []
run = 'TRUE'

def _obb_axis_first(b, tol=0.001):
    """Deterministic for prismatic members: long axis = longest edge;
    second axis = a side-face normal perpendicular to it."""
    axis = None
    best_len = 0.0
    for e in b.Edges:
        d = e.PointAtEnd - e.PointAtStart
        if d.Length > best_len:
            best_len = d.Length
            axis = d
    if axis is None or best_len < 1e-9:
        return None
    axis.Unitize()
    side_n = None
    for f in b.Faces:
        ok, plane = f.TryGetPlane(tol)
        if ok and abs(plane.Normal * axis) < 0.05:
            side_n = plane.Normal
            break
    if side_n is None:
        return None
    y = rg.Vector3d.CrossProduct(side_n, axis)
    y.Unitize()
    frame = rg.Plane(rg.Point3d.Origin, axis, y)
    bb = b.GetBoundingBox(frame)
    cand = rg.Box(frame, bb)
    return cand if cand.IsValid else None


def _obb(b, tol=0.001):
    ax = _obb_axis_first(b, tol)
    if ax is not None:
        return ax, "axis"
    best = None
    best_vol = None
    # candidate frames from planar faces + their edge directions
    for f in b.Faces:
        ok, plane = f.TryGetPlane(tol)
        if not ok:
            continue
        n = plane.Normal
        for e in b.Edges:
            d = e.PointAtEnd - e.PointAtStart
            if d.Length < 1e-9:
                continue
            d.Unitize()
            if abs(d * n) > 1e-3:      # edge not in the face plane family
                continue
            y = rg.Vector3d.CrossProduct(n, d)
            if y.Length < 1e-9:
                continue
            y.Unitize()
            frame = rg.Plane(rg.Point3d.Origin, d, y)
            bb = b.GetBoundingBox(frame)
            cand = rg.Box(frame, bb)
            if not cand.IsValid:
                continue
            vol = cand.Volume
            if best_vol is None or vol < best_vol - 1e-12:
                best_vol, best = vol, cand
    if best is None:                    # fallback: world-aligned
        return rg.Box(b.GetBoundingBox(True)), "world"
    return best, "search"


if run and beams:
    try:
        bs = beams if isinstance(beams, list) else [beams]
        bs = [b for b in bs if b is not None]
        if not bs:
            raise ValueError("no valid breps in `beams`")
        i = int(index or 0) % len(bs)
        report.append("received {} member(s)".format(len(bs)))
        for j, b in enumerate(bs):
            if j == i:
                ob, how = _obb(b)
                box = ob
                selected = b
                ext = sorted([ob.X.Length, ob.Y.Length, ob.Z.Length])
                report.append(">> [{}] SELECTED  {:.0f} x {:.0f} x {:.0f} mm"
                              "  (obb: {})".format(
                                  j, ext[0] * 1000, ext[1] * 1000,
                                  ext[2] * 1000, how))
            else:
                rest.Add(b, GH_Path(0))
        # listing for orientation
        for j, b in enumerate(bs):
            if j == i:
                continue
            bb = b.GetBoundingBox(True)
            d = bb.Diagonal
            report.append("   [{}] approx {:.0f} x {:.0f} x {:.0f} mm".format(
                j, abs(d.X) * 1000, abs(d.Y) * 1000, abs(d.Z) * 1000))
    except Exception as exc:
        report.append("ERROR: {}".format(exc))
else:
    report.append("wire all members into `beams`, choose `index`, set run")
# ---------- end select_beam ----------
beam_cells = Python3Script(mesh=select_beam.selected, box_mode=Toggle(True), resolution=value_list_2)  # -> out, timber, plane, box, centers, damage, report; inputs mesh: Mesh
# ---------- beam_cells: Python ----------
"""GH Python 3 -- BEAM CELLS: cellularize a beam mesh along the member.

Works for any member direction -- upright post, horizontal sill, diagonal
brace -- without modifying assembly_information_model.

WHY THE DETOUR
--------------
`CellularizedPart.build_cell_grid` grids `self.mesh.aabb()`, the WORLD
axis-aligned box, and never uses the `frame` you pass. On an upright post the
AABB happens to be the member, so it looks fine. On a brace rotated 0.9 rad
the AABB is 32x the member volume, and `grid=(nu, nv, nw)` subdivides world
X/Y/Z rather than width/length/height.

So: transform the mesh into the member's own frame, build the part there --
where the AABB *is* the tight oriented box -- and transform the result back.
Same package, correct grid, any orientation.

Patch `build_cell_grid` to use an oriented box (docs/cellularized_part_patch.md)
and this detour becomes unnecessary.

Inputs:
    mesh        (Mesh)   the beam
    box_mode    (bool)   True  = cells are plain boxes, active by centroid
                         False = cells are the mesh clipped to each cell
    nu          (int)    subdivisions ACROSS THE WIDTH   [3]
    nv          (int)    subdivisions ALONG THE LENGTH   [12]
    nw          (int)    subdivisions ACROSS THE HEIGHT  [3]
    resolution  (str)    optional "low"|"medium"|"fine"; overrides nu/nv/nw
                         and derives a grid with roughly cubic cells
Outputs:
    timber   the CellularizedPart, damage initialised to 0.0
    plane    the member frame; Y is the beam axis
    box      the oriented beam box
    centers  cell centroids in world coordinates
    damage   one 0.0 per cell, same order
    report
"""
import sys, os

REPO = r"C:\Users\tizian\workspace\projects\workshop_robarch_2026"
SRC = os.path.join(REPO, "src")
if SRC not in sys.path:
    sys.path.append(SRC)

import Rhino.Geometry as rg
from compas.geometry import Frame, Point, Transformation
from compas.geometry import transform_points, cross_vectors, dot_vectors
from compas_rhino.conversions import mesh_to_compas, frame_to_rhino, point_to_rhino
from assembly_information_model import CellularizedPart

timber = None
plane = None
box = None
centers = []
damage = []
report = []

PRESETS = {"low": 2, "medium": 3, "fine": 4}


def member_frame(cmesh):
    """OBB frame reordered so local Y is the member axis. -> (Frame, extents)."""
    obb = cmesh.obb()
    ax = [list(obb.frame.xaxis), list(obb.frame.yaxis), list(obb.frame.zaxis)]
    ext = [obb.xsize, obb.ysize, obb.zsize]
    iv = ext.index(max(ext))
    iu, iw = (iv + 1) % 3, (iv + 2) % 3
    u, v = ax[iu], ax[iv]
    if dot_vectors(cross_vectors(u, v), ax[iw]) < 0:
        u = [-c for c in u]
    return Frame(obb.frame.point, u, v), (ext[iu], ext[iv], ext[iw])


def grid_for(ext, resolution):
    n = PRESETS.get(str(resolution).lower())
    if n is None:
        n = int(resolution)
    cell = min(ext) / float(n)
    return tuple(max(1, int(round(e / cell))) for e in ext)


def move_network(net, T):
    """CellNetwork.transform() raises NotImplementedError -- move vertices."""
    for v in net.vertices():
        x, y, z = transform_points([net.vertex_coordinates(v)], T)[0]
        net.vertex_attributes(v, "xyz", [x, y, z])
    for c in net.cells():
        cm = net.cell_attribute(c, "cell_mesh")
        if cm is not None:
            cm.transform(T)


if mesh:
    try:
        cmesh = mesh_to_compas(mesh)          # no recentring - never needed
        f, ext = member_frame(cmesh)

        if resolution:
            grid = grid_for(ext, resolution)
        else:
            grid = (int(nu) if nu else 3,
                    int(nv) if nv else 12,
                    int(nw) if nw else 3)

        T = Transformation.from_frame_to_frame(f, Frame.worldXY())
        Tb = Transformation.from_frame_to_frame(Frame.worldXY(), f)

        timber = CellularizedPart.from_mesh(
            cmesh.transformed(T), grid=grid, box_mode=bool(box_mode),
            name="timber", frame=Frame.worldXY())

        timber.mesh.transform(Tb)
        move_network(timber.cell_network, Tb)
        timber.frame = f
        timber.set_damage_scores([0.0] * timber.num_cells)

        net = timber.cell_network
        for c in net.cells():
            centers.append(point_to_rhino(Point(*net.cell_centroid(c))))
            damage.append(0.0)

        plane = frame_to_rhino(f)
        box = rg.Box(plane,
                     rg.Interval(-ext[0] / 2.0, ext[0] / 2.0),
                     rg.Interval(-ext[1] / 2.0, ext[1] / 2.0),
                     rg.Interval(-ext[2] / 2.0, ext[2] / 2.0))

        cs = (ext[0] / grid[0], ext[1] / grid[1], ext[2] / grid[2])
        report.append("member %.3f x %.3f x %.3f m, axis = frame Y" % ext)
        report.append("grid %d x %d x %d = %d cells, %.0f x %.0f x %.0f mm"
                      % (grid + (timber.num_cells,)
                         + tuple(1000.0 * c for c in cs)))
        report.append("active %d of %d" % (len(net.active_cells()), timber.num_cells))
        report.append("box_mode=%s -> cells are %s"
                      % (bool(box_mode),
                         "plain boxes" if box_mode else "clipped mesh pieces"))
        if max(cs) / min(cs) > 3.0:
            report.append("WARNING: cells %.1f:1 elongated -- counting them will "
                          "measure the wrong thing" % (max(cs) / min(cs)))
        report.append("damage initialised to 0.0 on all %d cells" % timber.num_cells)
    except Exception as exc:
        report.append("ERROR: {}".format(exc))
else:
    report.append("connect a mesh")
# ---------- end beam_cells ----------
panel_2 = Panel(beam_cells.report)
run = BooleanToggle(True)  # disabled
python_3_script = Python3Script(beams=brep_2, index=number_slider)  # -> out, box, selected, rest, report; inputs beams: list of Brep; disabled; same code as select_beam
mesh = Mesh(select_beam.selected)
point = Point(Point(0, 0, 0.1721531645))
cell_example_damage = Python3Script(timber=beam_cells.timber, seed=point, radius=Slider(0.2, range=0..1))  # -> out, part, timber, damage, centers, report; inputs seed: Point3d
# ---------- cell_example_damage: Python ----------
"""GH Python 3 -- CELL DAMAGE: write damage scores onto a cellularized beam.

Damage lives ON THE PART, not in a parallel list, so it survives the JSON
round-trip and step 8 can read back what step 1 wrote.

Two ways in, and they compose -- `seed` first, then `bins` overrides:

    seed + radius   a rot-like blob falling off with distance. For testing,
                    and a reasonable stand-in for "soft around here".
    bins + scores   explicit, e.g. bins ["0,5,1", "0,6,1"] scores [0.9, 0.7].
                    This is what the step-1 annotation will emit.

Inputs:
    timber   (Part)      from gh_beam_cells
    seed     (Point3d)   optional; centre of the damage
    radius   (float)     where the blob reaches 0  [0.25]
    peak     (float)     score at the seed  [1.0]
    bins     (str, list) optional; "i,j,k" labels to set explicitly
    scores   (float, list) matching scores for `bins`
    active_only (bool)   leave inactive cells at 0.0  [True]
    reset    (bool)      zero everything first  [True]
Outputs:
    timber   the part, damage written (a copy -- the input is not mutated)
    damage   flat list, cell order, for gh_repair_search
    centers  cell centroids, same order
    colours  red-to-green per cell, for a Custom Preview
    report
"""
import sys, os

REPO = r"C:\Users\tizian\workspace\projects\workshop_robarch_2026"
SRC = os.path.join(REPO, "src")
if SRC not in sys.path:
    sys.path.append(SRC)

import System.Drawing as sd
from compas.geometry import Point
from compas_rhino.conversions import point_to_rhino

damage = []
centers = []
colours = []
report = []

R = float(radius) if radius else 0.25
PEAK = float(peak) if peak is not None else 1.0
RESET = True if reset is None else bool(reset)
ACTIVE_ONLY = True if active_only is None else bool(active_only)

if timber:
    try:
        part = timber.copy()
        net = part.cell_network
        ckeys = list(net.cells())

        vals = {}
        for ck in ckeys:
            vals[ck] = 0.0 if RESET else (net.cell_attribute(ck, "damage_score") or 0.0)

        if seed is not None and R > 0:
            sp = Point(seed.X, seed.Y, seed.Z)
            for ck in ckeys:
                c = Point(*net.cell_centroid(ck))
                d = c.distance_to_point(sp)
                s = PEAK * max(0.0, 1.0 - d / R)
                if s > vals[ck]:
                    vals[ck] = s

        if bins:
            sc = list(scores) if scores else []
            for i, b in enumerate(bins):
                ijk = tuple(int(t) for t in str(b).replace(" ", "").split(","))
                try:
                    ck = net.ijk_to_ckey[ijk]
                except KeyError:
                    report.append("bin %s is not on this grid" % str(b))
                    continue
                vals[ck] = float(sc[i]) if i < len(sc) else 1.0

        if ACTIVE_ONLY:
            for ck in ckeys:
                if not net.cell_attribute(ck, "active"):
                    vals[ck] = 0.0

        part.set_damage_scores([vals[ck] for ck in ckeys])

        for ck in ckeys:
            v = vals[ck]
            damage.append(v)
            centers.append(point_to_rhino(Point(*net.cell_centroid(ck))))
            colours.append(sd.Color.FromArgb(int(255 * v), int(255 * (1 - v)), 40))

        timber = part
        n = len(damage)
        for t in (0.3, 0.5, 0.7):
            report.append("threshold %.1f -> %d of %d cells damaged (%.0f%%)"
                          % (t, sum(1 for x in damage if x >= t), n,
                             100.0 * sum(1 for x in damage if x >= t) / n))
        report.append("mean damage %.3f" % (sum(damage) / n if n else 0.0))
        if all(x < 0.5 for x in damage):
            report.append("WARNING: nothing reaches 0.5 -- the search will have "
                          "nothing to do. Move the seed onto the beam or raise radius.")
    except Exception as exc:
        report.append("ERROR: {}".format(exc))
else:
    report.append("connect timber from gh_beam_cells")
# ---------- end cell_example_damage ----------
panel_3 = Panel(cell_example_damage.report)
gh_repair = Python3Script(
    box=python_3_script.box,
    key=value_list,
    position=number_slider_3,
    rotation=multiplication,
    side=value_list_3,
    interface_scale=number_slider_4,
    run=run)  # -> out, kept, prosthesis, cut_plane, cut_lines, info; inputs box: Box; disabled
# ---------- gh_repair: Python ----------
"""LOADER for the repair component. Edit the real code in
rhino/components/gh_repair.py; re-toggle run to reload.
Inputs:  box (Box), key (str), position (float 0..1),
         rotation (float, degrees), side (int +1/-1),
         interface_scale (float), run (bool)
Outputs: kept, prosthesis, cut_plane, cut_lines, info"""
# r: roslibpy
import os
SCRIPT = "gh_repair.py"


def _find_repo():
    marker = os.path.join("src", "workshop_robarch_2026")
    p = os.environ.get("ROBARCH_REPO")
    if p and os.path.isdir(os.path.join(p, marker)):
        return p
    try:
        d = os.path.dirname(ghenv.Component.OnPingDocument().FilePath or "")
        while d and len(d) > 3:
            if os.path.isdir(os.path.join(d, marker)):
                return d
            d = os.path.dirname(d)
    except Exception:
        pass
    try:
        import workshop_robarch_2026 as _w
        return os.path.abspath(os.path.join(
            os.path.dirname(_w.__file__), "..", ".."))
    except ImportError:
        pass
    home = os.path.expanduser("~")
    for c in (os.path.join(home, "workspace", "projects",
                           "workshop_robarch_2026"),
              os.path.join(home, "Documents", "workshop_robarch_2026")):
        if os.path.isdir(os.path.join(c, marker)):
            return c
    raise RuntimeError("repo not found: save this .gh inside the repo or "
                       "set the ROBARCH_REPO environment variable")

_p = os.path.join(_find_repo(), "rhino", "components", SCRIPT)
exec(compile(open(_p, encoding="utf-8").read(), _p, "exec"))
# ---------- end gh_repair ----------

value_list_4 = ValueList({"Corner Post": "corner_post", "End Post Right": "end_post_right", "Intermediate Post Right": "intermediate_post_right", "Diagonal Brace Right": "diagonal_brace_right", "Lower Rail Outer Right": "lower_rail_outer_right", "Upper Rail Outer Right": "upper_rail_outer_right", "Upper Rail Inner Right": "upper_rail_inner_right", "Upper Rail Middle Right": "upper_rail_middle_right", "Lower Rail Middle Right": "lower_rail_middle_right", "Lower Rail Inner Right": "lower_rail_inner_right", "End Post Left": "end_post_left", "Intermediate Post Left": "intermediate_post_left", "Diagonal Brace Left": "diagonal_brace_left", "Lower Rail Outer Left": "lower_rail_outer_left", "Upper Rail Outer Left": "upper_rail_outer_left", "Upper Rail Inner Left": "upper_rail_inner_left", "Upper Rail Middle Left": "upper_rail_middle_left", "Lower Rail Middle Left": "lower_rail_middle_left", "Lower Rail Inner Left": "lower_rail_inner_left", "Top Plate Right": "top_plate_right", "Top Plate Left": "top_plate_left", "Sill Beam Left": "sill_beam_left", "Sill Beam Right": "sill_beam_right"}, selected="Corner Post")
panel_4 = Panel("C:\Users\tizian\Downloads\timber-frame-corner__tizian__scarf-joint-post-repair__2026-08-21.zip")
repair_setup = Python3Script(
    workspace_json=panel_4,
    picker=value_list_4,
    box=beam_cells.box,
    centers=cell_example_damage.centers,
    damage=cell_example_damage.damage,
    threshold=Slider(0.5, range=0..1),
    refresh=Button())  # -> out, setup_json, beam_id, capabilities_json, report; inputs box: Box, centers: list of Point3d, damage: list of Double
# ---------- repair_setup: Python ----------
"""GH Python 3 -- 01 REPAIR SETUP: select a member and build its context.

Inputs: workspace_json, picker, refresh, box, centers, damage, threshold, repo
Outputs: setup_json, beam_id, capabilities_json, report
"""

import json
import os
import sys


def _repo_root():
    starts = [globals().get("repo"), os.environ.get("ROBARCH_REPO")]
    try:
        starts.append(os.path.dirname(str(ghenv.Component.OnPingDocument().FilePath or "")))
    except Exception:
        pass
    starts.extend([os.getcwd(), *sys.path])
    for start in starts:
        if not start or "://" in str(start):
            continue
        folder = os.path.abspath(os.path.expanduser(str(start)))
        if os.path.isfile(folder):
            folder = os.path.dirname(folder)
        for _ in range(9):
            if os.path.isdir(os.path.join(folder, "src", "workshop_robarch_2026")):
                return folder
            parent = os.path.dirname(folder)
            if parent == folder:
                break
            folder = parent
    raise RuntimeError("workshop repository not found; connect its folder to repo")


def _list(value):
    if value is None:
        return []
    try:
        return list(value)
    except TypeError:
        return [value]


def _xyz(value):
    return [float(value.X), float(value.Y), float(value.Z)]


def _box_summary(value):
    if value is None:
        return None
    if hasattr(value, "IsValid") and not value.IsValid:
        raise ValueError("box is invalid")
    return {
        "center": _xyz(value.Center),
        "axes": {
            "x": _xyz(value.Plane.XAxis),
            "y": _xyz(value.Plane.YAxis),
            "z": _xyz(value.Plane.ZAxis),
        },
        "size": {
            "x": float(value.X.Length),
            "y": float(value.Y.Length),
            "z": float(value.Z.Length),
        },
    }


def _rhino_settings():
    import Rhino

    document = Rhino.RhinoDoc.ActiveDoc
    return float(document.ModelAbsoluteTolerance), str(document.ModelUnitSystem)


def _expression_value(value):
    try:
        return str(json.loads(str(value)))
    except Exception:
        return str(value).strip().strip('"')


def _fill_picker(options):
    import Grasshopper.Kernel.Special as ghs

    parameter = next(
        (item for item in ghenv.Component.Params.Input if item.NickName == "picker"),
        None,
    )
    source = next(
        (
            item for item in (parameter.Sources if parameter else [])
            if isinstance(item, ghs.GH_ValueList)
        ),
        None,
    )
    if source is None:
        raise ValueError("wire a Grasshopper Value List into picker")
    previous = (
        _expression_value(source.SelectedItems[0].Value)
        if source.SelectedItems.Count else None
    )
    expected = [(item["label"], item["id"]) for item in options]
    ids = [item[1] for item in expected]
    selected = previous if previous in ids else ids[0]
    current = [(str(item.Name), _expression_value(item.Value)) for item in source.ListItems]
    if current != expected:
        source.ListItems.Clear()
        for label, part_id in expected:
            source.ListItems.Add(ghs.GH_ValueListItem(label, json.dumps(part_id)))
        source.SelectItem(ids.index(selected))
        source.ExpireSolution(True)
        return selected, True
    if previous != selected:
        source.SelectItem(ids.index(selected))
        source.ExpireSolution(True)
        return selected, True
    return selected, False


setup_json = beam_id = capabilities_json = ""
report = ["01 Repair Setup"]

try:
    root = _repo_root()
    source_path = os.path.join(root, "src")
    if source_path not in sys.path:
        sys.path.append(source_path)
    from workshop_robarch_2026 import workshop_flow, workspace_io

    workspace_input = globals().get("workspace_json")
    workspace = workspace_io.load_workspace(workspace_input)
    options = workspace_io.part_options(workspace)
    if not options:
        raise ValueError("Workspace contains no parts")
    beam_id = str(globals().get("picker") or "").strip()
    if bool(globals().get("refresh")):
        beam_id, changed = _fill_picker(options)
        report.append("dropdown filled" if changed else "dropdown already current")
    elif beam_id not in [item["id"] for item in options]:
        beam_id = options[0]["id"]
        report.append("press refresh once to fill the connected Value List")

    target = workspace_io.find_part(workspace, beam_id)
    gate = 0.5 if globals().get("threshold") is None else float(threshold)
    raw_centers = _list(globals().get("centers"))
    raw_damage = _list(globals().get("damage"))
    field = workspace_io.damage_field(raw_centers, raw_damage, gate)
    box_summary = _box_summary(globals().get("box"))
    tolerance, units = _rhino_settings()
    context = workspace_io.part_context(workspace, beam_id)
    context["rhinoContext"] = {
        "targetBox": box_summary,
        "cellularDamage": field["summary"],
        "absoluteTolerance": tolerance,
        "modelUnits": units,
    }
    context_hash = workspace_io.json_digest(
        {
            "context": context,
            "box": box_summary,
            "cellDataHash": field["dataHash"],
            "threshold": gate,
        }
    )
    scoped_parts = [context.get("targetPart")] + list(context.get("connectedParts") or [])
    session = {
        "schema": "repair-session@1",
        "workspaceHash": workspace_io.workspace_digest(workspace),
        "contextHash": context_hash,
        "cellDataHash": field["dataHash"],
        "instanceId": (workspace.get("instance") or {}).get("id"),
        "beamId": beam_id,
        "partIds": [str(item["id"]) for item in scoped_parts if item and item.get("id")],
        "actionIds": [
            str(item["id"])
            for item in ((context.get("currentPlan") or {}).get("steps") or [])
            if item.get("id")
        ],
        "threshold": gate,
        "rhinoTolerance": tolerance,
        "modelUnits": units,
        "cellCount": len(raw_centers),
    }
    raw_source = str(workspace_input or "").strip()
    if (
        raw_source and len(raw_source) < 1024 and "\n" not in raw_source
        and os.path.isfile(os.path.abspath(os.path.expanduser(raw_source)))
    ):
        source_file = os.path.abspath(os.path.expanduser(raw_source))
        session["workspaceSource"] = {
            "kind": "zip" if source_file.lower().endswith(".zip") else "json",
            "path": source_file,
        }
    capabilities = {
        "schema": "repair-capabilities@1",
        "targetBox": "available" if box_summary else "not connected",
        "cellularDamage": "available" if raw_centers else "not connected",
        "currentPlan": "available" if context.get("currentPlan") else "missing",
        "neighbourGeometry": "connect later when relevant",
        "checks": {
            "localGeometry": "available" if box_summary else "limited",
            "neighbourCollision": "requires neighbour geometry",
            "insertionSampled": "requires candidate movement data",
            "toolRadius": "requires candidate tool data",
        },
    }
    setup = workshop_flow.setup_record(session, context, capabilities)
    setup_json = json.dumps(setup, indent=2, ensure_ascii=False)
    capabilities_json = json.dumps(capabilities, indent=2, ensure_ascii=False)
    report.append("selected: {} ({})".format(target.get("label") or beam_id, beam_id))
    report.append("{} cells; {} at or above {:.3f}".format(
        len(raw_centers), field["summary"]["aboveThresholdCellCount"], gate
    ))
    report.append("Rhino tolerance: {} {}".format(tolerance, units))
except Exception as exc:
    report.append("ERROR: {}".format(exc))
# ---------- end repair_setup ----------
panel_5 = Panel(repair_setup.setup_json)
panel_6 = Panel(repair_setup.report)
panel_7 = Panel(repair_setup.beam_id)

panel_8 = Panel(gh_repair.info)  # disabled
geometry = Geometry(gh_repair.kept)  # disabled
geometry_2 = Geometry(gh_repair.prosthesis)  # disabled
curve = Curve(gh_repair.cut_lines)  # disabled
plane = Plane(gh_repair.cut_plane)  # disabled
colour_swatch = ColourSwatch(SwatchColor=RGB(255, 68, 0))  # disabled
custom_preview_lineweights = CustomPreviewLineweights(Geometry=curve, Shader=colour_swatch, Thickness=5, Absolute=False)  # disabled

# ----
# Visualise a cellularized part
toggle = BooleanToggle(True)
show = Python3Script(part=cell_example_damage.part, show=toggle)  # -> out, plane, mesh, cell_meshes, cell_centers, cell_bins, cell_damage
# ---------- show: Python ----------
from compas_rhino.conversions import mesh_to_rhino, box_to_rhino, frame_to_rhino
from compas_rhino.conversions import point_to_rhino

if show:
    # extract the mesh of the part for visualization
    full_mesh = part.mesh
    # convert to rhino mesh
    mesh = [mesh_to_rhino(full_mesh)]

    # extract the frame of the part for visualization
    full_frame = part.frame
    # convert to rhino plane
    plane = [frame_to_rhino(full_frame)]

    # one separate rhino mesh per cell (all cells, not just active ones):
    # the clipped irregular mesh if box_mode=False was used to build `part`,
    # otherwise (or if a cell just happens to be untouched) the plain grid box
    net = part.cell_network
    cell_meshes = [mesh_to_rhino(net.cell_mesh(ckey) or net.cell_to_mesh(ckey)) for ckey in net.cells()]

    # parallel lists so you can colour/filter cells downstream in GH
    cell_active = [net.cell_attribute(ckey, "active") for ckey in net.cells()]
    cell_centers = [point_to_rhino(net.cell_centroid(ckey)) for ckey in net.cells()]
    cell_bins = [net.cell_attribute(ckey, "bin") for ckey in net.cells()]
    cell_damage = [net.cell_attribute(ckey, "damage_score") for ckey in net.cells()]
    print(cell_bins)
# ---------- end show ----------
gradient = Gradient(
    LowerLimit=0,
    UpperLimit=1,
    Parameter=show.cell_damage,
    stops=[0: RGB(192, 192, 0), 0.508: RGB(255, 192, 128), 1: RGB(220, 0, 40)])
geo = Geometry(show.mesh)
pln = Plane(show.plane)
geo_2 = Geometry(show.cell_meshes)
preview = CustomPreview(Geometry=geo_2, Material=gradient)
tag = TextTag(Location=show.cell_centers, Text=show.cell_bins, Colour=ColourSwatch(SwatchColor=RGB(255, 255, 255)))

multiplication_2 = Multiplication(A=cell_example_damage.damage, B=100)

# ---- group: Move the Prosthesis
number_slider_5 = Slider(-0.7, range=-1..1)  # disabled
unit_y = UnitY(Factor=number_slider_5)  # disabled
move = Move(Geometry=geometry_2, Motion=unit_y)  # -> Geometry, Transform; disabled

# ----
number_slider_6 = Slider(44, range=0..100)  # disabled
number_slider_7 = Slider(25, range=0..100)  # disabled
round = Round(Number=multiplication_2)  # -> Nearest, Floor, Ceiling
tag_2 = TextTag(Location=show.cell_centers, Text=round.Nearest, Colour=ColourSwatch(SwatchColor=RGB(36, 0, 0)))
python_3_script_2 = Python3Script(timber=beam_cells.timber, box=beam_cells.box, index=number_slider_7, seed=number_slider_6)  # -> out, part, damage, centers, label, report; inputs box: Box; disabled
# ---------- python_3_script_2: Python ----------
"""GH Python 3 -- DAMAGE CASES: synthetic damage archetypes on a beam.

Real decay has shapes, and the shape decides which repair is right. This emits
NAMED archetypes with randomised parameters, so a test case can be labelled
and results reported per archetype instead of averaged over nothing.

    foot_rot        rising from one end -- the commonest post failure
    arris_weather   along one exposed corner, shallow and long
    face_pocket     compact soft spot on one face
    core_decay      deep and compact, mid-span
    shake           a split along the grain
    two_regions     two separated pockets
    notch_rot       all round the section at one station

Inputs:
    timber     (Part)  from gh_beam_cells
    box        (Box)   from gh_beam_cells -- defines the local frame
    archetype  (str)   one of the above; blank = cycle by `index`
    index      (int)   which case  [0]
    seed       (int)   RNG seed  [0]
Outputs:
    timber     the part with the case written onto it (a COPY -- the input is
               not mutated). Feed this to the visualise component, which reads
               `damage_score` off the cells rather than taking a list.
               NOTE the output socket must be called `timber`, same as the
               input. The script rebinds the name only after the last read of
               the incoming part, which is what gh_cell_damage does too.
    damage     flat list, cell order, for gh_repair_search
    centers    cell centroids, same order
    colours    green -> red per cell, ready for a Custom Preview `Material`.
               Wire the visualise component's `cell_meshes` to Geometry and
               this to Material -- no Gradient component needed, and no
               chance of the two lists getting out of step.
    label      what this case is
    report
"""
import sys, os

REPO = r"C:\Users\tizian\workspace\projects\workshop_robarch_2026"
SRC = os.path.join(REPO, "src")
if SRC not in sys.path:
    sys.path.append(SRC)

import numpy as np
import System.Drawing as sd
from compas.geometry import Point
from compas_rhino.conversions import point_to_rhino
from workshop_robarch_2026 import damagegen

damage = []
centers = []
colours = []
label = ""
report = []

if timber and box:
    try:
        net = timber.cell_network
        ck = list(net.cells())
        pts = np.array([net.cell_centroid(c) for c in ck], float)

        pl = box.Plane
        ax = [np.array([pl.XAxis.X, pl.XAxis.Y, pl.XAxis.Z]),
              np.array([pl.YAxis.X, pl.YAxis.Y, pl.YAxis.Z]),
              np.array([pl.ZAxis.X, pl.ZAxis.Y, pl.ZAxis.Z])]
        ext = [box.X.Length, box.Y.Length, box.Z.Length]
        iv = int(np.argmax(ext)); iu = (iv + 1) % 3; iw = (iv + 2) % 3
        U, V = ax[iu], ax[iv]
        W = np.cross(U, V); W /= np.linalg.norm(W)
        o = (np.array([pl.Origin.X, pl.Origin.Y, pl.Origin.Z])
             + box.X.Min * ax[0] + box.Y.Min * ax[1] + box.Z.Min * ax[2])
        if float(W @ ax[iw]) < 0:
            o = o + ext[iw] * ax[iw]
        frame = {"origin": o.tolist(), "u": U.tolist(), "v": V.tolist(),
                 "w": W.tolist(), "width": ext[iu], "length": ext[iv],
                 "height": ext[iw]}

        names = list(damagegen.ARCHETYPES)
        i = int(index) if index else 0
        name = str(archetype) if archetype else names[i % len(names)]
        if name not in damagegen.ARCHETYPES:
            report.append("unknown archetype %r; choose from %s"
                          % (name, ", ".join(names)))
        else:
            rng = np.random.default_rng((int(seed) if seed else 0) * 1000 + i)
            d, meta = damagegen.make(frame, pts, name, rng)

            # write onto a copy so the visualise component can read
            # cell_attribute(ckey, "damage_score")
            part = timber.copy()
            part.set_damage_scores([float(x) for x in d])
            timber = part

            damage = [float(x) for x in d]
            centers = [point_to_rhino(Point(*p)) for p in pts]
            for x in d:
                v = float(min(1.0, max(0.0, x)))
                colours.append(sd.Color.FromArgb(int(40 + 215 * v),
                                                 int(200 - 160 * v), 40))
            label = "%s #%d" % (name, i)
            report.append("archetype: %s   case %d" % (name, i))
            for t in (0.3, 0.5, 0.7):
                report.append("  threshold %.1f -> %d of %d damaged"
                              % (t, int((d >= t).sum()), len(d)))
            hot = d >= 0.5
            if hot.any():
                loc = (pts - o) @ V
                report.append("  axial %.3f..%.3f m of %.3f"
                              % (loc[hot].min(), loc[hot].max(), ext[iv]))
            else:
                report.append("  WARNING: nothing above 0.5 -- try another seed")
    except Exception as exc:
        report.append("ERROR: {}: {}".format(type(exc).__name__, exc))
else:
    report.append("connect timber and box from gh_beam_cells")
# ---------- end python_3_script_2 ----------
panel_9 = Panel(python_3_script_2.report)  # disabled

repair_brief = Python3Script(setup_json=repair_setup.setup_json, draft=Button(), review_note="checked", confirm=Button(), reset=Button())  # -> out, repair_json, brief_json, workspace_facts, llm_inferences, open_questions, status
# ---------- repair_brief: Python ----------
# r: google-genai==1.47.0
"""GH Python 3 -- 02 REPAIR BRIEF: draft, inspect, and confirm one brief.

Inputs: setup_json, instruction, gemini_model, draft, review_note, confirm,
        reset, repo
Outputs: repair_json, brief_json, workspace_facts, llm_inferences,
         open_questions, status
"""

import json
import os
import sys


def _repo_root():
    starts = [globals().get("repo"), os.environ.get("ROBARCH_REPO")]
    try:
        starts.append(os.path.dirname(str(ghenv.Component.OnPingDocument().FilePath or "")))
    except Exception:
        pass
    starts.extend([os.getcwd(), *sys.path])
    for start in starts:
        if not start or "://" in str(start):
            continue
        folder = os.path.abspath(os.path.expanduser(str(start)))
        if os.path.isfile(folder):
            folder = os.path.dirname(folder)
        for _ in range(9):
            if os.path.isdir(os.path.join(folder, "src", "workshop_robarch_2026")):
                return folder
            parent = os.path.dirname(folder)
            if parent == folder:
                break
            folder = parent
    raise RuntimeError("workshop repository not found; connect its folder to repo")


repair_json = brief_json = workspace_facts = llm_inferences = open_questions = ""
status = ["02 Repair Brief"]

try:
    root = _repo_root()
    source_path = os.path.join(root, "src")
    if source_path not in sys.path:
        sys.path.append(source_path)
    from workshop_robarch_2026 import (
        grasshopper_jobs, llm_candidate, repair_candidate, workshop_flow,
    )

    setup_input = globals().get("setup_json")
    setup = workshop_flow.validate_setup(setup_input)
    session, context = setup["session"], setup["context"]
    instruction_text = str(globals().get("instruction") or "")
    model = str(globals().get("gemini_model") or llm_candidate.DEFAULT_MODEL)
    reset_value = bool(globals().get("reset"))
    if reset_value:
        grasshopper_jobs.clear_job(ghenv.Component, "brief_stage_confirm")
    draft_signature = llm_candidate.stable_signature(
        setup["recordHash"], instruction_text, model
    )
    draft_state = grasshopper_jobs.background_step(
        ghenv.Component,
        "brief_stage_draft",
        draft_signature,
        lambda: llm_candidate.draft_brief(
            root, session, context, instruction_text, model
        ),
        trigger=bool(globals().get("draft")),
        reset=reset_value,
    )
    status.append("draft: " + draft_state.get("status", "idle"))
    if draft_state.get("error"):
        status.append("DRAFT ERROR: " + draft_state["error"])
    draft_result = draft_state.get("result") or {}
    if draft_result:
        brief = draft_result["brief"]
        brief_json = json.dumps(brief, indent=2, ensure_ascii=False)
        workspace_facts = json.dumps(
            draft_result.get("workspaceFacts") or brief.get("workspaceFacts") or [],
            indent=2, ensure_ascii=False,
        )
        llm_inferences = json.dumps(
            draft_result.get("llmInferences") or brief.get("llmInferences") or [],
            indent=2, ensure_ascii=False,
        )
        open_questions = json.dumps(
            draft_result.get("openQuestions") or brief.get("openQuestions") or [],
            indent=2, ensure_ascii=False,
        )
        note = str(globals().get("review_note") or "")
        confirm_signature = llm_candidate.stable_signature(
            setup["recordHash"], brief, note
        )

        def confirm_brief():
            reviewed = repair_candidate.confirm_brief(brief, session, note)
            llm_candidate.validate_brief(
                reviewed, session["beamId"], session, require_review=True
            )
            return reviewed

        confirm_state = grasshopper_jobs.cached_step(
            ghenv.Component,
            "brief_stage_confirm",
            confirm_signature,
            confirm_brief,
            trigger=bool(globals().get("confirm")),
        )
        status.append("review: " + confirm_state.get("status", "idle"))
        if confirm_state.get("error"):
            status.append("REVIEW ERROR: " + confirm_state["error"])
        reviewed = confirm_state.get("result")
        if reviewed:
            repair = workshop_flow.repair_record(setup, reviewed)
            repair_json = json.dumps(repair, indent=2, ensure_ascii=False)
            brief_json = json.dumps(reviewed, indent=2, ensure_ascii=False)
            verified = len(
                (reviewed.get("requirementsAuthority") or {}).get("requirementIds") or []
            )
            status.append("confirmed; {} cited requirement(s) can bind".format(verified))
except Exception as exc:
    status.append("ERROR: {}".format(exc))
# ---------- end repair_brief ----------
panel_10 = Panel(repair_brief.status)
panel_11 = Panel(repair_brief.repair_json)

# ---- group: Grain Visualisation / Run
run_2 = BooleanToggle(True)  # disabled

# ---- group: Grain Visualisation
number_slider_8 = Slider(0.6, range=0..5)  # disabled
number_slider_9 = Slider(0.0001, range=0..0.005)  # disabled
illustration = Python3Script(pieces=[geometry, move.Geometry], density=number_slider_8, lift=number_slider_9, run=run_2)  # -> out, visible, hidden, grain, report; inputs pieces: list of Brep; disabled
# ---------- illustration: Python ----------
"""GH Python 3 -- GRAIN v3: 3D wood-grain curves for the catalogue look.

Live companion to the "Katalog" display mode (white shading, black edges,
dashed hidden lines): generates real 3D grain curves ON the faces of the
pieces, lifted a hair off the surface. Solids occlude their own back-face
grain naturally -- nothing is view-dependent.

Grain by face type (angle between face normal and beam axis):
    |dot| >  end_threshold [0.15] -> growth-ring CYLINDERS around the piece's
        pith line, intersected with the face plane: circles on square cuts,
        stretched ovals on miters and scarf cheeks (anatomically continuous)
    |dot| <= end_threshold        -> longitudinal flowing lines

v3: clipping fully vectorized in 2D face space (numpy) -- no per-point
RhinoCommon calls; expect ~5-10x faster than v2.

Inputs:
    pieces        (Brep, list)
    axis          (Vector)  beam axis; empty -> longest bbox direction
    density       (float) [1.0]
    lift          (float) [auto = 0.0004 x bbox diagonal]
    end_threshold (float) [0.85] faces with |dot| above this get rings
    run           (bool)
Outputs:
    grain, report
"""
import sys, os, math, random

REPO = r"C:\Users\tizian\workspace\projects\workshop_robarch_2026"
SRC = os.path.join(REPO, "src")
if SRC not in sys.path:
    sys.path.append(SRC)

import numpy as np
import Rhino
import Rhino.Geometry as rg
from Grasshopper import DataTree
from Grasshopper.Kernel.Data import GH_Path

GRAIN_V = "14"
grain = DataTree[object]()
report = []


def _face_plane(face):
    ok, plane = face.TryGetPlane(0.001)
    return plane if ok else None


def _loops_2d(face, plane):
    loops = []
    for lp in face.Loops:
        c = lp.To3dCurve()
        if c is None:
            continue
        div = c.DivideByCount(96, True)
        if not div:
            continue
        pts = [c.PointAt(t) for t in div]
        arr = np.array([[(p - plane.Origin) * plane.XAxis,
                         (p - plane.Origin) * plane.YAxis] for p in pts])
        loops.append(arr)
    return loops


def _segments(loops):
    a, b = [], []
    for L in loops:
        a.append(L)
        b.append(np.roll(L, -1, axis=0))
    return np.vstack(a), np.vstack(b)


def _mask_points(P, seg_a, seg_b):
    if len(P) == 0:
        return np.zeros(0, bool)
    px, py = P[:, 0:1], P[:, 1:2]
    x1, y1 = seg_a[:, 0][None, :], seg_a[:, 1][None, :]
    x2, y2 = seg_b[:, 0][None, :], seg_b[:, 1][None, :]
    cond = (y1 > py) != (y2 > py)
    xin = x1 + (py - y1) * (x2 - x1) / (y2 - y1 + 1e-30)
    return (np.sum(cond & (px < xin), axis=1) % 2) == 1


def _snap_to_boundary(p_out, p_in, seg_a, seg_b):
    """Exact crossing of segment p_out->p_in with the face boundary (2D).
    Returns the crossing closest to the inside point, or None."""
    dd = p_in - p_out
    e = seg_b - seg_a
    w = seg_a - p_out[None, :]
    denom = dd[0] * (-e[:, 1]) - dd[1] * (-e[:, 0])
    denom = np.where(np.abs(denom) < 1e-30, 1e-30, denom)
    t = (w[:, 0] * (-e[:, 1]) - w[:, 1] * (-e[:, 0])) / denom
    u = (dd[0] * w[:, 1] - dd[1] * w[:, 0]) / denom
    ok = (t >= -1e-9) & (t <= 1 + 1e-9) & (u >= -1e-9) & (u <= 1 + 1e-9)
    if not ok.any():
        return None
    tbest = t[ok].max()
    return p_out + np.clip(tbest, 0, 1) * dd


def _face_inner_point(seg_a, seg_b, u0, u1, v0, v1, rnd):
    """A 2D point strictly inside the face polygon (centroid, then random)."""
    cands = [np.array([[(u0 + u1) / 2.0, (v0 + v1) / 2.0]])]
    for _ in range(24):
        cands.append(np.array([[u0 + rnd.random() * (u1 - u0),
                                v0 + rnd.random() * (v1 - v0)]]))
    for c in cands:
        if _mask_points(c, seg_a, seg_b)[0]:
            return c[0]
    return None


def _runs_to_curves(pts2d, mask, plane, lift_vec, seg_a, seg_b, min_pts=2):
    out = []
    if len(pts2d) == 0:
        return out
    idx = np.where(mask)[0]
    if len(idx) == 0:
        return out
    breaks = np.where(np.diff(idx) > 1)[0]
    starts = np.r_[0, breaks + 1]
    ends = np.r_[breaks, len(idx) - 1]
    for s, e in zip(starts, ends):
        run = idx[s:e + 1]
        if len(run) < min_pts:
            continue
        chain = [pts2d[i] for i in run]
        i0, i1 = run[0], run[-1]
        if i0 > 0:  # entered the face: snap start onto the boundary
            q = _snap_to_boundary(pts2d[i0 - 1], pts2d[i0], seg_a, seg_b)
            if q is not None:
                chain.insert(0, q)
        if i1 < len(pts2d) - 1:  # left the face: snap end onto the boundary
            q = _snap_to_boundary(pts2d[i1 + 1], pts2d[i1], seg_a, seg_b)
            if q is not None:
                chain.append(q)
        pts = [plane.Origin + plane.XAxis * float(u) + plane.YAxis * float(v)
               + lift_vec for u, v in chain]
        out.append(rg.PolylineCurve(pts))
    return out


def _rings_conic(plane, pith, a, allpts, du, dv, ring_base, dens, rnd, dot):
    """Growth-ring cylinders around the pith line intersected with the face
    plane. One system for ALL faces: circles (square cuts) -> stretched
    ovals (miters, scarfs) -> pairs of parallel lines (axis-parallel faces,
    i.e. tangential grain), all from the same ring radii."""
    A = np.array([a.X, a.Y, a.Z])
    X = np.array([plane.XAxis.X, plane.XAxis.Y, plane.XAxis.Z])
    Y = np.array([plane.YAxis.X, plane.YAxis.Y, plane.YAxis.Z])
    O = np.array([plane.Origin.X, plane.Origin.Y, plane.Origin.Z])
    P = np.array([pith.X, pith.Y, pith.Z])

    def rej(v):
        return v - (v @ A) * A

    e1, e2 = rej(X), rej(Y)
    c0p = rej(O - P)
    # radii ladder shared by every branch
    def radii():
        r = ring_base / dens * (0.4 + 0.4 * rnd.random())
        while True:
            yield r
            r += ring_base / dens * (0.75 + 0.5 * rnd.random())
    # farthest loop point from the pith line
    rmax = 0.0
    for uu, vv in allpts:
        wp = c0p + uu * e1 + vv * e2
        rmax = max(rmax, float(np.sqrt(wp @ wp)))

    polys = []
    if dot < 0.06:
        # Axis-parallel faces: COVERAGE-driven lines, evenly jittered across
        # the face's true perpendicular extent. (Radius-ladder line pairs
        # starve narrow faces far from the pith -- a tall beam's thin faces
        # got 0-2 lines. The book fills narrow faces evenly; so do we.)
        pu, pv = -dv, du
        proj_s = allpts[:, 0] * du + allpts[:, 1] * dv
        proj_p = allpts[:, 0] * pu + allpts[:, 1] * pv
        s0, s1 = float(proj_s.min()), float(proj_s.max())
        p0, p1 = float(proj_p.min()), float(proj_p.max())
        span, perp = s1 - s0, p1 - p0
        if span < 1e-9 or perp < 1e-9:
            return []
        step = span / 90.0
        svals = np.arange(s0 - step, s1 + 2 * step, step)
        n_lines = max(3, int(4 + 5 * dens))
        amp = min(perp * 0.06, ring_base * 0.2)
        for i in range(n_lines):
            f = (i + 0.5) / n_lines + rnd.uniform(-0.3, 0.3) / n_lines
            pval = p0 + f * perp
            off = amp * np.sin(2 * 6.28 * (svals - s0) / span
                               + rnd.random() * 6.28)
            pp = pval + off
            polys.append(np.column_stack([svals * du + pp * pu,
                                          svals * dv + pp * pv]))
        return polys

    # CONIC: well-conditioned quadratic -> (possibly very long) ellipses
    G = np.array([[e1 @ e1, e1 @ e2], [e1 @ e2, e2 @ e2]])
    bv = 2.0 * np.array([c0p @ e1, c0p @ e2])
    try:
        m = np.linalg.solve(G, -bv / 2.0)
    except Exception:
        return []
    lam, vec = np.linalg.eigh(G)
    if lam[0] < 1e-12:
        return []
    npts = int(np.clip(97 * (lam[1] / lam[0]) ** 0.25, 97, 641))
    t = np.linspace(0, 2 * math.pi, npts)
    cc = float(c0p @ c0p)
    for r in radii():
        if r > rmax + ring_base:
            break
        k = -(float(m @ (G @ m)) + float(bv @ m) + (cc - r * r))
        if k > 1e-14:
            r1, r2 = math.sqrt(k / lam[0]), math.sqrt(k / lam[1])
            wob = 1.0 + 0.04 * np.sin(3 * t + rnd.random() * 6)
            d = (np.outer(np.cos(t) * r1 * wob, vec[:, 0]) +
                 np.outer(np.sin(t) * r2 * wob, vec[:, 1]))
            polys.append(d + m[None, :])
    return polys


if run and pieces:
    try:
        breps = pieces if isinstance(pieces, list) else [pieces]
        breps = [b for b in breps if b is not None]
        bb = rg.BoundingBox.Empty
        for b in breps:
            bb.Union(b.GetBoundingBox(True))
        diag = bb.Diagonal.Length

        ax = axis
        if ax is None or (hasattr(ax, "Length") and ax.Length < 1e-9):
            d = bb.Diagonal
            ax = rg.Vector3d(1, 0, 0)
            best = -1
            for cand in (rg.Vector3d(1, 0, 0), rg.Vector3d(0, 1, 0),
                         rg.Vector3d(0, 0, 1)):
                ext = abs(d * cand)
                if ext > best:
                    best, ax = ext, cand
        a = rg.Vector3d(ax)
        a.Unitize()

        lift_v = float(lift) if lift else diag * 0.0008
        thr = float(end_threshold) if end_threshold else 0.15
        dens = float(density or 1.0)
        n_curves = 0
        face_lines = []

        # section frame perpendicular to the axis (shared by all pieces)
        e1 = rg.Vector3d.CrossProduct(a, rg.Vector3d(0, 0, 1))
        if e1.Length < 1e-6:
            e1 = rg.Vector3d.CrossProduct(a, rg.Vector3d(1, 0, 0))
        e1.Unitize()
        e2 = rg.Vector3d.CrossProduct(a, e1)
        e2.Unitize()

        for bi, b in enumerate(breps):
            # an Inward-oriented solid flips every face normal: lift must
            # respect the BREP's orientation, not only the face's
            ssign = -1.0 if b.SolidOrientation == \
                rg.BrepSolidOrientation.Inward else 1.0
            pbb = b.GetBoundingBox(True)
            pc = pbb.Center
            pd = pbb.Diagonal
            ext1 = abs(pd * e1) / 2.0
            ext2 = abs(pd * e2) / 2.0
            prnd = random.Random(0xA5 ^ (bi * 7919) ^
                                 (hash(round(pc.X + pc.Y + pc.Z, 3)) & 0xFFFF))
            pith = (rg.Point3d(pc) +
                    e1 * (ext1 * prnd.uniform(-0.45, 0.45)) +
                    e2 * (ext2 * prnd.uniform(-0.45, 0.45)))
            ring_base = min(ext1, ext2) / 4.0 * (0.9 + 0.2 * prnd.random())
            for fi, f in enumerate(b.Faces):
                plane = _face_plane(f)
                if plane is None:
                    continue
                n = rg.Vector3d(plane.Normal)
                n.Unitize()
                # OUTWARD normal from the surface itself -- TryGetPlane's
                # normal sign is arbitrary and must not be trusted for lift
                um = f.Domain(0).Mid
                vm = f.Domain(1).Mid
                out_n = f.NormalAt(um, vm)
                if f.OrientationIsReversed:
                    out_n.Reverse()
                out_n.Unitize()
                dot = abs(n * a)
                kind = "lines" if dot < 0.06 else "rings"

                loops = _loops_2d(f, plane)
                if not loops:
                    continue
                seg_a, seg_b = _segments(loops)
                allpts = np.vstack(loops)
                u0, u1 = allpts[:, 0].min(), allpts[:, 0].max()
                v0, v1 = allpts[:, 1].min(), allpts[:, 1].max()
                if (u1 - u0) < 1e-9 or (v1 - v0) < 1e-9:
                    continue

                dvec = a - n * (a * n)
                if dvec.Length < 1e-9:
                    dvec = plane.XAxis
                dvec.Unitize()
                du = dvec * plane.XAxis
                dv = dvec * plane.YAxis

                seed = hash((bi, fi, round(plane.Origin.X, 4),
                             round(plane.Origin.Y, 4),
                             round(plane.Origin.Z, 4))) & 0xFFFF
                rnd = random.Random(seed)
                # EMPIRICAL outward check: probe a point off the face along
                # the assumed normal; if it lands inside the solid, flip.
                # Immune to every orientation convention.
                flipped = ""
                ip = _face_inner_point(seg_a, seg_b, u0, u1, v0, v1, rnd)
                if ip is not None:
                    p3 = plane.Origin + plane.XAxis * float(ip[0]) \
                         + plane.YAxis * float(ip[1])
                    # two-sided probe, SMALL so it cannot pass through thin
                    # members; retry closer if both sides read outside
                    d0 = max(lift_v * 2.0, diag * 0.0003)
                    try:
                        for dp in (d0, d0 * 0.25):
                            fwd = b.IsPointInside(p3 + out_n * dp, 1e-9, True)
                            bwd = b.IsPointInside(p3 - out_n * dp, 1e-9, True)
                            if fwd and not bwd:
                                out_n = -out_n
                                flipped = " !"
                                break
                            if bwd and not fwd:
                                break            # normal confirmed outward
                            # both inside or both outside: probe again closer
                    except Exception:
                        pass
                lift_vec = out_n * lift_v

                polys2d = _rings_conic(plane, pith, a, allpts, du, dv,
                                       ring_base, dens, rnd, dot)
                n_face = 0
                for pts2d in polys2d:
                    mask = _mask_points(pts2d, seg_a, seg_b)
                    crvs = _runs_to_curves(pts2d, mask, plane, lift_vec,
                                           seg_a, seg_b)
                    for c in crvs:
                        grain.Add(c, GH_Path(bi))
                    n_face += len(crvs)
                n_curves += n_face
                face_lines.append("p{} f{}: dot={:.2f} -> {} ({} crv){}".format(
                    bi, fi, dot, kind, n_face, flipped))

        report.append("grain v{}: {} curves on {} piece(s)  lift {:.4f}  "
                      "end_threshold {:.2f}".format(
                          GRAIN_V, n_curves, len(breps), lift_v, thr))
        if len(face_lines) <= 28:
            report += face_lines
    except Exception as exc:
        report.append("ERROR: {}".format(exc))
else:
    report.append("wire kept + prosthesis into `pieces`, set run")
# ---------- end illustration ----------
edges_prosthesis = Python3Script(pieces=move.Geometry, lift=number_slider_9)  # -> out, edges, report; inputs pieces: Brep; disabled
# ---------- edges_prosthesis: Python ----------
"""GH Python 3 -- EDGES: brep edges lifted off the solid, catalogue-style.

Extracts every edge of the pieces and offsets it outward along the bisector
of its adjacent faces' normals, orientation verified EMPIRICALLY per edge
(probe point + Brep.IsPointInside), same as the grain component. Feed the
result into Custom Preview Lineweights (black, thickness 3-4) for the thick
book edges -- fully visible, never swallowed by the white shading.

Inputs:
    pieces  (Brep, list)
    lift    (float) [auto = 0.0008 x bbox diagonal, matching the grain]
    run     (bool)
Outputs:
    edges   lifted edge curves, one branch per piece
    report
"""
import Rhino.Geometry as rg
from Grasshopper import DataTree
from Grasshopper.Kernel.Data import GH_Path

EDGES_V = "1"
edges = DataTree[object]()
report = []
run = 'TRUE'

if run and pieces:
    try:
        breps = pieces if isinstance(pieces, list) else [pieces]
        breps = [b for b in breps if b is not None]
        bb = rg.BoundingBox.Empty
        for b in breps:
            bb.Union(b.GetBoundingBox(True))
        diag = bb.Diagonal.Length
        lift_v = float(lift) if lift else diag * 0.0008
        probe_d = max(lift_v * 4.0, diag * 0.002)

        n_edges = 0
        n_flip = 0
        for bi, b in enumerate(breps):
            for e in b.Edges:
                # outward-ish direction: bisector of adjacent face normals
                d = rg.Vector3d(0, 0, 0)
                for fidx in e.AdjacentFaces():
                    f = b.Faces[fidx]
                    um = f.Domain(0).Mid
                    vm = f.Domain(1).Mid
                    n = f.NormalAt(um, vm)
                    if f.OrientationIsReversed:
                        n.Reverse()
                    d += n
                if d.Length < 1e-9:
                    d = rg.Vector3d(0, 0, 1)
                d.Unitize()
                # empirical check at the edge midpoint
                tmid = e.Domain.Mid
                m = e.PointAt(tmid)
                try:
                    if b.IsPointInside(m + d * probe_d, 1e-6, True):
                        d = -d
                        n_flip += 1
                except Exception:
                    pass
                c = e.DuplicateCurve()
                c.Translate(d * lift_v)
                edges.Add(c, GH_Path(bi))
                n_edges += 1
        report.append("edges v{}: {} edge(s) on {} piece(s)  lift {:.4f}  "
                      "({} empirically flipped)".format(
                          EDGES_V, n_edges, len(breps), lift_v, n_flip))
    except Exception as exc:
        report.append("ERROR: {}".format(exc))
else:
    report.append("wire kept + prosthesis into `pieces`, set run")
# ---------- end edges_prosthesis ----------
colour_swatch_2 = ColourSwatch(SwatchColor=RGB(145, 145, 145))  # disabled
panel_12 = Panel(illustration.report)  # disabled
custom_preview = CustomPreview(Geometry=[illustration.grain, edges_prosthesis.edges], Material=colour_swatch_2)  # disabled

# ---- group: Prosthesis Visualisation
colour_swatch_3 = ColourSwatch(SwatchColor=RGB(0, 0, 0))  # disabled
number_slider_10 = Slider(7.1, range=0..10)  # disabled
create_material = CreateMaterial(Diffuse=colour_swatch_3, Specular=RGB(255, 255, 255), Emission=RGB(0, 0, 0), Transparency=0, Shine=0)  # disabled
custom_preview_lineweights_2 = CustomPreviewLineweights(Geometry=move.Geometry, Shader=create_material, Thickness=number_slider_10, Absolute=False)  # disabled

# ---- group: Kept Visualisation
colour_swatch_4 = ColourSwatch(SwatchColor=RGBA(0, 0, 0, 0))  # disabled
custom_preview_2 = CustomPreview(Geometry=[geometry, python_3_script.rest], Material=colour_swatch_4)  # disabled

# ----
repair_search = Python3Script(
    box=beam_cells.box,
    cells=python_3_script_2.centers,
    damage=python_3_script_2.damage,
    threshold=Slider(0.5, range=0..1),
    run=Toggle(True))  # -> out, brief, cut_plane, report, keys, position, rotation, side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; inputs box: Box, cells: list of Point3d, damage: list
# ---------- repair_search: Python ----------
"""GH Python 3 -- REPAIR SEARCH: rank catalogue joints against a beam's damage.

Numpy only. No Rhino booleans anywhere in the search loop -- `points_in_part`
is analytic and cheap, `evaluator` is not. Feed the shortlist to
gh_repair_gallery for geometry.

Inputs:
    box        (Box)      the beam; longest axis becomes the beam axis
    cells      (Point3d, list)  cell centroids from the CellularizedPart
    damage     (float, list)    damage score per cell, 0..1, same order
    threshold  (float)    cells at or above this count as damaged  [0.5]
    positions  (int)      placements to try across the derived window  [6]
    faces      (str)      rotations to allow, e.g. "0,90,180,270"; leave blank
                          for all four. Use this to exclude faces the site
                          blocks.
    top_n      (int)      how many survivors to report  [8]
    run        (bool)
Outputs:
    report     what happened, and the frame check
    brief      the Pareto front as a table -- this is what the agent reads
    keys, position, rotation, side, scale, sound_lost, damage_left
               parallel lists, best first -- feed straight into gh_repair
    cut_plane  planes of the top_n placements, for preview

FRAME: the box corner convention. If `cells` came from a CellularizedPart
built on a centroid-recentred mesh they will not line up, and `report` will
say so rather than silently returning nothing.
"""
import sys, os

REPO = r"C:\Users\tizian\workspace\projects\workshop_robarch_2026"
SRC = os.path.join(REPO, "src")
if SRC not in sys.path:
    sys.path.append(SRC)
for m in list(sys.modules):
    if m.startswith("workshop_robarch_2026"):
        sys.modules.pop(m)

from workshop_robarch_2026 import kernel, joints, scoring, placement
from workshop_robarch_2026.version import VERSION

import numpy as np
import Rhino.Geometry as rg

report = ["version: {}".format(VERSION)]
brief = ""
keys = []
position = []
rotation = []
side = []
scale = []
sound_lost = []
damage_left = []
cut_plane = []


def _box_frame(b):
    """Box -> frame dict; longest axis = beam axis v; origin is the corner
    from which +u, +v, +w all point into the box."""
    pl = b.Plane
    ax = [np.array([pl.XAxis.X, pl.XAxis.Y, pl.XAxis.Z]),
          np.array([pl.YAxis.X, pl.YAxis.Y, pl.YAxis.Z]),
          np.array([pl.ZAxis.X, pl.ZAxis.Y, pl.ZAxis.Z])]
    ext = [b.X.Length, b.Y.Length, b.Z.Length]
    iv = int(np.argmax(ext))
    iu, iw = (iv + 1) % 3, (iv + 2) % 3
    U, V = ax[iu], ax[iv]
    W = np.cross(U, V); W /= np.linalg.norm(W)
    c = b.Center
    C = np.array([c.X, c.Y, c.Z])
    O = C - 0.5 * (ext[iu] * U + ext[iv] * V + ext[iw] * W)
    return {"origin": O.tolist(), "u": U.tolist(), "v": V.tolist(),
            "w": W.tolist(), "width": ext[iu], "length": ext[iv],
            "height": ext[iw]}


def _describe(name, val):
    if val is None:
        return "%s: NOT CONNECTED" % name
    try:
        n = len(val)
        kinds = sorted(set(type(v).__name__ for v in val))
        nulls = sum(1 for v in val if v is None)
        return "%s: %d item(s), %s%s" % (
            name, n, "/".join(kinds),
            ", %d NULL" % nulls if nulls else "")
    except TypeError:
        return "%s: single %s (input access should be LIST)" % (
            name, type(val).__name__)


if run and box and cells and damage:
    try:
        # validate before assuming anything -- a bare AttributeError here is
        # almost always a wrong access mode or a null in the list
        problems = []
        try:
            _ = box.Plane, box.X.Length
        except Exception:
            problems.append("box: %s has no Plane/X -- expected a Box, and the "
                            "input type hint must be Box"
                            % type(box).__name__)
        for nm, val in (("cells", cells), ("damage", damage)):
            try:
                len(val)
            except TypeError:
                problems.append("%s: got a single %s. Set that input's access "
                                "to LIST (right-click > List Access)."
                                % (nm, type(val).__name__))
        if not problems:
            if any(p is None for p in cells):
                problems.append("cells: %d of %d entries are NULL"
                                % (sum(1 for p in cells if p is None), len(cells)))
            elif not hasattr(cells[0], "X"):
                problems.append("cells: got %s, expected Point3d. Set the type "
                                "hint to Point." % type(cells[0]).__name__)
        if problems:
            report.append("ERROR: input problem")
            report.extend("  " + t for t in problems)
            report.append("  " + _describe("cells", cells))
            report.append("  " + _describe("damage", damage))
            raise SystemExit

        frame = _box_frame(box)
        pts = np.array([[p.X, p.Y, p.Z] for p in cells], float)
        dmg = np.array([float(d) for d in damage], float)
        if len(dmg) != len(pts):
            report.append("ERROR: %d cells but %d damage values -- these must "
                          "come from the same component, in the same order"
                          % (len(pts), len(dmg)))
        else:
            rots = (0.0, 90.0, 180.0, 270.0)
            if faces:
                rots = tuple(float(t) for t in str(faces).replace(";", ",").split(",")
                             if t.strip())
            res, rep = placement.search(
                REPO, frame, pts, dmg,
                threshold=float(threshold) if threshold is not None else 0.5,
                n_positions=int(positions) if positions else 6,
                rotations=rots)
            report.extend(rep)

            if res:
                brief = placement.brief(res, top=int(top_n) if top_n else 8)
                for r in res[:int(top_n) if top_n else 8]:
                    keys.append(r["key"])
                    position.append(r["position"])
                    rotation.append(r["rotate_deg"])
                    side.append(r["side"])
                    scale.append(r["interface_scale"])
                    sound_lost.append(r["sound_sacrificed"])
                    damage_left.append(r["damage_left"])
                    j = joints.load_joint(REPO, r["key"])
                    built = kernel.build_repair(
                        j, frame, position=r["position"],
                        rotate_deg=r["rotate_deg"], side=r["side"],
                        interface_scale=r["interface_scale"])
                    pl = built.get("cut_plane")
                    if pl:
                        o = rg.Point3d(*pl["origin"])
                        x = rg.Vector3d(*pl["xaxis"])
                        y = rg.Vector3d(*pl["yaxis"])
                        cut_plane.append(rg.Plane(o, x, y))
            else:
                report.append("nothing cleared the damage -- widen the window, "
                              "allow more rotations, or consider a patch "
                              "rather than a splice")
    except SystemExit:
        pass
    except Exception as exc:
        report.append("ERROR: {}: {}".format(type(exc).__name__, exc))
        report.append("  " + _describe("cells", cells))
        report.append("  " + _describe("damage", damage))
else:
    missing = [n for n, v in (("box", box), ("cells", cells),
                              ("damage", damage), ("run", run)) if not v]
    report.append("waiting for: " + ", ".join(missing))
# ---------- end repair_search ----------
panel_13 = Panel(repair_search.sound_lost)
result = Panel(repair_search.report)
panel_14 = Panel(repair_search.brief)
panel_15 = Panel(repair_search.cut_plane)
number_slider_11 = Slider(0, range=0..5)

panel_16 = Panel("C:\Users\tizian\Downloads\timber-frame-corner__tizian__conservative-in-situ-splice__2026-08-20.zip")
agentic_joinery = Python3Script(
    workspace_json=panel_16,
    beam_id="corner_post",
    max_revisions=Slider(6, range=0..10),
    box=beam_cells.box,
    centers=cell_example_damage.centers,
    damage=cell_example_damage.damage,
    run=Toggle(True))  # -> out, report, prosthesis, plane_rectangles, plane_arrows, removed_cells, context_json, resolved_json, proposal_json, metrics; inputs box: Box, centers: list of Point3d, damage: list
# ---------- agentic_joinery: Python ----------
# r: google-genai
"""GH Python 3 -- AGENTIC JOINERY: execute an LLM-authored JointProgram.

This component is the geometric tool used by the Agentic Joinery Co-Designer.
The LLM reads the Workspace context and writes one or more semantic
JointPrograms; this component fits each to the cellular damage field and
returns the resolved repair proposals, ranked, with a measured account of what
each joint does and what it does not do.

WHAT CHANGED IN THIS REVISION
-----------------------------
1. Variants.   The model may return `alternativePrograms` alongside
   `jointProgram`. Each is fitted independently, so one unbuildable concept
   costs one card rather than the whole run. `variant` picks which fitted
   proposal drives the geometry outputs; `variants_json` carries them all.
2. A ladder instead of a refusal.  The strict contract is rung one and is
   unchanged. When it produces nothing the component keeps going -- direction
   claims aside, then the numeric gates dropped to a permissive floor, then
   gates off with full coverage, then partial coverage -- and reports which
   rung the geometry came from and what it gave up. You now only see nothing
   when no placement of those planes builds a solid at all, which is a
   different and much rarer problem, and it is named as such.
   Whatever is built is printed with the full gate table measured against what
   the program ORIGINALLY asked for:

       minimumEngagementSections     measured 0.82   required >= 2.500  FAIL by 1.680
       minimumInterfaceAreaRatio     measured 1.41   required >= 1.500  FAIL by 0.090
       minimumLigamentRatio          measured 0.11   required >= 0.100  ok
3. Bounded Booleans.  Removal groups are rewritten to intersect INTO the
   bounded stock, so Rhino never intersects two oversized cutter prisms whose
   side faces are coincident. That is the "boolean intersection failed
   (tolerance?)" class. Original expression and a tolerance ladder remain as
   fallbacks, and `diagnose_cuts` is reported when everything fails.
4. Explanation.  `explanation` states, from the measured geometry, which
   directions the joint locks and which it leaves open, and flags any lock the
   program claimed but the geometry does not deliver.
5. Contradictory claims no longer erase the run.  `assemblyDirection` and
   `geometricLockDirections` are checked BEFORE placement, so when the program
   claims an insertion direction its own undercut blocks -- or a lock its
   planes do not deliver -- every candidate is discarded and nothing is built,
   which reads as "impossible geometry" when the geometry was never tried. The
   component now retries once with those two claims set aside, keeping every
   numeric gate and full coverage armed, and reports exactly which claim the
   built joint fails to honour.
7. The search window is sized from the decay.  `searchWindowSections` bounds
   where the joint band may sit. The prompt's placeholder value of 1.5 is too
   small for a basal repair: the band cannot clear the rot, so the kernel's end
   trim stops inside the decayed stub and the joint's own features are left to
   cover through-section damage -- which a lap or a scarf cannot do, since both
   keep part of the section. Coverage fails, every strict rung refuses, and the
   fitter escalates to replacing the whole member because that is the only
   thing that covers everything. Measured on the 1.84 m corner post: window 1.5
   leaves 9 required cells uncovered; window 2.0 covers all of them with 9.3%
   sound loss and a prosthesis of 0.017..0.485 m. The component now raises the
   window to `decay + aspect + 0.5` section depths and says so.
8. Open removal groups are caught before placement.  A group that is not
   closed along the member axis on the kept side does not stop at the joint
   window -- every plane is placed as an oversized prism, so the group sweeps
   the entire beam and the "repair" replaces 98% of a sound post. The
   construction metrics cannot see it, because they sample only v in
   [0, aspect], where such a group looks well behaved: engagement, interface
   and ligament all read fine. The component now samples past the window,
   drops the offending variants, and names the group and its planes.
9. The replacement side comes from the decay, not from the search.  `side`
   decides which end of the member becomes the prosthesis. Measured on the
   1.84 m corner post with one identical joint: side -1 removes 0.017..0.619 m
   (126 of 495 cells); side +1 removes 0.284..1.823 m (387 cells). Left free the
   fitter sweeps both, and because damage coverage is ranked first, replacing
   the whole sound post can win -- it covers every damaged cell too. The
   component now infers the side from where the decay actually sits and says so.
10. A conservation ceiling.  `fit_program` returns `results[0]`, and with partial
   coverage allowed the sort puts `required_left` first -- so "replace the
   entire member" wins, because replacing everything covers every damaged cell.
   The full result list is now searched for the best placement under
   `max_sound_loss`, and the prosthesis extent is reported in metres.
6. Housekeeping.  The module purge no longer runs while a background thread is
   using those modules; the Gemini job has a wall-clock deadline; the cache key
   includes the prompt file; a failed re-run no longer blanks the last good
   geometry.

Inputs
------
workspace_json      str/dict    Workspace JSON, .json path, or exported .zip
beam_id             str         exact Workspace part id selected for repair
joint_program_json  str/dict    joinery-program@1 JSON from the LLM; optional
gemini_model        str         optional Gemini model [gemini-3.7-flash]
repair_step_id      str         optional expert override; LLM selects when empty
instruction         str         optional human construction instruction
variation_count     int         how many distinct concepts to ask for [3]
variant             int         which fitted proposal to output [0 = best]
temperature         float       optional sampling temperature [0.7 / 0.35 on revision]
relax_direction_claims bool     build the joint anyway when the program's own
                                assemblyDirection / geometricLockDirections
                                contradict its planes, and report that [True]
max_sound_loss      float       refuse placements that replace more than this
                                fraction of the sound member [0.5]
max_revisions       int         agent revisions after a failed fit [2]
box                 Box         oriented box from BEAM CELLS
centers             Point3d[]   world cell centres from BEAM CELLS
damage              float[]     one 0..1 damage value per centre
threshold           float       mandatory-removal threshold [0.50]
repo                str         optional repository override
run                 bool

Outputs
-------
kept                  Brep[]     retained historic member
prosthesis            Brep[]     fitted replacement member
plane_rectangles      Curve[]    active oriented plane graphics
plane_arrows          Curve[]    half-space polarity arrows
removed_cells         Point3d[]  cell centres removed by the proposal
context_json          str        scoped Workspace context given to the LLM
resolved_program_json str        validated program actually fitted
resolved_json         str        alias for existing Grasshopper canvases
proposal_json         str        record suitable for a Workspace plan step
variants_json         str        every concept: fitted or refused, with reasons
explanation           str[]      what this joint does, and what it does not
metrics               str        compact fit result
report                str[]      diagnostics and open questions
"""

import copy
import dataclasses
import hashlib
import json
import mimetypes
import os
import sys
import threading
import time
import zipfile


def _repo_from_component():
    override = globals().get("repo") or os.environ.get("ROBARCH_REPO")
    component_file = globals().get("_p") or globals().get("__file__")
    candidates = []
    if override:
        candidates.append(os.path.abspath(os.path.expanduser(str(override))))
    # A pasted RhinoCode component reports a virtual rhinocode:// URI. It is
    # useful as a traceback location but cannot be walked as a filesystem path.
    if component_file and "://" not in str(component_file):
        candidates.append(
            os.path.abspath(os.path.join(os.path.dirname(component_file), "..", ".."))
        )

    try:
        gh_document = ghenv.Component.OnPingDocument()
        gh_path = str(getattr(gh_document, "FilePath", "") or "").strip()
        if gh_path:
            candidates.append(os.path.dirname(os.path.abspath(gh_path)))
    except Exception:
        pass

    try:
        import Rhino

        rhino_path = str(getattr(Rhino.RhinoDoc.ActiveDoc, "Path", "") or "").strip()
        if rhino_path:
            candidates.append(os.path.dirname(os.path.abspath(rhino_path)))
    except Exception:
        pass

    candidates.append(os.getcwd())
    candidates.extend(
        str(value) for value in sys.path if value and "://" not in str(value)
    )

    seen = set()
    for candidate in candidates:
        root = os.path.abspath(os.path.expanduser(str(candidate)))
        if os.path.isfile(root):
            root = os.path.dirname(root)
        for _ in range(9):
            key = os.path.normcase(root)
            if key in seen:
                break
            seen.add(key)
            if os.path.isdir(os.path.join(root, "src", "workshop_robarch_2026")):
                return root
            parent = os.path.dirname(root)
            if parent == root:
                break
            root = parent
    raise RuntimeError(
        "repository package not found. Connect a Text Panel with the workshop_robarch_2026 "
        "folder to the repo input, save the Grasshopper file inside the repository, or set "
        "ROBARCH_REPO."
    )


REPO = _repo_from_component()
SRC = os.path.join(REPO, "src")
if SRC not in sys.path:
    sys.path.append(SRC)

import scriptcontext as sc  # noqa: E402

# Reload the package so edits to the library land without restarting Rhino --
# but NEVER while a background Gemini thread is still executing functions from
# those very module objects, or the thread re-imports a second live copy.
_jobs_snapshot = sc.sticky.get("agentic_joinery_jobs", {})
_busy = any(
    isinstance(item, dict) and not item.get("done") for item in _jobs_snapshot.values()
)
if not _busy:
    for module_name in list(sys.modules):
        if module_name.startswith("workshop_robarch_2026"):
            sys.modules.pop(module_name)

import numpy as np  # noqa: E402
import Rhino  # noqa: E402
import Rhino.Geometry as rg  # noqa: E402

from workshop_robarch_2026 import anyjoint, evaluator, joinery_program, kernel, scoring  # noqa: E402


KEY_NAME = "gemini_api_key.txt"
HOME_KEY = os.path.join(os.path.expanduser("~"), "Documents", "robarch", KEY_NAME)
MODEL = "gemini-3.7-flash"
def _prompt_file():
    """Prefer the revised prompt when it is present; fall back to the original."""
    folder = os.path.join(REPO, "data", "prompts")
    for name in ("design_joinery_standalone_v2.md", "design_joinery_standalone.md"):
        path = os.path.join(folder, name)
        if os.path.isfile(path):
            return path
    return os.path.join(folder, "design_joinery_standalone.md")


PROMPT_FILE = _prompt_file()
PROMPT_CONTRACT_VERSION = "anyjoint-six-plane-v3"
JOB_DEADLINE_SECONDS = 240.0
DIRECTIONS = ("+X", "-X", "+Y", "-Y", "+Z", "-Z")


kept = []
prosthesis = []
plane_rectangles = []
plane_arrows = []
removed_cells = []
context_json = ""
resolved_program_json = ""
resolved_json = ""
proposal_json = ""
variants_json = ""
explanation = []
metrics = ""
report = ["Agentic Joinery Co-Designer geometry tool"]


class _ContextReady(Exception):
    """End this solution normally after preparing the manual LLM handoff."""


# --------------------------------------------------------------------------
# key discovery and workspace reading -- unchanged behaviour
# --------------------------------------------------------------------------


def _key_paths():
    paths = []
    try:
        gh_path = str(ghenv.Component.OnPingDocument().FilePath or "").strip()
        if gh_path:
            folder = os.path.dirname(gh_path)
            paths.append(os.path.join(folder, KEY_NAME))
            paths.append(os.path.join(os.path.dirname(folder), KEY_NAME))
    except Exception:
        pass
    paths.append(HOME_KEY)
    return paths


def _get_key():
    env = os.environ.get("GEMINI_API_KEY")
    if env and env.strip():
        return env.strip(), "key from GEMINI_API_KEY"
    for path in _key_paths():
        if os.path.isfile(path):
            with open(path, "r", encoding="utf-8-sig") as handle:
                value = handle.read().strip().strip('"').strip("'")
            if value:
                return value, "key from {}".format(path)
            return None, "key file is empty: {}".format(path)
    try:
        os.makedirs(os.path.dirname(HOME_KEY), exist_ok=True)
        with open(HOME_KEY, "a", encoding="utf-8"):
            pass
    except Exception:
        pass
    return None, "no key found; add it to {}".format(HOME_KEY)


def _read_workspace(value):
    if isinstance(value, dict):
        return value
    text = str(value or "").strip()
    if not text:
        raise ValueError("connect Workspace JSON or an exported Workspace ZIP path")
    path = os.path.abspath(os.path.expanduser(text))
    if os.path.isfile(path):
        if path.lower().endswith(".zip"):
            with zipfile.ZipFile(path, "r") as archive:
                text = archive.read("workspace.json").decode("utf-8-sig")
        else:
            with open(path, "r", encoding="utf-8-sig") as handle:
                text = handle.read()
    parsed = json.loads(text)
    if not isinstance(parsed, dict):
        raise ValueError("Workspace JSON must contain one object")
    return parsed


def _stored_programs(workspace, target_id):
    """Programs already stored on the Workspace for this member."""
    found = []
    plans = list(workspace.get("plans") or [])
    current = next(
        (p for p in plans if str(p.get("id")) == str(workspace.get("currentPlanId"))),
        plans[0] if len(plans) == 1 else None,
    )
    if current:
        for step in current.get("steps") or []:
            refs = [str(v) for v in (step.get("affectedPartRefs") or [])]
            proposal = step.get("joineryProposal")
            if str(target_id) in refs and isinstance(proposal, dict):
                found.append(proposal.get("program") or proposal)
    for proposal in workspace.get("joineryProposals") or []:
        if str(proposal.get("targetPartRef")) == str(target_id):
            found.append(proposal.get("program") or proposal)
    return found


def _unwrap_programs(value, workspace, target_id):
    """Return a list of JointPrograms from the input, or from the Workspace.

    Accepts the single-program shapes this component has always accepted, plus
    a list under `jointPrograms` / `alternativePrograms`.
    """
    if value is not None and str(value).strip():
        if isinstance(value, dict):
            raw = value
        else:
            text = str(value).strip()
            path = os.path.abspath(os.path.expanduser(text))
            if os.path.isfile(path):
                with open(path, "r", encoding="utf-8-sig") as handle:
                    text = handle.read()
            raw = json.loads(text)
        programs = _programs_from_response(raw)
        if programs:
            return programs
        if isinstance(raw, dict):
            command = raw.get("command")
            if isinstance(command, dict):
                proposal = ((command.get("payload") or {}).get("step") or {}).get(
                    "joineryProposal"
                )
                if isinstance(proposal, dict):
                    return [proposal.get("program") or proposal]
            return [raw]

    stored = _stored_programs(workspace, target_id)
    if stored:
        return stored
    raise ValueError("no JointProgram supplied or stored for beam {}".format(target_id))


def _programs_from_response(raw):
    """Pull every authored program out of a model response, preferred first."""
    if not isinstance(raw, dict):
        return []
    programs = []
    for key in ("jointProgram", "program"):
        if isinstance(raw.get(key), dict):
            programs.append(raw[key])
            break
    for key in ("alternativePrograms", "jointPrograms"):
        for item in raw.get(key) or []:
            if isinstance(item, dict):
                # tolerate {"jointProgram": {...}} wrappers inside the list
                inner = item.get("jointProgram") if isinstance(item.get("jointProgram"), dict) else item
                if inner not in programs:
                    programs.append(inner)
    return programs


def _json_from_model_text(text):
    source = str(text or "").strip()
    if source.startswith("```"):
        lines = source.splitlines()
        if lines:
            lines = lines[1:]
        if lines and lines[-1].strip().startswith("```"):
            lines = lines[:-1]
        source = "\n".join(lines).strip()
    try:
        return json.loads(source)
    except Exception:
        start = source.find("{")
        end = source.rfind("}")
        if start >= 0 and end > start:
            return json.loads(source[start : end + 1])
        raise


def _evidence_attachments(workspace_value, context, max_total_bytes=12 * 1024 * 1024):
    path = str(workspace_value or "").strip()
    path = os.path.abspath(os.path.expanduser(path)) if path else ""
    if not path.lower().endswith(".zip") or not os.path.isfile(path):
        return [], []
    wanted = {
        str(item.get("id")): item
        for item in (context.get("evidence") or [])
        if item.get("id")
    }
    attachments = []
    messages = []
    total = 0
    with zipfile.ZipFile(path, "r") as archive:
        entries = [entry for entry in archive.infolist() if not entry.is_dir()]
        for evidence_id, metadata in wanted.items():
            prefix = "photos/{}/".format(evidence_id).lower()
            exact_prefix = "photos/{}.".format(evidence_id).lower()
            entry = next(
                (
                    item
                    for item in entries
                    if item.filename.replace("\\", "/").lower().startswith(exact_prefix)
                    or item.filename.replace("\\", "/").lower().startswith(prefix)
                ),
                None,
            )
            if entry is None:
                messages.append("evidence {} has no matching photo in ZIP".format(evidence_id))
                continue
            if total + int(entry.file_size) > max_total_bytes:
                messages.append("evidence {} skipped: attachment budget exceeded".format(evidence_id))
                continue
            data = archive.read(entry)
            total += len(data)
            mime = metadata.get("mimeType") or mimetypes.guess_type(entry.filename)[0]
            attachments.append(
                {
                    "id": evidence_id,
                    "name": entry.filename,
                    "mimeType": mime or "image/jpeg",
                    "data": data,
                }
            )
    if wanted:
        messages.append(
            "{} of {} evidence photograph(s) attached".format(len(attachments), len(wanted))
        )
    return attachments, messages


# --------------------------------------------------------------------------
# Gemini
# --------------------------------------------------------------------------


def _request_gemini_joint_programs(
    api_key,
    context,
    instruction,
    model,
    attachments=None,
    previous=None,
    feedback=None,
    variation_count=3,
    temperature=None,
):
    with open(PROMPT_FILE, "r", encoding="utf-8-sig") as handle:
        system_prompt = handle.read()
    payload = {
        "workspaceContext": context,
        "userMessage": instruction
        or "Design an actionable construction joinery for this repair area.",
        "requestedVariationCount": int(variation_count),
        "previousProgram": previous,
        "fitFeedback": feedback,
    }
    from google import genai
    from google.genai import types

    parts = [
        types.Part.from_text(text=json.dumps(payload, indent=2, ensure_ascii=False))
    ]
    for item in attachments or []:
        parts.append(
            types.Part.from_text(
                text="Evidence image {} ({})".format(item["id"], item["name"])
            )
        )
        parts.append(types.Part.from_bytes(data=item["data"], mime_type=item["mimeType"]))

    client = genai.Client(api_key=str(api_key).strip())
    config = {
        "response_mime_type": "application/json",
        # The prompt is the contract; attached photographs are evidence. Sending
        # it as a system instruction rather than as one more user text part is
        # what keeps that distinction real.
        "system_instruction": system_prompt,
    }
    if temperature is not None:
        config["temperature"] = float(temperature)
    try:
        response = client.models.generate_content(
            model=str(model or MODEL).strip(),
            contents=parts,
            config=types.GenerateContentConfig(**config),
        )
    except TypeError:
        # Older google-genai without system_instruction on this config object.
        config.pop("system_instruction", None)
        response = client.models.generate_content(
            model=str(model or MODEL).strip(),
            contents=[types.Part.from_text(text=system_prompt)] + parts,
            config=types.GenerateContentConfig(**config),
        )
    text = (response.text or "").strip()
    if not text:
        raise RuntimeError(
            "Gemini returned no text response (blocked, or the output token limit was hit)"
        )
    result = _json_from_model_text(text)
    programs = _programs_from_response(result)
    if not programs:
        raise RuntimeError("Gemini returned no jointProgram")
    return programs, result


def _llm_cache_key(context_text, instruction, model, variation_count):
    component_id = str(getattr(ghenv.Component, "InstanceGuid", "component"))
    try:
        with open(PROMPT_FILE, "rb") as handle:
            prompt_hash = hashlib.sha256(handle.read()).hexdigest()[:16]
    except Exception:
        prompt_hash = "no-prompt"
    payload = "\n".join(
        (
            PROMPT_CONTRACT_VERSION,
            prompt_hash,
            context_text,
            str(instruction or ""),
            str(model or ""),
            str(int(variation_count)),
        )
    )
    digest = hashlib.sha256(payload.encode("utf-8")).hexdigest()
    return "robarch.agentic_joinery.{}.{}".format(component_id, digest)


def _wake_up(delay=500):
    import Grasshopper

    document = ghenv.Component.OnPingDocument()
    if document:
        document.ScheduleSolution(
            delay,
            Grasshopper.Kernel.GH_Document.GH_ScheduleDelegate(
                lambda _: ghenv.Component.ExpireSolution(False)
            ),
        )


def _start_gemini_job(job, api_key, context, instruction, model, attachments,
                      previous=None, feedback=None, variation_count=3,
                      temperature=None):
    job["done"] = False
    job["error"] = None
    job["t0"] = time.time()

    def work():
        try:
            programs, response = _request_gemini_joint_programs(
                api_key, context, instruction, model,
                attachments=attachments, previous=previous, feedback=feedback,
                variation_count=variation_count, temperature=temperature,
            )
            job["programs"] = programs
            job["response"] = response
        except Exception as exc:
            job["error"] = str(exc)
        finally:
            job["done"] = True

    threading.Thread(target=work, daemon=True).start()


# --------------------------------------------------------------------------
# frame and damage
# --------------------------------------------------------------------------


def _box_frame(value):
    plane = value.Plane
    axes = [
        np.array([plane.XAxis.X, plane.XAxis.Y, plane.XAxis.Z], float),
        np.array([plane.YAxis.X, plane.YAxis.Y, plane.YAxis.Z], float),
        np.array([plane.ZAxis.X, plane.ZAxis.Y, plane.ZAxis.Z], float),
    ]
    extents = [float(value.X.Length), float(value.Y.Length), float(value.Z.Length)]
    axis_v = int(np.argmax(extents))
    axis_u, axis_w = (axis_v + 1) % 3, (axis_v + 2) % 3
    U, V = axes[axis_u], axes[axis_v]
    W = np.cross(U, V)
    W /= np.linalg.norm(W)
    intervals = [value.X, value.Y, value.Z]
    origin = (
        np.array([plane.Origin.X, plane.Origin.Y, plane.Origin.Z], float)
        + intervals[0].Min * axes[0]
        + intervals[1].Min * axes[1]
        + intervals[2].Min * axes[2]
    )
    if float(W @ axes[axis_w]) < 0:
        origin = origin + extents[axis_w] * axes[axis_w]
    return {
        "origin": origin.tolist(),
        "u": U.tolist(),
        "v": V.tolist(),
        "w": W.tolist(),
        "width": extents[axis_u],
        "length": extents[axis_v],
        "height": extents[axis_w],
    }


def _xyz(point):
    if hasattr(point, "X"):
        return [float(point.X), float(point.Y), float(point.Z)]
    return [float(point[0]), float(point[1]), float(point[2])]


def _damage_context(frame, points, values, gate, stations=12):
    """Describe the decay as a shape, not as a bounding box.

    `to_local` measures from a CORNER of the member in model units; the
    normalised figures are fractions of the member and are the ones the model
    should reason with. Both are labelled, and the frame is stated in the
    payload rather than left to be guessed.
    """
    local = scoring.to_local(points, frame)
    mandatory = values >= float(gate)
    dimensions = np.array([frame["width"], frame["length"], frame["height"]], float)
    result = {
        "frameNote": (
            "local coordinates are measured from a CORNER of the member, in model units; "
            "u = section width, v = beam axis, w = section height. Normalised values are "
            "fractions of the member. The joint window itself is placed by the fitter -- "
            "author the SHAPE, the aspect and the replacement side, not an absolute station."
        ),
        "threshold": float(gate),
        "cellCount": int(len(points)),
        "mandatoryCellCount": int(mandatory.sum()),
        "maximumDamage": float(values.max()) if len(values) else 0.0,
        "localAxes": ["section_u", "beam_axis_v", "section_w"],
        "beamDimensions": dimensions.tolist(),
    }

    # How sensitive is the required set to where the threshold was drawn?
    band = [
        {
            "threshold": round(float(gate) + delta, 3),
            "mandatoryCellCount": int((values >= float(gate) + delta).sum()),
        }
        for delta in (-0.1, 0.0, 0.1)
        if 0.0 <= float(gate) + delta <= 1.0
    ]
    result["thresholdSensitivity"] = band

    if mandatory.any():
        damaged = local[mandatory]
        lo = damaged.min(axis=0)
        hi = damaged.max(axis=0)
        weights = np.maximum(values[mandatory], 1e-9)
        centroid = np.average(damaged, axis=0, weights=weights)
        result.update(
            {
                "localBounds": {"min": lo.tolist(), "max": hi.tolist()},
                "normalisedBounds": {
                    "min": (lo / dimensions).tolist(),
                    "max": (hi / dimensions).tolist(),
                },
                "weightedCentroid": centroid.tolist(),
                "axialRange": [float(lo[1]), float(hi[1])],
                "touchesEnd": {
                    "low": bool(lo[1] <= 0.05 * dimensions[1]),
                    "high": bool(hi[1] >= 0.95 * dimensions[1]),
                },
            }
        )

        # Station profile: decay as a function of position along the member.
        edges = np.linspace(0.0, dimensions[1], int(stations) + 1)
        index = np.clip(np.digitize(local[:, 1], edges) - 1, 0, int(stations) - 1)
        profile = []
        for station in range(int(stations)):
            pick = index == station
            if not pick.any():
                continue
            profile.append(
                {
                    "vFraction": round(float((edges[station] + edges[station + 1]) * 0.5 / dimensions[1]), 3),
                    "requiredFraction": round(float(mandatory[pick].mean()), 3),
                    "maxDamage": round(float(values[pick].max()), 3),
                }
            )
        result["stationProfile"] = profile

        # Where the decay sits in the section, and which faces it breaks out
        # of. This is what says whether the joint may be asymmetric, and which
        # way it should lean.
        span_u = (damaged[:, 0] / dimensions[0])
        span_w = (damaged[:, 2] / dimensions[2])
        result["sectionExtent"] = {
            "u": [round(float(span_u.min()), 3), round(float(span_u.max()), 3)],
            "w": [round(float(span_w.min()), 3), round(float(span_w.max()), 3)],
            "note": "fractions of the section; 0 and 1 are opposite faces",
        }
        result["touchesFace"] = {
            "-u": bool(span_u.min() <= 0.05), "+u": bool(span_u.max() >= 0.95),
            "-w": bool(span_w.min() <= 0.05), "+w": bool(span_w.max() >= 0.95),
        }
    return result


# --------------------------------------------------------------------------
# Boolean evaluation -- bounded, with named failure
# --------------------------------------------------------------------------


def _serialise(node):
    if isinstance(node, str):
        return node
    op, children = node
    return "%s(%s)" % (op, ", ".join(_serialise(child) for child in children))


def _bind_to_stock(node, stock):
    """Rewrite every removal term so it intersects INTO the bounded stock.

    `Intersection(lhf_1, lhf_2)` asks Rhino to intersect two oversized cutter
    prisms that -- by construction in kernel.half_space_cut -- share their side
    faces exactly, and it returns null. Since every removal group is a subset
    of the stock, `Intersection(lhf_0, lhf_1, lhf_2)` is the same solid with
    the accumulator bounded by the beam. Provably identical downstream:
    kept = stock - U(G) and prosthesis = stock & U(G) are unchanged when each
    G is replaced by G & stock.
    """
    if isinstance(node, str):
        return node
    op, children = node
    kids = [_bind_to_stock(child, stock) for child in children]
    if op == "Intersection":
        if not any(isinstance(k, str) and k == stock for k in kids):
            kids = [stock] + kids
    elif op == "Union":
        kids = [
            ("Intersection", [stock, k]) if isinstance(k, str) and k != stock else k
            for k in kids
        ]
    return (op, kids)


def _bounded_expression(expression, stock="lhf_0"):
    try:
        return _serialise(_bind_to_stock(evaluator.parse_expression(expression), stock))
    except Exception:
        return expression


def _model_tolerance():
    try:
        value = float(Rhino.RhinoDoc.ActiveDoc.ModelAbsoluteTolerance)
        return value if value > 0 else evaluator.TOL
    except Exception:
        return evaluator.TOL


def _evaluate_part(part, notes):
    """Evaluate one part, bounded expression first, then documented fallbacks."""
    base = _model_tolerance()
    attempts = []
    for value in (base, evaluator.TOL, 0.5 * base, 2.0 * base):
        value = float(value)
        if value > 0 and value not in attempts:
            attempts.append(value)

    bounded = dict(part)
    bounded["expression"] = _bounded_expression(part["expression"])
    errors = []
    for label, candidate in (("bounded", bounded), ("authored", part)):
        if label == "authored" and candidate["expression"] == bounded["expression"]:
            continue
        for tolerance in attempts:
            try:
                breps = evaluator.evaluate_part(candidate, tolerance)
                if label == "authored":
                    notes.append(
                        "part %s: bounded expression failed, authored expression "
                        "succeeded at %g" % (part.get("name"), tolerance)
                    )
                return breps
            except Exception as exc:
                errors.append("%s @ %g: %s" % (label, tolerance, exc))
    try:
        notes.extend(
            "cut diagnosis: %s" % line
            for line in evaluator.diagnose_cuts(part, attempts[0])
        )
    except Exception:
        pass
    raise ValueError(
        "part %s failed every Boolean route: %s"
        % (part.get("name"), " | ".join(errors[:4]))
    )


def _plane_graphics(cut_json, size):
    cut = kernel.Cut.from_json(cut_json)
    origin = cut.origin()
    normal = np.asarray(cut.normal, float)
    normal /= np.linalg.norm(normal)
    point = rg.Point3d(float(origin[0]), float(origin[1]), float(origin[2]))
    vector = rg.Vector3d(float(normal[0]), float(normal[1]), float(normal[2]))
    plane = rg.Plane(point, vector)
    rectangle = rg.Rectangle3d(
        plane, rg.Interval(-size, size), rg.Interval(-size, size)
    ).ToNurbsCurve()
    arrow = rg.LineCurve(point, point + float(0.35 * size) * vector)
    return rectangle, arrow


# --------------------------------------------------------------------------
# fitting: one program in, one verdict out
# --------------------------------------------------------------------------


# Every hard gate in anyjoint.construction_failures, as (measured key,
# constraint key, library default, sense). Printing this table is the whole
# point: a refusal must say which number missed which number, and by how much.
_GATES = (
    ("engagementSections", "minimumEngagementSections", 1.0, ">="),
    ("interfaceAreaRatio", "minimumInterfaceAreaRatio", 1.0, ">="),
    ("medianLigamentRatio", "minimumLigamentRatio", 0.08, ">="),
    ("minimumPlaneAngleDeg", "minimumPlaneAngleDeg", 10.0, ">="),
    ("supportPlaneCount", "maximumSupportPlanes", 6, "<="),
    ("replacementVolumeFraction", "minimumReplacementVolumeFraction", 0.02, ">="),
    ("replacementVolumeFraction", "maximumReplacementVolumeFraction", 0.90, "<="),
)

# Deliberately permissive floor used by the "relaxed gates" rung. These are not
# good joints -- they are the widest values still worth showing on screen.
_PERMISSIVE = {
    "minimumEngagementSections": 0.5,
    "targetEngagementSections": 0.5,
    "minimumInterfaceAreaRatio": 0.6,
    "targetInterfaceAreaRatio": 0.6,
    "minimumLigamentRatio": 0.03,
    "minimumPlaneAngleDeg": 4.0,
    "maximumSupportPlanes": 8,
    "minimumReplacementVolumeFraction": 0.005,
    "maximumReplacementVolumeFraction": 0.98,
    "assemblyDirection": None,
    "geometricLockDirections": [],
}


def _gate_table(metrics, constraints):
    """Measured against required, one line per gate, worst first."""
    constraints = constraints or {}
    rows = []
    for measured_key, constraint_key, default, sense in _GATES:
        required = float(constraints.get(constraint_key, default))
        actual = float(metrics.get(measured_key, 0.0))
        ok = actual + 1e-9 >= required if sense == ">=" else actual <= required + 1e-9
        slack = (actual - required) if sense == ">=" else (required - actual)
        rows.append(
            {
                "gate": constraint_key,
                "measured": round(actual, 3),
                "required": "%s %.3f" % (sense, required),
                "pass": bool(ok),
                "slack": round(slack, 3),
            }
        )
    rows.sort(key=lambda row: (row["pass"], row["slack"]))
    return rows


def _gate_lines(metrics, constraints, only_failures=False):
    lines = []
    for row in _gate_table(metrics, constraints):
        if only_failures and row["pass"]:
            continue
        lines.append(
            "  {:<34} measured {:>8}   required {:<10} {}".format(
                row["gate"], row["measured"], row["required"],
                "ok" if row["pass"] else "FAIL by %.3f" % abs(row["slack"]),
            )
        )
    return lines


def _without_direction_claims(program):
    """The same program with only its two self-declared direction claims dropped.

    `assemblyDirection` and `geometricLockDirections` are the only gates that
    test the model's *intent* rather than the geometry's fitness, and they are
    checked BEFORE placement -- so when they disagree with the authored planes
    every candidate is discarded and nothing is ever built. Every numeric gate
    and full mandatory coverage stay armed.
    """
    relaxed = copy.deepcopy(program)
    constraints = relaxed.setdefault("constructionConstraints", {})
    constraints["assemblyDirection"] = None
    constraints["geometricLockDirections"] = []
    return relaxed


def _with_permissive_gates(program):
    """Drop to the permissive floor, keeping full mandatory damage coverage."""
    relaxed = copy.deepcopy(program)
    constraints = relaxed.setdefault("constructionConstraints", {})
    constraints.update(copy.deepcopy(_PERMISSIVE))
    return relaxed


def _claim_check(resolved_original, result):
    """Which declared direction claims the built geometry does not deliver."""
    measured = result.get("construction_metrics") or {}
    clear = [str(value) for value in (measured.get("clearExtractionDirections") or [])]
    constraints = (resolved_original or {}).get("constructionConstraints") or {}
    unmet = []
    assembly = constraints.get("assemblyDirection")
    if assembly is not None and str(assembly).upper() not in clear:
        unmet.append(
            "declared insertion along {} is blocked by this geometry".format(assembly)
        )
    for value in constraints.get("geometricLockDirections") or []:
        if str(value).upper() in clear:
            unmet.append(
                "declared geometric lock in {} is not delivered; that direction is open".format(value)
            )
    return unmet, clear


# The ladder. Each rung gives up one thing and says so. The run only ends with
# nothing on screen when no placement of these planes builds a solid at all.
_RUNGS = (
    ("contract", None, True, False, "as authored"),
    ("claims_relaxed", _without_direction_claims, True, False,
     "the program's own assemblyDirection and geometricLockDirections set aside"),
    ("relaxed_gates", _with_permissive_gates, True, False,
     "the program's numeric construction gates dropped to a permissive floor"),
    ("coverage_only", None, False, False,
     "every construction gate off; full damage coverage still required"),
    ("partial", None, False, True,
     "every construction gate off and partial damage coverage allowed"),
)


# Half a section depth of overhang is absorbed by the kernel's coverage-probed
# trim; beyond that the group is genuinely open and will sweep the member.
_ESCAPE_MARGIN = 0.5


def _escape_depth(template, aspect, margin=_ESCAPE_MARGIN):
    """How far a removal reaches PAST the kept-side end of the joint window.

    Every plane is placed as a deliberately oversized prism, so a removal group
    that is not closed along the member axis on the kept side does not stop at
    the window -- it sweeps the whole beam. Nothing upstream notices: the
    construction metrics sample only v in [0, aspect], where such a group looks
    perfectly well behaved. This is the difference between a splice and a
    demolition, and it is invisible until the geometry is placed.
    """
    ys = np.linspace(-3.0 * float(aspect), float(aspect), 200)
    xs = zs = np.linspace(-0.48, 0.48, 7)
    grid = np.array([[x, y, z] for y in ys for x in xs for z in zs])
    inside = anyjoint._template_removal_mask(template, grid)
    if not inside.any():
        return 0.0
    return max(0.0, -(float(grid[inside][:, 1].min()) + float(margin)))


def _open_groups(candidate):
    """(total escape, [(group index, plane ids, escape)]) for one candidate."""
    template = candidate.template
    aspect = float(candidate.parameters.get("aspect", 3.0))
    try:
        total = _escape_depth(template, aspect)
    except Exception:
        return 0.0, []
    if total <= 0.0:
        return 0.0, []
    culprits = []
    for index, group in enumerate(template.groups):
        try:
            depth = _escape_depth(dataclasses.replace(template, groups=(group,)), aspect)
        except Exception:
            continue
        if depth > 0.0:
            culprits.append(
                (index, ["P%d" % slot for slot in group], round(depth, 2))
            )
    return total, culprits


def _screen_candidates(grammar):
    """Split a grammar bank into groups that stay in the window and ones that do not."""
    clean, escaping, lines = [], [], []
    for candidate in grammar:
        total, culprits = _open_groups(candidate)
        if total <= 0.0:
            clean.append(candidate)
            continue
        escaping.append(candidate)
        for index, ids, depth in culprits:
            lines.append(
                "removalGroup {} ({}) is OPEN along the beam axis on the kept side: its "
                "removal reaches {:.1f} section depths past the joint window, so the "
                "placed cutter sweeps the whole member instead of cutting off the "
                "decayed end. Close it with a plane whose normal has a negative "
                "v-component -- a shoulder facing the timber that stays.".format(
                    index, ", ".join(ids), depth
                )
            )
        if not culprits:
            lines.append(
                "candidate {} removes material {:.1f} section depths past the kept-side "
                "end of the joint window".format(candidate.candidate_id, total)
            )
    seen, unique = set(), []
    for line in lines:
        if line not in seen:
            seen.add(line)
            unique.append(line)
    return clean, escaping, unique


def _replacement_sides(frame, v0, v1):
    """Which end the damage actually sits at, as the fitter's `side` values.

    `side` decides which end of the member becomes the prosthesis, and it is the
    single largest lever on the outcome: the same planes on the same post remove
    0.017..0.619 m at side -1 and 0.284..1.823 m at side +1. Left free, the
    fitter sweeps both, and with damage coverage ranked first the wrong end can
    win -- replacing the whole sound member covers every damaged cell too. The
    decay tells us the answer, so we take it rather than search for it.
    """
    length = float(frame["length"])
    near, far = float(v0), length - float(v1)
    if near <= far and near <= 0.25 * length:
        return [-1], "damage reaches the low end ({:.3f} m in)".format(near)
    if far < near and far <= 0.25 * length:
        return [1], "damage reaches the high end ({:.3f} m in)".format(far)
    return None, "damage is not end-localised -- this is a mid-member patch, not a splice"


def _numbers(value, default):
    try:
        out = [float(item) for item in value]
        return out if out else list(default)
    except Exception:
        return list(default)


def _prosthesis_extent(frame, points, result):
    """Where the replacement piece actually starts and ends along the member."""
    try:
        removed = scoring.removed_mask(points, result["repair"])
        if not removed.any():
            return None
        local = scoring.to_local(points, frame)[removed][:, 1]
        length = float(frame["length"])
        return {
            "from": float(local.min()), "to": float(local.max()),
            "length": float(local.max() - local.min()),
            "fractionOfMember": float((local.max() - local.min()) / max(length, 1e-9)),
            "memberLength": length,
        }
    except Exception:
        return None


def _fit_rung(program, frame, points, values, target_id, gate, enforce, partial,
              ceiling):
    """One rung of the ladder, choosing the least destructive placement.

    `fit_program` returns only `results[0]`, and with partial coverage allowed
    the sort puts `required_left` first -- so the placement that replaces the
    ENTIRE member always wins, because replacing everything covers every
    damaged cell. That is how a base repair ends up proposing to renew 93% of a
    sound post. Here the full result list is searched for the best placement
    that stays under a sound-loss ceiling, and the ceiling itself is reported.
    """
    grammar, resolved, warnings = joinery_program.program_candidates(
        program, beam_id=target_id
    )
    warnings = list(warnings)

    # Screen out plane programs whose removal escapes the joint window before
    # spending any placements on them.
    clean, escaping, escape_lines = _screen_candidates(grammar)
    warnings.extend(escape_lines)
    if clean:
        if escaping:
            warnings.append(
                "dropped {} of {} plane variant(s) whose removal escapes the joint "
                "window".format(len(escaping), len(grammar))
            )
        grammar = clean
    elif escaping:
        warnings.append(
            "EVERY plane variant of this program escapes the joint window. Whatever is "
            "built below will replace most of the member; the fix is in removalGroups, "
            "not in the angles."
        )

    objective = resolved.get("fitObjective") or {}
    threshold = float(
        gate if gate is not None else objective.get("damageThreshold", 0.5)
    )

    # The search window bounds where the joint band may sit:
    #   lo = (v0 - window*section)/length,  hi = (v1 + window*section)/length
    # If it is too small the band cannot clear the decay, so the kernel's end
    # trim stops short of the rotten stub and the joint features are left to
    # cover it -- which a lap or a scarf cannot do, because they keep part of
    # the section. Coverage then fails and every strict rung refuses, for a
    # reason that has nothing to do with the joint. Size the floor from the
    # decay itself.
    authored_window = float(objective.get("searchWindowSections", 1.5))
    window = authored_window
    window_note = None
    sides = [int(value) for value in _numbers(objective.get("replacementSides"), (1, -1))]
    side_note = None
    try:
        v0, v1, _mandatory = anyjoint.damage_extent(points, values, frame, threshold)
        if v0 is not None:
            inferred, reason = _replacement_sides(frame, v0, v1)
            if inferred and inferred != sides:
                side_note = (
                    "replacementSides forced to {} -- {}. Left free, the fitter can "
                    "replace the sound end instead, which also covers every damaged "
                    "cell and therefore ranks first.".format(inferred, reason)
                )
                sides = inferred
            section = min(float(frame["width"]), float(frame["height"]))
            decay_sections = (float(v1) - float(v0)) / max(section, 1e-9)
            aspect = float((resolved.get("geometry") or {}).get("aspect", 3.0))
            needed = decay_sections + aspect + 0.5
            if needed > authored_window:
                window = needed
                window_note = (
                    "searchWindowSections raised {:.1f} -> {:.1f}: the decay runs {:.1f} "
                    "section depths and the joint is {:.1f} long, so the authored window "
                    "could not place the joint clear of the rot".format(
                        authored_window, needed, decay_sections, aspect
                    )
                )
    except Exception:
        pass

    results, report_lines = anyjoint.search(
        frame, points, values, threshold=threshold, grammar=grammar,
        n_positions=max(2, min(25, int(objective.get("positionSamples", 7)))),
        window=window,
        margin=float(objective.get("damageMarginSections", 1.0)),
        rotations=_numbers(objective.get("rotationsDeg"), (0.0, 90.0, 180.0, 270.0)),
        sides=sides,
        complexity_weight=float(objective.get("complexityWeight", 0.0)),
        construction_constraints=(
            resolved.get("constructionConstraints") or None if enforce else None
        ),
        verify=True, allow_partial=partial,
    )
    lines = list(warnings)
    if side_note:
        lines.append(side_note)
    if window_note:
        lines.append(window_note)
    lines.extend(report_lines)
    if not results:
        return None, resolved, lines, None

    def loss(item):
        denominator = max(1, int(item.get("n_sound", 0)))
        return float(item.get("sound_sacrificed", 0)) / denominator

    within = [item for item in results if loss(item) <= float(ceiling)]
    if within:
        chosen, note = within[0], None
        if chosen is not results[0]:
            note = (
                "skipped {} higher-ranked placement(s) that would have replaced more "
                "than {:.0%} of the sound member".format(
                    results.index(chosen), float(ceiling)
                )
            )
    else:
        chosen = results[0]
        note = (
            "EVERY placement of these planes replaces more than {:.0%} of the sound "
            "member ({:.0%} here). That is a demolition, not a repair. The usual cause "
            "is that the authored planes reach full section at the far end of the joint "
            "window, so the kernel's end trim runs the length of the member instead of "
            "cutting off the decayed stub.".format(float(ceiling), loss(chosen))
        )
    return chosen, resolved, lines, note


def _fit_with_diagnosis(program, frame, points, values, target_id, gate,
                        relax=True, ceiling=0.5):
    """Fit down a ladder of increasingly relaxed contracts and report the rung.

    The first rung is the unchanged strict contract. Each rung below it gives up
    one specific thing, and whatever is finally built is reported together with
    the full gate table measured against what the program ORIGINALLY asked for,
    so a participant can see exactly how far the geometry is from its own brief.
    """
    attempts = []
    original_constraints = None
    rungs = _RUNGS if relax else _RUNGS[:1]

    for name, transform, enforce, partial, note in rungs:
        candidate = transform(program) if transform is not None else program
        try:
            result, resolved, fit_report, ceiling_note = _fit_rung(
                candidate, frame, points, values, target_id, gate,
                enforce, partial, ceiling,
            )
        except (joinery_program.JointProgramError, ValueError) as exc:
            return {
                "result": None, "resolved": program, "mode": None, "unmet": [],
                "report": ["JointProgram validation failed: {}".format(exc)],
                "diagnosis": {"stage": "validation", "error": str(exc)},
            }
        if original_constraints is None:
            original_constraints = copy.deepcopy(
                (resolved or {}).get("constructionConstraints") or {}
            )

        if result is None:
            attempts.append((name, note, fit_report))
            continue

        measured = result.get("construction_metrics") or {}
        unmet, clear = _claim_check({"constructionConstraints": original_constraints}, result)
        lines = []
        if name != "contract":
            lines.append(
                "BUILT ON RUNG '{}' -- {}. The stricter rungs above produced nothing.".format(
                    name, note
                )
            )
        lines.extend(fit_report)
        if ceiling_note:
            lines.append(ceiling_note)
        try:
            repair = result["repair"]
            band = [round(float(value), 3) for value in repair.get("band", [])]
            names = [cut.get("name") for cut in repair["parts"][0]["cuts"]]
            lines.append(
                "placed band {} m, interface {:.3f} m, flipped {}, cutters {}".format(
                    band, float(repair.get("interface_length", 0.0)),
                    bool(repair.get("flipped")), ", ".join(str(n) for n in names),
                )
            )
            lines.append(
                "removal expression: " + str(repair["parts"][1].get("expression"))
            )
        except Exception:
            pass
        extent = _prosthesis_extent(frame, points, result)
        if extent:
            lines.append(
                "prosthesis spans {:.3f}..{:.3f} m of a {:.2f} m member ({:.0%}); "
                "removes {} of {} sound cells".format(
                    extent["from"], extent["to"], extent["memberLength"],
                    extent["fractionOfMember"],
                    int(result.get("sound_sacrificed", 0)),
                    int(result.get("n_sound", 0)),
                )
            )
        lines.append("measured against what the program asked for:")
        lines.extend(_gate_lines(measured, original_constraints))
        lines.append(
            "  clear extraction directions: {}".format(
                ", ".join(clear) if clear else "none -- fully interlocked"
            )
        )
        lines.extend("  claim not met: " + item for item in unmet)
        if int(result.get("required_left", 0)):
            lines.append(
                "  WARNING: {} required damaged cell(s) remain in the kept member".format(
                    int(result.get("required_left", 0))
                )
            )
        return {"result": result, "resolved": resolved, "mode": name,
                "unmet": unmet, "report": lines,
                "gates": _gate_table(measured, original_constraints),
                "diagnosis": None}

    # Nothing built on any rung: the planes themselves do not produce a solid.
    lines = ["no rung produced geometry -- the planes do not build a valid two-part solid"]
    for name, note, fit_report in attempts:
        tail = [line for line in fit_report if "rejected before placement" in line]
        lines.append("  rung '{}' ({}): {}".format(
            name, note, tail[0] if tail else (fit_report[-1] if fit_report else "no fit")
        ))
    lines.append(
        "The Boolean region is probably empty, degenerate, or it swallows the whole "
        "joint window. Check removalGroups before changing angles."
    )
    return {
        "result": None, "resolved": program, "mode": None, "unmet": [],
        "report": lines,
        "diagnosis": {"stage": "fit", "rungs": [name for name, _, _ in attempts],
                      "note": lines[-1]},
    }


# --------------------------------------------------------------------------
# explanation: measured, not narrated
# --------------------------------------------------------------------------


def _explain(resolved, result, mode="contract", unmet=()):
    """What this joint does, and what it does not -- from the geometry."""
    lines = []
    _RUNG_NOTE = {
        "claims_relaxed": "This joint was built with the program's own assemblyDirection "
                          "and geometricLockDirections set aside. Every numeric gate and "
                          "full damage coverage still passed.",
        "relaxed_gates": "This joint does NOT meet the construction gates the program "
                         "asked for. It is shown so the shape can be judged; the gate "
                         "table in the report says by how much it misses.",
        "coverage_only": "No construction gate was applied. This joint covers the damage "
                         "and nothing more has been checked about it.",
        "partial": "No construction gate was applied AND the damage is not fully covered. "
                   "This is a diagnostic shape, not a repair.",
    }
    if mode in _RUNG_NOTE:
        lines.append(_RUNG_NOTE[mode])
    if unmet:
        lines.extend("  " + item for item in unmet)
    measured = result.get("construction_metrics") or {}
    clear = [str(value) for value in (measured.get("clearExtractionDirections") or [])]
    blocked = [value for value in DIRECTIONS if value not in clear]

    if blocked:
        lines.append(
            "LOCKS: the prosthesis cannot be withdrawn along {}.".format(", ".join(blocked))
        )
    else:
        lines.append("LOCKS: none. The prosthesis is free in every axis direction.")
    if clear:
        lines.append(
            "OPEN: nothing in this geometry resists movement along {}. "
            "Retention there depends on bearing, friction or a fastener, which "
            "this model does not represent.".format(", ".join(clear))
        )

    behaviour = resolved.get("jointBehaviour") or {}
    constraints = resolved.get("constructionConstraints") or {}
    claimed = [str(value) for value in (constraints.get("geometricLockDirections") or [])]
    unmet = [value for value in claimed if value in clear]
    if claimed:
        lines.append(
            "CLAIMED LOCKS: {}{}".format(
                ", ".join(claimed),
                "" if not unmet else "  --  NOT DELIVERED in {}".format(", ".join(unmet)),
            )
        )
    if behaviour.get("tensionRetention"):
        lines.append("AUTHORED TENSION RETENTION: {}".format(behaviour["tensionRetention"]))

    lines.append(
        "BEARING AND FIT: engagement {:.2f} sections, interface ratio {:.2f}, "
        "median ligament {:.2f}, {} support plane(s), smallest plane angle {:.0f} deg.".format(
            float(measured.get("engagementSections", 0.0)),
            float(measured.get("interfaceAreaRatio", 0.0)),
            float(measured.get("medianLigamentRatio", 0.0)),
            int(measured.get("supportPlaneCount", 0)),
            float(measured.get("minimumPlaneAngleDeg", 0.0)),
        )
    )
    lines.append(
        "MATERIAL: removes {} sound cell(s) of {} (weighted {:.2f}); leaves {} "
        "required damaged cell(s); replacement is {:.0%} of the joint window.".format(
            int(result.get("sound_sacrificed", 0)),
            int(result.get("n_sound", 0)),
            float(result.get("sound_sacrificed_weighted", 0.0)),
            int(result.get("required_left", 0)),
            float(measured.get("replacementVolumeFraction", 0.0)),
        )
    )
    lines.append(
        "PLACEMENT: position {:.3f}, rotation {:.0f} deg, replacement side {:+d}, "
        "interface scale {:.2f}.".format(
            float(result.get("position", 0.0)),
            float(result.get("rotate_deg", 0.0)),
            int(result.get("side", 1)),
            float(result.get("interface_scale", 1.0)),
        )
    )
    for question in resolved.get("openQuestions") or []:
        lines.append("OPEN QUESTION: {}".format(question))
    lines.append(
        "NOT MODELLED: pegs, keys and any fastener; neighbour connections; "
        "shrinkage and fitting clearance."
    )
    return lines


def _rank_key(entry):
    result = entry["result"]
    measured = result.get("construction_metrics") or {}
    clear = len(measured.get("clearExtractionDirections") or [])
    return (
        int(result.get("required_left", 0)),
        0 if entry.get("mode") == "contract" else 1,      # met its own claims first
        clear,                                            # fewer open directions next
        float(result.get("sound_sacrificed_weighted", 0.0)),
        int(measured.get("supportPlaneCount", 0)),
        str(result.get("candidate_id", "")),
    )


# --------------------------------------------------------------------------
# main
# --------------------------------------------------------------------------

_STICKY_LAST = "agentic_joinery_last_good"

if bool(globals().get("run")):
    try:
        if globals().get("box") is None:
            raise ValueError("connect the oriented box from BEAM CELLS")
        target_id = str(globals().get("beam_id") or "").strip()
        if not target_id:
            raise ValueError("beam_id is required and must match a Workspace part id")
        raw_centres = list(globals().get("centers") or [])
        raw_damage = list(globals().get("damage") or [])
        if not raw_centres:
            raise ValueError("connect cell centres from BEAM CELLS")
        if len(raw_centres) != len(raw_damage):
            raise ValueError(
                "centres/damage length mismatch: {} vs {}".format(
                    len(raw_centres), len(raw_damage)
                )
            )

        step_id = str(globals().get("repair_step_id") or "").strip() or None
        workspace_value = globals().get("workspace_json")
        workspace = _read_workspace(workspace_value)
        context = joinery_program.workspace_context(
            workspace, target_id, repair_step_id=step_id
        )
        frame = _box_frame(box)
        points = np.asarray([_xyz(point) for point in raw_centres], float)
        values = np.asarray([float(value) for value in raw_damage], float)
        gate = (
            0.5 if globals().get("threshold") is None else float(globals().get("threshold"))
        )
        context["cellularDamage"] = _damage_context(frame, points, values, gate)
        context_json = json.dumps(context, indent=2, ensure_ascii=False)

        gemini_model = str(
            globals().get("gemini_model") or os.environ.get("GEMINI_MODEL") or MODEL
        ).strip()
        wanted = max(1, min(6, int(globals().get("variation_count") or 3)))
        temperature_input = globals().get("temperature")
        attachments, attachment_report = _evidence_attachments(workspace_value, context)
        report.extend(attachment_report)
        instruction_text = str(globals().get("instruction") or "")
        signature = _llm_cache_key(context_json, instruction_text, gemini_model, wanted)

        programs_from_gemini = False
        gemini_job = None
        gemini_key = None
        try:
            programs = _unwrap_programs(
                globals().get("joint_program_json"), workspace, target_id
            )
            report.append(
                "program source: input or stored Workspace proposal ({} concept(s))".format(
                    len(programs)
                )
            )
        except ValueError:
            gemini_key, key_note = _get_key()
            report.append(key_note)
            if not gemini_key:
                report.append(
                    "STATUS: local LLM context ready for beam {}; no geometry generated yet".format(
                        target_id
                    )
                )
                report.append(
                    "add the key to the reported file, or paste a Gemini response into joint_program_json"
                )
                raise _ContextReady()
            jobs = sc.sticky.setdefault("agentic_joinery_jobs", {})
            job_id = str(ghenv.Component.InstanceGuid)
            gemini_job = jobs.get(job_id)
            if not isinstance(gemini_job, dict) or gemini_job.get("signature") != signature:
                gemini_job = {
                    "signature": signature, "done": False, "error": None,
                    "programs": None, "response": None, "revision": 0, "t0": time.time(),
                }
                jobs[job_id] = gemini_job
                _start_gemini_job(
                    gemini_job, gemini_key, context, instruction_text, gemini_model,
                    attachments, variation_count=wanted,
                    temperature=(0.7 if temperature_input is None else float(temperature_input)),
                )
                report.append(
                    "STATUS: Gemini is authoring {} JointProgram concept(s)".format(wanted)
                )
                _wake_up()
                raise _ContextReady()
            if not gemini_job.get("done"):
                waited = time.time() - float(gemini_job.get("t0") or time.time())
                if waited > JOB_DEADLINE_SECONDS:
                    gemini_job["done"] = True
                    gemini_job["error"] = (
                        "no response after {:.0f} s; press run again to retry".format(waited)
                    )
                else:
                    report.append("STATUS: Gemini working, {:.0f} s so far".format(waited))
                    _wake_up()
                    raise _ContextReady()
            if gemini_job.get("error"):
                raise RuntimeError("Gemini failed: {}".format(gemini_job["error"]))
            programs = gemini_job.get("programs") or []
            agent_response = gemini_job.get("response") or {}
            if not programs:
                raise RuntimeError("Gemini job completed without a JointProgram")
            programs_from_gemini = True
            report.append(
                "Gemini authored {} concept(s): {}".format(
                    len(programs), agent_response.get("summary", "done")
                )
            )

        raw_revisions = globals().get("max_revisions")
        revisions = 2 if raw_revisions is None else max(0, min(3, int(raw_revisions)))

        # ---- fit every concept independently -----------------------------
        relax = globals().get("relax_direction_claims")
        relax = True if relax is None else bool(relax)
        ceiling = globals().get("max_sound_loss")
        ceiling = 0.5 if ceiling is None else max(0.05, min(1.0, float(ceiling)))
        fitted, refused = [], []
        for index, program in enumerate(programs):
            outcome = _fit_with_diagnosis(
                program, frame, points, values, target_id, gate,
                relax=relax, ceiling=ceiling,
            )
            label = str(program.get("id") or "concept_{}".format(index))
            lines = outcome["report"]
            if outcome["result"] is None:
                refused.append({"id": label, "resolved": outcome["resolved"],
                                "diagnosis": outcome["diagnosis"], "report": lines})
                report.append("REFUSED {}".format(label))
                report.extend(lines)
            else:
                fitted.append({"id": label, "result": outcome["result"],
                               "resolved": outcome["resolved"], "mode": outcome["mode"],
                               "unmet": outcome["unmet"], "gates": outcome.get("gates"),
                               "report": lines})
                report.append(
                    "FITTED {} [rung: {}] {}".format(
                        label, outcome["mode"], anyjoint.result_summary(outcome["result"])
                    )
                )
                report.extend(lines)

        # ---- one bounded revision, driven by the named gate failures ------
        if not fitted and programs_from_gemini and gemini_job is not None \
                and int(gemini_job.get("revision") or 0) < revisions:
            worst = refused[0] if refused else {}
            feedback = {
                "attempt": int(gemini_job.get("revision") or 0) + 1,
                "whatFailed": worst.get("diagnosis"),
                "reportLines": worst.get("report", [])[-4:],
                "instruction": (
                    "Every concept was refused. Change the planes or the Boolean "
                    "groups so the named gates pass with margin, keeping the "
                    "construction reasoning that is still valid. Do not restate "
                    "the previous program."
                ),
            }
            next_revision = int(gemini_job.get("revision") or 0) + 1
            gemini_job["revision"] = next_revision
            _start_gemini_job(
                gemini_job, gemini_key, context, instruction_text, gemini_model,
                attachments, previous=worst.get("resolved"), feedback=feedback,
                variation_count=wanted,
                temperature=(0.35 if temperature_input is None else float(temperature_input)),
            )
            report.append(
                "STATUS: Gemini revision {} running, with the failed gates named".format(
                    next_revision
                )
            )
            _wake_up()
            raise _ContextReady()

        fitted.sort(key=_rank_key)
        variants_json = json.dumps(
            {
                "fitted": [
                    {
                        "id": entry["id"],
                        "mode": entry.get("mode"),
                        "gates": entry.get("gates"),
                        "claimsNotMet": entry.get("unmet"),
                        "summary": (entry["resolved"].get("contextAssessment") or {}).get("reasoning"),
                        "constructionNotes": entry["resolved"].get("constructionNotes"),
                        "metrics": entry["result"].get("construction_metrics"),
                        "requiredLeft": int(entry["result"].get("required_left", 0)),
                        "soundRemoved": int(entry["result"].get("sound_sacrificed", 0)),
                        "explanation": _explain(
                            entry["resolved"], entry["result"],
                            entry.get("mode"), entry.get("unmet") or (),
                        ),
                    }
                    for entry in fitted
                ],
                "refused": [
                    {"id": item["id"], "diagnosis": item["diagnosis"]} for item in refused
                ],
            },
            indent=2, ensure_ascii=False,
        )

        if not fitted:
            report.append(
                "STATUS: no concept passed the construction contract. The gate "
                "failures above are what to change."
            )
            previous = sc.sticky.get(_STICKY_LAST)
            if previous:
                report.append(
                    "showing the last good geometry from this component; it is STALE"
                )
                kept, prosthesis = previous["kept"], previous["prosthesis"]
                plane_rectangles = previous["rectangles"]
                plane_arrows = previous["arrows"]
                removed_cells = previous["removed"]
                resolved_program_json = previous["program"]
                resolved_json = previous["program"]
                proposal_json = previous["proposal"]
                explanation = ["STALE -- from the previous run"] + previous["explanation"]
                metrics = previous["metrics"]
        else:
            pick = int(globals().get("variant") or 0)
            pick = max(0, min(len(fitted) - 1, pick))
            chosen = fitted[pick]
            result, resolved = chosen["result"], chosen["resolved"]
            report.append(
                "showing variant {} of {}: {}".format(pick + 1, len(fitted), chosen["id"])
            )

            resolved_program_json = json.dumps(resolved, indent=2, ensure_ascii=False)
            resolved_json = resolved_program_json
            proposal = joinery_program.proposal_record(resolved, result, report)
            proposal_json = json.dumps(proposal, indent=2, ensure_ascii=False)

            repair = result["repair"]
            notes = []
            for part in repair["parts"]:
                breps = _evaluate_part(part, notes)
                if part["name"] == "kept":
                    kept.extend(breps)
                elif part["name"] == "prosthesis":
                    prosthesis.extend(breps)
            report.extend(notes)

            predicate_count = int(result["predicate_count"])
            cut_jsons = repair["parts"][0]["cuts"][1 : 1 + predicate_count]
            display_size = 0.75 * max(frame["width"], frame["height"])
            for cut_json in cut_jsons:
                rectangle, arrow = _plane_graphics(cut_json, display_size)
                plane_rectangles.append(rectangle)
                plane_arrows.append(arrow)

            removed = scoring.removed_mask(points, repair)
            removed_cells = [
                raw_centres[index] for index, flag in enumerate(removed) if bool(flag)
            ]
            metrics = anyjoint.result_summary(result)
            explanation = _explain(
                resolved, result, chosen.get("mode"), chosen.get("unmet") or ()
            )
            report.extend(explanation)

            sc.sticky[_STICKY_LAST] = {
                "kept": list(kept), "prosthesis": list(prosthesis),
                "rectangles": list(plane_rectangles), "arrows": list(plane_arrows),
                "removed": list(removed_cells), "program": resolved_program_json,
                "proposal": proposal_json, "explanation": list(explanation),
                "metrics": metrics,
            }
    except _ContextReady:
        pass
    except Exception as exc:
        report.append("ERROR: {}".format(exc))
else:
    try:
        sc.sticky.get("agentic_joinery_jobs", {}).pop(
            str(ghenv.Component.InstanceGuid), None
        )
    except Exception:
        pass
# ---------- end agentic_joinery ----------
geometry_3 = Geometry(agentic_joinery.prosthesis)
volume = Volume(Geometry=geometry_3)  # -> Volume, Centroid
scale = Scale(Geometry=geometry_3, Center=volume.Centroid, Factor=1.0001)  # -> Geometry, Transform
custom_preview_3 = CustomPreview(Geometry=scale.Geometry, Material=ColourSwatch(SwatchColor=RGB(0, 221, 255)))
panel_17 = Panel(agentic_joinery.report)

panel_18 = Panel("C:\Users\tizian\Downloads\timber-frame-corner__tizian__conservative-in-situ-splice__2026-08-20.zip")
agentic_joinery_2 = Python3Script(
    workspace_json=panel_18,
    beam_id="corner_post",
    max_revisions=Slider(6, range=0..10),
    box=beam_cells.box,
    centers=cell_example_damage.centers,
    damage=cell_example_damage.damage,
    run=Toggle(True))  # -> out, report, prosthesis, plane_rectangles, plane_arrows, removed_cells, context_json, resolved_json, proposal_json, metrics; inputs box: Box, centers: list of Point3d, damage: list
# ---------- agentic_joinery_2: Python ----------
# r: google-genai
"""GH Python 3 -- AGENTIC JOINERY: execute an LLM-authored JointProgram.

This component is the geometric tool used by the Agentic Joinery Co-Designer.
The LLM reads the Workspace context and writes one semantic JointProgram;
this component fits that program to the cellular damage field and returns one
resolved repair proposal.

Inputs
------
workspace_json      str/dict    Workspace JSON, .json path, or exported .zip
beam_id             str         exact Workspace part id selected for repair
joint_program_json  str/dict    joinery-program@1 JSON from the LLM; optional
gemini_model         str         optional Gemini model [gemini-3.7-flash]
repair_step_id       str         optional expert override; LLM selects when empty
instruction          str         optional human construction instruction
max_revisions        int         agent revisions after a failed fit [2]
box                  Box         oriented box from BEAM CELLS
centers              Point3d[]   world cell centres from BEAM CELLS
damage               float[]     one 0..1 damage value per centre
threshold            float       mandatory-removal threshold [0.50]
repo                 str         optional repository override
run                  bool

When ``joint_program_json`` is empty, the component first looks for an already
stored ``joineryProposal.program`` on a current-plan step affecting ``beam_id``.
If none exists, it reads the participant's ZIP locally, attaches relevant
evidence photographs, and asks Gemini directly. The key is discovered through
``GEMINI_API_KEY`` or ``Documents/robarch/gemini_api_key.txt``. With no key it
returns a context-ready handoff in ``context_json``. A failed damage fit can be
sent back once for a bounded Gemini revision.

Outputs
-------
kept                  Brep[]     retained historic member
prosthesis            Brep[]     fitted replacement member
plane_rectangles      Curve[]    active oriented plane graphics
plane_arrows          Curve[]    half-space polarity arrows
removed_cells         Point3d[]  cell centres removed by the proposal
context_json          str        scoped Workspace context given to the LLM
resolved_program_json str        validated program actually fitted
resolved_json         str        alias for existing Grasshopper canvases
proposal_json         str        record suitable for a Workspace plan step
metrics               str        compact fit result
report                str[]      diagnostics and open questions

The only universal hard gate in this prototype is complete coverage of cells
whose damage value reaches ``threshold``.  Construction behaviour is authored
upstream in the JointProgram and therefore steers topology before fitting.
"""

import hashlib
import json
import mimetypes
import os
import sys
import threading
import time
import zipfile


def _repo_from_component():
    override = globals().get("repo") or os.environ.get("ROBARCH_REPO")
    component_file = globals().get("_p") or globals().get("__file__")
    candidates = []
    if override:
        candidates.append(os.path.abspath(os.path.expanduser(str(override))))
    # A pasted RhinoCode component reports a virtual rhinocode:// URI. It is
    # useful as a traceback location but cannot be walked as a filesystem path.
    if component_file and "://" not in str(component_file):
        candidates.append(
            os.path.abspath(os.path.join(os.path.dirname(component_file), "..", ".."))
        )

    # When the script is pasted into a component, the saved .gh/.ghx file is
    # the most dependable portable anchor. OnPingDocument is available in the
    # normal Grasshopper runtime and harmlessly absent in syntax/unit tests.
    try:
        gh_document = ghenv.Component.OnPingDocument()
        gh_path = str(getattr(gh_document, "FilePath", "") or "").strip()
        if gh_path:
            candidates.append(os.path.dirname(os.path.abspath(gh_path)))
    except Exception:
        pass

    # A Rhino model saved beside the repository is another useful anchor.
    try:
        import Rhino

        rhino_path = str(getattr(Rhino.RhinoDoc.ActiveDoc, "Path", "") or "").strip()
        if rhino_path:
            candidates.append(os.path.dirname(os.path.abspath(rhino_path)))
    except Exception:
        pass

    candidates.append(os.getcwd())
    candidates.extend(
        str(value) for value in sys.path if value and "://" not in str(value)
    )

    seen = set()
    for candidate in candidates:
        root = os.path.abspath(os.path.expanduser(str(candidate)))
        if os.path.isfile(root):
            root = os.path.dirname(root)
        for _ in range(9):
            key = os.path.normcase(root)
            if key in seen:
                break
            seen.add(key)
            if os.path.isdir(os.path.join(root, "src", "workshop_robarch_2026")):
                return root
            parent = os.path.dirname(root)
            if parent == root:
                break
            root = parent
    raise RuntimeError(
        "repository package not found. Connect a Text Panel with the workshop_robarch_2026 "
        "folder to the repo input, save the Grasshopper file inside the repository, or set "
        "ROBARCH_REPO."
    )


REPO = _repo_from_component()
SRC = os.path.join(REPO, "src")
if SRC not in sys.path:
    sys.path.append(SRC)
for module_name in list(sys.modules):
    if module_name.startswith("workshop_robarch_2026"):
        sys.modules.pop(module_name)

import numpy as np
import Rhino.Geometry as rg
import scriptcontext as sc

from workshop_robarch_2026 import evaluator, joinery_program, kernel, scoring


KEY_NAME = "gemini_api_key.txt"
HOME_KEY = os.path.join(os.path.expanduser("~"), "Documents", "robarch", KEY_NAME)
MODEL = "gemini-3.7-flash"
PROMPT_CONTRACT_VERSION = "anyjoint-six-plane-v2"


kept = []
prosthesis = []
plane_rectangles = []
plane_arrows = []
removed_cells = []
context_json = ""
resolved_program_json = ""
resolved_json = ""
proposal_json = ""
metrics = ""
report = ["Agentic Joinery Co-Designer geometry tool"]


class _ContextReady(Exception):
    """End this solution normally after preparing the manual LLM handoff."""


def _key_paths():
    paths = []
    try:
        gh_path = str(ghenv.Component.OnPingDocument().FilePath or "").strip()
        if gh_path:
            folder = os.path.dirname(gh_path)
            paths.append(os.path.join(folder, KEY_NAME))
            paths.append(os.path.join(os.path.dirname(folder), KEY_NAME))
    except Exception:
        pass
    paths.append(HOME_KEY)
    return paths


def _get_key():
    env = os.environ.get("GEMINI_API_KEY")
    if env and env.strip():
        return env.strip(), "key from GEMINI_API_KEY"
    checked = _key_paths()
    for path in checked:
        if os.path.isfile(path):
            with open(path, "r", encoding="utf-8-sig") as handle:
                value = handle.read().strip().strip('"').strip("'")
            if value:
                return value, "key from {}".format(path)
            return None, "key file is empty: {}".format(path)
    try:
        os.makedirs(os.path.dirname(HOME_KEY), exist_ok=True)
        with open(HOME_KEY, "a", encoding="utf-8"):
            pass
    except Exception:
        pass
    return None, "no key found; add it to {}".format(HOME_KEY)


def _read_workspace(value):
    if isinstance(value, dict):
        return value
    text = str(value or "").strip()
    if not text:
        raise ValueError("connect Workspace JSON or an exported Workspace ZIP path")
    path = os.path.abspath(os.path.expanduser(text))
    if os.path.isfile(path):
        if path.lower().endswith(".zip"):
            with zipfile.ZipFile(path, "r") as archive:
                text = archive.read("workspace.json").decode("utf-8-sig")
        else:
            with open(path, "r", encoding="utf-8-sig") as handle:
                text = handle.read()
    parsed = json.loads(text)
    if not isinstance(parsed, dict):
        raise ValueError("Workspace JSON must contain one object")
    return parsed


def _unwrap_program(value, workspace, target_id):
    if value is not None and str(value).strip():
        if isinstance(value, dict):
            raw = value
        else:
            text = str(value).strip()
            path = os.path.abspath(os.path.expanduser(text))
            if os.path.isfile(path):
                with open(path, "r", encoding="utf-8-sig") as handle:
                    text = handle.read()
            raw = json.loads(text)
        if isinstance(raw, dict):
            for key in ("jointProgram", "program"):
                if isinstance(raw.get(key), dict):
                    return raw[key]
            command = raw.get("command")
            if isinstance(command, dict):
                proposal = ((command.get("payload") or {}).get("step") or {}).get(
                    "joineryProposal"
                )
                if isinstance(proposal, dict):
                    return proposal.get("program") or proposal
            return raw

    plans = list(workspace.get("plans") or [])
    current = next(
        (p for p in plans if str(p.get("id")) == str(workspace.get("currentPlanId"))),
        plans[0] if len(plans) == 1 else None,
    )
    if current:
        for step in current.get("steps") or []:
            refs = [str(v) for v in (step.get("affectedPartRefs") or [])]
            proposal = step.get("joineryProposal")
            if str(target_id) in refs and isinstance(proposal, dict):
                return proposal.get("program") or proposal
    for proposal in workspace.get("joineryProposals") or []:
        if str(proposal.get("targetPartRef")) == str(target_id):
            return proposal.get("program") or proposal
    raise ValueError(
        "no JointProgram supplied or stored for beam {}".format(target_id)
    )


def _json_from_model_text(text):
    source = str(text or "").strip()
    if source.startswith("```"):
        lines = source.splitlines()
        if lines:
            lines = lines[1:]
        if lines and lines[-1].strip().startswith("```"):
            lines = lines[:-1]
        source = "\n".join(lines).strip()
    try:
        return json.loads(source)
    except Exception:
        start = source.find("{")
        end = source.rfind("}")
        if start >= 0 and end > start:
            return json.loads(source[start : end + 1])
        raise


def _evidence_attachments(workspace_value, context, max_total_bytes=12 * 1024 * 1024):
    path = str(workspace_value or "").strip()
    path = os.path.abspath(os.path.expanduser(path)) if path else ""
    if not path.lower().endswith(".zip") or not os.path.isfile(path):
        return [], []
    wanted = {
        str(item.get("id")): item
        for item in (context.get("evidence") or [])
        if item.get("id")
    }
    attachments = []
    messages = []
    total = 0
    with zipfile.ZipFile(path, "r") as archive:
        entries = [entry for entry in archive.infolist() if not entry.is_dir()]
        for evidence_id, metadata in wanted.items():
            prefix = "photos/{}/".format(evidence_id).lower()
            exact_prefix = "photos/{}.".format(evidence_id).lower()
            entry = next(
                (
                    item
                    for item in entries
                    if item.filename.replace("\\", "/").lower().startswith(exact_prefix)
                    or item.filename.replace("\\", "/").lower().startswith(prefix)
                ),
                None,
            )
            if entry is None:
                messages.append("evidence {} has no matching photo in ZIP".format(evidence_id))
                continue
            if total + int(entry.file_size) > max_total_bytes:
                messages.append("evidence {} skipped: attachment budget exceeded".format(evidence_id))
                continue
            data = archive.read(entry)
            total += len(data)
            mime = metadata.get("mimeType") or mimetypes.guess_type(entry.filename)[0]
            attachments.append(
                {
                    "id": evidence_id,
                    "name": entry.filename,
                    "mimeType": mime or "image/jpeg",
                    "data": data,
                }
            )
    return attachments, messages


def _request_gemini_joint_program(
    api_key,
    context,
    instruction,
    model,
    attachments=None,
    previous=None,
    feedback=None,
):
    prompt_path = os.path.join(REPO, "data", "prompts", "design_joinery_standalone.md")
    with open(prompt_path, "r", encoding="utf-8-sig") as handle:
        system_prompt = handle.read()
    payload = {
        "workspaceContext": context,
        "userMessage": instruction
        or "Design an actionable construction joinery for this repair area.",
        "previousProgram": previous,
        "fitFeedback": feedback,
    }
    from google import genai
    from google.genai import types

    parts = [types.Part.from_text(text=system_prompt)]
    parts.append(
        types.Part.from_text(
            text=json.dumps(payload, indent=2, ensure_ascii=False)
        )
    )
    for item in attachments or []:
        parts.append(
            types.Part.from_text(
                text="Evidence image {} ({})".format(item["id"], item["name"])
            )
        )
        parts.append(
            types.Part.from_bytes(data=item["data"], mime_type=item["mimeType"])
        )
    client = genai.Client(api_key=str(api_key).strip())
    response = client.models.generate_content(
        model=str(model or MODEL).strip(),
        contents=parts,
        config=types.GenerateContentConfig(response_mime_type="application/json"),
    )
    text = (response.text or "").strip()
    if not text:
        raise RuntimeError("Gemini returned no text response")
    result = _json_from_model_text(text)
    if not isinstance(result, dict) or not isinstance(result.get("jointProgram"), dict):
        raise RuntimeError("Gemini returned no jointProgram")
    return result["jointProgram"], result


def _damage_context(frame, points, values, gate):
    local = scoring.to_local(points, frame)
    mandatory = values >= float(gate)
    dimensions = np.array(
        [frame["width"], frame["length"], frame["height"]], dtype=float
    )
    result = {
        "threshold": float(gate),
        "cellCount": int(len(points)),
        "mandatoryCellCount": int(mandatory.sum()),
        "maximumDamage": float(values.max()) if len(values) else 0.0,
        "localAxes": ["section_u", "beam_axis_v", "section_w"],
        "beamDimensions": dimensions.tolist(),
    }
    if mandatory.any():
        damaged = local[mandatory]
        lo = damaged.min(axis=0)
        hi = damaged.max(axis=0)
        weights = np.maximum(values[mandatory], 1e-9)
        centroid = np.average(damaged, axis=0, weights=weights)
        result.update(
            {
                "localBounds": {"min": lo.tolist(), "max": hi.tolist()},
                "normalisedBounds": {
                    "min": (lo / dimensions).tolist(),
                    "max": (hi / dimensions).tolist(),
                },
                "weightedCentroid": centroid.tolist(),
                "axialRange": [float(lo[1]), float(hi[1])],
            }
        )
    return result


def _llm_cache_key(context_text, instruction, model):
    component_id = str(getattr(ghenv.Component, "InstanceGuid", "component"))
    payload = "\n".join(
        (
            PROMPT_CONTRACT_VERSION,
            context_text,
            str(instruction or ""),
            str(model or ""),
        )
    )
    digest = hashlib.sha256(payload.encode("utf-8")).hexdigest()
    return "robarch.agentic_joinery.{}.{}".format(component_id, digest)


def _wake_up(delay=500):
    import Grasshopper

    document = ghenv.Component.OnPingDocument()
    if document:
        document.ScheduleSolution(
            delay,
            Grasshopper.Kernel.GH_Document.GH_ScheduleDelegate(
                lambda _: ghenv.Component.ExpireSolution(False)
            ),
        )


def _start_gemini_job(
    job,
    api_key,
    context,
    instruction,
    model,
    attachments,
    previous=None,
    feedback=None,
):
    job["done"] = False
    job["error"] = None
    job["t0"] = time.time()

    def work():
        try:
            program, response = _request_gemini_joint_program(
                api_key,
                context,
                instruction,
                model,
                attachments=attachments,
                previous=previous,
                feedback=feedback,
            )
            job["program"] = program
            job["response"] = response
        except Exception as exc:
            job["error"] = str(exc)
        finally:
            job["done"] = True

    threading.Thread(target=work, daemon=True).start()


def _box_frame(value):
    plane = value.Plane
    axes = [
        np.array([plane.XAxis.X, plane.XAxis.Y, plane.XAxis.Z], float),
        np.array([plane.YAxis.X, plane.YAxis.Y, plane.YAxis.Z], float),
        np.array([plane.ZAxis.X, plane.ZAxis.Y, plane.ZAxis.Z], float),
    ]
    extents = [float(value.X.Length), float(value.Y.Length), float(value.Z.Length)]
    axis_v = int(np.argmax(extents))
    axis_u, axis_w = (axis_v + 1) % 3, (axis_v + 2) % 3
    U, V = axes[axis_u], axes[axis_v]
    W = np.cross(U, V)
    W /= np.linalg.norm(W)
    intervals = [value.X, value.Y, value.Z]
    origin = (
        np.array([plane.Origin.X, plane.Origin.Y, plane.Origin.Z], float)
        + intervals[0].Min * axes[0]
        + intervals[1].Min * axes[1]
        + intervals[2].Min * axes[2]
    )
    if float(W @ axes[axis_w]) < 0:
        origin = origin + extents[axis_w] * axes[axis_w]
    return {
        "origin": origin.tolist(),
        "u": U.tolist(),
        "v": V.tolist(),
        "w": W.tolist(),
        "width": extents[axis_u],
        "length": extents[axis_v],
        "height": extents[axis_w],
    }


def _xyz(point):
    if hasattr(point, "X"):
        return [float(point.X), float(point.Y), float(point.Z)]
    return [float(point[0]), float(point[1]), float(point[2])]


def _plane_graphics(cut_json, size):
    cut = kernel.Cut.from_json(cut_json)
    origin = cut.origin()
    normal = np.asarray(cut.normal, float)
    normal /= np.linalg.norm(normal)
    point = rg.Point3d(float(origin[0]), float(origin[1]), float(origin[2]))
    vector = rg.Vector3d(float(normal[0]), float(normal[1]), float(normal[2]))
    plane = rg.Plane(point, vector)
    rectangle = rg.Rectangle3d(
        plane, rg.Interval(-size, size), rg.Interval(-size, size)
    ).ToNurbsCurve()
    arrow = rg.LineCurve(point, point + float(0.35 * size) * vector)
    return rectangle, arrow


if bool(globals().get("run")):
    try:
        if globals().get("box") is None:
            raise ValueError("connect the oriented box from BEAM CELLS")
        target_id = str(globals().get("beam_id") or "").strip()
        if not target_id:
            raise ValueError("beam_id is required and must match a Workspace part id")
        raw_centres = list(globals().get("centers") or [])
        raw_damage = list(globals().get("damage") or [])
        if not raw_centres:
            raise ValueError("connect cell centres from BEAM CELLS")
        if len(raw_centres) != len(raw_damage):
            raise ValueError(
                "centres/damage length mismatch: {} vs {}".format(
                    len(raw_centres), len(raw_damage)
                )
            )

        step_id = str(globals().get("repair_step_id") or "").strip() or None
        workspace_value = globals().get("workspace_json")
        workspace = _read_workspace(workspace_value)
        context = joinery_program.workspace_context(
            workspace, target_id, repair_step_id=step_id
        )
        frame = _box_frame(box)
        points = np.asarray([_xyz(point) for point in raw_centres], float)
        values = np.asarray([float(value) for value in raw_damage], float)
        gate = (
            0.5
            if globals().get("threshold") is None
            else float(globals().get("threshold"))
        )
        context["cellularDamage"] = _damage_context(frame, points, values, gate)
        context_json = json.dumps(context, indent=2, ensure_ascii=False)
        gemini_model = str(
            globals().get("gemini_model")
            or os.environ.get("GEMINI_MODEL")
            or MODEL
        ).strip()
        attachments, attachment_report = _evidence_attachments(
            workspace_value, context
        )
        report.extend(attachment_report)
        instruction_text = str(globals().get("instruction") or "")
        signature = _llm_cache_key(context_json, instruction_text, gemini_model)
        program_from_gemini = False
        gemini_job = None
        gemini_key = None
        try:
            program = _unwrap_program(
                globals().get("joint_program_json"), workspace, target_id
            )
            report.append("program source: input or stored Workspace proposal")
        except ValueError:
            gemini_key, key_note = _get_key()
            report.append(key_note)
            if not gemini_key:
                report.append(
                    "STATUS: local LLM context ready for beam {}; no geometry generated yet".format(
                        target_id
                    )
                )
                report.append(
                    "add the key to the reported file, or paste a Gemini response into joint_program_json"
                )
                raise _ContextReady()
            jobs = sc.sticky.setdefault("agentic_joinery_jobs", {})
            job_id = str(ghenv.Component.InstanceGuid)
            gemini_job = jobs.get(job_id)
            if not isinstance(gemini_job, dict) or gemini_job.get("signature") != signature:
                gemini_job = {
                    "signature": signature,
                    "done": False,
                    "error": None,
                    "program": None,
                    "response": None,
                    "revision": 0,
                    "t0": time.time(),
                }
                jobs[job_id] = gemini_job
                _start_gemini_job(
                    gemini_job,
                    gemini_key,
                    context,
                    instruction_text,
                    gemini_model,
                    attachments,
                )
                report.append(
                    "STATUS: Gemini is authoring the JointProgram in the background"
                )
                _wake_up()
                raise _ContextReady()
            if not gemini_job.get("done"):
                report.append(
                    "STATUS: Gemini working, {:.0f} s so far".format(
                        time.time() - float(gemini_job.get("t0") or time.time())
                    )
                )
                _wake_up()
                raise _ContextReady()
            if gemini_job.get("error"):
                raise RuntimeError("Gemini failed: {}".format(gemini_job["error"]))
            program = gemini_job.get("program")
            agent_response = gemini_job.get("response") or {}
            if not isinstance(program, dict):
                raise RuntimeError("Gemini job completed without a JointProgram")
            program_from_gemini = True
            report.append(
                "Gemini authored program directly: {}".format(
                    agent_response.get("summary", "done")
                )
            )
        raw_revisions = globals().get("max_revisions")
        revisions = (
            2
            if raw_revisions is None
            else max(0, min(3, int(raw_revisions)))
        )
        try:
            result, resolved, fit_report = joinery_program.fit_program(
                program,
                frame,
                points,
                values,
                beam_id=target_id,
                threshold=gate,
            )
        except (joinery_program.JointProgramError, ValueError) as exc:
            # Feed executable-contract errors into the bounded Gemini revision
            # cycle instead of terminating the Grasshopper solution.
            result = None
            resolved = program
            fit_report = ["JointProgram validation failed: {}".format(exc)]
        report.extend(fit_report)
        if (
            result is None
            and program_from_gemini
            and gemini_job is not None
            and int(gemini_job.get("revision") or 0) < revisions
        ):
            feedback = joinery_program.proposal_record(resolved, None, fit_report)
            next_revision = int(gemini_job.get("revision") or 0) + 1
            gemini_job["revision"] = next_revision
            _start_gemini_job(
                gemini_job,
                gemini_key,
                context,
                instruction_text,
                gemini_model,
                attachments,
                previous=resolved,
                feedback=feedback,
            )
            report.append(
                "STATUS: Gemini revision {} running after failed damage fit".format(
                    next_revision
                )
            )
            _wake_up()
            raise _ContextReady()
        resolved_program_json = json.dumps(resolved, indent=2, ensure_ascii=False)
        resolved_json = resolved_program_json
        proposal = joinery_program.proposal_record(resolved, result, report)
        proposal_json = json.dumps(proposal, indent=2, ensure_ascii=False)

        if result is None:
            report.append("STATUS: program needs revision; no damage-covering fit found")
        else:
            repair = result["repair"]
            for part in repair["parts"]:
                breps = evaluator.evaluate_part(part)
                if part["name"] == "kept":
                    kept.extend(breps)
                elif part["name"] == "prosthesis":
                    prosthesis.extend(breps)

            predicate_count = int(result["predicate_count"])
            cut_jsons = repair["parts"][0]["cuts"][1 : 1 + predicate_count]
            display_size = 0.75 * max(frame["width"], frame["height"])
            for cut_json in cut_jsons:
                rectangle, arrow = _plane_graphics(cut_json, display_size)
                plane_rectangles.append(rectangle)
                plane_arrows.append(arrow)

            removed = scoring.removed_mask(points, repair)
            removed_cells = [
                raw_centres[index] for index, flag in enumerate(removed) if bool(flag)
            ]
            metrics = joinery_program.anyjoint.result_summary(result)
            report.append(
                "STATUS: AnyJoint passed the current damage and construction contract; "
                "neighbour connections and unmodelled fasteners remain human-review items"
            )
            for question in resolved.get("openQuestions") or []:
                report.append("OPEN QUESTION: {}".format(question))
    except _ContextReady:
        pass
    except Exception as exc:
        report.append("ERROR: {}".format(exc))
else:
    try:
        sc.sticky.get("agentic_joinery_jobs", {}).pop(
            str(ghenv.Component.InstanceGuid), None
        )
    except Exception:
        pass
# ---------- end agentic_joinery_2 ----------
geometry_4 = Geometry(agentic_joinery_2.prosthesis)
volume_2 = Volume(Geometry=geometry_4)  # -> Volume, Centroid
panel_19 = Panel(agentic_joinery_2.report)
scale_2 = Scale(Geometry=geometry_4, Center=volume_2.Centroid, Factor=1.0001)  # -> Geometry, Transform
custom_preview_4 = CustomPreview(Geometry=scale_2.Geometry, Material=ColourSwatch(SwatchColor=RGB(0, 221, 255)))

value_list_5 = ValueList()

list_item = ListItem(List=repair_search.rotation, Index=number_slider_11, Wrap=True)
list_item_2 = ListItem(List=repair_search.side, Index=number_slider_11, Wrap=True)
list_item_3 = ListItem(List=repair_search.scale, Index=number_slider_11, Wrap=True)
list_item_4 = ListItem(List=repair_search.keys, Index=number_slider_11, Wrap=True)
list_item_5 = ListItem(List=repair_search.position, Index=number_slider_11, Wrap=True)
run_3 = BooleanToggle(True)
gh_repair_2 = Python3Script(
    box=beam_cells.box,
    key=list_item_4,
    position=list_item_5,
    rotation=list_item,
    side=list_item_2,
    interface_scale=list_item_3,
    run=run_3)  # -> out, kept, prosthesis, cut_plane, cut_lines, info; inputs box: Box; same code as gh_repair

repair_variations = Python3Script(
    repair_json=repair_brief.repair_json,
    instruction="checked",
    variation_count=Slider(3, range=0..10),
    generate=Button(),
    reset=Button(),
    picker=value_list_5,
    refresh=Button(),
    box=beam_cells.box,
    centers=cell_example_damage.centers,
    damage=cell_example_damage.damage,
    threshold=Slider(0.5, range=0..1),
    execute_all=Button())  # -> out, candidate_set_json, selection_json, candidate_id, candidate_ids, candidate_json, candidate_code, summary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; inputs box: Box, centers: list of Point3d, damage: list of Double
# ---------- repair_variations: Python ----------
# r: google-genai==1.47.0
# r: numpy
"""GH Python 3 -- 03 VARIATIONS: author one joint and browse local studies.

Inputs: repair_json, instruction, gemini_model, variation_count, generate,
        reset, picker, refresh, box, centers, damage, threshold,
        neighbour_geometry, neighbour_ids, execute_all, repo
Outputs: candidate_set_json, selection_json, candidate_id, candidate_ids,
         candidate_json, candidate_code, summary, kept, prosthesis, frames, other,
         candidate_geometry, execution_json, report

`frames` contains the active cutting-plane rectangles and direction arrows. `other`
is the same list for canvases that still use the old output name.
"""

import json
import os
import sys


def _repo_root():
    starts = [globals().get("repo"), os.environ.get("ROBARCH_REPO")]
    try:
        starts.append(os.path.dirname(str(ghenv.Component.OnPingDocument().FilePath or "")))
    except Exception:
        pass
    starts.extend([os.getcwd(), *sys.path])
    for start in starts:
        if not start or "://" in str(start):
            continue
        folder = os.path.abspath(os.path.expanduser(str(start)))
        if os.path.isfile(folder):
            folder = os.path.dirname(folder)
        for _ in range(9):
            if os.path.isdir(os.path.join(folder, "src", "workshop_robarch_2026")):
                return folder
            parent = os.path.dirname(folder)
            if parent == folder:
                break
            folder = parent
    raise RuntimeError("workshop repository not found; connect its folder to repo")


def _list(value):
    if value is None:
        return []
    try:
        return list(value)
    except TypeError:
        return [value]


def _value(value):
    try:
        return str(json.loads(str(value)))
    except Exception:
        return str(value).strip().strip('"')


def _fill_picker(options):
    import Grasshopper.Kernel.Special as ghs

    parameter = next((p for p in ghenv.Component.Params.Input if p.NickName == "picker"), None)
    source = next((s for s in (parameter.Sources if parameter else []) if isinstance(s, ghs.GH_ValueList)), None)
    if source is None:
        raise ValueError("wire a Grasshopper Value List into picker")
    previous = _value(source.SelectedItems[0].Value) if source.SelectedItems.Count else None
    ids = [item[1] for item in options]
    selected = previous if previous in ids else ids[0]
    current = [(str(item.Name), _value(item.Value)) for item in source.ListItems]
    if current != options:
        source.ListItems.Clear()
        for label, item_id in options:
            source.ListItems.Add(ghs.GH_ValueListItem(label, json.dumps(item_id)))
        source.SelectItem(ids.index(selected))
        source.ExpireSolution(True)
        return selected, True
    return selected, False


def _clear_picker():
    import Grasshopper.Kernel.Special as ghs

    parameter = next((p for p in ghenv.Component.Params.Input if p.NickName == "picker"), None)
    source = next((s for s in (parameter.Sources if parameter else []) if isinstance(s, ghs.GH_ValueList)), None)
    if source is not None and source.ListItems.Count:
        source.ListItems.Clear()
        source.ExpireSolution(True)


candidate_set_json = selection_json = candidate_id = ""
candidate_json = candidate_code = summary = execution_json = ""
candidate_ids = []
kept = prosthesis = frames = other = candidate_geometry = []
report = ["03 Repair Variations"]

try:
    root = _repo_root()
    source_path = os.path.join(root, "src")
    if source_path not in sys.path:
        sys.path.append(source_path)
    for name in list(sys.modules):
        if name == "workshop_robarch_2026" or name.startswith("workshop_robarch_2026."):
            sys.modules.pop(name, None)
    from workshop_robarch_2026 import (
        candidate_runtime, grasshopper_jobs, llm_candidate, plane_variations,
        repair_variations, workshop_flow,
    )

    repair = workshop_flow.validate_repair(globals().get("repair_json"))
    session, context, brief = repair["session"], repair["context"], repair["brief"]
    runtime_box = candidate_runtime.box_from_context(context, globals().get("box"))
    centers_value = _list(globals().get("centers"))
    damage_value = _list(globals().get("damage"))
    neighbours = _list(globals().get("neighbour_geometry"))
    neighbour_names = [str(value) for value in _list(globals().get("neighbour_ids"))]
    gate = 0.5 if globals().get("threshold") is None else float(threshold)
    count = max(2, min(8, int(globals().get("variation_count") or 5)))
    model = str(globals().get("gemini_model") or llm_candidate.DEFAULT_MODEL)
    instruction_value = str(globals().get("instruction") or "")
    damage_summary = repair_variations.damage_context(
        runtime_box, centers_value, damage_value, gate
    )
    fit_probe = {
        "frame": plane_variations.box_frame(runtime_box),
        "centers": [[float(point.X), float(point.Y), float(point.Z)] for point in centers_value],
        "damage": [float(value) for value in damage_value],
        "threshold": gate,
    }
    reset_value = bool(globals().get("reset"))
    if reset_value:
        grasshopper_jobs.clear_job(ghenv.Component, "repair_variations_author")
        grasshopper_jobs.clear_job(ghenv.Component, "repair_variations_explore")

    author_signature = llm_candidate.stable_signature(
        "repair-variations-v7", repair["recordHash"], instruction_value, model, count
    )
    author_state = grasshopper_jobs.background_step(
        ghenv.Component,
        "repair_variations_author",
        author_signature,
        lambda: repair_variations.author_joint(
            root, session, context, brief, damage_summary, fit_probe,
            instruction_value, model, count,
        ),
        trigger=bool(globals().get("generate")),
        reset=reset_value,
    )
    report.append("author: " + author_state.get("status", "idle"))
    if author_state.get("error"):
        report.append("AUTHOR ERROR: " + author_state["error"])
        _clear_picker()
    source = author_state.get("result")

    if source:
        source = repair_variations.validate_source(source)
        candidate_set_json = json.dumps(source, indent=2, ensure_ascii=False)
        report.append("one six-plane joint authored in {} pass(es)".format(source["authoringAttempts"]))
        if source.get("summary"):
            report.append("concept: " + source["summary"])
        report.extend("author warning: " + value for value in (source.get("warnings") or []))
        execute_signature = candidate_runtime.runtime_signature(
            "repair-explore-v8", source, runtime_box, centers_value, damage_value,
            gate, count, neighbours, neighbour_names,
        )

        def execute_set():
            explored = repair_variations.explore(
                source, runtime_box, centers_value, damage_value, gate, count
            )
            runs = {}
            for variation in explored["variations"]:
                result = {
                    "kept": variation["kept"],
                    "prosthesis": variation["prosthesis"],
                    "other": [],
                    "resolvedProgram": variation["resolvedProgram"],
                    "fit": variation["fit"],
                    "report": variation["report"] + [variation["analysis"]["text"]],
                }
                result["fit"]["variationAnalysis"] = variation["analysis"]
                manifest, code, geometry, entities, execution = plane_variations.selection_payload(
                    result, brief, session, runtime_box, centers_value, damage_value,
                    gate, neighbours, neighbour_names,
                )
                entity = candidate_runtime.entity_envelope(execution, entities)
                selection = workshop_flow.selection_record(
                    manifest, code, entity, execution, source["sourceHash"]
                )
                runs[variation["id"]] = {
                    "result": result, "frames": variation["frames"],
                    "rank": variation["rank"],
                    "analysis": variation["analysis"], "manifest": manifest,
                    "code": code, "geometry": geometry, "selection": selection,
                    "execution": execution,
                }
            explored["runs"] = runs
            return explored

        execute_state = grasshopper_jobs.automatic_step(
            ghenv.Component, "repair_variations_explore", execute_signature,
            execute_set,
        )
        report.append("fit: " + execute_state.get("status", "idle"))
        if execute_state.get("error"):
            report.append("EXECUTION ERROR: " + execute_state["error"])
        if execute_state.get("message"):
            report.append(execute_state["message"])
        explored = execute_state.get("result") or {}
        runs = explored.get("runs") or {}
        if runs:
            report.append(
                "{} studies evaluated: {} full coverage, {} produced exact Breps".format(
                    explored.get("fitCount", 0), explored.get("fullCoverageCount", 0), len(runs)
                )
            )
            failure_counts = {}
            for failure in explored.get("failures") or []:
                stage = failure.get("stage", "unknown")
                failure_counts[stage] = failure_counts.get(stage, 0) + 1
            if failure_counts:
                report.append("skipped: " + ", ".join(
                    "{} {}".format(value, key) for key, value in sorted(failure_counts.items())
                ))
            options = []
            for item_id, value in runs.items():
                analysis = value["analysis"]
                transform = analysis.get("transform") or {}
                study_name = str(transform.get("summary") or "angle study")
                label = "{:02d} | damage {}/{} | sound {}/{} | {}".format(
                    int(value.get("rank") or 0),
                    analysis["requiredDamageRemoved"], analysis["requiredDamageCount"],
                    analysis["soundRemoved"], analysis["soundCount"],
                    study_name[:42],
                )
                options.append((label, item_id))
            candidate_ids = [item[1] for item in options]
            candidate_id = str(globals().get("picker") or "").strip()
            try:
                dropdown_id, changed = _fill_picker(options)
                if changed or candidate_id not in candidate_ids:
                    candidate_id = dropdown_id
                if changed:
                    report.append("variation dropdown updated")
            except Exception as exc:
                if candidate_id not in candidate_ids:
                    candidate_id = candidate_ids[0]
                report.append("picker: {}".format(exc))
        run = runs.get(candidate_id) or {}
        if run:
            result = run["result"]
            kept, prosthesis, frames = result["kept"], result["prosthesis"], run["frames"]
            other = frames
            candidate_geometry = run["geometry"]
            candidate_json = json.dumps(run["manifest"], indent=2, ensure_ascii=False)
            candidate_code = run["code"]
            selection_json = json.dumps(run["selection"], indent=2, ensure_ascii=False)
            execution_json = json.dumps(run["execution"], indent=2, ensure_ascii=False)
            summary = run["analysis"]["text"]
            report.append("selected: {} Kept, {} Prosthesis, {} frame curves".format(
                len(kept), len(prosthesis), len(frames)
            ))
            report.append(summary)
            report.append("selected id: " + candidate_id)
except Exception as exc:
    report.append("ERROR: {}".format(exc))
# ---------- end repair_variations ----------
report = Panel(repair_variations.report)
panel_20 = Panel(repair_variations.candidate_json)

panel_21 = Panel(gh_repair_2.info)
geometry_5 = Geometry(gh_repair_2.kept)
geometry_6 = Geometry(gh_repair_2.prosthesis)
curve_2 = Curve(gh_repair_2.cut_lines)
plane_2 = Plane(gh_repair_2.cut_plane)
custom_preview_lineweights_3 = CustomPreviewLineweights(Geometry=curve_2, Shader=ColourSwatch(SwatchColor=RGB(255, 68, 0)), Thickness=5, Absolute=False)
geometry_7 = Geometry(repair_variations.prosthesis)

# ---- group: Move the Prosthesis
unit_y_2 = UnitY(Factor=Slider(0, range=-1..1))
move_2 = Move(Geometry=geometry_6, Motion=unit_y_2)  # -> Geometry, Transform

# ----
repair_candidate_author = Python3Script()  # -> out, a; unedited script template
repair_candidate_gallery = Python3Script()  # -> out, a; unedited script template

# ---- group: Grain Visualisation / Run
run_4 = BooleanToggle(True)

# ---- group: Grain Visualisation
number_slider_12 = Slider(0.0001, range=0..0.005)
illustration_2 = Python3Script(pieces=[geometry_5, move_2.Geometry], density=Slider(0.6, range=0..5), lift=number_slider_12, run=run_4)  # -> out, visible, hidden, grain, report; inputs pieces: list of Brep; same code as illustration
edges_prosthesis_2 = Python3Script(pieces=move_2.Geometry, lift=number_slider_12)  # -> out, edges, report; inputs pieces: Brep; same code as edges_prosthesis
panel_22 = Panel(illustration_2.report)
custom_preview_5 = CustomPreview(Geometry=[illustration_2.grain, edges_prosthesis_2.edges], Material=ColourSwatch(SwatchColor=RGB(145, 145, 145)))

# ----
volume_3 = Volume(Geometry=move_2.Geometry)  # -> Volume, Centroid
scale_3 = Scale(Geometry=move_2.Geometry, Center=volume_3.Centroid, Factor=1.01)  # -> Geometry, Transform

# ---- group: Prosthesis Visualisation
create_material_2 = CreateMaterial(
    Diffuse=ColourSwatch(SwatchColor=RGB(0, 0, 0)),
    Specular=RGB(255, 255, 255),
    Emission=RGB(0, 0, 0),
    Transparency=0,
    Shine=0)
custom_preview_lineweights_4 = CustomPreviewLineweights(Geometry=scale_3.Geometry, Shader=create_material_2, Thickness=Slider(7.1, range=0..10), Absolute=False)

# ----
python_3_script_3 = Python3Script()  # -> out, a; unedited script template

# ---- group: Kept Visualisation
custom_preview_6 = CustomPreview(Geometry=[geometry_5, select_beam.rest], Material=ColourSwatch(SwatchColor=RGBA(0, 0, 0, 0)))

custom_preview_7 = CustomPreview(Geometry=geometry_5, Material=ColourSwatch(SwatchColor=RGBA(0, 0, 0, 0)))
