# Grasshopper definition repair_joint_selection_MANUAL_UsingCatalogJoinery.gh (Grasshopper 1.0.8)
# plug-ins: Human

# ---- group: Joint Picker
value_list = ValueList({"PJ1 – Surface Patch": "PJ1", "PJ2 – Bowtie Key": "PJ2", "PJ3 – Arris Patch": "PJ3", "PJ4 – Cheek Patch": "PJ4", "SJ1 – Half Lap Joint": "SJ1", "SJ2 – Undersquinted Half Lap Joint": "SJ2", "SJ3 – Spear Point Half Lap Joint": "SJ3", "SJ4 – Undersquinted Spear Point Half Lap Joint": "SJ4", "SJ5 – Splayed Scarf Joint": "SJ5", "SJ6 – Half Lap Joint with Mitered Ends": "SJ6", "SJ8 – Lapped Dovetail Joint": "SJ7"}, selected="SJ2 – Undersquinted Half Lap Joint")
refresh = Python3Script(refresh=Button(), picker=value_list)  # -> out, keys, report
# ---------- refresh: Python ----------
"""GH Python 3 -- JOINT PICKER: auto-fill a Value List from the catalogue.

Wire a Value List component INTO `picker`, set `refresh` True once.
The Value List then shows every joint in data/corpus/joints/ (label from the
datasheet's first line, value = the key). Wire that same Value List into
gh_repair's `key`. Re-run refresh after authoring a new joint.

Inputs:
    picker   (no type hint needed -- only its wire matters)
    refresh  (bool)
Outputs:
    keys, report
"""
import sys, os

REPO = r"C:\Users\tizian\workspace\projects\workshop_robarch_2026"
SRC = os.path.join(REPO, "src")
if SRC not in sys.path:
    sys.path.append(SRC)
for m in list(sys.modules):
    if m.startswith("workshop_robarch_2026"):
        sys.modules.pop(m)

from workshop_robarch_2026 import joints
import Grasshopper.Kernel.Special as ghs

keys = joints.list_keys(REPO)
report = ["{} joint(s): {}".format(len(keys), ", ".join(keys) or "-")]


def _label(key):
    md = joints.load_datasheet(REPO, key)
    for line in md.splitlines():
        line = line.strip().lstrip("#").strip()
        if line:
            return line          # e.g. "SW2 -- Half lap with mitered ends"
    return key

if refresh and keys:
    filled = False
    try:
        picker_param = None
        for prm in ghenv.Component.Params.Input:
            if prm.NickName == "picker":
                picker_param = prm
                break
        for src in (picker_param.Sources if picker_param else []):
            if isinstance(src, ghs.GH_ValueList):
                sel = None
                if src.SelectedItems.Count > 0:
                    sel = str(src.SelectedItems[0].Value).strip('"')
                src.ListItems.Clear()
                for k in keys:
                    src.ListItems.Add(
                        ghs.GH_ValueListItem(_label(k), '"{}"'.format(k)))
                # keep the previous selection if it still exists
                for i, k in enumerate(keys):
                    if k == sel:
                        src.SelectItem(i)
                        break
                src.ExpireSolution(True)
                filled = True
    except Exception as exc:
        report.append("could not fill Value List: {}".format(exc))
    report.append("dropdown filled" if filled
                  else "wire a Value List INTO `picker`")
# ---------- end refresh ----------
panel = Panel(refresh.report)

# ---- group: Beams
brep = Brep([<brep referenced from the Rhino model> x23])

# ----
steps_degrees = Panel("5")
value_list_2 = ValueList({"far end": "1", "near end": "-1"}, selected="near end")
multiplication = Multiplication(A=Slider(33, range=0..72), B=steps_degrees)

python_3_script = Python3Script(beams=brep, index=Slider(16, range=0..100))  # -> out, box, selected, rest, report; inputs beams: list of Brep
# ---------- python_3_script: Python ----------
"""GH Python 3 -- SELECT BEAM: pick one member of an assembly for repair.

Takes all beams of the model, fits a tight ORIENTED bounding box to each
(correct for diagonal braces, not just axis-aligned members), and lets you
select one by index. The selected member leaves as a Box for gh_repair;
all other members pass through unchanged.

OBB strategy: for prismatic members the optimal box is aligned to one of
the planar faces and one of that face's edges -- we test those candidate
frames and keep the smallest-volume box. Exact for typical timber.

Inputs:
    beams  (Brep, list)   all members of the assembly
    index  (int)          which member to repair (see report for the list)
    run    (bool)
Outputs:
    box       oriented Box of the selected member -> gh_repair `box`
    selected  the selected member's original Brep (reference overlay)
    rest      all other members, unchanged
    report    per-member dimensions, so the index is informed
"""
import Rhino.Geometry as rg
from Grasshopper import DataTree
from Grasshopper.Kernel.Data import GH_Path

box = None
selected = None
rest = DataTree[object]()
report = []
run = 'TRUE'

def _obb_axis_first(b, tol=0.001):
    """Deterministic for prismatic members: long axis = longest edge;
    second axis = a side-face normal perpendicular to it."""
    axis = None
    best_len = 0.0
    for e in b.Edges:
        d = e.PointAtEnd - e.PointAtStart
        if d.Length > best_len:
            best_len = d.Length
            axis = d
    if axis is None or best_len < 1e-9:
        return None
    axis.Unitize()
    side_n = None
    for f in b.Faces:
        ok, plane = f.TryGetPlane(tol)
        if ok and abs(plane.Normal * axis) < 0.05:
            side_n = plane.Normal
            break
    if side_n is None:
        return None
    y = rg.Vector3d.CrossProduct(side_n, axis)
    y.Unitize()
    frame = rg.Plane(rg.Point3d.Origin, axis, y)
    bb = b.GetBoundingBox(frame)
    cand = rg.Box(frame, bb)
    return cand if cand.IsValid else None


def _obb(b, tol=0.001):
    ax = _obb_axis_first(b, tol)
    if ax is not None:
        return ax, "axis"
    best = None
    best_vol = None
    # candidate frames from planar faces + their edge directions
    for f in b.Faces:
        ok, plane = f.TryGetPlane(tol)
        if not ok:
            continue
        n = plane.Normal
        for e in b.Edges:
            d = e.PointAtEnd - e.PointAtStart
            if d.Length < 1e-9:
                continue
            d.Unitize()
            if abs(d * n) > 1e-3:      # edge not in the face plane family
                continue
            y = rg.Vector3d.CrossProduct(n, d)
            if y.Length < 1e-9:
                continue
            y.Unitize()
            frame = rg.Plane(rg.Point3d.Origin, d, y)
            bb = b.GetBoundingBox(frame)
            cand = rg.Box(frame, bb)
            if not cand.IsValid:
                continue
            vol = cand.Volume
            if best_vol is None or vol < best_vol - 1e-12:
                best_vol, best = vol, cand
    if best is None:                    # fallback: world-aligned
        return rg.Box(b.GetBoundingBox(True)), "world"
    return best, "search"


if run and beams:
    try:
        bs = beams if isinstance(beams, list) else [beams]
        bs = [b for b in bs if b is not None]
        if not bs:
            raise ValueError("no valid breps in `beams`")
        i = int(index or 0) % len(bs)
        report.append("received {} member(s)".format(len(bs)))
        for j, b in enumerate(bs):
            if j == i:
                ob, how = _obb(b)
                box = ob
                selected = b
                ext = sorted([ob.X.Length, ob.Y.Length, ob.Z.Length])
                report.append(">> [{}] SELECTED  {:.0f} x {:.0f} x {:.0f} mm"
                              "  (obb: {})".format(
                                  j, ext[0] * 1000, ext[1] * 1000,
                                  ext[2] * 1000, how))
            else:
                rest.Add(b, GH_Path(0))
        # listing for orientation
        for j, b in enumerate(bs):
            if j == i:
                continue
            bb = b.GetBoundingBox(True)
            d = bb.Diagonal
            report.append("   [{}] approx {:.0f} x {:.0f} x {:.0f} mm".format(
                j, abs(d.X) * 1000, abs(d.Y) * 1000, abs(d.Z) * 1000))
    except Exception as exc:
        report.append("ERROR: {}".format(exc))
else:
    report.append("wire all members into `beams`, choose `index`, set run")
# ---------- end python_3_script ----------

# ---- group: Run
run = BooleanToggle(True)

# ----
gh_repair = Python3Script(
    box=python_3_script.box,
    key=value_list,
    position=Slider(0.43, range=0..1),
    rotation=multiplication,
    side=value_list_2,
    interface_scale=Slider(1, range=0.5..5),
    run=run)  # -> out, kept, prosthesis, cut_plane, cut_lines, info; inputs box: Box
# ---------- gh_repair: Python ----------
"""LOADER for the repair component. Edit the real code in
rhino/components/gh_repair.py; re-toggle run to reload.
Inputs:  box (Box), key (str), position (float 0..1),
         rotation (float, degrees), side (int +1/-1),
         interface_scale (float), run (bool)
Outputs: kept, prosthesis, cut_plane, cut_lines, info"""
# r: roslibpy
import os
SCRIPT = "gh_repair.py"


def _find_repo():
    marker = os.path.join("src", "workshop_robarch_2026")
    p = os.environ.get("ROBARCH_REPO")
    if p and os.path.isdir(os.path.join(p, marker)):
        return p
    try:
        d = os.path.dirname(ghenv.Component.OnPingDocument().FilePath or "")
        while d and len(d) > 3:
            if os.path.isdir(os.path.join(d, marker)):
                return d
            d = os.path.dirname(d)
    except Exception:
        pass
    try:
        import workshop_robarch_2026 as _w
        return os.path.abspath(os.path.join(
            os.path.dirname(_w.__file__), "..", ".."))
    except ImportError:
        pass
    home = os.path.expanduser("~")
    for c in (os.path.join(home, "workspace", "projects",
                           "workshop_robarch_2026"),
              os.path.join(home, "Documents", "workshop_robarch_2026")):
        if os.path.isdir(os.path.join(c, marker)):
            return c
    raise RuntimeError("repo not found: save this .gh inside the repo or "
                       "set the ROBARCH_REPO environment variable")

_p = os.path.join(_find_repo(), "rhino", "components", SCRIPT)
exec(compile(open(_p, encoding="utf-8").read(), _p, "exec"))
# ---------- end gh_repair ----------
panel_2 = Panel(gh_repair.info)
geometry = Geometry(gh_repair.kept)
geometry_2 = Geometry(gh_repair.prosthesis)
curve = Curve(gh_repair.cut_lines)
plane = Plane(gh_repair.cut_plane)
custom_preview_lineweights = CustomPreviewLineweights(Geometry=curve, Shader=ColourSwatch(SwatchColor=RGB(255, 68, 0)), Thickness=5, Absolute=False)

# ---- group: Prosthesis Visualisation
unit_y = UnitY(Factor=Slider(0, range=-1..1))
move = Move(Geometry=geometry_2, Motion=unit_y)  # -> Geometry, Transform
volume = Volume(Geometry=move.Geometry)  # -> Volume, Centroid
scale = Scale(Geometry=move.Geometry, Center=volume.Centroid, Factor=1.001)  # -> Geometry, Transform
create_material = CreateMaterial(
    Diffuse=ColourSwatch(SwatchColor=RGB(0, 0, 0)),
    Specular=RGB(255, 255, 255),
    Emission=RGB(0, 0, 0),
    Transparency=0,
    Shine=0)
custom_preview_lineweights_2 = CustomPreviewLineweights(Geometry=scale.Geometry, Shader=create_material, Thickness=Slider(7.1, range=0..10), Absolute=False)

# ---- group: Kept Visualisation
custom_preview = CustomPreview(Geometry=[geometry, python_3_script.rest], Material=ColourSwatch(SwatchColor=RGBA(0, 0, 0, 53)))
