# Grasshopper definition repair_joint_selection_V2.gh (Grasshopper 1.0.8)
# plug-ins: Human

# ---- group: Joint Picker
value_list = ValueList({"SW1", "SW2 – Stehendes gerades Blatt mit beidseitig schrägem Stoß": "SW2"}, selected="SW1")
refresh = Python3Script(refresh=Button(), picker=value_list)  # -> out, keys, report
# ---------- refresh: Python ----------
"""GH Python 3 -- JOINT PICKER: auto-fill a Value List from the catalogue.

Wire a Value List component INTO `picker`, set `refresh` True once.
The Value List then shows every joint in data/corpus/joints/ (label from the
datasheet's first line, value = the key). Wire that same Value List into
gh_repair's `key`. Re-run refresh after authoring a new joint.

Inputs:
    picker   (no type hint needed -- only its wire matters)
    refresh  (bool)
Outputs:
    keys, report
"""
import sys, os

REPO = r"C:\Users\tizian\workspace\projects\workshop_robarch_2026"
SRC = os.path.join(REPO, "src")
if SRC not in sys.path:
    sys.path.append(SRC)
for m in list(sys.modules):
    if m.startswith("workshop_robarch_2026"):
        sys.modules.pop(m)

from workshop_robarch_2026 import joints
import Grasshopper.Kernel.Special as ghs

keys = joints.list_keys(REPO)
report = ["{} joint(s): {}".format(len(keys), ", ".join(keys) or "-")]


def _label(key):
    md = joints.load_datasheet(REPO, key)
    for line in md.splitlines():
        line = line.strip().lstrip("#").strip()
        if line:
            return line          # e.g. "SW2 -- Half lap with mitered ends"
    return key

if refresh and keys:
    filled = False
    try:
        picker_param = None
        for prm in ghenv.Component.Params.Input:
            if prm.NickName == "picker":
                picker_param = prm
                break
        for src in (picker_param.Sources if picker_param else []):
            if isinstance(src, ghs.GH_ValueList):
                sel = None
                if src.SelectedItems.Count > 0:
                    sel = str(src.SelectedItems[0].Value).strip('"')
                src.ListItems.Clear()
                for k in keys:
                    src.ListItems.Add(
                        ghs.GH_ValueListItem(_label(k), '"{}"'.format(k)))
                # keep the previous selection if it still exists
                for i, k in enumerate(keys):
                    if k == sel:
                        src.SelectItem(i)
                        break
                src.ExpireSolution(True)
                filled = True
    except Exception as exc:
        report.append("could not fill Value List: {}".format(exc))
    report.append("dropdown filled" if filled
                  else "wire a Value List INTO `picker`")
# ---------- end refresh ----------
panel = Panel(refresh.report)

# ---- group: Beams
brep = Brep([<brep referenced from the Rhino model> x17])

# ----
steps_degrees = Panel("15")
value_list_2 = ValueList({"far end": "1", "near end": "-1"}, selected="near end")
multiplication = Multiplication(A=Slider(0, range=0..72), B=steps_degrees)

# ---- group: Run
run = BooleanToggle(True)

# ----
python_3_script = Python3Script(beams=brep, index=Slider(3, range=0..100))  # -> out, box, selected, rest, report; inputs beams: list of Brep
# ---------- python_3_script: Python ----------
"""GH Python 3 -- SELECT BEAM: pick one member of an assembly for repair.

Takes all beams of the model, fits a tight ORIENTED bounding box to each
(correct for diagonal braces, not just axis-aligned members), and lets you
select one by index. The selected member leaves as a Box for gh_repair;
all other members pass through unchanged.

OBB strategy: for prismatic members the optimal box is aligned to one of
the planar faces and one of that face's edges -- we test those candidate
frames and keep the smallest-volume box. Exact for typical timber.

Inputs:
    beams  (Brep, list)   all members of the assembly
    index  (int)          which member to repair (see report for the list)
    run    (bool)
Outputs:
    box       oriented Box of the selected member -> gh_repair `box`
    selected  the selected member's original Brep (reference overlay)
    rest      all other members, unchanged
    report    per-member dimensions, so the index is informed
"""
import Rhino.Geometry as rg
from Grasshopper import DataTree
from Grasshopper.Kernel.Data import GH_Path

box = None
selected = None
rest = DataTree[object]()
report = []
run = 'TRUE'

def _obb_axis_first(b, tol=0.001):
    """Deterministic for prismatic members: long axis = longest edge;
    second axis = a side-face normal perpendicular to it."""
    axis = None
    best_len = 0.0
    for e in b.Edges:
        d = e.PointAtEnd - e.PointAtStart
        if d.Length > best_len:
            best_len = d.Length
            axis = d
    if axis is None or best_len < 1e-9:
        return None
    axis.Unitize()
    side_n = None
    for f in b.Faces:
        ok, plane = f.TryGetPlane(tol)
        if ok and abs(plane.Normal * axis) < 0.05:
            side_n = plane.Normal
            break
    if side_n is None:
        return None
    y = rg.Vector3d.CrossProduct(side_n, axis)
    y.Unitize()
    frame = rg.Plane(rg.Point3d.Origin, axis, y)
    bb = b.GetBoundingBox(frame)
    cand = rg.Box(frame, bb)
    return cand if cand.IsValid else None


def _obb(b, tol=0.001):
    ax = _obb_axis_first(b, tol)
    if ax is not None:
        return ax, "axis"
    best = None
    best_vol = None
    # candidate frames from planar faces + their edge directions
    for f in b.Faces:
        ok, plane = f.TryGetPlane(tol)
        if not ok:
            continue
        n = plane.Normal
        for e in b.Edges:
            d = e.PointAtEnd - e.PointAtStart
            if d.Length < 1e-9:
                continue
            d.Unitize()
            if abs(d * n) > 1e-3:      # edge not in the face plane family
                continue
            y = rg.Vector3d.CrossProduct(n, d)
            if y.Length < 1e-9:
                continue
            y.Unitize()
            frame = rg.Plane(rg.Point3d.Origin, d, y)
            bb = b.GetBoundingBox(frame)
            cand = rg.Box(frame, bb)
            if not cand.IsValid:
                continue
            vol = cand.Volume
            if best_vol is None or vol < best_vol - 1e-12:
                best_vol, best = vol, cand
    if best is None:                    # fallback: world-aligned
        return rg.Box(b.GetBoundingBox(True)), "world"
    return best, "search"


if run and beams:
    try:
        bs = beams if isinstance(beams, list) else [beams]
        bs = [b for b in bs if b is not None]
        if not bs:
            raise ValueError("no valid breps in `beams`")
        i = int(index or 0) % len(bs)
        report.append("received {} member(s)".format(len(bs)))
        for j, b in enumerate(bs):
            if j == i:
                ob, how = _obb(b)
                box = ob
                selected = b
                ext = sorted([ob.X.Length, ob.Y.Length, ob.Z.Length])
                report.append(">> [{}] SELECTED  {:.0f} x {:.0f} x {:.0f} mm"
                              "  (obb: {})".format(
                                  j, ext[0] * 1000, ext[1] * 1000,
                                  ext[2] * 1000, how))
            else:
                rest.Add(b, GH_Path(0))
        # listing for orientation
        for j, b in enumerate(bs):
            if j == i:
                continue
            bb = b.GetBoundingBox(True)
            d = bb.Diagonal
            report.append("   [{}] approx {:.0f} x {:.0f} x {:.0f} mm".format(
                j, abs(d.X) * 1000, abs(d.Y) * 1000, abs(d.Z) * 1000))
    except Exception as exc:
        report.append("ERROR: {}".format(exc))
else:
    report.append("wire all members into `beams`, choose `index`, set run")
# ---------- end python_3_script ----------
gh_repair = Python3Script(
    box=python_3_script.box,
    key=value_list,
    position=Slider(0.4, range=0..1),
    rotation=multiplication,
    side=value_list_2,
    interface_scale=Slider(1.67, range=0.5..5),
    run=run)  # -> out, kept, prosthesis, cut_plane, cut_lines, info; inputs box: Box
# ---------- gh_repair: Python ----------
"""LOADER for the repair component. Edit the real code in
rhino/components/gh_repair.py; re-toggle run to reload.
Inputs:  box (Box), key (str), position (float 0..1),
         rotation (float, degrees), side (int +1/-1),
         interface_scale (float), run (bool)
Outputs: kept, prosthesis, cut_plane, cut_lines, info"""
# r: roslibpy
import os
SCRIPT = "gh_repair.py"


def _find_repo():
    marker = os.path.join("src", "workshop_robarch_2026")
    p = os.environ.get("ROBARCH_REPO")
    if p and os.path.isdir(os.path.join(p, marker)):
        return p
    try:
        d = os.path.dirname(ghenv.Component.OnPingDocument().FilePath or "")
        while d and len(d) > 3:
            if os.path.isdir(os.path.join(d, marker)):
                return d
            d = os.path.dirname(d)
    except Exception:
        pass
    try:
        import workshop_robarch_2026 as _w
        return os.path.abspath(os.path.join(
            os.path.dirname(_w.__file__), "..", ".."))
    except ImportError:
        pass
    home = os.path.expanduser("~")
    for c in (os.path.join(home, "workspace", "projects",
                           "workshop_robarch_2026"),
              os.path.join(home, "Documents", "workshop_robarch_2026")):
        if os.path.isdir(os.path.join(c, marker)):
            return c
    raise RuntimeError("repo not found: save this .gh inside the repo or "
                       "set the ROBARCH_REPO environment variable")

_p = os.path.join(_find_repo(), "rhino", "components", SCRIPT)
exec(compile(open(_p, encoding="utf-8").read(), _p, "exec"))
# ---------- end gh_repair ----------
panel_2 = Panel(gh_repair.info)
geometry = Geometry(gh_repair.kept)
geometry_2 = Geometry(gh_repair.prosthesis)
curve = Curve(gh_repair.cut_lines)
plane = Plane(gh_repair.cut_plane)
custom_preview_lineweights = CustomPreviewLineweights(Geometry=curve, Shader=ColourSwatch(SwatchColor=RGB(255, 0, 0)), Thickness=5, Absolute=False)

# ---- group: Move the Prosthesis
unit_y = UnitY(Factor=Slider(0, range=0..1))
move = Move(Geometry=geometry_2, Motion=unit_y)  # -> Geometry, Transform

# ---- group: Grain Visualisation / Run
run_2 = BooleanToggle(True)

# ---- group: Grain Visualisation
number_slider = Slider(0.0001, range=0..0.005)
illustration = Python3Script(pieces=[geometry, move.Geometry], density=Slider(0.8, range=0..5), lift=number_slider, run=run_2)  # -> out, visible, hidden, grain, report; inputs pieces: list of Brep
# ---------- illustration: Python ----------
"""GH Python 3 -- GRAIN v3: 3D wood-grain curves for the catalogue look.

Live companion to the "Katalog" display mode (white shading, black edges,
dashed hidden lines): generates real 3D grain curves ON the faces of the
pieces, lifted a hair off the surface. Solids occlude their own back-face
grain naturally -- nothing is view-dependent.

Grain by face type (angle between face normal and beam axis):
    |dot| >  end_threshold [0.15] -> growth-ring CYLINDERS around the piece's
        pith line, intersected with the face plane: circles on square cuts,
        stretched ovals on miters and scarf cheeks (anatomically continuous)
    |dot| <= end_threshold        -> longitudinal flowing lines

v3: clipping fully vectorized in 2D face space (numpy) -- no per-point
RhinoCommon calls; expect ~5-10x faster than v2.

Inputs:
    pieces        (Brep, list)
    axis          (Vector)  beam axis; empty -> longest bbox direction
    density       (float) [1.0]
    lift          (float) [auto = 0.0004 x bbox diagonal]
    end_threshold (float) [0.85] faces with |dot| above this get rings
    run           (bool)
Outputs:
    grain, report
"""
import sys, os, math, random

REPO = r"C:\Users\tizian\workspace\projects\workshop_robarch_2026"
SRC = os.path.join(REPO, "src")
if SRC not in sys.path:
    sys.path.append(SRC)

import numpy as np
import Rhino
import Rhino.Geometry as rg
from Grasshopper import DataTree
from Grasshopper.Kernel.Data import GH_Path

GRAIN_V = "14"
grain = DataTree[object]()
report = []


def _face_plane(face):
    ok, plane = face.TryGetPlane(0.001)
    return plane if ok else None


def _loops_2d(face, plane):
    loops = []
    for lp in face.Loops:
        c = lp.To3dCurve()
        if c is None:
            continue
        div = c.DivideByCount(96, True)
        if not div:
            continue
        pts = [c.PointAt(t) for t in div]
        arr = np.array([[(p - plane.Origin) * plane.XAxis,
                         (p - plane.Origin) * plane.YAxis] for p in pts])
        loops.append(arr)
    return loops


def _segments(loops):
    a, b = [], []
    for L in loops:
        a.append(L)
        b.append(np.roll(L, -1, axis=0))
    return np.vstack(a), np.vstack(b)


def _mask_points(P, seg_a, seg_b):
    if len(P) == 0:
        return np.zeros(0, bool)
    px, py = P[:, 0:1], P[:, 1:2]
    x1, y1 = seg_a[:, 0][None, :], seg_a[:, 1][None, :]
    x2, y2 = seg_b[:, 0][None, :], seg_b[:, 1][None, :]
    cond = (y1 > py) != (y2 > py)
    xin = x1 + (py - y1) * (x2 - x1) / (y2 - y1 + 1e-30)
    return (np.sum(cond & (px < xin), axis=1) % 2) == 1


def _snap_to_boundary(p_out, p_in, seg_a, seg_b):
    """Exact crossing of segment p_out->p_in with the face boundary (2D).
    Returns the crossing closest to the inside point, or None."""
    dd = p_in - p_out
    e = seg_b - seg_a
    w = seg_a - p_out[None, :]
    denom = dd[0] * (-e[:, 1]) - dd[1] * (-e[:, 0])
    denom = np.where(np.abs(denom) < 1e-30, 1e-30, denom)
    t = (w[:, 0] * (-e[:, 1]) - w[:, 1] * (-e[:, 0])) / denom
    u = (dd[0] * w[:, 1] - dd[1] * w[:, 0]) / denom
    ok = (t >= -1e-9) & (t <= 1 + 1e-9) & (u >= -1e-9) & (u <= 1 + 1e-9)
    if not ok.any():
        return None
    tbest = t[ok].max()
    return p_out + np.clip(tbest, 0, 1) * dd


def _face_inner_point(seg_a, seg_b, u0, u1, v0, v1, rnd):
    """A 2D point strictly inside the face polygon (centroid, then random)."""
    cands = [np.array([[(u0 + u1) / 2.0, (v0 + v1) / 2.0]])]
    for _ in range(24):
        cands.append(np.array([[u0 + rnd.random() * (u1 - u0),
                                v0 + rnd.random() * (v1 - v0)]]))
    for c in cands:
        if _mask_points(c, seg_a, seg_b)[0]:
            return c[0]
    return None


def _runs_to_curves(pts2d, mask, plane, lift_vec, seg_a, seg_b, min_pts=2):
    out = []
    if len(pts2d) == 0:
        return out
    idx = np.where(mask)[0]
    if len(idx) == 0:
        return out
    breaks = np.where(np.diff(idx) > 1)[0]
    starts = np.r_[0, breaks + 1]
    ends = np.r_[breaks, len(idx) - 1]
    for s, e in zip(starts, ends):
        run = idx[s:e + 1]
        if len(run) < min_pts:
            continue
        chain = [pts2d[i] for i in run]
        i0, i1 = run[0], run[-1]
        if i0 > 0:  # entered the face: snap start onto the boundary
            q = _snap_to_boundary(pts2d[i0 - 1], pts2d[i0], seg_a, seg_b)
            if q is not None:
                chain.insert(0, q)
        if i1 < len(pts2d) - 1:  # left the face: snap end onto the boundary
            q = _snap_to_boundary(pts2d[i1 + 1], pts2d[i1], seg_a, seg_b)
            if q is not None:
                chain.append(q)
        pts = [plane.Origin + plane.XAxis * float(u) + plane.YAxis * float(v)
               + lift_vec for u, v in chain]
        out.append(rg.PolylineCurve(pts))
    return out


def _rings_conic(plane, pith, a, allpts, du, dv, ring_base, dens, rnd, dot):
    """Growth-ring cylinders around the pith line intersected with the face
    plane. One system for ALL faces: circles (square cuts) -> stretched
    ovals (miters, scarfs) -> pairs of parallel lines (axis-parallel faces,
    i.e. tangential grain), all from the same ring radii."""
    A = np.array([a.X, a.Y, a.Z])
    X = np.array([plane.XAxis.X, plane.XAxis.Y, plane.XAxis.Z])
    Y = np.array([plane.YAxis.X, plane.YAxis.Y, plane.YAxis.Z])
    O = np.array([plane.Origin.X, plane.Origin.Y, plane.Origin.Z])
    P = np.array([pith.X, pith.Y, pith.Z])

    def rej(v):
        return v - (v @ A) * A

    e1, e2 = rej(X), rej(Y)
    c0p = rej(O - P)
    # radii ladder shared by every branch
    def radii():
        r = ring_base / dens * (0.4 + 0.4 * rnd.random())
        while True:
            yield r
            r += ring_base / dens * (0.75 + 0.5 * rnd.random())
    # farthest loop point from the pith line
    rmax = 0.0
    for uu, vv in allpts:
        wp = c0p + uu * e1 + vv * e2
        rmax = max(rmax, float(np.sqrt(wp @ wp)))

    polys = []
    if dot < 0.06:
        # Axis-parallel faces: COVERAGE-driven lines, evenly jittered across
        # the face's true perpendicular extent. (Radius-ladder line pairs
        # starve narrow faces far from the pith -- a tall beam's thin faces
        # got 0-2 lines. The book fills narrow faces evenly; so do we.)
        pu, pv = -dv, du
        proj_s = allpts[:, 0] * du + allpts[:, 1] * dv
        proj_p = allpts[:, 0] * pu + allpts[:, 1] * pv
        s0, s1 = float(proj_s.min()), float(proj_s.max())
        p0, p1 = float(proj_p.min()), float(proj_p.max())
        span, perp = s1 - s0, p1 - p0
        if span < 1e-9 or perp < 1e-9:
            return []
        step = span / 90.0
        svals = np.arange(s0 - step, s1 + 2 * step, step)
        n_lines = max(3, int(4 + 5 * dens))
        amp = min(perp * 0.06, ring_base * 0.2)
        for i in range(n_lines):
            f = (i + 0.5) / n_lines + rnd.uniform(-0.3, 0.3) / n_lines
            pval = p0 + f * perp
            off = amp * np.sin(2 * 6.28 * (svals - s0) / span
                               + rnd.random() * 6.28)
            pp = pval + off
            polys.append(np.column_stack([svals * du + pp * pu,
                                          svals * dv + pp * pv]))
        return polys

    # CONIC: well-conditioned quadratic -> (possibly very long) ellipses
    G = np.array([[e1 @ e1, e1 @ e2], [e1 @ e2, e2 @ e2]])
    bv = 2.0 * np.array([c0p @ e1, c0p @ e2])
    try:
        m = np.linalg.solve(G, -bv / 2.0)
    except Exception:
        return []
    lam, vec = np.linalg.eigh(G)
    if lam[0] < 1e-12:
        return []
    npts = int(np.clip(97 * (lam[1] / lam[0]) ** 0.25, 97, 641))
    t = np.linspace(0, 2 * math.pi, npts)
    cc = float(c0p @ c0p)
    for r in radii():
        if r > rmax + ring_base:
            break
        k = -(float(m @ (G @ m)) + float(bv @ m) + (cc - r * r))
        if k > 1e-14:
            r1, r2 = math.sqrt(k / lam[0]), math.sqrt(k / lam[1])
            wob = 1.0 + 0.04 * np.sin(3 * t + rnd.random() * 6)
            d = (np.outer(np.cos(t) * r1 * wob, vec[:, 0]) +
                 np.outer(np.sin(t) * r2 * wob, vec[:, 1]))
            polys.append(d + m[None, :])
    return polys


if run and pieces:
    try:
        breps = pieces if isinstance(pieces, list) else [pieces]
        breps = [b for b in breps if b is not None]
        bb = rg.BoundingBox.Empty
        for b in breps:
            bb.Union(b.GetBoundingBox(True))
        diag = bb.Diagonal.Length

        ax = axis
        if ax is None or (hasattr(ax, "Length") and ax.Length < 1e-9):
            d = bb.Diagonal
            ax = rg.Vector3d(1, 0, 0)
            best = -1
            for cand in (rg.Vector3d(1, 0, 0), rg.Vector3d(0, 1, 0),
                         rg.Vector3d(0, 0, 1)):
                ext = abs(d * cand)
                if ext > best:
                    best, ax = ext, cand
        a = rg.Vector3d(ax)
        a.Unitize()

        lift_v = float(lift) if lift else diag * 0.0008
        thr = float(end_threshold) if end_threshold else 0.15
        dens = float(density or 1.0)
        n_curves = 0
        face_lines = []

        # section frame perpendicular to the axis (shared by all pieces)
        e1 = rg.Vector3d.CrossProduct(a, rg.Vector3d(0, 0, 1))
        if e1.Length < 1e-6:
            e1 = rg.Vector3d.CrossProduct(a, rg.Vector3d(1, 0, 0))
        e1.Unitize()
        e2 = rg.Vector3d.CrossProduct(a, e1)
        e2.Unitize()

        for bi, b in enumerate(breps):
            # an Inward-oriented solid flips every face normal: lift must
            # respect the BREP's orientation, not only the face's
            ssign = -1.0 if b.SolidOrientation == \
                rg.BrepSolidOrientation.Inward else 1.0
            pbb = b.GetBoundingBox(True)
            pc = pbb.Center
            pd = pbb.Diagonal
            ext1 = abs(pd * e1) / 2.0
            ext2 = abs(pd * e2) / 2.0
            prnd = random.Random(0xA5 ^ (bi * 7919) ^
                                 (hash(round(pc.X + pc.Y + pc.Z, 3)) & 0xFFFF))
            pith = (rg.Point3d(pc) +
                    e1 * (ext1 * prnd.uniform(-0.45, 0.45)) +
                    e2 * (ext2 * prnd.uniform(-0.45, 0.45)))
            ring_base = min(ext1, ext2) / 4.0 * (0.9 + 0.2 * prnd.random())
            for fi, f in enumerate(b.Faces):
                plane = _face_plane(f)
                if plane is None:
                    continue
                n = rg.Vector3d(plane.Normal)
                n.Unitize()
                # OUTWARD normal from the surface itself -- TryGetPlane's
                # normal sign is arbitrary and must not be trusted for lift
                um = f.Domain(0).Mid
                vm = f.Domain(1).Mid
                out_n = f.NormalAt(um, vm)
                if f.OrientationIsReversed:
                    out_n.Reverse()
                out_n.Unitize()
                dot = abs(n * a)
                kind = "lines" if dot < 0.06 else "rings"

                loops = _loops_2d(f, plane)
                if not loops:
                    continue
                seg_a, seg_b = _segments(loops)
                allpts = np.vstack(loops)
                u0, u1 = allpts[:, 0].min(), allpts[:, 0].max()
                v0, v1 = allpts[:, 1].min(), allpts[:, 1].max()
                if (u1 - u0) < 1e-9 or (v1 - v0) < 1e-9:
                    continue

                dvec = a - n * (a * n)
                if dvec.Length < 1e-9:
                    dvec = plane.XAxis
                dvec.Unitize()
                du = dvec * plane.XAxis
                dv = dvec * plane.YAxis

                seed = hash((bi, fi, round(plane.Origin.X, 4),
                             round(plane.Origin.Y, 4),
                             round(plane.Origin.Z, 4))) & 0xFFFF
                rnd = random.Random(seed)
                # EMPIRICAL outward check: probe a point off the face along
                # the assumed normal; if it lands inside the solid, flip.
                # Immune to every orientation convention.
                flipped = ""
                ip = _face_inner_point(seg_a, seg_b, u0, u1, v0, v1, rnd)
                if ip is not None:
                    p3 = plane.Origin + plane.XAxis * float(ip[0]) \
                         + plane.YAxis * float(ip[1])
                    # two-sided probe, SMALL so it cannot pass through thin
                    # members; retry closer if both sides read outside
                    d0 = max(lift_v * 2.0, diag * 0.0003)
                    try:
                        for dp in (d0, d0 * 0.25):
                            fwd = b.IsPointInside(p3 + out_n * dp, 1e-9, True)
                            bwd = b.IsPointInside(p3 - out_n * dp, 1e-9, True)
                            if fwd and not bwd:
                                out_n = -out_n
                                flipped = " !"
                                break
                            if bwd and not fwd:
                                break            # normal confirmed outward
                            # both inside or both outside: probe again closer
                    except Exception:
                        pass
                lift_vec = out_n * lift_v

                polys2d = _rings_conic(plane, pith, a, allpts, du, dv,
                                       ring_base, dens, rnd, dot)
                n_face = 0
                for pts2d in polys2d:
                    mask = _mask_points(pts2d, seg_a, seg_b)
                    crvs = _runs_to_curves(pts2d, mask, plane, lift_vec,
                                           seg_a, seg_b)
                    for c in crvs:
                        grain.Add(c, GH_Path(bi))
                    n_face += len(crvs)
                n_curves += n_face
                face_lines.append("p{} f{}: dot={:.2f} -> {} ({} crv){}".format(
                    bi, fi, dot, kind, n_face, flipped))

        report.append("grain v{}: {} curves on {} piece(s)  lift {:.4f}  "
                      "end_threshold {:.2f}".format(
                          GRAIN_V, n_curves, len(breps), lift_v, thr))
        if len(face_lines) <= 28:
            report += face_lines
    except Exception as exc:
        report.append("ERROR: {}".format(exc))
else:
    report.append("wire kept + prosthesis into `pieces`, set run")
# ---------- end illustration ----------
edges_prosthesis = Python3Script(pieces=move.Geometry, lift=number_slider)  # -> out, edges, report; inputs pieces: Brep
# ---------- edges_prosthesis: Python ----------
"""GH Python 3 -- REPAIR (human-driven v1): place a catalogue joint on a beam.

The beam is a Rhino BOX; its longest axis becomes the beam axis. The joint is
selected by key (Value List), positioned by slider, rotated in degrees, and
`side` says which end becomes the prosthesis.

Inputs:
    box             (Box)    the beam
    key             (str)    joint key from the catalogue (see info for keys)
    position        (float)  NORMALIZED cut position: 0.0 = beam start,
                             1.0 = beam end (independent of beam length)
    rotation        (float)  degrees about the beam axis
    side            (int)    +1 = far end is replaced, -1 = near end
    interface_scale (float)  [1.0]
    run             (bool)
Outputs:
    kept, prosthesis, cut_plane, info
    cut_lines   the scribe lines: where the cut surfaces meet the beam's
                skin -- the layout a carpenter (or marking robot) draws
"""
# r: roslibpy

import sys, os

REPO = r"C:\Users\tizian\workspace\projects\workshop_robarch_2026"
SRC = os.path.join(REPO, "src")
if SRC not in sys.path:
    sys.path.append(SRC)
for m in list(sys.modules):
    if m.startswith("workshop_robarch_2026"):
        sys.modules.pop(m)

from workshop_robarch_2026 import kernel, joints, evaluator
from workshop_robarch_2026.version import VERSION

import numpy as np
import Rhino.Geometry as rg
from Grasshopper import DataTree
from Grasshopper.Kernel.Data import GH_Path

kept = DataTree[object]()
prosthesis = DataTree[object]()
cut_lines = DataTree[object]()
cut_plane = None
info = ["version: {}".format(VERSION)]

def _box_frame(b):
    """Box -> frame dict; longest axis = beam axis v; right-handed."""
    pl = b.Plane
    ax = [np.array([pl.XAxis.X, pl.XAxis.Y, pl.XAxis.Z]),
          np.array([pl.YAxis.X, pl.YAxis.Y, pl.YAxis.Z]),
          np.array([pl.ZAxis.X, pl.ZAxis.Y, pl.ZAxis.Z])]
    ext = [b.X.Length, b.Y.Length, b.Z.Length]
    iv = int(np.argmax(ext))
    iu = (iv + 1) % 3
    iw = (iv + 2) % 3
    U, V = ax[iu], ax[iv]
    W = np.cross(U, V)
    W /= np.linalg.norm(W)
    # origin: the box corner from which +U, +V, +W all point inward
    corner = b.PointAt(0, 0, 0)
    o = np.array([corner.X, corner.Y, corner.Z])
    ivals = [b.X, b.Y, b.Z]
    o = (np.array([b.Plane.Origin.X, b.Plane.Origin.Y, b.Plane.Origin.Z])
         + ivals[0].Min * ax[0] + ivals[1].Min * ax[1] + ivals[2].Min * ax[2])
    # if W is opposite the box's own third axis, shift origin to the far
    # w-corner so the frame stays on the box with right-handed axes
    if float(W @ ax[iw]) < 0:
        o = o + ext[iw] * ax[iw]
    return {"origin": o.tolist(), "u": U.tolist(), "v": V.tolist(),
            "w": W.tolist(), "width": float(ext[iu]),
            "height": float(ext[iw]), "length": float(ext[iv])}

if run and box is not None and key:
    try:
        j = joints.load_joint(REPO, str(key))
        frame = _box_frame(box)
        pos_n = float(position) if position is not None else 0.5
        r = kernel.build_repair(
            j, frame,
            position=pos_n * frame["length"],
            rotate_deg=float(rotation) if rotation else 0.0,
            side=int(side) if side else +1,
            interface_scale=float(interface_scale) if interface_scale else 1.0)

        info.append("joint: {}   interface: {:.1f} cm".format(
            key, r["interface_length"] * 100))
        info.append("cut @ {:.2f} (= {:.3f} m)   band {:.2f}..{:.2f} m   "
                    "side: {}".format(
            r["position_used"] / frame["length"], r["position_used"],
            r["band"][0], r["band"][1],
            "near (flipped)" if r["flipped"] else "far"))

        o, V = frame["origin"], frame["v"]
        pos = r["position_used"]
        cpt = rg.Point3d(o[0] + pos * V[0], o[1] + pos * V[1], o[2] + pos * V[2])
        vn = rg.Vector3d(V[0], V[1], V[2]); vn.Unitize()
        cut_plane = rg.Plane(cpt, vn)

        for part in r["parts"]:
            try:
                bs = evaluator.evaluate_part(part)
            except Exception as exc:
                info.append("WARNING: {} failed: {}".format(part["name"], exc))
                bs = []
            (kept if part["name"] == "kept" else prosthesis).AddRange(bs, GH_Path(0))
            vol = 0.0
            for b in bs:
                vp = rg.VolumeMassProperties.Compute(b)
                if vp:
                    vol += vp.Volume
            info.append("{}: {} brep(s)  vol={:.2f} L".format(
                part["name"], len(bs), vol * 1000))

        # scribe lines: edges of the kept piece lying ON the beam skin,
        # excluding the beam's own arrises -- the in-situ marking layout
        try:
            skin = box.ToBrep()
            arris = [e.DuplicateCurve() for e in skin.Edges]
            def _on_skin(p):
                ok, cp, ci, u, v, mx = False, None, None, 0, 0, None
                cp = skin.ClosestPoint(p)
                return cp.DistanceTo(p) < 1e-6
            def _on_arris(p):
                for c in arris:
                    okc, t = c.ClosestPoint(p)
                    if okc and c.PointAt(t).DistanceTo(p) < 1e-6:
                        return True
                return False
            raw = []
            for b_ in kept.AllData():
                for e in b_.Edges:
                    pts = [e.PointAt(e.Domain.ParameterAt(f))
                           for f in (0.25, 0.5, 0.75)]
                    if all(_on_skin(p) for p in pts) and \
                       not all(_on_arris(p) for p in pts):
                        raw.append(e.DuplicateCurve())
            joined = rg.Curve.JoinCurves(raw, 1e-6) if raw else []
            cut_lines.AddRange(list(joined), GH_Path(0))
            info.append("scribe lines: {} curve(s)".format(len(list(joined))))
        except Exception as exc:
            info.append("scribe lines failed: {}".format(exc))
    except Exception as exc:
        info.append("ERROR: {}".format(exc))
else:
    info.append("catalogue: {}".format(", ".join(joints.list_keys(REPO)) or "(empty)"))
    info.append("connect box + key, set run")
# ---------- end edges_prosthesis ----------
panel_3 = Panel(illustration.report)
custom_preview = CustomPreview(Geometry=[illustration.grain, edges_prosthesis.edges], Material=ColourSwatch(SwatchColor=RGB(145, 145, 145)))

# ---- group: Prosthesis Visualisation
create_material = CreateMaterial(
    Diffuse=ColourSwatch(SwatchColor=RGB(0, 0, 0)),
    Specular=RGB(255, 255, 255),
    Emission=RGB(0, 0, 0),
    Transparency=0,
    Shine=0)
custom_preview_lineweights_2 = CustomPreviewLineweights(Geometry=move.Geometry, Shader=create_material, Thickness=Slider(7.1, range=0..10), Absolute=False)

# ---- group: Kept Visualisation
custom_preview_2 = CustomPreview(Geometry=[geometry, python_3_script.rest], Material=ColourSwatch(SwatchColor=RGBA(0, 0, 0, 0)))
