# Grasshopper definition surface_reconstruction.ghx (Grasshopper 1.0.8)
# plug-ins: RhinoCodePluginGH, Volvox, Pufferfish, MetaHopper, Tarsier, Kangaroo2 Components

# ---- group: Timber Profile
length = Slider(557, range=0..1000)
move_upwards = Slider(0, range=0..1000)
pln = Plane(PlaneXY(-35.32133119, -48.92090669, -150.7288841))
rectangle = Rectangle(Plane=pln, XSize=Slider(80, range=0..1000), YSize=Slider(80, range=0..1000), Radius=0)  # -> Rectangle, Length
_2d_boundary_curve = Curve(rectangle.Rectangle)

# ----
# Load pointcloud from file
toggle = BooleanToggle(True)
path = FilePath("C:\Users\saral\workspace\projects\workshop_robarch_2026\data\scans\2026-07-27_profile_sensor_pointcloud_printed_seg0_v0.json")
from_file = Python3Script(json_cloud=path, show_points=toggle)  # -> out, points_out
# ---------- from_file: Python ----------
from compas.geometry import Point
from compas_rhino.conversions import point_to_rhino
from workshop_robarch_2026.pointcloud_publisher import PointCloud2

import csv
import json

def load_points_from_file(list_file):
    with open(list_file, "r") as f:
        data = json.load(f)
    return data


if show_points:
    msg = load_points_from_file(json_cloud)
    pointcloud = PointCloud2.from_msg(msg)
    points_out = [point_to_rhino(pt) for pt in pointcloud.points]
# ---------- end from_file ----------
pt = Point(from_file.points_out)

scale = Scale(Geometry=pt, Center=Point(0, 0, 0), Factor=1000)  # -> Geometry, Transform
pt_2 = Point(scale.Geometry)

# ---- group: Timber Profile
number_slider = Slider(50, range=0..1000)  # disabled
number_slider_2 = Slider(50, range=0..1000)  # disabled
top_shift_upwards = Slider(269, range=0..1000)  # disabled
pln_2 = Plane(PlaneXY(1.721621321, -60, 0))  # disabled
rectangle_2 = Rectangle(Plane=pln_2, XSize=number_slider, YSize=number_slider_2, Radius=0)  # -> Rectangle, Length; disabled
_2d_boundary_curve_2 = Curve(rectangle_2.Rectangle)  # disabled

# ----
top_shift_upwards_2 = Slider(149, range=0..1000)

# ----
# Surface Construction
face_count_about_200 = Slider(250, range=0..1000)
accuracy_about_10 = Slider(10, range=0..10)
point_cloud = Cloud(<cloud referenced from the Rhino model>)
movement_just_for_visualization = Panel("{0,-1000,0}")
movement_just_for_visualization_2 = Panel("{0,-2000,0}")
toggle_2 = GroupToggle(ToggleActive=True, ToggleVisible=False)  # disabled

# ---- group: Point Cloud Reduction
decloud = DeconstructCloud(Cloud=point_cloud)  # -> Points, Normals, Colors
bbox = BoundingBox(Content=point_cloud, Plane=PlaneXY(0, 0, 0))  # -> Box, Box_2
pt_3 = Point(decloud.Points)
brepinc = PointInBrep(Brep=bbox.Box, Point=pt_3, Strict=False)
dispatch = Dispatch(List=pt_3, DispatchPattern=brepinc)  # -> ListA, ListB
pt_4 = Point(dispatch.ListA)
construct = ConstructPointCloud(Points=pt_4)
cloud_reduce = ReducePointCloud(PointCloud=construct, Fraction=Slider(0.3, range=0..1), Seed=2)
voxellize = VoxellizePointCloud(
    PointCloud=cloud_reduce,
    BoundingBox=bbox.Box,
    CellSize=Slider(4, range=0..100),
    DecayRate=0,
    MaximumValue=Slider(73, range=0..1000),
    LowerThreshold=Slider(3, range=0..50))  # -> PointCloud, BoundingBox, VoxelData
deconstruct = DeconstructPointCloud(PointCloud=voxellize.PointCloud)  # -> Points, Colours, Normals

# ---- group: Rebuilding the Delauny Triangulation with adjusted parameters
del = DelaunayMesh(Points=deconstruct.Points, Plane=PlaneXY(0, 0, 0))
clean = CombineClean(Meshes=del)
weld = WeldMesh(Mesh=clean, Angle=3.141592654)
redumsh = ReduceMesh(Mesh=weld, FaceCount=face_count_about_200, Accuracy=accuracy_about_10, FaceType=1, Distort="TRUE", Normalize=False)  # -> Reduced, CountDifference

# ---- group: Boundary volume design
vec = VectorXYZ(XComponent=0, YComponent=0, ZComponent=move_upwards)  # -> Vector, Length
pdecon = Deconstruct(Point=deconstruct.Points)  # -> XComponent, YComponent, ZComponent
movetoplane = MoveToPlane(Geometry=deconstruct.Points, Plane=PlaneXY(0, 0, 0), Above=True, Below=True)  # -> Geometry, Transform
hilonums = HighestLowestNumbers(Numbers=pdecon.ZComponent)  # -> Highest, Lowest
patch = Patch(Curves=_2d_boundary_curve, Spans=20, Flexibility=1, Trim=True)
srf = Surface(patch)
move = Move(Geometry=srf, Motion=vec.Vector)  # -> Geometry, Transform
vec_2 = VectorXYZ(XComponent=0, YComponent=0, ZComponent=length)  # -> Vector, Length
extr = Extrude(Base=move.Geometry, Direction=vec_2.Vector)
mesh = Mesh(extr)

# ----
subtraction = Subtraction(A=hilonums.Highest, B=hilonums.Lowest)
addition = Addition(A=length, B=subtraction)

# ----
# Full Timber Profile Generation
movement_just_for_visualization_3 = Panel("{0,-3000,0}")
movement_just_for_visualization_4 = Panel("{0,-3000,0}")
movement_just_for_visualization_5 = Panel("{0,-3000,0}")
move_2 = Move(Geometry=_2d_boundary_curve, Motion=movement_just_for_visualization_4)  # -> Geometry, Transform
move_3 = Move(Geometry=movetoplane.Geometry, Motion=movement_just_for_visualization_3)  # -> Geometry, Transform
move_4 = Move(Geometry=mesh, Motion=movement_just_for_visualization_5)  # -> Geometry, Transform
toggle_3 = GroupToggle(ToggleActive=True, ToggleVisible=False)  # disabled

move_5 = Move(Geometry=deconstruct.Points, Motion=movement_just_for_visualization)  # -> Geometry, Transform
move_6 = Move(Geometry=redumsh.Reduced, Motion=movement_just_for_visualization_2)  # -> Geometry, Transform

# ----
# Split Timber Profile
which_part_of_the_sliced_surface = Slider(1, range=0..10)
which_part_of_the_sliced_object = Slider(0, range=0..10)
movement_just_for_visualization_6 = Panel("{0,0,0}")
movement_just_for_visualization_7 = Panel("{0,-5000,0}")
movement_just_for_visualization_8 = Panel("{0,-4000,0}")
toggle_4 = GroupToggle(ToggleActive=True, ToggleVisible=False)  # disabled

# ---- group: Split designed Object with surface
msplit = MeshSplit(Mesh=mesh, Splitters=redumsh.Reduced)
item = ListItem(List=msplit, Index=which_part_of_the_sliced_object, Wrap=True)
clean_2 = CombineClean(Meshes=item)
msh2psrf = MeshToPolysurface(Mesh=clean_2, Triangles=False, FaceMerge=False)

# ---- group: Slice the surface with the designed object
mesh_2 = Mesh(mesh)
mesh_3 = Mesh(redumsh.Reduced)
msh2psrf_2 = MeshToPolysurface(Mesh=mesh_2, Triangles=False, FaceMerge=False)
msh2psrf_3 = MeshToPolysurface(Mesh=mesh_3, Triangles=False, FaceMerge=False)
splitmul = SplitBrepMultiple(Brep=msh2psrf_3, Cutters=msh2psrf_2)
item_2 = ListItem(List=splitmul, Index=which_part_of_the_sliced_surface, Wrap=True)

# ---- group: Preview of the reconstructed object
merge = Merge(Data1=msh2psrf, Data2=item_2)
join = BrepJoin(Breps=merge)  # -> Breps, Closed

# ----
move_7 = Move(Geometry=join.Breps, Motion=movement_just_for_visualization_6)  # -> Geometry, Transform
move_8 = Move(Geometry=msh2psrf, Motion=movement_just_for_visualization_8)  # -> Geometry, Transform
move_9 = Move(Geometry=item_2, Motion=movement_just_for_visualization_7)  # -> Geometry, Transform

# ---- group: Boundary volume design
pdecon_2 = Deconstruct(Point=deconstruct.Points)  # -> XComponent, YComponent, ZComponent; disabled
movetoplane_2 = MoveToPlane(Geometry=deconstruct.Points, Plane=PlaneXY(0, 0, 0), Above=True, Below=True)  # -> Geometry, Transform; disabled
hilonums_2 = HighestLowestNumbers(Numbers=pdecon_2.ZComponent)  # -> Highest, Lowest; disabled
patch_2 = Patch(Curves=_2d_boundary_curve_2, Spans=20, Flexibility=1, Trim=True)  # disabled
srf_2 = Surface(patch_2)  # disabled

# ----
subtraction_2 = Subtraction(A=hilonums_2.Lowest, B=top_shift_upwards_2)
subtraction_3 = Subtraction(A=hilonums_2.Highest, B=hilonums_2.Lowest)
addition_2 = Addition(A=top_shift_upwards, B=subtraction_3)

# ---- group: Boundary volume design (continued)
vec_3 = VectorXYZ(XComponent=0, YComponent=0, ZComponent=subtraction_2)  # -> Vector, Length; disabled
move_10 = Move(Geometry=srf_2, Motion=vec_3.Vector)  # -> Geometry, Transform; disabled
vec_4 = VectorXYZ(XComponent=0, YComponent=0, ZComponent=addition_2)  # -> Vector, Length; disabled
extr_2 = Extrude(Base=move_10.Geometry, Direction=vec_4.Vector)  # disabled
move_11 = Move(Geometry=extr_2, Motion=Vector(0, 0, 10))  # -> Geometry, Transform; disabled
mesh_4 = Mesh(move_11.Geometry)  # disabled

# ----
# Full Timber Profile Generation
movement_just_for_visualization_9 = Panel("{0,-3000,0}")  # disabled
movement_just_for_visualization_10 = Panel("{0,-3000,0}")  # disabled
movement_just_for_visualization_11 = Panel("{0,-3000,0}")  # disabled
move_12 = Move(Geometry=_2d_boundary_curve_2, Motion=movement_just_for_visualization_10)  # -> Geometry, Transform; disabled
move_13 = Move(Geometry=movetoplane_2.Geometry, Motion=movement_just_for_visualization_9)  # -> Geometry, Transform; disabled
move_14 = Move(Geometry=mesh_4, Motion=movement_just_for_visualization_11)  # -> Geometry, Transform; disabled
toggle_5 = GroupToggle(ToggleActive=True, ToggleVisible=False)  # disabled
