# Grasshopper definition surface_reconstruction_v2.ghx (Grasshopper 1.0.8)
# plug-ins: RhinoCodePluginGH, Volvox, Pufferfish, MetaHopper, Tarsier, Kangaroo2 Components

# ---- group: Timber Profile
length = Slider(557, range=0..1000)
move_upwards = Slider(0, range=0..1000)
pln = Plane(PlaneXY(-35.32133119, -48.92090669, -150.7288841))
rectangle = Rectangle(Plane=pln, XSize=Slider(100, range=0..1000), YSize=Slider(100, range=0..1000), Radius=0)  # -> Rectangle, Length
_2d_boundary_curve = Curve(rectangle.Rectangle)

# ----
# Load pointcloud from file
toggle = BooleanToggle(True)
path = FilePath("C:\Users\saral\workspace\projects\workshop_robarch_2026\data\scans\2026-07-27_profile_sensor_pointcloud_printed_seg0_v0.json")
from_file = Python3Script(json_cloud=path, show_points=toggle)  # -> out, points_out
# ---------- from_file: Python ----------
from compas.geometry import Point
from compas_rhino.conversions import point_to_rhino
from workshop_robarch_2026.pointcloud_publisher import PointCloud2

import csv
import json

def load_points_from_file(list_file):
    with open(list_file, "r") as f:
        data = json.load(f)
    return data


if show_points:
    msg = load_points_from_file(json_cloud)
    pointcloud = PointCloud2.from_msg(msg)
    points_out = [point_to_rhino(pt) for pt in pointcloud.points]
# ---------- end from_file ----------
pt = Point(from_file.points_out)

scale = Scale(Geometry=pt, Center=Point(0, 0, 0), Factor=1000)  # -> Geometry, Transform
pt_2 = Point(scale.Geometry)

# ----
# Surface Construction
face_count_about_200 = Slider(400, range=0..1000)
accuracy_about_10 = Slider(5, range=0..10)
point_cloud = Cloud(<cloud referenced from the Rhino model>)
movement_just_for_visualization = Panel("{0,-1000,0}")
movement_just_for_visualization_2 = Panel("{0,-2000,0}")
toggle_2 = GroupToggle(ToggleActive=True, ToggleVisible=False)  # disabled

# ---- group: Point Cloud Reduction
decloud = DeconstructCloud(Cloud=point_cloud)  # -> Points, Normals, Colors
bbox = BoundingBox(Content=point_cloud, Plane=PlaneXY(0, 0, 0))  # -> Box, Box_2
pt_3 = Point(decloud.Points)
brepinc = PointInBrep(Brep=bbox.Box, Point=pt_3, Strict=False)
dispatch = Dispatch(List=pt_3, DispatchPattern=brepinc)  # -> ListA, ListB
pt_4 = Point(dispatch.ListA)
construct = ConstructPointCloud(Points=pt_4)
cloud_reduce = ReducePointCloud(PointCloud=construct, Fraction=Slider(0.3, range=0..1), Seed=2)
voxellize = VoxellizePointCloud(
    PointCloud=cloud_reduce,
    BoundingBox=bbox.Box,
    CellSize=Slider(4, range=0..100),
    DecayRate=0,
    MaximumValue=Slider(73, range=0..1000),
    LowerThreshold=Slider(3, range=0..50))  # -> PointCloud, BoundingBox, VoxelData
deconstruct = DeconstructPointCloud(PointCloud=cloud_reduce)  # -> Points, Colours, Normals

# ---- group: Rebuilding the Delauny Triangulation with adjusted parameters
del = DelaunayMesh(Points=deconstruct.Points, Plane=PlaneXY(0, 0, 0))
clean = CombineClean(Meshes=del)
weld = WeldMesh(Mesh=clean, Angle=3.141592654)
redumsh = ReduceMesh(Mesh=weld, FaceCount=face_count_about_200, Accuracy=accuracy_about_10, FaceType=1, Distort="TRUE", Normalize=False)  # -> Reduced, CountDifference

# ---- group: Boundary volume design
vec = VectorXYZ(XComponent=0, YComponent=0, ZComponent=move_upwards)  # -> Vector, Length
pdecon = Deconstruct(Point=deconstruct.Points)  # -> XComponent, YComponent, ZComponent
movetoplane = MoveToPlane(Geometry=deconstruct.Points, Plane=PlaneXY(0, 0, 0), Above=True, Below=True)  # -> Geometry, Transform
hilonums = HighestLowestNumbers(Numbers=pdecon.ZComponent)  # -> Highest, Lowest
patch = Patch(Curves=_2d_boundary_curve, Spans=20, Flexibility=1, Trim=True)
srf = Surface(patch)
move = Move(Geometry=srf, Motion=vec.Vector)  # -> Geometry, Transform
vec_2 = VectorXYZ(XComponent=0, YComponent=0, ZComponent=length)  # -> Vector, Length
extr = Extrude(Base=move.Geometry, Direction=vec_2.Vector)
mesh = Mesh(extr)

# ----
subtraction = Subtraction(A=hilonums.Highest, B=hilonums.Lowest)

# ---- group: Offseting the mesh
mshnakededgs = MeshNakedEdges(Mesh=redumsh.Reduced)  # -> Naked, R
msh2psrf = MeshToPolysurface(Mesh=redumsh.Reduced, Triangles=True, FaceMerge=True)
xy = XYPlane(Origin=Point(0, 0, 0))
offcrv = OffsetCurve(Curve=mshnakededgs.Naked, Plane=xy, Distance="-50", BothSides=0, Kinks=0, CapType=1)
merge = Merge(Data1=mshnakededgs.Naked, Data2=offcrv)
unsplitloft = UnsplitLoftSurface(Sections=flatten(merge), Closed=False, LoftType=0)
join = BrepJoin(Breps=flatten([msh2psrf, unsplitloft]))  # -> Breps, Closed
paramloftmsh = ParameterLoftMesh(
    Sections=flatten(merge),
    ParametersU=[0, 0.1, 0.2, 0.3, 0.4, 0.5, 0.6, 0.7, 0.8, 0.9, 1],
    ParametersV=[0, 0.25, 0.5, 0.75, 1],
    Weighted=False,
    Lengths=True,
    Angle=0,
    Closed=False,
    Triangulate=True)  # disabled
merge_2 = Merge(Data1=redumsh.Reduced, Data2=paramloftmsh)  # disabled
mjoin = MeshJoin(Meshes=flatten(merge_2))  # disabled
rebmsh = RebuildMesh(
    Mesh=mjoin,
    RebuildNormals=True,
    CullUnused=False,
    UnifyNormals=False,
    FlipNormals=False,
    IdenticalCombine=True,
    WeldVertices=0.1)  # disabled

# ----
addition = Addition(A=length, B=subtraction)
brep = Brep(join.Breps)

# ----
# Full Timber Profile Generation
movement_just_for_visualization_3 = Panel("{0,-3000,0}")
movement_just_for_visualization_4 = Panel("{0,-3000,0}")
movement_just_for_visualization_5 = Panel("{0,-3000,0}")
move_2 = Move(Geometry=_2d_boundary_curve, Motion=movement_just_for_visualization_4)  # -> Geometry, Transform
move_3 = Move(Geometry=movetoplane.Geometry, Motion=movement_just_for_visualization_3)  # -> Geometry, Transform
move_4 = Move(Geometry=mesh, Motion=movement_just_for_visualization_5)  # -> Geometry, Transform
toggle_3 = GroupToggle(ToggleActive=True, ToggleVisible=False)  # disabled

move_5 = Move(Geometry=deconstruct.Points, Motion=movement_just_for_visualization)  # -> Geometry, Transform
move_6 = Move(Geometry=redumsh.Reduced, Motion=movement_just_for_visualization_2)  # -> Geometry, Transform
move_7 = Move(Geometry=msh2psrf, Motion=movement_just_for_visualization_2)  # -> Geometry, Transform

# ----
# Split Timber Profile
which_part_of_the_sliced_surface = Slider(1, range=0..10)
which_part_of_the_sliced_object = Slider(0, range=0..10)
movement_just_for_visualization_6 = Panel("{0,0,0}")
movement_just_for_visualization_7 = Panel("{0,-5000,0}")
movement_just_for_visualization_8 = Panel("{0,-4000,0}")
move_8 = Move(Motion=movement_just_for_visualization_7)  # -> Geometry, Transform
toggle_4 = GroupToggle(ToggleActive=True, ToggleVisible=False)  # disabled

# ---- group: Slice the surface with the designed object
mesh_2 = Mesh(mesh)
msh2psrf_2 = MeshToPolysurface(Mesh=mesh_2, Triangles=True, FaceMerge=True)
split = SplitBrep(Brep=brep, Cutter=msh2psrf_2)
item = ListItem(List=split, Index=which_part_of_the_sliced_surface, Wrap=False)

# ---- group: Split designed Object with surface
msplit = MeshSplit(Mesh=mesh, Splitters=rebmsh)  # disabled
split_2 = SplitBrep(Brep=msh2psrf_2, Cutter=brep)
item_2 = ListItem(List=msplit, Index=which_part_of_the_sliced_object, Wrap=True)  # disabled
item_3 = ListItem(List=split_2, Index=which_part_of_the_sliced_surface, Wrap=False)
clean_2 = CombineClean(Meshes=item_2)  # disabled
msh2psrf_3 = MeshToPolysurface(Mesh=clean_2, Triangles=False, FaceMerge=False)  # disabled

# ---- group: Preview of the reconstructed object
merge_3 = Merge(Data1=item_3, Data2=item)
join_2 = BrepJoin(Breps=merge_3)  # -> Breps, Closed

# ----
move_9 = Move(Geometry=join_2.Breps, Motion=movement_just_for_visualization_6)  # -> Geometry, Transform
move_10 = Move(Geometry=msh2psrf_3, Motion=movement_just_for_visualization_8)  # -> Geometry, Transform
